# Dynamo custom node Draw Revit Model Lines From Point.dyf (Dynamo 1.3.3.4111)
# category: Bakery.Geometry

points = Input()
watch = Watch(points)
deconstructPoint = DummyNode(watch, inputCount=1, outputCount=1, legacyNodeName=Points.DeconstructPoint, legacyAssembly="E:\LunchBox for Dynamo\bin\LunchBox.dll", nodeNature=Unresolved)  # "Points.DeconstructPoint"
code_block = CodeBlock { x+1000; }  # unwired: x
byCoordinates = Point.ByCoordinates(x=deconstructPoint, z=code_block)
byStartPointEndPoint = Line.ByStartPointEndPoint(startPoint=watch, endPoint=byCoordinates)
code_block_2 = CodeBlock { 300; }
byCenterPointRadius = Circle.ByCenterPointRadius(centerPoint=byCoordinates, radius=code_block_2)
code_block_3 = CodeBlock { {0,0.33,0.66}; }
pointAtParameter = Curve.PointAtParameter(curve=byCenterPointRadius, param=code_block_3, lacing=Longest)
byStartPointEndPoint_2 = Line.ByStartPointEndPoint(startPoint=watch, endPoint=pointAtParameter, lacing=Longest)
create = List.Create(byStartPointEndPoint, byStartPointEndPoint_2, byCenterPointRadius)
flatten = Flatten(create)
byCurve = ModelCurve.ByCurve(flatten)
ModelCurve = Output(byCurve)
