# Dynamo custom node 3DView ByEyeUpForwardDirections.dyf (Dynamo 2.6.1.8786)
# category: GeniusLoci.View
# Sets the orientation of a given 3D view based on a given eye position, an Up and a forward directions.
# Based on a script by Mark Ackerley

ThreeDView = Input(ThreeDView: Revit.Elements.Views.View3D = Revit.Application.Document.Current.ActiveView)
eyePosition = Input(eyePosition: Autodesk.DesignScript.Geometry.Point)  # The coordinates of the eye position
forwardDirection = Input(forwardDirection: Autodesk.DesignScript.Geometry.Vector)  # A vector pointing from the camera towards the screen
upDirection = Input(upDirection: Autodesk.DesignScript.Geometry.Vector)  # A vector pointing to the Up direction of the view
python_script = Python(IN[0]=ThreeDView, IN[1]=eyePosition, IN[2]=forwardDirection, IN[3]=upDirection)
# ---------- python_script.python (36 lines) ----------
#Based on a script by Mark Ackerley
#https://forum.dynamobim.com/t/rotate-3d-isometric-view/44388/2
import clr
clr.AddReference('RevitAPI')
from Autodesk.Revit.DB import *

clr.AddReference("RevitNodes")
import Revit
clr.ImportExtensions(Revit.Elements)
clr.ImportExtensions(Revit.GeometryConversion)

clr.AddReference("RevitServices")
import RevitServices
from RevitServices.Persistence import DocumentManager
from RevitServices.Transactions import TransactionManager

doc = DocumentManager.Instance.CurrentDBDocument

#we need to unwrap Dynamo 'elements'
views = UnwrapElement(IN[0]) if isinstance(IN[0],list) else [UnwrapElement(IN[0])]
#we need to convert Dynamo Vectors & Points to Revit XYZs
eye = IN[1].ToRevitType()
forward = IN[2].ToRevitType()
up = IN[3].ToRevitType()
#start transaction
TransactionManager.Instance.EnsureInTransaction(doc)
for view in views:
#unlock view
	view.Unlock()
#create a new orientation object based on our modified info
	viewOrientation = ViewOrientation3D(eye, up, forward)
	view.SetOrientation(viewOrientation)
#finish transaction
TransactionManager.Instance.TransactionTaskDone()

OUT = views
# ----------------------------------------
ThreeDView_2 = Output(ThreeDView)  # "ThreeDView"
