# Dynamo custom node 3DView Collector.dyf (Dynamo 2.12.1.8246)
# category: GeniusLoci.View
# Retrieves the 3D views in the active or given document.

docOrRevitLinkInstance = Input(docOrRevitLinkInstance: var = null)  # Use only if you want to query a linked model Autodesk.Revit.DB.Document or RevitLinkInstance
python_script = Python(IN[0]=docOrRevitLinkInstance)  # IronPython2
# ---------- python_script.python (34 lines) ----------
import clr
# Import DocumentManager and TransactionManager
clr.AddReference("RevitServices")
import RevitServices
from RevitServices.Persistence import DocumentManager
# Import RevitAPI
clr.AddReference("RevitAPI")
import Autodesk
from Autodesk.Revit.DB import View, ViewType, FilteredElementCollector, RevitLinkInstance, Document

threeD = []
#Part of script from Clockwork
inputdocs = UnwrapElement(IN[0]) if isinstance(IN[0],list) else [UnwrapElement(IN[0])]
for inputdoc in inputdocs:
	if inputdoc == None:
		doc = DocumentManager.Instance.CurrentDBDocument
	elif isinstance (inputdoc, RevitLinkInstance) :
		doc = inputdoc.GetLinkDocument()
	elif isinstance (inputdoc, Document) :
		doc = inputdoc
	else: doc = DocumentManager.Instance.CurrentDBDocument

	#collect all views in the model
	views = FilteredElementCollector(doc).OfClass(View).ToElements()
	#sort views into separate lists based on view type
	for i in views:
		if not i.IsTemplate:
			if i.ViewType == ViewType.ThreeD:
				threeD.append(i)
			else:
				continue
				
if len(threeD)>1 : OUT = threeD
else: OUT = threeD[0]
# ----------------------------------------
n3DViews = Output(python_script)  # "3DViews"
