# Dynamo custom node 3DView Create.dyf (Dynamo 2.6.1.8786)
# category: GeniusLoci.View
# Creates a new isometric View3D in the given document.

ViewName = Input(ViewName: var[]..[] = "ThreeD")  # String
document = Input(document: var = null)  # Use only if you want to query a linked model
create_3dview = Python(IN[0]=ViewName, IN[1]=document)
# ---------- create_3dview.python (53 lines) ----------
#Suggestion by Marck Ackerley
#Suggestion of improvement by Jonathan Atger
import clr
# Import DocumentManager and TransactionManager
clr.AddReference('RevitServices')
import RevitServices
from RevitServices.Persistence import DocumentManager
from RevitServices.Transactions import TransactionManager

# Import RevitAPI
clr.AddReference('RevitAPI')
import Autodesk
from Autodesk.Revit.DB import *

def ProcessParallelLists(_func, *lists):
	return map( lambda *xs: ProcessParallelLists(_func, *xs) if all(type(x) is list for x in xs) else _func(*xs), *lists )

def tolist(obj1):
    if hasattr(obj1,"__iter__"): return obj1
    else: return [obj1]

viewNames = tolist(IN[0])
inputdoc = tolist(UnwrapElement(IN[1]))
inputdoc = inputdoc[0]
	
#Inputdoc : Part of script by Andreas Dieckmann
if inputdoc == None:
	doc = DocumentManager.Instance.CurrentDBDocument
elif inputdoc.GetType().ToString() == "Autodesk.Revit.DB.Document":
	doc = inputdoc
elif inputdoc.GetType().ToString() == "Autodesk.Revit.DB.RevitLinkInstance":
	doc = inputdoc.GetLinkDocument()
else :
	doc = DocumentManager.Instance.CurrentDBDocument

#Get 3D View ViewFamilyType
viewType = FilteredElementCollector(doc).OfClass(ViewFamilyType).ToElements().Find(lambda x : x.ViewFamily == ViewFamily.ThreeDimensional)

def CreateView(name):
	view = View3D.CreateIsometric(doc, viewType.Id)
	try:view.Name = name
	except:pass
	return view

TransactionManager.Instance.ForceCloseTransaction()
t = Transaction(doc,'Create3D')
t.Start()
views=ProcessParallelLists(CreateView, viewNames)
t.Commit()
#TransactionManager.Instance.ForceCloseTransaction()

#Assign your output to the OUT variable
OUT = views, doc
# ----------------------------------------
code_block = CodeBlock(x=create_3dview) { x[0]; x[1]; }
View = Output(code_block.out0)
Document = Output(code_block.out1)
