# Dynamo custom node 3DView Lock or Unlock.dyf (Dynamo 2.6.1.8786)
# category: GeniusLoci.View
# Use a boolean True to unlock the 3D view.
# False locks the 3D view and saves its orientation.
# (The default 3D view aka {3D} must be renamed to be saved)

ThreeDView = Input(ThreeDView: Revit.Elements.Views.View3D = Revit.Application.Document.Current.ActiveView)
Toggle = Input(Toggle: bool = true)  # True = Unlock False = Lock
n3dview_lock_or_unlock = Python(IN[0]=ThreeDView, IN[1]=Toggle)  # "3Dview Lock or Unlock"
# ---------- n3dview_lock_or_unlock.python (45 lines) ----------
#Alban de Chasteigner 2018
#twitter : @geniusloci_bim
#geniusloci.bim@gmail.com

import clr
clr.AddReference('ProtoGeometry')
from Autodesk.DesignScript.Geometry import *

clr.AddReference("RevitNodes")
import Revit
clr.ImportExtensions(Revit.Elements)

clr.AddReference("RevitAPI")
import Autodesk

clr.AddReference("RevitServices")
import RevitServices
from RevitServices.Persistence import DocumentManager
from RevitServices.Transactions import TransactionManager

doc = DocumentManager.Instance.CurrentDBDocument

def ProcessList(_func, _list):
    return map( lambda x: ProcessList(_func, x) if type(x)==list else _func(x), _list )

def Unwrap(item):
    return UnwrapElement(item)

if isinstance(IN[0], list):
    views = ProcessList(Unwrap, IN[0])
else:
    views = [Unwrap(IN[0])]

toggle = IN[1]

TransactionManager.Instance.EnsureInTransaction(doc)
for view in views:
	if toggle == True:
		view.Unlock()
	else:
		view.SaveOrientationAndLock()
TransactionManager.Instance.TransactionTaskDone()

if isinstance(IN[0], list): OUT = views 
else: OUT = views[0]
# ----------------------------------------
ThreeDView_2 = Output(n3dview_lock_or_unlock)  # "ThreeDView"
