# Dynamo custom node 3DView Set Orientation.dyf (Dynamo 2.6.1.8786)
# category: GeniusLoci.View
# This node will copy the orientation from the desired 3D view and apply it to a list of 3D views.
# The 3D views will be locked.
# The name of the 3D view mustn't include any special characters  \ : {} etc.
# Based on a Ben Osborne's script.

ControlView = Input(ControlView: var[]..[])
ControlView_2 = Output(ControlView)  # "ControlView"
ThreeDView = Input(ThreeDView: var[]..[])  # The active view mustn't be part of the input 3DView
set_the_view_orientation = Python(IN[0]=ControlView, IN[1]=ThreeDView)
# ---------- set_the_view_orientation.python (51 lines) ----------
#From Ben Osborne
#http://dynamobim.org/forums/topic/view-orientation-and-python-script-refresh/

import clr
clr.AddReference('ProtoGeometry')
from Autodesk.DesignScript.Geometry import *

clr.AddReference("RevitNodes")
import Revit
clr.ImportExtensions(Revit.Elements)

clr.AddReference("RevitAPI")
import Autodesk

clr.AddReference("RevitServices")
import RevitServices
from RevitServices.Persistence import DocumentManager
from RevitServices.Transactions import TransactionManager

#Les entrées effectuées dans ce noeud sont stockées sous forme de liste dans les variables IN.
doc = DocumentManager.Instance.CurrentDBDocument

def ProcessList(_func, _list):
    return map( lambda x: ProcessList(_func, x) if type(x)==list else _func(x), _list )

def Unwrap(item):
    return UnwrapElement(item)

if isinstance(IN[0], list):
    controlview = ProcessList(Unwrap, IN[0])
else:
    controlview = [Unwrap(IN[0])]

if isinstance(IN[1], list):
    views = ProcessList(Unwrap, IN[1])
else:
    views = [Unwrap(IN[1])]

TransactionManager.Instance.EnsureInTransaction(doc)
for control in controlview:
	control.Unlock()
	viewSetting = control.GetOrientation()
	control.SaveOrientationAndLock()
for view in views:
	view.Unlock()
	view.SetOrientation(viewSetting)
	view.SaveOrientationAndLock()
TransactionManager.Instance.TransactionTaskDone()

#Affectez la sortie à la variable OUT.
OUT = (controlview,views)
# ----------------------------------------
code_block = CodeBlock(seq=set_the_view_orientation) { seq[1]; }
Views = Output(code_block)
