# Dynamo custom node 3DView Toggle To Isometric.dyf (Dynamo 2.6.1.8786)
# category: GeniusLoci.View
# Use a boolean True to toggle the 3D view to isometric.
# False toggles the 3D view to perspective.

ThreeDView = Input(ThreeDView: Revit.Elements.Views.View3D = Revit.Application.Document.Current.ActiveView)
Toggle = Input(Toggle: bool = true)  # True = Isometric False = Perspective
n3dview_toggle = Python(IN[0]=ThreeDView, IN[1]=Toggle)  # "3Dview Toggle"
# ---------- n3dview_toggle.python (46 lines) ----------
#Alban de Chasteigner 2019
#twitter : @geniusloci_bim
#geniusloci.bim@gmail.com

import clr
clr.AddReference('ProtoGeometry')
from Autodesk.DesignScript.Geometry import *

clr.AddReference("RevitNodes")
import Revit
clr.ImportExtensions(Revit.Elements)

clr.AddReference("RevitAPI")
import Autodesk

clr.AddReference("RevitServices")
import RevitServices
from RevitServices.Persistence import DocumentManager
from RevitServices.Transactions import TransactionManager

doc = DocumentManager.Instance.CurrentDBDocument

def ProcessList(_func, _list):
    return map( lambda x: ProcessList(_func, x) if type(x)==list else _func(x), _list )

def Unwrap(item):
    return UnwrapElement(item)

if isinstance(IN[0], list):
    views = ProcessList(Unwrap, IN[0])
else:
    views = [Unwrap(IN[0])]

toggle = IN[1]

TransactionManager.Instance.EnsureInTransaction(doc)
for view in views:
	view.Unlock()
	if toggle == True:
		view.ToggleToIsometric()
	else:
		view.ToggleToPerspective()
TransactionManager.Instance.TransactionTaskDone()

#Affectez la sortie à la variable OUT.
OUT = views
# ----------------------------------------
ThreeDView_2 = Output(n3dview_toggle)  # "ThreeDView"
