# Dynamo custom node Adjacent Levels.dyf (Dynamo 2.6.1.8786)
# category: GeniusLoci.Level
# Returns the levels above and bottom the input level.
# Based on an archilab node

level = Input(level: var[]..[])
python_script = Python(IN[0]=level)
# ---------- python_script.python (65 lines) ----------
# Copyright(c) 2016, Konrad K Sobon
# @arch_laboratory, http://archi-lab.net

import clr
# Import Element wrapper extension methods
clr.AddReference("RevitNodes")
import Revit
clr.ImportExtensions(Revit.Elements)

# Import DocumentManager and TransactionManager
clr.AddReference("RevitServices")
import RevitServices
from RevitServices.Persistence import DocumentManager
doc = DocumentManager.Instance.CurrentDBDocument

# Import RevitAPI
clr.AddReference("RevitAPI")
import Autodesk
from Autodesk.Revit.DB import *

if isinstance(IN[0], list):
	levels = IN[0]
else:
	levels = [IN[0]]

def ProcessList(_func, _list):
    return map( lambda x: ProcessList(_func, x) if type(x)==list else _func(x), _list )

allLevels = FilteredElementCollector(doc) \
				.OfCategory(BuiltInCategory.OST_Levels) \
				.WhereElementIsNotElementType() \
				.ToElements()

elevations = [i.Elevation for i in allLevels]
sortedLevels = [x for (y,x) in sorted(zip(elevations,allLevels))]
sortedLevelNames = [i.Name for i in sortedLevels]

def GetLevelBottom(e):
	index = sortedLevelNames.index(e.Name)
	if index - 1 == -1 :
		return None
	else:
		return sortedLevels[index-1]

def GetLevelAbove(e):
	index = sortedLevelNames.index(e.Name)
	if index + 1 >= len(sortedLevels):
		return None
	else:
		return sortedLevels[index+1]

try:
	errorReport = None
	above = ProcessList(GetLevelAbove, levels)
	bottom = ProcessList(GetLevelBottom, levels)
except:
	# if error accurs anywhere in the process catch it
	import traceback
	errorReport = traceback.format_exc()

#Assign your output to the OUT variable
if errorReport == None:
	OUT = above, bottom
else:
	OUT = errorReport
# ----------------------------------------
code_block = CodeBlock(x=python_script) { x[0]; x[1]; }
AboveLevel = Output(code_block.out0)
BottomLevel = Output(code_block.out1)
