# Dynamo custom node Align Pattern To Edges.dyf (Dynamo 2.12.1.8246)
# category: GeniusLoci.Material
# Aligns the lines of the surface (model) pattern with the bottom and right edges.
# The element can be a roof, a floor, a ceiling or a wall.

element = Input(element: var[]..[])  # Roof, floor, ceiling or wall
point = Input(point: Autodesk.DesignScript.Geometry.Point[]..[] = Autodesk.DesignScript.Geometry.Point.ByCoordinates(0, 0, 0))  # Optional input
python_script = Python(IN[0]=element, IN[1]=point)  # IronPython2
# ---------- python_script.python (103 lines) ----------
#Inspired by Fair59 https://forums.autodesk.com/t5/revit-api-forum/use-of-align-function-programatically-to-change-the-alignment-of/td-p/6008184
#Suggestion by Mark Ackerley
#Improvement by Piotr Spyra

#Alban de Chasteigner 2020
#twitter : @geniusloci_bim
#geniusloci.bim@gmail.com

import clr
clr.AddReference("RevitAPI")
import Autodesk
from Autodesk.Revit.DB import *

clr.AddReference("RevitNodes")
import Revit
# Import GeometryConversion
clr.ImportExtensions(Revit.GeometryConversion)

clr.AddReference("RevitServices")
import RevitServices
from RevitServices.Persistence import DocumentManager
from RevitServices.Transactions import TransactionManager
doc = DocumentManager.Instance.CurrentDBDocument

elements = UnwrapElement(IN[0]) if isinstance(IN[0],list) else [UnwrapElement(IN[0])]
DynPoints = [i.ToXyz() for i in IN[1]] if isinstance(IN[1],list) else [IN[1].ToXyz()]

for item, DynPoint in zip(elements, DynPoints) :
	if item.ToString() == 'Autodesk.Revit.DB.Floor' or item.ToString() == 'Autodesk.Revit.DB.RoofBase' or item.ToString() == 'Autodesk.Revit.DB.FootPrintRoof':
		ext = HostObjectUtils.GetTopFaces(item)
		end=0
	elif item.ToString() == 'Autodesk.Revit.DB.Wall':
		#get the external face reference of the item as an array
		ext = HostObjectUtils.GetSideFaces(item,ShellLayerType.Exterior)
		end=1
	else :
		ext = HostObjectUtils.GetBottomFaces(item)
		end=1
	#for (the array containing) the external face reference, get it's geometry
	for e in ext:
		extFace = item.GetGeometryObjectFromReference(e)
		#get the external face surface edges as lines, get the first line (the bottom)
		for	cv in extFace.GetEdgesAsCurveLoops()[0]:
			#get the finish point of the line
			corner = cv.GetEndPoint(end)
		#Check for model surfacepattern
		mat=doc.GetElement(extFace.MaterialElementId)
		patternType = doc.GetElement(mat.SurfaceForegroundPatternId)
		pattern = patternType.GetFillPattern()
		#Get number of gridLines in pattern                
		gridCount = pattern.GridCount
		#Construct StableRepresentation to top face reference
		StableRef = e.ConvertToStableRepresentation(doc)
		
		#we want horizontal and vertical refs so we want 2 arrays
		for hatchindex in range(0, gridCount):
			refAr = ReferenceArray()
			ip=0
			while ip<2:
				#generate an index for each hatch reference
				index = (hatchindex+1) + (ip * gridCount *2)
				#create a string for each hatch reference using the face reference and hatch index
				StableHatchString = StableRef + str.Format("/{0}", index)
				#generate a new reference for each hatch reference using the string
				HatchRef = Reference.ParseFromStableRepresentation(doc, StableHatchString)
				refAr.Append(HatchRef)
				ip += 1

			TransactionManager.Instance.EnsureInTransaction(doc)
			#create dimension to use it's references and length
			#this uses 2 references to the hatch pattern for each orientation
			_dimension = doc.Create.NewDimension(doc.ActiveView, Line.CreateBound(XYZ.Zero, XYZ(10, 0, 0)), refAr)
			ElementTransformUtils.MoveElement(doc, _dimension.Id, XYZ(.1, 0, 0))
			r1 = _dimension.References.get_Item(0)
			direction =_dimension.Curve.Direction
			hatchDirection = direction.CrossProduct(extFace.FaceNormal).Normalize()
			#move back by half because origin is always centered on the dimension
			origin = _dimension.Origin.Subtract(direction.Multiply(_dimension.Value/2))
			#create reference plane at the pattern location
			pl = doc.Create.NewReferencePlane(origin.Add(hatchDirection.Multiply(3)),origin,extFace.FaceNormal.Multiply(3),doc.ActiveView)
			#generate a unique name for the reference plane using it's Guid
			#pl.Name = str.Format("{0}_{1}","ref", Guid.NewGuid())
			TransactionManager.Instance.TransactionTaskDone()

			stableRef = str.Format("{0}:0:{1}",pl.UniqueId,"SURFACE")
			ref2Plane = Reference.ParseFromStableRepresentation(doc,stableRef)
	
			TransactionManager.Instance.ForceCloseTransaction()
			TransactionManager.Instance.EnsureInTransaction(doc)
			doc.Create.NewAlignment(doc.ActiveView,ref2Plane,r1)
			
			if DynPoint != XYZ(0,0,0):
				translation = origin.Subtract(DynPoint)
			else:
				translation = origin.Subtract(corner)
			ElementTransformUtils.MoveElement(doc,pl.Id,-translation)
			
			#we don't need the dimensions or reference planes any more
			doc.Delete(_dimension.Id)
			doc.Delete(pl.Id)
			TransactionManager.Instance.TransactionTaskDone()

OUT="Success"
# ----------------------------------------
Result = Output(python_script)
