# Dynamo custom node Align Tag with CropRegion.dyf
# category: GeniusLoci.Tag
# Aligns the tags with the Crop Region's boundaries of the active view.
# By Cyril Poupin on Dynamo Forum

category = Input(category: var[]..[])  # Tag Category
offset = Input(offset: var[]..[])  # Distance offset from Crop Region
python = Python(IN[0]=category, IN[1]=offset)  # IronPython2
# ---------- python.python (62 lines) ----------
#Initially by Cyril Poupin on Dynamo Forum
#https://forum.dynamobim.com/t/room-tags-should-be-outside-the-crop-region/57507/5
#Changes by Alban de Chasteigner

import clr
clr.AddReference('RevitAPI')
import Autodesk
from Autodesk.Revit.DB import *

clr.AddReference('RevitServices')
import RevitServices
from RevitServices.Persistence import DocumentManager
from RevitServices.Transactions import TransactionManager
doc = DocumentManager.Instance.CurrentDBDocument
uiapp = DocumentManager.Instance.CurrentUIApplication
app = uiapp.Application
version=int(app.VersionNumber)

if version < 2021:
	UIunit = doc.GetUnits().GetFormatOptions(UnitType.UT_Length).DisplayUnits
else:
	UIunit = doc.GetUnits().GetFormatOptions(SpecTypeId.Length).GetUnitTypeId()

def moveTgtoCrop(boundLines, rtag):
	if isinstance(rtag,SpatialElementTag):
		ptTag = rtag.Location.Point
	elif isinstance(rtag,IndependentTag):
		rtag.LeaderEndCondition = LeaderEndCondition.Free
		if version < 2023 :
			ptTag = rtag.LeaderEnd
		else : ptTag = rtag.GetLeaderEnd(rtag.GetTaggedReferences()[0])
	lstInter = []
	for lineBound in boundLines:
		interResult = lineBound.Project(ptTag)
		lstInter.append(interResult)
	lstInter.sort(key = lambda x : ptTag.DistanceTo(x.XYZPoint))
	firsttInterResult = lstInter[0]
	rtag.TagHeadPosition = firsttInterResult.XYZPoint
	#move location to update TagHeadPosition
	#rtag.Location.Move(XYZ(0.0001,0.0001,0))

def getBoundLines(view, offsetCrop = 1):
	shape = view.GetCropRegionShapeManager().GetCropShape()
	if len(shape) > 0 :
		offsetShape = CurveLoop.CreateViaOffset(shape[0], offsetCrop, -view.ViewDirection)
	return offsetShape	

category = UnwrapElement(IN[0])
offsetCrop = UnitUtils.ConvertToInternalUnits(IN[1],UIunit)

activeView = doc.ActiveView

fecTag = FilteredElementCollector(doc, activeView.Id).OfCategoryId(category.Id).ToElements()
boundLines = getBoundLines(activeView, offsetCrop)

TransactionManager.Instance.EnsureInTransaction(doc)
for rtag in fecTag :
	rtag.HasLeader = True
	moveTgtoCrop(boundLines, rtag)
TransactionManager.Instance.TransactionTaskDone()

OUT = fecTag
# ----------------------------------------
Tag = Output(python)
