# Dynamo custom node All Elements at Level+.dyf (Dynamo 2.6.1.8786)
# category: GeniusLoci.Level
# Get all the elements at the specified Level from the model. Unlike the OOTB node it works with MEP Curves and Structural Framings.

level = Input(level: var[]..[])
python_script = Python(IN[0]=level)
# ---------- python_script.python (46 lines) ----------
#Alban de Chasteigner 2020
#twitter : @geniusloci_bim
#geniusloci.bim@gmail.com

import clr
clr.AddReference('RevitAPI')
import Autodesk
from Autodesk.Revit.DB import *

#Import Collections
from System.Collections.Generic import *
import System

levelInput = UnwrapElement(IN[0]) if isinstance(IN[0],list) else [UnwrapElement(IN[0])]
levList = []

sysId = ElementId(BuiltInParameter.RBS_START_LEVEL_PARAM)
schedId = ElementId(BuiltInParameter.INSTANCE_SCHEDULE_ONLY_LEVEL_PARAM)
stairsId = ElementId(BuiltInParameter.STAIRS_BASE_LEVEL_PARAM)
framingId = ElementId(BuiltInParameter.INSTANCE_REFERENCE_LEVEL_PARAM)
trussId = ElementId(BuiltInParameter.TRUSS_ELEMENT_REFERENCE_LEVEL_PARAM)
roofId = ElementId(BuiltInParameter.ROOF_CONSTRAINT_LEVEL_PARAM)
wkId = ElementId(BuiltInParameter.SKETCH_PLANE_PARAM)

for levelIn in levelInput :
	doc=levelIn.Document
	filters = List[ElementFilter]()
	filters.Add(ElementLevelFilter(levelIn.Id))
	filters.Add(ElementParameterFilter(ParameterFilterRuleFactory.CreateEqualsRule(schedId, levelIn.Id)))
	filters.Add(ElementParameterFilter(ParameterFilterRuleFactory.CreateEqualsRule(sysId, levelIn.Id)))
	filters.Add(ElementParameterFilter(ParameterFilterRuleFactory.CreateEqualsRule(stairsId, levelIn.Id)))
	filters.Add(ElementParameterFilter(ParameterFilterRuleFactory.CreateEqualsRule(framingId, levelIn.Id)))
	filters.Add(ElementParameterFilter(ParameterFilterRuleFactory.CreateEqualsRule(trussId, levelIn.Id)))
	filters.Add(ElementParameterFilter(ParameterFilterRuleFactory.CreateEqualsRule(roofId, levelIn.Id)))
	filters.Add(ElementParameterFilter(ParameterFilterRuleFactory.CreateEndsWithRule(wkId, levelIn.Name, False)))
	orFilter = LogicalOrFilter(filters)
	cat_list = [BuiltInCategory.OST_ConduitCenterLine, BuiltInCategory.OST_PipeCurvesCenterLine, BuiltInCategory.OST_DuctCurvesCenterLine, 
BuiltInCategory.OST_FlexPipeCurvesCenterLine, BuiltInCategory.OST_FlexDuctCurvesCenterLine,  BuiltInCategory.OST_ConduitFittingCenterLine, BuiltInCategory.OST_PipeFittingCenterLine, BuiltInCategory.OST_DuctFittingCenterLine,  BuiltInCategory.OST_CurtainWallMullions,BuiltInCategory.OST_CurtainWallPanels]
	catFilter = ElementMulticategoryFilter(List[BuiltInCategory](cat_list),True)
	andFilter = LogicalAndFilter(orFilter,catFilter)	
	levList.append(FilteredElementCollector(doc).WherePasses(andFilter).WhereElementIsNotElementType().ToElements())
	
if isinstance(IN[0], list): OUT = levList
else: OUT = levList[0]
orFilter.Dispose()
andFilter.Dispose()
# ----------------------------------------
Elements = Output(python_script)
