# Dynamo custom node All Elements at Phase.dyf (Dynamo 2.6.1.8786)
# category: GeniusLoci.Phase
# Collect all elements at a given phase.

phase = Input(phase: var[]..[])
python_script = Python(IN[0]=phase)
# ---------- python_script.python (27 lines) ----------
#Alban de Chasteigner 2020
#twitter : @geniusloci_bim
#geniusloci.bim@gmail.com

import clr
clr.AddReference('RevitAPI')
import Autodesk
from Autodesk.Revit.DB import *

from System.Collections.Generic import *
import System

phases = UnwrapElement(IN[0]) if isinstance(IN[0],list) else [UnwrapElement(IN[0])]
phaseList = []

#Remove center line
cat_list = [BuiltInCategory.OST_ConduitCenterLine, BuiltInCategory.OST_PipeCurvesCenterLine, BuiltInCategory.OST_DuctCurvesCenterLine, BuiltInCategory.OST_FlexPipeCurvesCenterLine, BuiltInCategory.OST_FlexDuctCurvesCenterLine, BuiltInCategory.OST_ConduitFittingCenterLine, BuiltInCategory.OST_PipeFittingCenterLine, BuiltInCategory.OST_DuctFittingCenterLine, BuiltInCategory.OST_FloorAnalytical, BuiltInCategory.OST_ColumnAnalytical, BuiltInCategory.OST_BeamAnalytical, BuiltInCategory.OST_WallAnalytical]
catFilter = ElementMulticategoryFilter(List[BuiltInCategory](cat_list),True)

for phase in phases :
	doc=phase.Document
	filter=ElementParameterFilter(ParameterFilterRuleFactory.CreateEqualsRule(ElementId(BuiltInParameter.PHASE_CREATED), phase.Id))
	andFilter = LogicalAndFilter(filter,catFilter)
	phaseList.append(FilteredElementCollector(doc).WherePasses(andFilter).WhereElementIsNotElementType().ToElements())
	
if isinstance(IN[0], list): OUT = phaseList
else: OUT = phaseList[0]
# ----------------------------------------
Element = Output(python_script)
