# Dynamo custom node All Elements at Workset.dyf (Dynamo 2.6.1.8786)
# category: GeniusLoci.Workset
# Collect all elements at a given workset.
# Works with a workset name or with a Autodesk.Revit.DB.Workset.

workset = Input(workset: var[]..[])  # Workset Name or Autodesk.Revit.DB.Workset
python_script = Python(IN[0]=workset)
# ---------- python_script.python (29 lines) ----------
#Alban de Chasteigner 2020
#twitter : @geniusloci_bim
#geniusloci.bim@gmail.com

import clr
# Import DocumentManager and TransactionManager
clr.AddReference("RevitServices")
import RevitServices
from RevitServices.Persistence import DocumentManager
doc = DocumentManager.Instance.CurrentDBDocument
# Import RevitAPI
clr.AddReference("RevitAPI")
import Autodesk
from Autodesk.Revit.DB import *

worksets = IN[0] if isinstance(IN[0],list) else [IN[0]]
worksetList = []

for workset in worksets :
	if isinstance(workset,Autodesk.Revit.DB.Workset):
		wks = workset
	else:
		userWorksets = FilteredWorksetCollector(doc).OfKind(WorksetKind.UserWorkset).ToWorksets()
		wks=next((ws for ws in userWorksets if ws.Name.lower() == workset.lower()), None)
	filter=ElementWorksetFilter(wks.Id,False)
	worksetList.append(FilteredElementCollector(doc).WherePasses(filter).WhereElementIsNotElementType().ToElements())

if isinstance(IN[0], list): OUT = worksetList
else: OUT = worksetList[0]
# ----------------------------------------
Element = Output(python_script)
