# Dynamo custom node All Elements of Class+.dyf (Dynamo 2.6.2.15705)
# category: GeniusLoci.Select
# Get the instances of the given class. Works with Element Class, FamilyType, ViewFamilyType, Wall/Floor/Roof/CeilingType, GroupType, FilledRegionType and TextNoteType.

elementClass = Input(elementClass: var[]..[])  # Element Class, FamilyType, ViewFamilyType, Compound Type
docOrRevitLinkInstance = Input(docOrRevitLinkInstance: var[]..[] = null)  # Use only if you want to query a linked model
python_script = Python(IN[0]=elementClass, IN[1]=docOrRevitLinkInstance)
# ---------- python_script.python (60 lines) ----------
#Alban de Chasteigner 2020
#twitter : @geniusloci_bim
#geniusloci.bim@gmail.com
#https://github.com/albandechasteigner/GeniusLociForDynamo

import clr
clr.AddReference('RevitAPI')
import Autodesk
from Autodesk.Revit.DB import *
clr.AddReference('RevitServices')
import RevitServices
from RevitServices.Persistence import DocumentManager
import System

def tolist(x):
    if hasattr(x,'__iter__'): return x
    else : return [x]

cats = tolist(UnwrapElement(IN[0]))
inputdocs = tolist(UnwrapElement(IN[1]))

#Inspired by Clockwork
for inputdoc in inputdocs :
	if inputdoc == None:
		doc = DocumentManager.Instance.CurrentDBDocument
	elif isinstance (inputdoc, Document):
		doc = inputdoc
	elif isinstance (inputdoc, RevitLinkInstance):
		doc = inputdoc.GetLinkDocument()
	else: doc = DocumentManager.Instance.CurrentDBDocument

provider = ParameterValueProvider(ElementId(BuiltInParameter.ELEM_FAMILY_PARAM))
provider2 = ParameterValueProvider(ElementId(BuiltInParameter.ELEM_TYPE_PARAM))
evaluator = FilterNumericEquals()
elements = []

for cat in cats:
	if isinstance(cat, Category) :
		collector = FilteredElementCollector(doc).OfCategoryId(cat.Id).WhereElementIsNotElementType().ToElements()
	elif isinstance(cat, System.Type) : 
		collector = FilteredElementCollector(doc).OfClass(cat).ToElements()
	elif isinstance(cat, FamilySymbol) or isinstance(cat,Autodesk.Revit.DB.FilledRegionType) :
		filter = ElementParameterFilter(FilterElementIdRule(provider, evaluator, cat.Id))	
		collector = FilteredElementCollector(doc).OfCategoryId(cat.Category.Id).WherePasses(filter).ToElements()
	elif isinstance(cat,TextNoteType):
		collector = FilteredElementCollector(doc).OfClass(TextNote).WhereElementIsNotElementType().ToElements().FindAll(lambda x : x.GetTypeId() == cat.Id)
	elif isinstance(cat,ModelTextType):
		collector = FilteredElementCollector(doc).OfClass(ModelText).WhereElementIsNotElementType().ToElements().FindAll(lambda x : x.GetTypeId() == cat.Id)
	elif isinstance(cat, HostObjAttributes):
		filter = ElementParameterFilter(FilterElementIdRule(provider2, evaluator, cat.Id))	
		collector = FilteredElementCollector(doc).OfCategoryId(cat.Category.Id).WherePasses(filter).ToElements()
	elif isinstance(cat, ViewFamilyType) :
		collector = FilteredElementCollector(doc).OfClass(View).WhereElementIsNotElementType().ToElements().FindAll(lambda x : x.GetTypeId() == cat.Id)
	elif isinstance(cat, GroupType):
		collector = [c for c in cat.Groups]
	col = collector if len(collector)>1 else collector[0]
	elements.append(col)

if isinstance(IN[0], list) : OUT = elements
else: OUT = elements[0]
# ----------------------------------------
elements = Output(python_script)
