# Dynamo custom node All Elements of System.dyf (Dynamo 2.12.1.8246)
# category: GeniusLoci.MEP
# Returns every element of the duct or piping network, including ducts, pipes, fittings, fixtures, equipments etc.

system = Input(system: var[]..[])  # MEPSystem Type, MechanicalSystem, PipingSystem or MEP element
python_script = Python(IN[0]=system)  # IronPython2
# ---------- python_script.python (63 lines) ----------
#Alban de Chasteigner 2021
#twitter : @geniusloci_bim
#geniusloci.bim@gmail.com
#https://github.com/albandechasteigner/GeniusLociForDynamo

import clr
clr.AddReference('RevitAPI')
import Autodesk
from Autodesk.Revit.DB import *

clr.AddReference("RevitNodes")
import Revit
clr.ImportExtensions(Revit.Elements)

clr.AddReference('RevitServices')
import RevitServices
from RevitServices.Persistence import DocumentManager
doc = DocumentManager.Instance.CurrentDBDocument
import System

def getSystem(elem):
	mepsys = None
	if isinstance(elem, System.Type) : 
		try : mepsys = FilteredElementCollector(doc).OfClass(elem).ToElements()
		except : pass
	elif isinstance(elem, MEPCurve):
		mepsys = elem.MEPSystem
	elif isinstance(elem, FamilyInstance):
		try : connSet = elem.MEPModel.ConnectorManager.Connectors
		except : connSet = elem.ConnectorManager.Connectors
		for con in connSet:
			if con.IsConnected:
				mepsys = con.MEPSystem
	elif isinstance(elem, MEPSystem) : 
		mepsys = elem
	return mepsys
			
def getNetwork(system):
	network = None
	if isinstance(system, Mechanical.MechanicalSystem):
		try:
			network = [e.ToDSType(True) for e in system.DuctNetwork]
		except:
			pass
	elif isinstance(system, Plumbing.PipingSystem):
		try:
			network = [e.ToDSType(True) for e in system.PipingNetwork]
		except:
			pass
	return network

elems = UnwrapElement(IN[0]) if isinstance(IN[0],list) else [UnwrapElement(IN[0])]
systems,networkElements = [],[]

for e in elems:
	mepSystem = getSystem(e)
	if hasattr(mepSystem, '__iter__'): networkElem = [getNetwork(system) for system in mepSystem]
	else: networkElem = getNetwork(mepSystem)
	systems.append(mepSystem)
	networkElements.append(networkElem)
	
if isinstance(IN[0], list): OUT = networkElements,systems
else: OUT = networkElements[0],systems[0]
# ----------------------------------------
code_block = CodeBlock(x=python_script) { x[0]; x[1]; }
Elements = Output(code_block.out0)
System = Output(code_block.out1)
