# Dynamo custom node Annotation BoundingBox.dyf (Dynamo 2.6.1.8786)
# category: GeniusLoci.Geometry
# Get the BoundingBox of the view specific element. (Text, tag, etc)

element = Input(element: var[]..[])
python_script = Python(IN[0]=element)
# ---------- python_script.python (44 lines) ----------
#Alban de Chasteigner 2018
#twitter : @geniusloci_bim
#geniusloci.bim@gmail.com
#https://github.com/albandechasteigner/GeniusLociForDynamo

import clr
clr.AddReference('RevitAPI')
import Autodesk
from Autodesk.Revit.DB import XYZ, DatumPlane, Grid, ReferencePlane, DatumExtentType, BoundingBoxXYZ
clr.AddReference('RevitNodes')
import Revit
clr.ImportExtensions(Revit.GeometryConversion)

annotations=UnwrapElement(IN[0]) if isinstance(IN[0],list) else [UnwrapElement(IN[0])]
bbox,center = [],[]

for anno in annotations:
	if not isinstance(anno,DatumPlane):
		viewId = anno.OwnerViewId
		view = anno.Document.GetElement(viewId)
		box=anno.BoundingBox[view]
	elif isinstance(anno,Grid):
		line=anno.Curve
		start=line.GetEndPoint(0)
		end=line.GetEndPoint(1)   
		box=BoundingBoxXYZ()
		box.Min = start
		box.Max = end		
	elif isinstance(anno,ReferencePlane):
		doc=anno.Document
		view = doc.ActiveView
		for crv in anno.GetCurvesInView(DatumExtentType.ViewSpecific,view):
			line = crv
		start=line.GetEndPoint(0)
		end=line.GetEndPoint(1)   
		box=BoundingBoxXYZ()
		box.Min = start
		box.Max = end	

	bbox.append(box.ToProtoType())
	center.append(((box.Min+box.Max)/2).ToPoint())

if isinstance(IN[0], list): OUT = bbox,center
else: OUT = bbox[0],center[0]
# ----------------------------------------
code_block = CodeBlock(x=python_script) { x[0]; x[1]; }
BoundingBox = Output(code_block.out0)
Centroid = Output(code_block.out1)  # Point
