# Dynamo custom node AppearanceAsset Get Properties.dyf (Dynamo 2.6.1.8786)
# category: GeniusLoci.Material
# Get all the properties and their values from an AppearanceAsset.

appearanceAsset = Input(appearanceAsset: var[]..[])
python_script = Python(IN[0]=appearanceAsset)
# ---------- python_script.python (50 lines) ----------
#Alban de Chasteigner 2019
#twitter : @geniusloci_bim
#geniusloci.bim@gmail.com

import clr
clr.AddReference('RevitAPI')
import Autodesk
from Autodesk.Revit.DB import *

clr.AddReference('RevitServices')
import RevitServices
from RevitServices.Persistence import DocumentManager
from RevitServices.Transactions import TransactionManager

clr.AddReference('DSCoreNodes')
import DSCore
from DSCore import Color

doc = DocumentManager.Instance.CurrentDBDocument

def toList(obj):
    if hasattr(obj, '__iter__'): return obj
    else: return [obj]

assets = toList(UnwrapElement(IN[0]))

for appAsset in assets:
	if isinstance(appAsset, Autodesk.Revit.DB.AppearanceAssetElement):
		asset=appAsset.GetRenderingAsset()
	elif isinstance(appAsset, Autodesk.Revit.DB.Visual.Asset):
		asset=appAsset
	else:
		pass
	propName,propType,properties,propValue=[],[],[],[]
	idx=0
	while idx < asset.Size:
		property=asset.Get(idx)
		#properties.append(property)
		propName.append(property.Name)
		propType.append(property.Type)
		if str(property.Type) != "Double4" and str(property.Type) != "Reference":
			propValue.append(property.Value)
		if str(property.Type) == "Double4":
			color=property.GetValueAsColor()
			propValue.append(DSCore.Color.ByARGB(255, color.Red, color.Green, color.Blue))
		if str(property.Type) == "Reference":
			propValue.append(property.Type)	
		idx += 1

OUT=propName,propType,propValue
# ----------------------------------------
code_block = CodeBlock(e=python_script) { e[0]; e[1]; e[2]; }
Property_Name = Output(code_block.out0)
Property_Type = Output(code_block.out1)
Value = Output(code_block.out2)
