# Dynamo custom node AppearanceAsset GetSchema.dyf (Dynamo 2.6.1.8786)
# category: GeniusLoci.Material
# Works only in Revit 2018.1 and later.
# Retrieves the Base Schema of the given AppearanceAsset Element.

appearanceAsset = Input(appearanceAsset: var[]..[])
python_script = Python(IN[0]=appearanceAsset)
# ---------- python_script.python (22 lines) ----------
#Alban de Chasteigner 2019
#twitter : @geniusloci_bim
#geniusloci.bim@gmail.com

import clr
clr.AddReference('RevitAPI')
from Autodesk.Revit.DB import *

assetElems = UnwrapElement(IN[0]) if isinstance(IN[0],list) else [UnwrapElement(IN[0])]
names=[]

for assetElem in assetElems:
	if hasattr(assetElem, 'GetRenderingAsset'):
		asset = assetElem.GetRenderingAsset()
	else:
		asset = None
	if hasattr(asset, 'AssetType'):
		names.append(asset.FindByName("BaseSchema").Value)
	else:names.append(None)
	
if isinstance(IN[0], list): OUT = names 
else: OUT = names[0]
# ----------------------------------------
Schema = Output(python_script)
