# Dynamo custom node AppearanceAsset Set Color.dyf (Dynamo 2.6.1.8786)
# category: GeniusLoci.Material
# Works only in Revit 2018.1 and later.
# Set the color property into the rendering color of the AppearanceAsset Element.

appearanceAsset = Input(appearanceAsset: var[]..[])
color = Input(color: var[]..[])  # Dynamo Color
set_appearance_color = Python(IN[0]=appearanceAsset, IN[1]=color)
# ---------- set_appearance_color.python (64 lines) ----------
#Alban de Chasteigner 2019
#twitter : @geniusloci_bim
#geniusloci.bim@gmail.com

import clr
clr.AddReference('RevitAPI')
from Autodesk.Revit.DB import *
clr.AddReference('RevitServices')
import RevitServices
from RevitServices.Persistence import DocumentManager
from RevitServices.Transactions import TransactionManager
doc = DocumentManager.Instance.CurrentDBDocument

def toList(obj):
    if hasattr(obj, '__iter__'): return obj
    else: return [obj]
    
assetElems = toList(UnwrapElement(IN[0]))
colors = toList(IN[1])

def ToRevitColor(dynamoColor):
	return Color(dynamoColor.Red, dynamoColor.Green, dynamoColor.Blue)

for assetElem, color in zip(assetElems, colors):
	TransactionManager.Instance.EnsureInTransaction(doc)
	with Visual.AppearanceAssetEditScope(assetElem.Document) as editScope:
		editableAsset = editScope.Start(assetElem.Id)
		if (editableAsset.FindByName("BaseSchema")).Value == "GenericSchema":
			genericDiffuseProperty = editableAsset.FindByName("generic_diffuse")
		elif (editableAsset.FindByName("BaseSchema")).Value == "CeramicSchema":
			genericDiffuseProperty = editableAsset.FindByName("ceramic_color")
		elif (editableAsset.FindByName("BaseSchema")).Value == "ConcreteSchema":
			genericDiffuseProperty = editableAsset.FindByName("concrete_color")
		elif (editableAsset.FindByName("BaseSchema")).Value == "GlazingSchema":
			genericDiffuseProperty = editableAsset.FindByName("glazing_transmittance_map")			
		elif (editableAsset.FindByName("BaseSchema")).Value == "MetallicPaintSchema":
			genericDiffuseProperty = editableAsset.FindByName("metallicpaint_base_color")
		elif (editableAsset.FindByName("BaseSchema")).Value == "MasonryCMUSchema":
			genericDiffuseProperty = editableAsset.FindByName("masonrycmu_color")
		elif (editableAsset.FindByName("BaseSchema")).Value == "MirrorSchema":
			genericDiffuseProperty = editableAsset.FindByName("mirror_tintcolor")			
		elif (editableAsset.FindByName("BaseSchema")).Value == "PlasticVinylSchema":
			genericDiffuseProperty = editableAsset.FindByName("plasticvinyl_color")			
		elif (editableAsset.FindByName("BaseSchema")).Value == "PrismLayeredSchema":
			genericDiffuseProperty = editableAsset.FindByName("layered_diffuse")
		elif (editableAsset.FindByName("BaseSchema")).Value == "PrismMetalSchema":
			genericDiffuseProperty = editableAsset.FindByName("metal_f0")			
		elif (editableAsset.FindByName("BaseSchema")).Value == "PrismOpaqueSchema":
			genericDiffuseProperty = editableAsset.FindByName("opaque_albedo")
		elif (editableAsset.FindByName("BaseSchema")).Value == "SolidGlassSchema":
			genericDiffuseProperty = editableAsset.FindByName("solidglass_transmittance_custom_color")
		elif (editableAsset.FindByName("BaseSchema")).Value == "WallPaintSchema":
			genericDiffuseProperty = editableAsset.FindByName("wallpaint_color")
		elif (editableAsset.FindByName("BaseSchema")).Value == "PrismTransparentSchema":
			genericDiffuseProperty = editableAsset.FindByName("transparent_color")
		elif (editableAsset.FindByName("BaseSchema")).Value == "WaterSchema":
			genericDiffuseProperty = editableAsset.FindByName("water_tint_color")
		elif (editableAsset.FindByName("BaseSchema")).Value == "HardwoodSchema":
			genericDiffuseProperty = editableAsset.FindByName("hardwood_tint_color")
		genericDiffuseProperty.SetValueAsColor(ToRevitColor(color))
		editScope.Commit(True)
	TransactionManager.Instance.TransactionTaskDone()

OUT = assetElems
# ----------------------------------------
AppearanceAsset = Output(set_appearance_color)
