# Dynamo custom node AppearanceAsset Set Properties.dyf (Dynamo 2.12.1.8246)
# category: GeniusLoci.Material
# Set the properties and their values in the given AppearanceAssetElement.
# You can find the property's name with the AppearanceAsset Get Properties node.

appearanceAsset = Input(appearanceAsset: var[]..[])
property = Input(property: string[]..[])
value = Input(value: var[]..[])  # One value per AppearanceAsset
set_properties = Python(IN[0]=appearanceAsset, IN[1]=property, IN[2]=value)  # IronPython2
# ---------- set_properties.python (53 lines) ----------
#Alban de Chasteigner 2022
#twitter : @geniusloci_bim
#geniusloci.bim@gmail.com
#https://github.com/albandechasteigner/GeniusLociForDynamo

import clr
clr.AddReference('RevitAPI')
from Autodesk.Revit.DB import *
from Autodesk.Revit.DB.Visual import *
clr.AddReference('RevitServices')
import RevitServices
from RevitServices.Persistence import DocumentManager
from RevitServices.Transactions import TransactionManager

def toList(obj):
    if hasattr(obj, '__iter__'): return obj
    else: return [obj]

assetElems = toList(UnwrapElement(IN[0]))
parameters = toList(IN[1])
values = toList(IN[2])

def ToRevitColor(dynamoColor):
	return Color(dynamoColor.Red, dynamoColor.Green, dynamoColor.Blue)
	
TransactionManager.Instance.ForceCloseTransaction()
for i, e in enumerate(assetElems):
	doc = e.Document
	TransactionManager.Instance.EnsureInTransaction(doc)
	for j, p in enumerate(parameters):
		with Visual.AppearanceAssetEditScope(e.Document) as editScope:
			editableAsset = editScope.Start(e.Id)
			property = editableAsset.FindByName(p)
			if isinstance(IN[0], list):
				if p == "UIName":
					e.Name = values[j][i]
				if property.IsEditable():
					if not isinstance(property, AssetPropertyDoubleArray4d):
						property.Value = values[j][i]
					else: 
						property.SetValueAsColor(ToRevitColor(values[j][i]))
			else:
				if p == "UIName":
					e.Name = values[j]
				if property.IsEditable():
					if not isinstance(property, AssetPropertyDoubleArray4d):
						property.Value = values[j]
					else: 
						property.SetValueAsColor(ToRevitColor(values[j]))
			editScope.Commit(True)
	TransactionManager.Instance.TransactionTaskDone()

OUT = IN[0]
# ----------------------------------------
AppearanceAssetElement = Output(set_properties)
