# Dynamo custom node Borrow Element.dyf (Dynamo 2.6.1.8786)
# category: GeniusLoci.Element
# Obtains ownership for the current user of as many specified elements as possible.

element = Input(element: var[]..[])
python_script = Python(IN[0]=element)
# ---------- python_script.python (24 lines) ----------
#By Ewan_Opie
import clr
clr.AddReference('RevitAPI')
import Autodesk
from Autodesk.Revit.DB import *

clr.AddReference('RevitServices')
import RevitServices
from RevitServices.Persistence import DocumentManager
doc = DocumentManager.Instance.CurrentDBDocument

clr.AddReference('System')
from System.Collections.Generic import List

elements = UnwrapElement(IN[0]) if isinstance(IN[0],list) else [UnwrapElement(IN[0])]
checkedout_elem=[]

ids = [elem.Id for elem in elements]
IDS = List[ElementId](ids)

try: checkedout_elem = [doc.GetElement(checkedout_el) for checkedout_el in WorksharingUtils.CheckoutElements(doc,IDS)]
except Exception as er: checkedout_elem.append(str(er))

OUT = checkedout_elem
# ----------------------------------------
Element = Output(python_script)
