# Dynamo custom node BoundingBox ByUnion.dyf (Dynamo 2.6.1.8786)
# category: GeniusLoci.Geometry
# Creates a single bounding box for one or more elements and returns a solid.
# The optional input Rotation allows to be not aligned with the axis.
# By Vsevolod Chugreev

element = Input(element: var[]..[])
rotationAngle = Input(rotationAngle: var[]..[] = 0)
python_script = Python(IN[0]=element, IN[1]=rotationAngle)
# ---------- python_script.python (111 lines) ----------
#Main part of the script by Vsevolod Chugreev
#https://twitter.com/vschugr/status/1260581659214258176
import clr
clr.AddReference('ProtoGeometry') 
import Autodesk.DesignScript.Geometry as DG

clr.AddReference("RevitNodes")
import Revit 
clr.ImportExtensions(Revit.GeometryConversion) 

clr.AddReference('RevitAPI') 
from Autodesk.Revit.DB import *

clr.AddReference('RevitServices')
import RevitServices 
from RevitServices.Persistence import DocumentManager
doc = DocumentManager.Instance.CurrentDBDocument
uiapp = DocumentManager.Instance.CurrentUIApplication
app = uiapp.Application
version=int(app.VersionNumber)

import math

if version < 2021:
	UIunit = Document.GetUnits(doc).GetFormatOptions(UnitType.UT_Length).DisplayUnits
else:
	UIunit = doc.GetUnits().GetFormatOptions(SpecTypeId.Length).GetUnitTypeId()

def flatten(x):
    result = []
    for el in x:
        if hasattr(el, "__iter__") and not isinstance(el, basestring):
            result.extend(flatten(el))
        else:
            result.append(el)
    return result

def RotatedBox(elements,angle):
	def SumBoxes(boxes):
		minx = min([b.Min.X for b in boxes])
		miny = min([b.Min.Y for b in boxes])
		minz = min([b.Min.Z for b in boxes])
		maxx = max([b.Max.X for b in boxes])
		maxy = max([b.Max.Y for b in boxes])
		maxz = max([b.Max.Z for b in boxes])
		
		bb = BoundingBoxXYZ()
		bb.Min = XYZ(minx,miny,minz)
		bb.Max = XYZ(maxx,maxy,maxz)
		return bb

	def GeoBox(g):
		box = g.GetBoundingBox()
		origin = box.Transform.Origin
		box.Min = box.Min.Add(origin)
		box.Max = box.Max.Add(origin)
		return box

	boxes = []
	opt = Options()
	opt.DetailLevel = ViewDetailLevel.Fine
	
	solids,boxes = [],[]
	for element in elements:
		instGeo = element.get_Geometry(opt)
		for ig in instGeo:
			if isinstance(ig,Solid):
				box = GeoBox(ig)
				boxes.append(box)
				solids.append(ig)
			else:			
				geo = flatten(ig.GetInstanceGeometry())
				for g in geo:
					if isinstance(g,Solid):
						box = g.GetBoundingBox()
						if box.Max.X < 99999:					
							box = GeoBox(g)
							boxes.append(box)
							solids.append(g)
					
	sumBox = SumBoxes(boxes)
	center = box.Max.Add(box.Min).Multiply(0.5)
	
	rotatedBoxes = []
	for i in range(len(boxes)):
		t = Transform.CreateRotationAtPoint(XYZ.BasisZ,-angle,center)
		g = SolidUtils.CreateTransformed(solids[i],t)
		rotatedBoxes.append(GeoBox(g))
					
	sumBox = SumBoxes(rotatedBoxes)
	minp = sumBox.Min
	maxp = sumBox.Max
	h = UnitUtils.ConvertFromInternalUnits(maxp.Z-minp.Z,UIunit)
	
	p1 = minp
	p3 = XYZ(maxp.X,maxp.Y,minp.Z)
	p2 = XYZ(minp.X,maxp.Y,minp.Z)
	p4 = XYZ(maxp.X,minp.Y,minp.Z)
	
	t2 = Transform.CreateRotationAtPoint(XYZ.BasisZ,angle,center)
	points = [t2.OfPoint(p).ToPoint() for p in [p1,p2,p3,p4]]
	poly = DG.PolyCurve.ByPoints(points,True)
	solid = poly.ExtrudeAsSolid(DG.Vector.ZAxis(),h)
	return solid
	points.Dispose()
	poly.Dispose()
	
elements = UnwrapElement(IN[0]) if isinstance(IN[0],list) else [UnwrapElement(IN[0])]
angle = math.radians((IN[1] if isinstance(IN[1],list) else [IN[1]])[0])

OUT =  RotatedBox(elements,angle)
# ----------------------------------------
Solid = Output(python_script)
