# Dynamo custom node CAD Block.dyf (Dynamo 2.18.1.5096)
# category: GeniusLoci.CAD Import
# Get the location point, name and layer of the CAD blocks / XRefs from a CAD link or import.
# Please note : The non-uniform scaling of blocks is not supported (The X, Y and Z values ​​of the Block Scale must be the same).

importInstance = Input(importInstance: var)
python_script = Python(IN[0]=importInstance)  # IronPython2
# ---------- python_script.python (49 lines) ----------
#Alban de Chasteigner 2021
#twitter : @geniusloci_bim
#geniusloci.bim@gmail.com
#https://github.com/albandechasteigner/GeniusLociForDynamo
  
import clr
clr.AddReference('RevitAPI')
import Autodesk
from Autodesk.Revit.DB import Options,GeometryInstance, XYZ
clr.AddReference("RevitNodes")
import Revit
clr.ImportExtensions(Revit.GeometryConversion)
clr.ImportExtensions(Revit.Elements)
clr.AddReference("RevitServices")
import RevitServices
from RevitServices.Persistence import DocumentManager
import math
uiapp = DocumentManager.Instance.CurrentUIApplication
version=int(uiapp.Application.VersionNumber)

points,rotations,blocks,layersAll=[],[],[],[]

elem = UnwrapElement(IN[0])
geoElem = elem.get_Geometry(Options())		
for geoObj in geoElem:
	transform=geoObj.Transform
	instance=geoObj.SymbolGeometry
	for inst in instance:
		layers=[]
		if isinstance(inst,GeometryInstance):
			points.append(transform.OfPoint(inst.Transform.Origin).ToPoint())
			rotation=abs(math.degrees(inst.Transform.BasisX.AngleOnPlaneTo(XYZ.BasisX, XYZ.BasisZ))-360)
			if round(rotation,3)==360:
				rotation = 0
			rotations.append(round(rotation,3))
			if version > 2022:
				blocks.append(elem.Document.GetElement(inst.GetSymbolGeometryId().SymbolId).ToDSType(True).Name.split(".dwg.")[-1])
			else:
				blocks.append(inst.Symbol.ToDSType(True).Name.split(".dwg.")[-1])
			geom=inst.SymbolGeometry
			for geo in geom:
				try:
					layers.append(elem.Document.GetElement(geo.GraphicsStyleId).GraphicsStyleCategory.Name)
				except:
					layers.append(None)
			if layers != [] : layersAll.append(layers[0])
			else : layersAll.append(layers)
			
OUT = blocks,points,rotations,layersAll
# ----------------------------------------
code_block = CodeBlock(x=python_script) { x[0]; x[1]; x[2]; x[3]; }
BlockName = Output(code_block.out0)
OriginPoint = Output(code_block.out1)
Rotation = Output(code_block.out2)
LayerName = Output(code_block.out3)
