# Dynamo custom node CADLayer ObjectStyle.dyf (Dynamo 2.6.2.15705)
# category: GeniusLoci.CAD Import
# Get the weight, color and line Pattern of CAD link or Import Object Styles (layers)

importInstance = Input(importInstance: var[]..[])  # ImportInstance or CADLinkType
view = Input(view: var[]..[] = Revit.Application.Document.Current.ActiveView)
python_script = Python(IN[0]=importInstance, IN[1]=view)
# ---------- python_script.python (43 lines) ----------
#Alban de Chasteigner 2023
#twitter : @geniusloci_bim
#geniusloci.bim@gmail.com
#Github: https://github.com/albandechasteigner/GeniusLociForDynamo/

import clr
clr.AddReference('RevitAPI')
from Autodesk.Revit.DB import *

clr.AddReference('DSCoreNodes')
import DSCore
from DSCore import Color

clr.AddReference("RevitServices")
import RevitServices
from RevitServices.Persistence import DocumentManager
doc = DocumentManager.Instance.CurrentDBDocument

elements = UnwrapElement(IN[0]) if isinstance(IN[0],list) else [UnwrapElement(IN[0])]
view = UnwrapElement(IN[1])

listName, patname, listpatid,lineProjWeight,listRGB,listMaterial = [],[],[],[],[],[]

for element in elements:
	catSub = element.Category.SubCategories
	for cat_cad in catSub:
		id = cat_cad.GetLinePatternId(GraphicsStyleType.Projection)
		pat = LinePatternElement.GetLinePattern(doc,id)
		projWeight = cat_cad.GetLineWeight(GraphicsStyleType.Projection)
		rgb = DSCore.Color.ByARGB(255, cat_cad.LineColor.Red, cat_cad.LineColor.Green, cat_cad.LineColor.Blue)
		listMaterial.append(cat_cad.Material)
		listRGB.append(rgb)
		lineProjWeight.append(projWeight)
		#listPattern.append(pat)
		try:listpatid.append(doc.GetElement(id))
		except:listpatid.append(id)
		try:
			patname.append(pat.Name)
		except:
			patname.append("Solid")
		listName.append(doc.GetElement(cat_cad.Id).Name)

OUT = listName, lineProjWeight, listRGB, listpatid, patname, listMaterial
# ----------------------------------------
code_block = CodeBlock(x=python_script) { x[0]; x[1]; x[2]; x[3]; x[4]; x[5]; }
Layer_Name = Output(code_block.out0)
Projection_Line_Weight = Output(code_block.out1)
Line_Colors = Output(code_block.out2)
Line_Pattern = Output(code_block.out3)
Line_Pattern_Name = Output(code_block.out4)
Material = Output(code_block.out5)
