# Dynamo custom node Category Document.dyf (Dynamo 2.12.0.5650)
# category: GeniusLoci.Document
# Retrieves the category and subcategories of a given document by BuiltInCategory.

document = Input(document: var[]..[] = null)  # Autodesk.Revit.DB.Document Optional input
builtInCategory = Input(builtInCategory: var[]..[] = "OST_Walls")  # string or BuiltInCategory
python_script = Python(IN[0]=document, IN[1]=builtInCategory)  # IronPython2
# ---------- python_script.python (35 lines) ----------
#Alban de Chasteigner 2022
#twitter : @geniusloci_bim
#geniusloci.bim@gmail.com
#https://github.com/albandechasteigner/GeniusLociForDynamo

import clr
clr.AddReference('RevitAPI')
import Autodesk
from Autodesk.Revit.DB import *
clr.AddReference('RevitNodes')
import Revit
clr.AddReference('RevitServices')
import RevitServices
from RevitServices.Persistence import DocumentManager
import System

inputdoc = UnwrapElement(IN[0]) if isinstance(IN[0],list) else [UnwrapElement(IN[0])]
name = IN[1]

if inputdoc[0] == None :
	doc = DocumentManager.Instance.CurrentDBDocument
else : doc = inputdoc[0]

if isinstance(name, Autodesk.Revit.DB.BuiltInCategory):
	builtIn=name
else:
	builtIn=System.Enum.Parse(Autodesk.Revit.DB.BuiltInCategory, name)
		
cat = doc.Settings.Categories.get_Item(builtIn)
cate=Revit.Elements.Category.ById((cat.Id).IntegerValue)
#subCategory = [Revit.Elements.Category.ById(i.Id.IntegerValue) for i in cat.SubCategories]
subCategory = cat.SubCategories
names = [i.Name for i in cat.SubCategories]

OUT = cate, subCategory, names
# ----------------------------------------
code_block = CodeBlock(x=python_script) { x[0]; x[1]; x[2]; }
Category = Output(code_block.out0)
SubCategory = Output(code_block.out1)
SubCategoryName = Output(code_block.out2)
