# Dynamo custom node Change Family Thumbnail Preview.dyf (Dynamo 2.6.1.8786)
# category: GeniusLoci.Family
# Update the Family Thumbnail Preview visible in the directory, save and close the family Document.

familyDocument = Input(familyDocument: var[]..[])  # Autodesk.Revit.DB.Document
familyView = Input(familyView: var[]..[])  # Chosen view
python_script = Python(IN[0]=familyDocument, IN[1]=familyView)
# ---------- python_script.python (37 lines) ----------
#https://apidocs.co/apps/revit/2019/df74c7e1-a98a-7751-676a-e9b074566f62.htm
import clr
clr.AddReference('RevitAPI')
from Autodesk.Revit.DB import *

clr.AddReference("RevitServices")
import RevitServices
from RevitServices.Persistence import DocumentManager
from RevitServices.Transactions import TransactionManager
doc = DocumentManager.Instance.CurrentDBDocument

#familyDocument = app.OpenDocumentFile(path)
familyDocuments = UnwrapElement(IN[0]) if isinstance(IN[0],list) else [UnwrapElement(IN[0])]
targetViews = UnwrapElement(IN[1]) if isinstance(IN[1],list) else [UnwrapElement(IN[1])]
paths=[]

opt = SaveAsOptions()
opt.OverwriteExistingFile = True

TransactionManager.Instance.ForceCloseTransaction()
TransactionManager.Instance.EnsureInTransaction(doc)
for familyDocument,targetView in zip(familyDocuments,targetViews):
	path = familyDocument.PathName
	paths.append(path)
	
	documentPreviewSettings = familyDocument.GetDocumentPreviewSettings()
	if documentPreviewSettings.IsViewIdValidForPreview(targetView.Id) :
		documentPreviewSettings.PreviewViewId = targetView.Id
		opt.PreviewViewId = targetView.Id
	documentPreviewSettings.ForceViewUpdate(True)

	familyDocument.SaveAs(path, opt)
	familyDocument.Close(False)
TransactionManager.Instance.TransactionTaskDone()

if isinstance(IN[0], list): OUT = paths
else: OUT = paths[0]
# ----------------------------------------
Path = Output(python_script)
