# Dynamo custom node Closest Level.dyf (Dynamo 2.6.1.8786)
# category: GeniusLoci.Level
# Return the closest level below the given element.

element = Input(element: var[]..[])
python_script = Python(IN[0]=element)
# ---------- python_script.python (68 lines) ----------
#Alban de Chasteigner 2020
#twitter : @geniusloci_bim
#geniusloci.bim@gmail.com
#https://github.com/albandechasteigner/GeniusLociForDynamo

import clr
clr.AddReference("RevitAPI")
import Autodesk
from Autodesk.Revit.DB import *

clr.AddReference("RevitServices")
import RevitServices
from RevitServices.Persistence import DocumentManager
doc = DocumentManager.Instance.CurrentDBDocument

items = UnwrapElement(IN[0]) if isinstance(IN[0],list) else [UnwrapElement(IN[0])]
search = []

levels = FilteredElementCollector(doc).OfClass(Level).ToElements()
sortedLevels = sorted(levels,key=lambda level : level.Elevation, reverse=True)

def closest(sortedLevels, number): 
	try:
		result= min([level for level in sortedLevels if level.ProjectElevation <= number], key=lambda x: abs(x.ProjectElevation-number))
	except:
		result= min([level for level in sortedLevels if level.ProjectElevation >= number], key=lambda x: abs(x.ProjectElevation-number))
	return result
	
for item in items:
	if hasattr(item, "Location") :
		loc = item.Location
		if loc:
			# line-based elements (e.g. walls)
			if isinstance(loc,LocationCurve):
				try:elementZ=loc.Curve.Evaluate(0.5, True).Z
				except:elementZ=loc.Curve.Evaluate(0.5, False).Z
			# point-based elements (e.g. most loadable families)
			elif isinstance(loc,LocationPoint):
				elementZ=loc.Point.Z
			elif isinstance(item,Instance):
				elementZ = item.GetTotalTransform().Origin.Z
			elif hasattr(item, "Origin"):
				elementZ = item.Origin.Z
			##Section Marker and ReferenceElevationMarker(Doesn't work for ReferenceElevationMarker)
			elif ElementId(BuiltInCategory.OST_Viewers) == item.Category.Id :
				viewSection = doc.GetElement(ElementId(element.Id.IntegerValue + 1))
				elementZ = viewSection.Origin.Z
			#Elevation Marker
			elif isinstance(item,Autodesk.Revit.DB.ElevationMarker) :
				marker = doc.GetElement(ElementId(item.Id.IntegerValue + 1))
				box=marker.BoundingBox[doc.ActiveView]
				elementZ = ((box.Min+box.Max)/2).Z
			# Grid	
			elif isinstance(item,Autodesk.Revit.DB.Grid):
				elementZ=item.Curve.Evaluate(0.5,True).Z
			# view specific elements (e.g. filled regions)
			elif hasattr(item, "OwnerViewId") and item.OwnerViewId != ElementId.InvalidElementId :
				view=item.Document.GetElement(item.OwnerViewId)
				box = item.BoundingBox[view]
				elementZ = ((box.Min+box.Max)/2).Z
			# sketch-based elements (e.g. floors)
			else :
				box = item.get_BoundingBox(None)
				elementZ = box.Max.Z
		try:search.append(closest(sortedLevels, elementZ))
		except:search.append(None)

OUT = search
# ----------------------------------------
Level = Output(python_script)
