# Dynamo custom node Collector of DWFMarkup.dyf (Dynamo 2.6.1.8786)
# category: GeniusLoci.DWF
# Collects all DWF Markup in the document or in the active sheet view.

SheetOrDocument = Input(SheetOrDocument: bool = false)  # True = Active sheet view False = Current document
python_script = Python(IN[0]=SheetOrDocument)
# ---------- python_script.python (36 lines) ----------
#Alban de Chasteigner 2020
#twitter : @geniusloci_bim
#geniusloci.bim@gmail.com

import clr
# Import RevitAPI Classes
clr.AddReference('RevitAPI')
import Autodesk
from Autodesk.Revit.DB import *

# Import DocumentManager
clr.AddReference("RevitServices")
import RevitServices
from RevitServices.Persistence import DocumentManager

#Import Collections
from System.Collections.Generic import List
import System

doc = DocumentManager.Instance.CurrentDBDocument
activeView = doc.ActiveView

filters = List[ElementFilter]()
pvp = ParameterValueProvider(ElementId(BuiltInParameter.IMPORT_SYMBOL_NAME))
filters.Add(ElementParameterFilter(FilterStringRule(pvp, FilterStringBeginsWith(),"Markup",False)))
filters.Add(ElementParameterFilter(FilterStringRule(pvp, FilterStringBeginsWith(),"Objet d'annotation",False)))
filter = LogicalOrFilter(filters)

boolean =IN[0]

if boolean == True:
	dwfMarkups = FilteredElementCollector(doc, activeView.Id).OfClass( ImportInstance ).WhereElementIsNotElementType().WherePasses(filter).ToElements()
else:
	dwfMarkups = FilteredElementCollector(doc).OfClass( ImportInstance ).WhereElementIsNotElementType().WherePasses(filter).ToElements()
		
OUT=dwfMarkups
# ----------------------------------------
DWFMarkup = Output(python_script)
