# Dynamo custom node Collector of Detail Items Types.dyf (Dynamo 2.6.1.8786)
# category: GeniusLoci.Select
# Retrieves all the Detail Items Family Types in the model.

refresh = Input(refresh: bool = true)
python_script = Python(IN[0]=refresh)
# ---------- python_script.python (22 lines) ----------
import clr
clr.AddReference('RevitServices')
from RevitServices.Persistence import DocumentManager
doc = DocumentManager.Instance.CurrentDBDocument

clr.AddReference('RevitNodes')
import Revit
clr.ImportExtensions(Revit.Elements)

clr.AddReference('RevitAPI')
from Autodesk.Revit.DB import *
import Autodesk

familyTypes = FilteredElementCollector(doc).OfClass(Autodesk.Revit.DB.FamilySymbol).ToElements()

detaiItems=[]

for x in familyTypes :
	if x.Category.Id == ElementId(BuiltInCategory.OST_DetailComponents):
		detaiItems.append(x)

OUT=detaiItems
# ----------------------------------------
Detail_Items_Types = Output(python_script)
