# Dynamo custom node Collector of ViewSheetSets.dyf (Dynamo 2.6.1.8786)
# category: GeniusLoci.Sheet
# Retrieve all available View Sets in the active or given document.
# For use with ViewSheetSet.Views of the Clockwork package.

docOrRevitLinkInstance = Input(docOrRevitLinkInstance: var = null)  # Use only if you want to query a linked model
RunIt = Input(RunIt: bool = true)
python_script = Python(IN[0]=docOrRevitLinkInstance, IN[1]=RunIt)
# ---------- python_script.python (26 lines) ----------
#Inspired by archilab

import clr
# Import DocumentManager and TransactionManager
clr.AddReference("RevitServices")
import RevitServices
from RevitServices.Persistence import DocumentManager

# Import RevitAPI
clr.AddReference("RevitAPI")
import Autodesk
from Autodesk.Revit.DB import *

#Part of script from Clockwork
inputdoc = UnwrapElement(IN[0])
if inputdoc == None:
	doc = DocumentManager.Instance.CurrentDBDocument
elif isinstance (inputdoc, RevitLinkInstance) :
	doc = inputdoc.GetLinkDocument()
elif isinstance (inputdoc, Document) :
	doc = inputdoc
else: doc = None

vs = FilteredElementCollector(doc).OfClass(ViewSheetSet)

OUT = [i.Name for i in vs],[i for i in vs]
# ----------------------------------------
code_block = CodeBlock(Vs=python_script) { Vs[0]; Vs[1]; }
ViewSheetSet_s_names = Output(code_block.out0)  # "ViewSheetSet's names"
ViewSheetSets = Output(code_block.out1)
