# Dynamo custom node ColorFill Scheme UpdateEntry.dyf (Dynamo 2.12.1.8246)
# category: GeniusLoci.ColorScheme
# Works only in Revit 2022.0.1 and later.
# Updates the scheme entry with the given color, fill pattern or visibility.

colorFillScheme = Input(colorFillScheme: var[]..[])  # ColorFillScheme element or ColorFillScheme Name
entry = Input(entry: var[]..[])  # Autodesk.Revit.DB.ColorFillSchemeEntry.
color = Input(color: var[]..[] = null)
fillPatternElement = Input(fillPatternElement: var[]..[] = null)
IsVisible = Input(IsVisible: bool[]..[] = null)
python_script = Python(IN[0]=colorFillScheme, IN[1]=entry, IN[2]=color, IN[3]=fillPatternElement, IN[4]=IsVisible)  # IronPython2
# ---------- python_script.python (55 lines) ----------
#Alban de Chasteigner 2021
#twitter : @geniusloci_bim
#geniusloci.bim@gmail.com
#https://github.com/albandechasteigner/GeniusLociForDynamo
 
import clr
clr.AddReference('RevitAPI')
import Autodesk
from Autodesk.Revit.DB import *
clr.AddReference('RevitServices')
import RevitServices
from RevitServices.Persistence import DocumentManager
from RevitServices.Transactions import TransactionManager
doc = DocumentManager.Instance.CurrentDBDocument

def tolist(obj1):
    if hasattr(obj1,"__iter__"): return obj1
    else: return [obj1]

def ToRevitColor(dynamoColor):
	return Color(dynamoColor.Red, dynamoColor.Green, dynamoColor.Blue)

element = tolist(UnwrapElement(IN[0]))[0]
entries = tolist(UnwrapElement(IN[1]))
colors = tolist(IN[2])
fillPatt = tolist(UnwrapElement(IN[3]))
visibles = tolist(IN[4])
color_len = len(colors) == 1
fillPatt_len = len(fillPatt) == 1
visibles_len = len(visibles) == 1

if isinstance(element, Autodesk.Revit.DB.ColorFillScheme):
	scheme = element
elif isinstance(element, basestring):
	scheme = FilteredElementCollector(doc).OfCategory(BuiltInCategory.OST_ColorFillSchema).ToElements().Find(lambda x : x.Name == element)
	
TransactionManager.Instance.EnsureInTransaction(doc)
for number in xrange(len(entries)):
	if IN[2] != None:	
		c = 0 if color_len else number
		entries[number].Color = ToRevitColor(colors[c])
	else: pass
	if IN[3] != None:
		f = 0 if fillPatt_len else number
		entries[number].FillPatternId = fillPatt[f].Id
	else: pass
	if IN[4] != None:
		v = 0 if visibles_len else number
		entries[number].IsVisible = visibles[v]
	else: pass
	if scheme.CanUpdateEntry(entries[number]):
		scheme.UpdateEntry(entries[number])
TransactionManager.Instance.TransactionTaskDone()

OUT = scheme
# ----------------------------------------
ColorFillScheme = Output(python_script)
