# Dynamo custom node Compound Pattern Reference.dyf (Dynamo 2.6.1.8786)
# category: GeniusLoci.Reference
# Retrieves Surface, Material, Fill Pattern and its references of a roof, floor, ceiling or wall.
# These references can then be used to dimension the FillPattern.
# Also works with linked element.

element = Input(element: var[]..[])  # Roof, floor, ceiling or wall
ReferenceNumber = Input(ReferenceNumber: int = 2)
pattern_ref = Python(IN[0]=element, IN[1]=ReferenceNumber)
# ---------- pattern_ref.python (62 lines) ----------
# C# code by FAIR59
import clr
clr.AddReference('RevitServices')
import RevitServices
from RevitServices.Transactions import TransactionManager

clr.AddReference('RevitAPI')
from Autodesk.Revit.DB import *
from Autodesk.Revit.DB.Structure import *

# Import ToDSType  (bool) extension method
clr.AddReference("RevitNodes")
import Revit
# Adds ToProtoType, ToRevitType geometry conversion extension methods to objects
clr.ImportExtensions(Revit.GeometryConversion)
# Import Element wrapper extension methods
clr.ImportExtensions(Revit.Elements)
from Revit.Elements import *

elements = UnwrapElement(IN[0])
if not hasattr(elements, '__iter__'):
	elements = [elements]
	
n = IN[1]
topFaces,mats,patterntypes,resArrVer,resArrHor=[],[],[],[],[]

for element in elements:
	doc=element.Document
	if element.ToString() == 'Autodesk.Revit.DB.Ceiling':
		top = HostObjectUtils.GetBottomFaces(element)
	elif element.ToString() == 'Autodesk.Revit.DB.Wall':
		top = HostObjectUtils.GetSideFaces(element,ShellLayerType.Exterior)
	else :
		top = HostObjectUtils.GetTopFaces(element)
	for t in top:
		topFace = element.GetGeometryObjectFromReference(t)
		topFaces.append(topFace.ToProtoType()[0])
		#Check for model surfacepattern
		mat=doc.GetElement(topFace.MaterialElementId)
		mats.append(mat)
		patterntype = doc.GetElement(mat.SurfaceForegroundPatternId)
		patterntypes.append(patterntype)
		pattern = patterntype.GetFillPattern()

		#Get number of gridLines in pattern                
		gridCount = pattern.GridCount

		#Construct StableRepresentations and find the Reference to HatchLines
		StableRef = t.ConvertToStableRepresentation(doc)
	
		for ip in range(0, n):
			indexVer = 1 + ( ip * gridCount * 2 )
			indexHor = 2 + ( ip * gridCount * 2 )
			verStableHatchString = StableRef + str.Format( "/{0}", indexVer)
			horStableHatchString = StableRef + str.Format( "/{0}", indexHor)
			HatchRefVer = Reference.ParseFromStableRepresentation(doc, verStableHatchString)
			HatchRefHor = Reference.ParseFromStableRepresentation(doc, horStableHatchString)
			resArrVer.append(HatchRefVer)
			resArrHor.append(HatchRefHor)
			
if isinstance(IN[0], (list)): OUT = topFaces,mats,patterntypes,resArrVer,resArrHor
else: OUT = topFaces[0],mats[0],patterntypes[0],resArrVer,resArrHor
# ----------------------------------------
code_block = CodeBlock(x=pattern_ref) { x[0]; x[1]; x[2]; x[3]; x[4]; }
Surface = Output(code_block.out0)
Material = Output(code_block.out1)
FillPatternElement = Output(code_block.out2)
Vertical_References = Output(code_block.out3)
Horizontal_References = Output(code_block.out4)
