# Dynamo custom node Compound Surfaces References.dyf (Dynamo 2.12.1.8246)
# category: GeniusLoci.Reference
# Retrieves Top, Bottom and Side Faces, Materials, and references of a roof, floor, ceiling or wall if applicable.
# Also works with linked element.

element = Input(element: var[]..[])  # Roof, floor, ceiling or wall
surfaces = Python(IN[0]=element)  # IronPython2
# ---------- surfaces.python (72 lines) ----------
#Alban de Chasteigner 2019
#twitter : @geniusloci_bim
#geniusloci.bim@gmail.com
import clr
clr.AddReference('RevitAPI')
from Autodesk.Revit.DB import *
from Autodesk.Revit.DB.Structure import *

# Import ToDSType  (bool) extension method
clr.AddReference("RevitNodes")
import Revit
clr.ImportExtensions(Revit.GeometryConversion)
clr.ImportExtensions(Revit.Elements)
from Revit.Elements import *

elements = UnwrapElement(IN[0]) if isinstance(IN[0],list) else [UnwrapElement(IN[0])]
	
topFaces,topMats,topRef,bottomFaces,bottomMats,bottomRef,extFaces,extMats,extRef,intFaces,intMats,intRef=[],[],[],[],[],[],[],[],[],[],[],[]

for element in elements:
	doc=element.Document
	try:
		top = HostObjectUtils.GetTopFaces(element)
		for t in top:
			topFace = element.GetGeometryObjectFromReference(t)
			topFaces.append(topFace.ToProtoType())
			topmat=doc.GetElement(topFace.MaterialElementId)
			topMats.append(topmat)
			topRef.append(t)
	except:
		topFaces.append(None)
		topMats.append(None)
		topRef.append(None)
	try:
		bottom = HostObjectUtils.GetBottomFaces(element)
		for b in bottom:
			bottomFace = element.GetGeometryObjectFromReference(b)
			bottomFaces.append(bottomFace.ToProtoType())
			bottommat=doc.GetElement(bottomFace.MaterialElementId)
			bottomMats.append(bottommat)
			bottomRef.append(b)
	except:
		bottomFaces.append(None)
		bottomMats.append(None)
		bottomRef.append(None)
	try:
		extSide = HostObjectUtils.GetSideFaces(element,ShellLayerType.Exterior)
		for e in extSide:
			extFace = element.GetGeometryObjectFromReference(e)
			extFaces.append(extFace.ToProtoType())
			extmat=doc.GetElement(extFace.MaterialElementId)
			extMats.append(extmat)
			extRef.append(e)
	except:
		extFaces.append(None)
		extMats.append(None)
		extRef.append(None)
	try:
		intSide = HostObjectUtils.GetSideFaces(element,ShellLayerType.Interior)
		for i in intSide:
			intFace = element.GetGeometryObjectFromReference(i)
			intFaces.append(intFace.ToProtoType())
			intmat=doc.GetElement(intFace.MaterialElementId)
			intMats.append(intmat)
			intRef.append(i)
	except:
		intFaces.append(None)
		intMats.append(None)
		intRef.append(None)
		
if isinstance(IN[0], (list)): OUT = topFaces,topMats,topRef,bottomFaces,bottomMats,bottomRef,extFaces,extMats,extRef,intFaces,intMats,intRef
else: OUT = topFaces[0],topMats[0],topRef[0],bottomFaces[0],bottomMats[0],bottomRef[0],extFaces[0],extMats[0],extRef[0],intFaces[0],intMats[0],intRef[0]
# ----------------------------------------
code_block = CodeBlock(x=surfaces) { x[0]; x[1]; x[2]; x[3]; x[4]; x[5]; x[6]; x[7]; x[8]; x[9]; x[10]; x[11]; }
Top_Surface = Output(code_block.out0)
Top_Material = Output(code_block.out1)
Top_Reference = Output(code_block.out2)
Bottom_Surface = Output(code_block.out3)
Bottom_Material = Output(code_block.out4)
Bottom_Reference = Output(code_block.out5)
Exterior_Side_Surface = Output(code_block.out6)
Exterior_Side_Material = Output(code_block.out7)
Exterior_Side_Reference = Output(code_block.out8)
Interior_Side_Surface = Output(code_block.out9)
Interior_Side_Material = Output(code_block.out10)
Interior_Side_Reference = Output(code_block.out11)
