# Dynamo custom node Connect MEPCurves.dyf (Dynamo 2.6.1.8786)
# category: GeniusLoci.MEP
# Connects unordered MEP system elements (pipe, duct, cable tray, conduit) to the nearest fittings.
# By MEPover on the Dynamo Forum

elements = Input(elements: var[]..[])  # Fittings and ducts or pipes, cable trays, conduits
margin = Input(margin: int = 0.01)
python_script = Python(IN[0]=elements, IN[1]=margin)
# ---------- python_script.python (58 lines) ----------
#By MEPover on the Dynamo Forum
#https://forum.dynamobim.com/t/invalid-duct-pipe-connections/16145/10

import clr
clr.AddReference("RevitServices")
import RevitServices
from RevitServices.Persistence import DocumentManager
from RevitServices.Transactions import TransactionManager
doc = DocumentManager.Instance.CurrentDBDocument

clr.AddReference("RevitAPI")
from Autodesk.Revit.DB import *

pipes = UnwrapElement(IN[0])
margin = IN[1]

connectors = {}
connlist = []

for pipe in pipes:
	try:
		conns = pipe.ConnectorManager.Connectors
	except:
		conns = pipe.MEPModel.ConnectorManager.Connectors
	for conn in conns:
		if conn.IsConnected:
			continue
		connectors[conn] = None
		connlist.append(conn)

for k in connectors.keys():
	mindist = 1000000
	closest = None
	for conn in connlist:
		if conn.Owner.Id.Equals(k.Owner.Id):
			continue
		dist = k.Origin.DistanceTo(conn.Origin)
		if dist < mindist:
			mindist = dist
			closest = conn
	if mindist > margin:
		continue
	connectors[k] = closest
	connlist.remove(closest)
	try:
		del connectors[closest]
	except:
		pass

for k,v in connectors.items():
	TransactionManager.Instance.EnsureInTransaction(doc)		
	try:
		k.ConnectTo(v)
	except:
		pass
	TransactionManager.Instance.TransactionTaskDone()

OUT = "Done"
# ----------------------------------------
Result = Output(python_script)
