# Dynamo custom node Convert Linked Reference.dyf (Dynamo 2.6.1.8786)
# category: GeniusLoci.Reference
# Creates a usable reference from a reference from a linked document.

reference = Input(reference: var[])  # Autodesk.DB.Reference
RevitLinkInstance = Input(RevitLinkInstance: var[]..[])
python_script = Python(IN[0]=reference, IN[1]=RevitLinkInstance)
# ---------- python_script.python (43 lines) ----------
#Based on a C# script by Fair59
#https://forums.autodesk.com/t5/revit-api-forum/create-dimensions-for-familyinstance-in-linked-file/td-p/8424237
import clr
clr.AddReference("RevitAPI")
from Autodesk.Revit.DB import *
clr.AddReference("RevitServices")
import RevitServices
from RevitServices.Persistence import DocumentManager
doc = DocumentManager.Instance.CurrentDBDocument

linkReferences = IN[0] if isinstance(IN[0],list) else [IN[0]]
linkedInstance = UnwrapElement(IN[1])

def parseLinkedReference(doc, linkedRef):
	reps = linkedRef.ConvertToStableRepresentation(doc).split(':')      
	res = ''
	first=True        
	for i, s in enumerate(reps):
		t = s
		if "RVTLINK" in s:
			if(i<len(reps)-1):
				if reps[i+1]=="0":
					t = "RVTLINK"
				else:
					t = "0:RVTLINK"
			else:
				t = "0:RVTLINK"
		if not first:
			res = res + ":" + t
		else:
			res = t
			first = False          
	ref = Reference.ParseFromStableRepresentation(doc,res)
	return ref

refArray = ReferenceArray()
for refLink in linkReferences:
	linkedReference = refLink.CreateLinkReference(linkedInstance)
	ref = parseLinkedReference(doc,linkedReference)
	refArray.Append(ref)

if isinstance(IN[0], list): OUT = refArray
else: OUT = refArray[0]
# ----------------------------------------
Reference = Output(python_script)
