# Dynamo custom node Convert from ProjectBasePoint CoordinateSystem.dyf (Dynamo 2.6.1.8786)
# category: GeniusLoci.Geometry
# Convert from Project Base Point Coordinate to Internal Origin Coordinate.

point = Input(point: Autodesk.DesignScript.Geometry.Point[]..[])  # Point in Project BasePoint Coordinate System
python_script = Python(IN[0]=point)
# ---------- python_script.python (24 lines) ----------
import clr
clr.AddReference('RevitAPI')
import Autodesk
from Autodesk.Revit.DB import FilteredElementCollector, BuiltInCategory

clr.AddReference('RevitServices')
import RevitServices
from RevitServices.Persistence import DocumentManager
doc = DocumentManager.Instance.CurrentDBDocument

clr.AddReference('RevitNodes')
import Revit
clr.ImportExtensions(Revit.GeometryConversion)

pts = [pt.ToXyz(True) for pt in IN[0]] if isinstance(IN[0],list) else [IN[0].ToXyz(True)]

# Collect Project Basepoint...
basePt = FilteredElementCollector(doc).OfCategory(BuiltInCategory.OST_ProjectBasePoint).FirstElement()
pbp = basePt.get_BoundingBox(None).Min

translatedPoint = [pt.Add(pbp).ToPoint() for pt in pts]

if isinstance(IN[0], list): OUT = translatedPoint
else: OUT = translatedPoint[0]
# ----------------------------------------
Point = Output(python_script)  # Point in Internal Origin Coordinate System
