# Dynamo custom node Copy DWFMarkup Curve to View.dyf (Dynamo 2.6.1.8786)
# category: GeniusLoci.DWF
# Copies the line, polyline and ellipse from the Markup objects for the given or active sheet.
# Please note that markups are found by name (label) and therefore depend on the Revit localization (language).

sheet = Input(sheet: var[]..[] = Revit.Application.Document.Current.ActiveView)
python_script = Python(IN[0]=sheet)
# ---------- python_script.python (168 lines) ----------
#Alban de Chasteigner 2020
#twitter : @geniusloci_bim
#geniusloci.bim@gmail.com

import clr
# Import RevitAPI Classes
clr.AddReference('RevitAPI')
import Autodesk
from Autodesk.Revit.DB import *

# Import DocumentManager
clr.AddReference("RevitServices")
import RevitServices
from RevitServices.Persistence import DocumentManager
from RevitServices.Transactions import TransactionManager

clr.AddReference("RevitNodes")
import Revit
clr.ImportExtensions(Revit.GeometryConversion)
#Import Collections
from System.Collections.Generic import List
import System

import math

doc = DocumentManager.Instance.CurrentDBDocument
activeView = UnwrapElement(IN[0])

filters = List[ElementFilter]()
pvp = ParameterValueProvider(ElementId(BuiltInParameter.IMPORT_SYMBOL_NAME))

filters.Add(ElementParameterFilter(FilterStringRule(pvp, FilterStringContains(),"Rectangle",False)))
filters.Add(ElementParameterFilter(FilterStringRule(pvp, FilterStringContains(),"Markup Object Li",False)))
filters.Add(ElementParameterFilter(FilterStringRule(pvp, FilterStringContains(),"Markup Object Polyli",False)))
filters.Add(ElementParameterFilter(FilterStringRule(pvp, FilterStringContains(),"Ellipse",False)))
filters.Add(ElementParameterFilter(FilterStringRule(pvp, FilterStringContains(),"Ligne",False)))
filters.Add(ElementParameterFilter(FilterStringRule(pvp, FilterStringContains(),"Polyligne",False)))
orFilter = LogicalOrFilter(filters)

dwfMarkups = FilteredElementCollector(doc, activeView.Id).OfClass(ImportInstance).WhereElementIsNotElementType().WherePasses(orFilter).ToElements()

def pairwise(iterable, step=2):
#	Iterate through items in pairs.
	if step == 1:
		from itertools import tee, izip
		a, b = tee(iterable)
		next(b, None)
		return izip(a, b)
	elif step == 2:
		a = iter(iterable)
		return zip(a, a)

def convert(coor):
	if view.ViewType == ViewType.FloorPlan or view.ViewType == ViewType.CeilingPlan or view.ViewType == ViewType.EngineeringPlan:
		conv=[VC + XYZ((coor-BC).X * scale, (coor-BC).Y * scale, 0) for coor in coordinates]
	elif view.ViewType == ViewType.Section or view.ViewType == ViewType.Elevation :
		if view.ViewDirection.IsAlmostEqualTo(-XYZ.BasisY):
			conv=[VC + XYZ((coor-BC).X * scale, 0, (coor-BC).Y * scale) for coor in coordinates]
		elif view.ViewDirection.IsAlmostEqualTo(XYZ.BasisY):
			conv=[VC + XYZ((BC-coor).X * scale, 0, (coor-BC).Y * scale) for coor in coordinates]
		elif view.ViewDirection.IsAlmostEqualTo(-XYZ.BasisX):
			conv=[VC + XYZ(0,(BC-coor).X * scale,(coor-BC).Y * scale) for coor in coordinates]
		elif view.ViewDirection.IsAlmostEqualTo(XYZ.BasisX):
			conv=[VC + XYZ(0,(coor-BC).X * scale,(coor-BC).Y * scale) for coor in coordinates]
	return conv

def ellips(symbIns):
	if view.ViewType == ViewType.FloorPlan or view.ViewType == ViewType.CeilingPlan or view.ViewType == ViewType.EngineeringPlan:
		ellipse=Ellipse.CreateCurve(VC+(symbIns.Center-BC)* scale,symbIns.RadiusX* scale,symbIns.RadiusY* scale,symbIns.XDirection,symbIns.YDirection,0,2*math.pi)
	elif view.ViewType == ViewType.Section or view.ViewType == ViewType.Elevation :
		if view.ViewDirection.IsAlmostEqualTo(-XYZ.BasisY):
			ellipse=Ellipse.CreateCurve(VC + XYZ((symbIns.Center-BC).X * scale, 0, (symbIns.Center-BC).Y * scale),symbIns.RadiusX* scale,symbIns.RadiusY* scale,symbIns.XDirection, XYZ.BasisZ,0,2*math.pi)
		elif view.ViewDirection.IsAlmostEqualTo(XYZ.BasisY):
			ellipse=Ellipse.CreateCurve(VC + XYZ((-symbIns.Center+BC).X * scale, 0, (symbIns.Center-BC).Y * scale),symbIns.RadiusX* scale,symbIns.RadiusY* scale,symbIns.XDirection,XYZ.BasisZ,0,2*math.pi)
		elif view.ViewDirection.IsAlmostEqualTo(-XYZ.BasisX):
			ellipse=Ellipse.CreateCurve(VC + XYZ(0,(BC-symbIns.Center).X * scale, (symbIns.Center-BC).Y * scale),symbIns.RadiusX* scale,symbIns.RadiusY* scale, symbIns.YDirection, XYZ.BasisZ, 0,2*math.pi)
		elif view.ViewDirection.IsAlmostEqualTo(XYZ.BasisX):
			ellipse=Ellipse.CreateCurve(VC + XYZ(0,(symbIns.Center-BC).X * scale,(symbIns.Center-BC).Y * scale),symbIns.RadiusX* scale,symbIns.RadiusY* scale,symbIns.YDirection,XYZ.BasisZ,0,2*math.pi)
	return ellipse

def arc(symbIns):
	if view.ViewType == ViewType.FloorPlan or view.ViewType == ViewType.CeilingPlan or view.ViewType == ViewType.EngineeringPlan:
		circle=Ellipse.CreateCurve(VC+(symbIns.Center-BC)* scale,symbIns.Radius * scale,symbIns.Radius* scale, symbIns.XDirection, symbIns.YDirection,0,2*math.pi)
	elif view.ViewType == ViewType.Section or view.ViewType == ViewType.Elevation :
		if view.ViewDirection.IsAlmostEqualTo(-XYZ.BasisY):
			circle=Ellipse.CreateCurve(VC + XYZ((symbIns.Center-BC).X * scale, 0, (symbIns.Center-BC).Y * scale),symbIns.Radius* scale,symbIns.Radius* scale,symbIns.XDirection, XYZ.BasisZ,0,2*math.pi)
		elif view.ViewDirection.IsAlmostEqualTo(XYZ.BasisY):
			circle=Ellipse.CreateCurve(VC + XYZ((-symbIns.Center+BC).X * scale, 0, (symbIns.Center-BC).Y * scale),symbIns.Radius* scale,symbIns.Radius* scale,symbIns.XDirection,XYZ.BasisZ,0,2*math.pi)
		elif view.ViewDirection.IsAlmostEqualTo(-XYZ.BasisX):
			circle=Ellipse.CreateCurve(VC + XYZ(0,(BC-symbIns.Center).X * scale, (symbIns.Center-BC).Y * scale),symbIns.Radius* scale,symbIns.Radius* scale, symbIns.YDirection, XYZ.BasisZ, 0,2*math.pi)
		elif view.ViewDirection.IsAlmostEqualTo(XYZ.BasisX):
			circle=Ellipse.CreateCurve(VC + XYZ(0,(symbIns.Center-BC).X * scale,(symbIns.Center-BC).Y * scale),symbIns.Radius* scale,symbIns.Radius* scale,symbIns.YDirection,XYZ.BasisZ,0,2*math.pi)
	return circle

TransactionManager.Instance.EnsureInTransaction(doc)
viewports=[doc.GetElement(vip) for vip in activeView.GetAllViewports()]	
for vp in viewports:
	view=doc.GetElement(vp.ViewId)
	if view.ViewType == ViewType.FloorPlan or view.ViewType == ViewType.CeilingPlan or view.ViewType == ViewType.EngineeringPlan or view.ViewType == ViewType.Section or view.ViewType == ViewType.Elevation :
		scale=vp.get_Parameter(BuiltInParameter.VIEW_SCALE).AsInteger()
		trans1 = SubTransaction(doc)
		trans1.Start()
		try:
			view.get_Parameter(BuiltInParameter.VIEWER_CROP_REGION).Set(1)
			view.SetCategoryHidden(ElementId(BuiltInCategory.OST_Sections),True)
			view.SetCategoryHidden(ElementId(BuiltInCategory.OST_CLines),True)
			view.SetCategoryHidden(ElementId(BuiltInCategory.OST_Grids),True)
			view.SetCategoryHidden(ElementId(BuiltInCategory.OST_Levels),True)
			view.SetCategoryHidden(ElementId(BuiltInCategory.OST_Callouts),True)
		except: pass
		BC = vp.GetBoxCenter()
		if view.ViewType == ViewType.Section or view.ViewType == ViewType.Elevation :
			viewCenter = (view.CropBox.Min + view.CropBox.Max)/2
			origin = view.CropBox.Transform.Origin
			if view.ViewDirection.IsAlmostEqualTo(-XYZ.BasisY):
				VC = origin + XYZ(viewCenter.X,0,viewCenter.Y)
			elif view.ViewDirection.IsAlmostEqualTo(XYZ.BasisY):
				VC = origin + XYZ(-viewCenter.X,0,viewCenter.Y)
			elif view.ViewDirection.IsAlmostEqualTo(-XYZ.BasisX):
				VC = origin + XYZ(0,-viewCenter.X, viewCenter.Y)
			elif view.ViewDirection.IsAlmostEqualTo(XYZ.BasisX):
				VC = origin + XYZ(0,viewCenter.X,viewCenter.Y)
		else:
			VC = (view.CropBox.Min + view.CropBox.Max)/2
		trans1.RollBack()

lineList,elementlist=[],[]
for dwf in dwfMarkups :
	geoEle=dwf.get_Geometry(Options())
	if geoEle != None:
		for geoInstance in geoEle:
			if isinstance(geoInstance, GeometryInstance):
				for symbIns in geoInstance.GetInstanceGeometry():
					if isinstance(symbIns, Ellipse):
						lines,curvelist=[],[]
						ellipse=ellips(symbIns)
						try:
							curvelist.append(doc.Create.NewDetailCurve(view, ellipse))
						except:
							curvelist.append(None)
						lines.append(ellipse.ToProtoType())
					elif isinstance(symbIns, Arc):
						lines,curvelist=[],[]
						circle=arc(symbIns)
						try:
							curvelist.append(doc.Create.NewDetailCurve(view, circle))
						except:
							curvelist.append(None)
						lines.append(circle.ToProtoType())
					elif isinstance(symbIns, PolyLine) :
						lines,curvelist=[],[]
						coordinates=symbIns.GetCoordinates()
						#Convert DWF sheet coordinates into model coordinates
						conv=convert(coordinates)
						for xyz1, xyz2 in pairwise(conv, step=1):
							#Exception: Curve length is too small for Revit's tolerance (as identified by Application.ShortCurveTolerance).
							try: line=Line.CreateBound(xyz1, xyz2)
							except : pass
							try:
								curvelist.append(doc.Create.NewDetailCurve(view, line))
							except:
								curvelist.append(None)
							lines.append(line.ToProtoType())
		elementlist.append(curvelist)
		lineList.append(lines)
		TransactionManager.Instance.TransactionTaskDone()

OUT = dwfMarkups,elementlist,lineList
# ----------------------------------------
code_block = CodeBlock(x=python_script) { x[0]; x[1]; x[2]; }
DWFMarkup = Output(code_block.out0)
DetailCurve = Output(code_block.out1)  # Revit Detail Line
Curve = Output(code_block.out2)  # Dynamo Geometry curve
