# Dynamo custom node Copy DWFMarkup Symbol to View.dyf (Dynamo 2.6.1.8786)
# category: GeniusLoci.DWF
# Place a family instance from the location of the Markup symbol for the given or active sheet.
# Please note : A family type with a name similar to that of the markup symbol (label) should be loaded into the document.

sheet = Input(sheet: var[]..[] = Revit.Application.Document.Current.ActiveView)
python_script = Python(IN[0]=sheet)
# ---------- python_script.python (113 lines) ----------
#Alban de Chasteigner 2020
#twitter : @geniusloci_bim
#geniusloci.bim@gmail.com

import clr
# Import RevitAPI Classes
clr.AddReference('RevitAPI')
import Autodesk
from Autodesk.Revit.DB import *
from Autodesk.Revit.DB.Structure import StructuralType

# Import DocumentManager
clr.AddReference("RevitServices")
import RevitServices
from RevitServices.Persistence import DocumentManager
from RevitServices.Transactions import TransactionManager

clr.AddReference("RevitNodes")
import Revit
clr.ImportExtensions(Revit.Elements)
clr.ImportExtensions(Revit.GeometryConversion)
#Import Collections
from System.Collections.Generic import List
import System

doc = DocumentManager.Instance.CurrentDBDocument
activeView = UnwrapElement(IN[0])

filters = List[ElementFilter]()
pvp = ParameterValueProvider(ElementId(BuiltInParameter.IMPORT_SYMBOL_NAME))
filters.Add(ElementParameterFilter(FilterStringRule(pvp, FilterStringContains(),"Markup Object Rec",False),True))
filters.Add(ElementParameterFilter(FilterStringRule(pvp, FilterStringContains(),"Markup Object Li",False),True))
filters.Add(ElementParameterFilter(FilterStringRule(pvp, FilterStringContains(),"Markup Object Polyli",False),True))
filters.Add(ElementParameterFilter(FilterStringRule(pvp, FilterStringContains(),"Markup Object Ell",False),True))
filters.Add(ElementParameterFilter(FilterStringRule(pvp, FilterStringContains(),"nuage",False),True))
filters.Add(ElementParameterFilter(FilterStringRule(pvp, FilterStringContains(),"cloud",False),True))
filters.Add(ElementParameterFilter(FilterStringRule(pvp, FilterStringContains(),"a main",False),True))
filters.Add(ElementParameterFilter(FilterStringRule(pvp, FilterStringContains(),"hand",False),True))
filters.Add(ElementParameterFilter(FilterStringRule(pvp, FilterStringContains(),"Cote",False),True))
filters.Add(ElementParameterFilter(FilterStringRule(pvp, FilterStringContains(),"Dimension",False),True))
orFilter = LogicalAndFilter(filters)

def convert(box):
	if view.ViewType == ViewType.FloorPlan or view.ViewType == ViewType.CeilingPlan or view.ViewType == ViewType.EngineeringPlan:
		centr = (box.Min+box.Max)/2
		coor = VC + XYZ((centr-BC).X * scale, (centr-BC).Y * scale, 0 )
	elif view.ViewType == ViewType.Section or view.ViewType == ViewType.Elevation :
		centr = XYZ(box.Min.X,box.Min.Y,0)
		if view.ViewDirection.IsAlmostEqualTo(-XYZ.BasisY):
			coor = VC + XYZ((centr-BC).X * scale, 0, (centr-BC).Y * scale)
		elif view.ViewDirection.IsAlmostEqualTo(XYZ.BasisY):
			coor = VC + XYZ((-centr+BC).X * scale, 0, (centr-BC).Y * scale)
		elif view.ViewDirection.IsAlmostEqualTo(-XYZ.BasisX):
			coor = VC + XYZ(0,(BC-centr).X * scale, (centr-BC).Y * scale)
		elif view.ViewDirection.IsAlmostEqualTo(XYZ.BasisX):
			coor = VC + XYZ(0,(centr-BC).X * scale, (centr-BC).Y * scale)
	return coor
	
TransactionManager.Instance.EnsureInTransaction(doc)
viewports=[doc.GetElement(vip) for vip in activeView.GetAllViewports()]	
for vp in viewports:
	view=doc.GetElement(vp.ViewId)
	if view.ViewType == ViewType.FloorPlan or view.ViewType == ViewType.CeilingPlan or view.ViewType == ViewType.EngineeringPlan or view.ViewType == ViewType.Section or view.ViewType == ViewType.Elevation :
		scale=vp.get_Parameter(BuiltInParameter.VIEW_SCALE).AsInteger()
		trans1 = SubTransaction(doc)
		trans1.Start()
		try:
			view.get_Parameter(BuiltInParameter.VIEWER_CROP_REGION).Set(1)
			view.SetCategoryHidden(ElementId(BuiltInCategory.OST_Sections),True)
			view.SetCategoryHidden(ElementId(BuiltInCategory.OST_CLines),True)
			view.SetCategoryHidden(ElementId(BuiltInCategory.OST_Grids),True)
			view.SetCategoryHidden(ElementId(BuiltInCategory.OST_Levels),True)
			view.SetCategoryHidden(ElementId(BuiltInCategory.OST_Callouts),True)
		except: pass
		BC = vp.GetBoxCenter()
		if view.ViewType == ViewType.Section or view.ViewType == ViewType.Elevation :
			viewCenter= (view.CropBox.Min + view.CropBox.Max)/2
			origin = view.CropBox.Transform.Origin
			if view.ViewDirection.IsAlmostEqualTo(-XYZ.BasisY):
				VC = origin + XYZ(viewCenter.X,0,viewCenter.Y)
			elif view.ViewDirection.IsAlmostEqualTo(XYZ.BasisY):
				VC = origin + XYZ(-viewCenter.X,0,viewCenter.Y)
			elif view.ViewDirection.IsAlmostEqualTo(-XYZ.BasisX):
				VC = origin + XYZ(0,-viewCenter.X, viewCenter.Y)
			elif view.ViewDirection.IsAlmostEqualTo(XYZ.BasisX):
				VC = origin + XYZ(0,viewCenter.X,viewCenter.Y)
		else:
			VC = (view.CropBox.Min + view.CropBox.Max)/2
		trans1.RollBack()

dwfMarkups = FilteredElementCollector(doc, activeView.Id).OfClass(ImportInstance).WhereElementIsNotElementType().WherePasses(orFilter).ToElements()

types = FilteredElementCollector(doc).OfClass(FamilySymbol).ToElements()
instances,dwfs = [],[]
sT = StructuralType.NonStructural
for dwf in dwfMarkups:
	for famType in types:
		if famType.ToDSType(False).Name in dwf.Name or famType.FamilyName in dwf.Name:
			box=dwf.BoundingBox[activeView]
			dwfs.append(dwf)
			placement=famType.Family.FamilyPlacementType 
			if not famType.IsActive : famType.Activate()
			if placement == FamilyPlacementType.ViewBased :
				instances.append(doc.Create.NewFamilyInstance(convert(box), famType, view).ToDSType(False))
			elif placement == FamilyPlacementType.OneLevelBased :
				instance = doc.Create.NewFamilyInstance(convert(box),famType,view.GenLevel,sT)
				instances.append(instance.ToDSType(False))
				if view.ViewType == ViewType.FloorPlan or view.ViewType == ViewType.CeilingPlan or view.ViewType == ViewType.EngineeringPlan :
					instance.get_Parameter(BuiltInParameter.INSTANCE_FREE_HOST_OFFSET_PARAM).Set(0)
			else : instances = None
TransactionManager.Instance.TransactionTaskDone()

OUT = dwfs, instances
# ----------------------------------------
code_block = CodeBlock(x=python_script) { x[0]; x[1]; }
DWFMarkup = Output(code_block.out0)
FamilyInstance = Output(code_block.out1)
