# Dynamo custom node Copy DWFMarkup TextNote to View.dyf (Dynamo 2.6.1.8786)
# category: GeniusLoci.DWF
# Copies the text note from the Markup objects for the given or active sheet.
# Please note that markups are found by name (label) and therefore depend on the Revit localization (language).

sheet = Input(sheet: var[]..[] = Revit.Application.Document.Current.ActiveView)
python_script = Python(IN[0]=sheet)
# ---------- python_script.python (121 lines) ----------
#Alban de Chasteigner 2020
#twitter : @geniusloci_bim
#geniusloci.bim@gmail.com

import clr
# Import RevitAPI Classes
clr.AddReference('RevitAPI')
import Autodesk
from Autodesk.Revit.DB import *

# Import DocumentManager
clr.AddReference("RevitServices")
import RevitServices
from RevitServices.Persistence import DocumentManager
from RevitServices.Transactions import TransactionManager

clr.AddReference("RevitNodes")
import Revit
clr.ImportExtensions(Revit.GeometryConversion)
#Import Collections
from System.Collections.Generic import List
import System

doc = DocumentManager.Instance.CurrentDBDocument
activeView = UnwrapElement(IN[0])

filters = List[ElementFilter]()
pvp = ParameterValueProvider(ElementId(BuiltInParameter.IMPORT_SYMBOL_NAME))
filters.Add(ElementParameterFilter(FilterStringRule(pvp, FilterStringContains(),"Rectangle",False),True))
filters.Add(ElementParameterFilter(FilterStringRule(pvp, FilterStringContains(),"Markup Object Li",False),True))
filters.Add(ElementParameterFilter(FilterStringRule(pvp, FilterStringContains(),"Markup Object Polyli",False),True))
filters.Add(ElementParameterFilter(FilterStringRule(pvp, FilterStringContains(),"Ligne",False),True))
filters.Add(ElementParameterFilter(FilterStringRule(pvp, FilterStringContains(),"Polyligne",False),True))
filters.Add(ElementParameterFilter(FilterStringRule(pvp, FilterStringContains(),"Ellipse",False),True))
filters.Add(ElementParameterFilter(FilterStringRule(pvp, FilterStringContains(),"nuage",False),True))
filters.Add(ElementParameterFilter(FilterStringRule(pvp, FilterStringContains(),"cloud",False),True))
filters.Add(ElementParameterFilter(FilterStringRule(pvp, FilterStringContains(),"a main",False),True))
filters.Add(ElementParameterFilter(FilterStringRule(pvp, FilterStringContains(),"hand",False),True))
filters.Add(ElementParameterFilter(FilterStringRule(pvp, FilterStringContains(),"Cote",False),True))
filters.Add(ElementParameterFilter(FilterStringRule(pvp, FilterStringContains(),"Dimension",False),True))
orFilter = LogicalAndFilter(filters)

ueWrapper = None
wrappers = clr.GetClrType(Revit.Elements.ElementWrapper).GetMethods()
for w in wrappers:
	if w.ToString().startswith("Revit.Elements.UnknownElement"):
		ueWrapper = w
		break

def convert(centr):
	if view.ViewType == ViewType.FloorPlan or view.ViewType == ViewType.CeilingPlan or view.ViewType == ViewType.EngineeringPlan:
		coor= VC + XYZ((centr-BC).X * scale, (centr-BC).Y * scale, 0 )
	elif view.ViewType == ViewType.Section or view.ViewType == ViewType.Elevation :
		if view.ViewDirection.IsAlmostEqualTo(-XYZ.BasisY):
			coor = VC + XYZ((centr-BC).X * scale, 0, (centr-BC).Y * scale)
		elif view.ViewDirection.IsAlmostEqualTo(XYZ.BasisY):
			coor = VC + XYZ((-centr+BC).X * scale, 0, (centr-BC).Y * scale)
		elif view.ViewDirection.IsAlmostEqualTo(-XYZ.BasisX):
			coor = VC + XYZ(0,(BC-centr).X * scale, (centr-BC).Y * scale)
		elif view.ViewDirection.IsAlmostEqualTo(XYZ.BasisX):
			coor = VC + XYZ(0,(centr-BC).X * scale, (centr-BC).Y * scale)
	return coor

TransactionManager.Instance.EnsureInTransaction(doc)
viewports=[doc.GetElement(vip) for vip in activeView.GetAllViewports()]	
for vp in viewports:
	view=doc.GetElement(vp.ViewId)
	if view.ViewType == ViewType.FloorPlan or view.ViewType == ViewType.CeilingPlan or view.ViewType == ViewType.EngineeringPlan or view.ViewType == ViewType.Section or view.ViewType == ViewType.Elevation :
		scale=vp.get_Parameter(BuiltInParameter.VIEW_SCALE).AsInteger()
		trans1 = SubTransaction(doc)
		trans1.Start()
		try:
			view.get_Parameter(BuiltInParameter.VIEWER_CROP_REGION).Set(1)
			view.SetCategoryHidden(ElementId(BuiltInCategory.OST_Sections),True)
			view.SetCategoryHidden(ElementId(BuiltInCategory.OST_CLines),True)
			view.SetCategoryHidden(ElementId(BuiltInCategory.OST_Grids),True)
			view.SetCategoryHidden(ElementId(BuiltInCategory.OST_Levels),True)
			view.SetCategoryHidden(ElementId(BuiltInCategory.OST_Callouts),True)
		except: 
			pass
		BC = vp.GetBoxCenter()
		if view.ViewType == ViewType.Section or view.ViewType == ViewType.Elevation:
			viewCenter = (view.CropBox.Min + view.CropBox.Max)/2
			origin = view.CropBox.Transform.Origin
			if view.ViewDirection.IsAlmostEqualTo(-XYZ.BasisY):
				VC = origin + XYZ(viewCenter.X,0,viewCenter.Y)
			elif view.ViewDirection.IsAlmostEqualTo(XYZ.BasisY):
				VC = origin + XYZ(-viewCenter.X,0,viewCenter.Y)
			elif view.ViewDirection.IsAlmostEqualTo(-XYZ.BasisX):
				VC = origin + XYZ(0,-viewCenter.X, viewCenter.Y)
			elif view.ViewDirection.IsAlmostEqualTo(XYZ.BasisX):
				VC = origin + XYZ(0,viewCenter.X,viewCenter.Y)
		else:
			VC = (view.CropBox.Min + view.CropBox.Max)/2
		trans1.RollBack()

dwfMarkups = FilteredElementCollector(doc, activeView.Id).OfClass(ImportInstance).WhereElementIsNotElementType().WherePasses(orFilter).ToElements()

textTypeId = FilteredElementCollector(doc).OfClass(TextNoteType).FirstElementId()

types = FilteredElementCollector(doc).OfClass(FamilySymbol).ToElements()

dwfs,texts,labels=[],[],[]
TransactionManager.Instance.EnsureInTransaction(doc)
for dwf in dwfMarkups:
	if all(famType.FamilyName.lower() not in dwf.Name.lower() for famType in types):
		box=dwf.BoundingBox[activeView]
		centr=XYZ(box.Min.X,box.Max.Y,0)	
		label=dwf.get_Parameter(BuiltInParameter.MARKUPS_LABEL).AsString()
		labels.append(label)
		textNote=TextNote.Create(doc, view.Id, convert(centr), label, textTypeId)
		try: check = Revit.Elements.ElementWrapper.Wrap(textNote, True)
		except: check = None
		if check is None:
			texts.append(ueWrapper.Invoke(None, (textNote, False)))
		else:
			texts.append(textNote)
		dwfs.append(dwf)
TransactionManager.Instance.TransactionTaskDone()

OUT = dwfs,texts, labels
# ----------------------------------------
code_block = CodeBlock(x=python_script) { x[0]; x[1]; x[2]; }
DWFMarkup = Output(code_block.out0)
TextNote = Output(code_block.out1)
String = Output(code_block.out2)
