# Dynamo custom node Create ColorFill Legend.dyf (Dynamo 2.0.4.12684)
# category: GeniusLoci.ColorScheme
# Works only in Revit 2022 and later.
# Places a Color fill legend in a given view.

view = Input(view: var[]..[] = Revit.Application.Document.Current.ActiveView)
point = Input(point: Autodesk.DesignScript.Geometry.Point[]..[])
category = Input(category: var[]..[])
python_script = Python(IN[0]=view, IN[1]=point, IN[2]=category)
# ---------- python_script.python (40 lines) ----------
#Alban de Chasteigner 2021
#twitter : @geniusloci_bim
#geniusloci.bim@gmail.com
#https://github.com/albandechasteigner/GeniusLociForDynamo

import clr
clr.AddReference('RevitAPI')
from Autodesk.Revit.DB import ColorFillLegend, XYZ

clr.AddReference('RevitNodes')
import Revit
clr.ImportExtensions(Revit.GeometryConversion)

clr.AddReference("RevitServices")
import RevitServices
from RevitServices.Persistence import DocumentManager
from RevitServices.Transactions import TransactionManager
doc = DocumentManager.Instance.CurrentDBDocument

def tolist(obj1):
	if hasattr(obj1,"__iter__"): return obj1
	else: return [obj1]

views = tolist(UnwrapElement(IN[0]))
points = tolist(UnwrapElement(IN[1]))
categories = tolist(UnwrapElement(IN[2]))[0]
pnts = [i.ToXyz() for i in points]
legend = []

TransactionManager.Instance.EnsureInTransaction(doc) 
for number in range(len(views)):
	if len(points) > 1:
		legend.append(ColorFillLegend.Create(doc,views[number].Id,categories.Id,XYZ(pnts[number].X,pnts[number].Y,views[number].Origin.Z)))
		#new legends with different points
	else:
		legend.append(ColorFillLegend.Create(doc,views[number].Id,categories.Id,XYZ(pnts[0].X,pnts[0].Y,views[number].Origin.Z)))
		#new legend whith identical point
TransactionManager.Instance.TransactionTaskDone()

OUT = legend
# ----------------------------------------
ColorFillLegend = Output(python_script)
