# Dynamo custom node Create Compound Layer.dyf (Dynamo 2.6.1.8786)
# category: GeniusLoci.CompoundStructure
# Creates a new layer at the specified index in the compound system family (wall, floor, roof or ceiling).

ElementOrFamilyType = Input(ElementOrFamilyType: var[]..[])
LayerFunction = Input(LayerFunction: var[]..[] = "Structure")  # String or MaterialFunctionAssignement Use the Enumerate LayerFunction node
material = Input(material: var[]..[])  # One material per layer
Thickness = Input(Thickness: double[]..[])  # One thickness per layer In Document Units
index = Input(index: int[]..[])  # The index of the layer (The first index is 0) Counts from the exterior of the wall and from the top of roof, floor and ceiling.
python_script = Python(IN[0]=ElementOrFamilyType, IN[1]=LayerFunction, IN[2]=material, IN[3]=Thickness, IN[4]=index)
# ---------- python_script.python (112 lines) ----------
#Alban de Chasteigner 2020
#twitter : @geniusloci_bim
#geniusloci.bim@gmail.com

import clr
clr.AddReference('RevitAPI')
import Autodesk
from Autodesk.Revit.DB import *

clr.AddReference('RevitServices')
import RevitServices
from RevitServices.Persistence import DocumentManager
from RevitServices.Transactions import TransactionManager
doc = DocumentManager.Instance.CurrentDBDocument
uiapp = DocumentManager.Instance.CurrentUIApplication
app = uiapp.Application
version=int(app.VersionNumber)

import System
from System.Collections.Generic import IDictionary

if version < 2021:
	UIunit = doc.GetUnits().GetFormatOptions(UnitType.UT_Length).DisplayUnits
else:
	UIunit = doc.GetUnits().GetFormatOptions(SpecTypeId.Length).GetUnitTypeId()

def tolist(obj1):
    if hasattr(obj1,"__iter__"): return obj1
    else: return [obj1]

elements = tolist(UnwrapElement(IN[0]))
functions = tolist(IN[1])
materials = tolist(UnwrapElement(IN[2]))
widths = tolist(IN[3])
index = tolist(IN[4])

outList,boolList = [], []

# Out error Dictionaries for CompoundStructure.IsValid() method...
isValidError = clr.StrongBox[IDictionary[int, CompoundStructureError]]()
isValidError2Layer = clr.StrongBox[IDictionary[int, int]]()

for elem in elements :
	if isinstance(elem, ElementType):
		famType=elem
	elif isinstance(elem, Wall):
		famType = elem.WallType
	elif isinstance(elem, Floor):
		famType = elem.FloorType
	elif isinstance(elem, FootPrintRoof) or isinstance(elem, ExtrusionRoof) or isinstance(elem, RoofBase) :
		famType = elem.RoofType
	elif isinstance(elem, Ceiling) or isinstance(elem, FaceWall) :
		famType = doc.GetElement(elem.GetTypeId())
	else:
		pass
		
	compStr = famType.GetCompoundStructure()
	layers = list(compStr.GetLayers())
	structural=compStr.StructuralMaterialIndex
	variable=compStr.VariableLayerIndex
	
	idx = 0
	while idx < compStr.LayerCount:
		boolList.Add(compStr.ParticipatesInWrapping(idx))
		idx = idx+1
	firstCoreLayerIndex = compStr.GetFirstCoreLayerIndex()
	lastCoreLayerIndex = compStr.GetLastCoreLayerIndex()
	numberOfShellLayExt = compStr.GetNumberOfShellLayers(ShellLayerType.Exterior)
	numberOfShellLayInt = compStr.GetNumberOfShellLayers(ShellLayerType.Interior)
	
	for indx,material,width,function in zip(index,materials,widths,functions):	
		if isinstance(function, Autodesk.Revit.DB.MaterialFunctionAssignment):
			layerFunction=function
		else:
			layerFunction=System.Enum.Parse(Autodesk.Revit.DB.MaterialFunctionAssignment, function)
		
		compoundStructureLayer = CompoundStructureLayer((UnitUtils.ConvertToInternalUnits(width,UIunit)),layerFunction,material.Id)
		boolList.insert(indx, True)
		layers.insert(indx, compoundStructureLayer)
		if indx < firstCoreLayerIndex :
			numberOfShellLayExt += 1
		if indx > lastCoreLayerIndex:
			numberOfShellLayInt += 1
		if indx <= variable:
			variable += 1
		if indx <= structural: 
			structural += 1
			
	compStr.SetLayers(layers)
	compStr.SetNumberOfShellLayers(ShellLayerType.Exterior, numberOfShellLayExt)
	compStr.SetNumberOfShellLayers(ShellLayerType.Interior, numberOfShellLayInt)
	compStr.StructuralMaterialIndex=structural
	compStr.VariableLayerIndex=variable
		
	idx = 0
	while idx < compStr.LayerCount:
		if idx < compStr.GetFirstCoreLayerIndex() or idx > compStr.GetLastCoreLayerIndex() :
			compStr.SetParticipatesInWrapping(idx, boolList[idx])
		idx = idx+1
			
	TransactionManager.Instance.EnsureInTransaction(doc)
	if compStr.IsValid(doc, isValidError, isValidError2Layer):
		famType.SetCompoundStructure(compStr)
		outList.append(famType)
	else:
		xErrInfo = list(isValidError.Value)	
		outList.append(xErrInfo)
	TransactionManager.Instance.TransactionTaskDone()
	TransactionManager.Instance.ForceCloseTransaction()
		
if isinstance(IN[0], list): OUT = outList
else: OUT = outList[0]
# ----------------------------------------
FamilyType = Output(python_script)
