# Dynamo custom node Create DuctConnector.dyf (Dynamo 2.12.1.8246)
# category: GeniusLoci.ConnectorElement
# In a familyDocument, creates a new duct ConnectorElement.

familyDocument = Input(familyDocument: var[]..[] = null)  # Autodesk.Revit.DB.Document Optional input
ductSystemType = Input(ductSystemType: var[]..[])  # Autodesk.Revit.DB.Mechanical.DuctSystemType or string
connectorProfileType = Input(connectorProfileType: var[]..[])  # Autodesk.Revit.DB.ConnectorProfileType or string
reference = Input(reference: var[]..[])  # Autodesk.Revit.DB.Reference
create_ductconnector = Python(IN[0]=familyDocument, IN[1]=ductSystemType, IN[2]=connectorProfileType, IN[3]=reference)  # IronPython2
# ---------- create_ductconnector.python (37 lines) ----------
#Alban de Chasteigner 2022
#twitter : @geniusloci_bim
#geniusloci.bim@gmail.com
#https://github.com/albandechasteigner/GeniusLociForDynamo

import clr
clr.AddReference('RevitAPI')
import Autodesk
from Autodesk.Revit.DB import *

clr.AddReference('RevitServices')
import RevitServices
from RevitServices.Persistence import DocumentManager
from RevitServices.Transactions import TransactionManager

import System

inputdoc = UnwrapElement(IN[0]) if isinstance(IN[0],list) else [UnwrapElement(IN[0])]
mepSystemTypes = IN[1] if isinstance(IN[1],list) else [IN[1]]
connectorProfileTypes = IN[2] if isinstance(IN[2],list) else [IN[2]]
references = IN[3] if isinstance(IN[3],list) else [IN[3]]
connector=[]
if inputdoc[0] == None and (DocumentManager.Instance.CurrentDBDocument).IsFamilyDocument :
	doc = DocumentManager.Instance.CurrentDBDocument
else : doc = inputdoc[0]

TransactionManager.Instance.ForceCloseTransaction()
TransactionManager.Instance.EnsureInTransaction(doc)
for mepSystemType, profileType, ref in zip(mepSystemTypes, connectorProfileTypes, references):
	if isinstance(mepSystemType, Autodesk.Revit.DB.Mechanical.DuctSystemType):
		mepSys=mepSystemType
	else:
		mepSys=System.Enum.Parse(Autodesk.Revit.DB.Mechanical.DuctSystemType, mepSystemType)
	connector.append(ConnectorElement.CreateDuctConnector(doc, mepSys, profileType, ref))
TransactionManager.Instance.TransactionTaskDone()

OUT = connector if isinstance(IN[3], list) else connector[0]
# ----------------------------------------
ConnectorElement = Output(create_ductconnector)
