# Dynamo custom node Create Family Parameter.dyf (Dynamo 2.13.1.3887)
# category: GeniusLoci.Parameter
# Creates a family parameter in the active family.
# Can also be used to associate a label with a given dimension.
# Set the lacing to longest to create several parameters.

ParameterName = Input(ParameterName: var[]..[] = null)
ParameterType = Input(ParameterType: var[]..[] = null)  # String, DB.ParameterType or Spec Type Name
ParameterGroup = Input(ParameterGroup: var[]..[] = null)  # String, DB.BuiltInParameterGroup or Group Type Name
IsInstance = Input(IsInstance: bool = false)  # Is instance parameter otherwise it's a type parameter
reporting = Input(reporting: bool = false)  # Is reporting parameter. This is only available with Length and Angle parameters
dimension = Input(dimension: var[]..[] = null)  # Use only to associate a label (parameter) with the dimension
familyParameter = Input(familyParameter: var[]..[] = null)  # Optional input to use with the dimension input
python_script = Python(IN[0]=ParameterName, IN[1]=ParameterType, IN[2]=ParameterGroup, IN[3]=IsInstance, IN[4]=reporting, IN[5]=dimension, IN[6]=familyParameter)  # IronPython2
# ---------- python_script.python (57 lines) ----------
#Alban de Chasteigner 2020
#twitter : @geniusloci_bim
#geniusloci.bim@gmail.com
#https://github.com/albandechasteigner/GeniusLociForDynamo

import clr
clr.AddReference('RevitAPI')
import Autodesk
from Autodesk.Revit.DB import *

clr.AddReference("RevitServices")
import RevitServices
from RevitServices.Persistence import DocumentManager
from RevitServices.Transactions import TransactionManager
doc = DocumentManager.Instance.CurrentDBDocument
uiapp = DocumentManager.Instance.CurrentUIApplication
app = uiapp.Application
version=int(app.VersionNumber)

paramName = IN[0]
parameterType = IN[1]
parameterGroup = IN[2]
instance = IN[3]
reporting = IN[4]
dimension = UnwrapElement(IN[5])
famParameter = UnwrapElement(IN[6])

TransactionManager.Instance.EnsureInTransaction(doc)
if famParameter == None:
	if version < 2022:
		if isinstance(parameterGroup, basestring):
			exec("paramGroup = BuiltInParameterGroup.%s" % parameterGroup)
		else:
			paramGroup = parameterGroup
		if isinstance(parameterType, basestring):
			exec("paramType = ParameterType.%s" % parameterType)
		else :
			paramType = parameterType
	else:
		if isinstance(parameterGroup, basestring):
			paramGroup = [group for group in ParameterUtils.GetAllBuiltInGroups() if parameterGroup == LabelUtils.GetLabelForGroup(group)][0]
		if isinstance(parameterType, basestring):
			paramType=[spec for spec in SpecUtils.GetAllSpecs() if UnitUtils.IsMeasurableSpec(spec) and parameterType == LabelUtils.GetLabelForSpec(spec)][0]
		
	familyParam = doc.FamilyManager.AddParameter(paramName, paramGroup, paramType, instance)
	if reporting == True:
		doc.FamilyManager.MakeReporting(familyParam)
else:
	familyParam = famParameter

if dimension :
	dimension.FamilyLabel = familyParam
else:
	pass
TransactionManager.Instance.TransactionTaskDone()

OUT = familyParam.Definition.Name
# ----------------------------------------
FamilyParameter_Name = Output(python_script)
