# Dynamo custom node Create FamilyDocument.dyf (Dynamo 2.12.0.5650)
# category: GeniusLoci.Family
# Creates a new familyDocument from a family template file (.rft)

filePath = Input(filePath: var[]..[])  # .rft file
new_familydocument = Python(IN[0]=filePath)  # IronPython2
# ---------- new_familydocument.python (25 lines) ----------
#Alban de Chasteigner 2022
#twitter : @geniusloci_bim
#geniusloci.bim@gmail.com
#https://github.com/albandechasteigner/GeniusLociForDynamo
 
import clr
clr.AddReference('RevitAPI')
import Autodesk
from Autodesk.Revit.DB import *
clr.AddReference('RevitServices')
import RevitServices
from RevitServices.Persistence import DocumentManager
from RevitServices.Transactions import TransactionManager
doc = DocumentManager.Instance.CurrentDBDocument
uidoc=DocumentManager.Instance.CurrentUIApplication.ActiveUIDocument
uiapp = DocumentManager.Instance.CurrentUIApplication
app = uiapp.Application

templateFileName = IN[0]

TransactionManager.Instance.EnsureInTransaction(doc)
familyDocument = app.NewFamilyDocument(templateFileName)
TransactionManager.Instance.TransactionTaskDone()

OUT = familyDocument
# ----------------------------------------
FamilyDocument = Output(new_familydocument)
