# Dynamo custom node Create Fill Pattern.dyf (Dynamo 2.6.1.8786)
# category: GeniusLoci.FillPattern
# Creates a new FillPatternElement with a repeating sequence of angles, origins, shifts, offsets,
# dashes and spaces.

Name = Input(Name: var[]..[])
fillPatternTarget = Input(fillPatternTarget: var[]..[])  # String or Revit.DB.FillPatternTarget To use with the Fill Pattern Targets node
fillPatternHostOrientation = Input(fillPatternHostOrientation: var[]..[])  # String or Revit.DB.FillPatternHostOrientation To use with the FillPattern HostOrientation node
angles = Input(angles: double[]..[])  # Degrees. The angle specifies the direction
x_origins = Input(x_origins: double[]..[])  # The line in the set starts at the specified x origin.
y_origins = Input(y_origins: double[]..[])  # The line in the set starts at the specified y origin.
shifts = Input(shifts: double[]..[])  # Shift moves the pattern of dashes and spaces along the length of each new parallel line.
offsets = Input(offsets: double[]..[])  # Offset defines the vertical distance between parallel lines.
dashes = Input(dashes: double[]..[])  # The dash-space sequence defines a repeating pattern for a line.
spaces = Input(spaces: double[]..[])  # The dash-space sequence defines a repeating pattern for a line.
python_script = Python(IN[0]=Name, IN[1]=fillPatternTarget, IN[2]=fillPatternHostOrientation, IN[3]=angles, IN[4]=x_origins, IN[5]=y_origins, IN[6]=shifts, IN[7]=offsets, IN[8]=dashes, IN[9]=spaces)
# ---------- python_script.python (68 lines) ----------
#Alban de Chasteigner 2020
#twitter : @geniusloci_bim
#geniusloci.bim@gmail.com
import clr
clr.AddReference('RevitAPI')
import Autodesk
from Autodesk.Revit.DB import *

clr.AddReference('RevitServices')
from RevitServices.Persistence import DocumentManager
from RevitServices.Transactions import TransactionManager
doc = DocumentManager.Instance.CurrentDBDocument
uiapp = DocumentManager.Instance.CurrentUIApplication
app = uiapp.Application
version=int(app.VersionNumber)

clr.AddReference('System')
import System
from System.Collections.Generic import List

if version < 2021:
	UIunit = doc.GetUnits().GetFormatOptions(UnitType.UT_Length).DisplayUnits
	ut_degrees = DisplayUnitType.DUT_DECIMAL_DEGREES
else:
	UIunit = doc.GetUnits().GetFormatOptions(SpecTypeId.Length).GetUnitTypeId()
	ut_degrees = UnitTypeId.Degrees

patternName, angles, x_origins, y_origins, shifts, offsets, segments1, segments2 = IN[0],IN[3],IN[4],IN[5],IN[6],IN[7],IN[8],IN[9]
if isinstance(IN[1],Autodesk.Revit.DB.FillPatternTarget) :
	fillPatternTarget = IN[1]
else :
	fillPatternTarget = System.Enum.Parse(Autodesk.Revit.DB.FillPatternTarget, IN[1])
	
if isinstance(IN[2],Autodesk.Revit.DB.FillPatternHostOrientation) :
	fillPatternHostOrientation = IN[2]
else :
	fillPatternHostOrientation = System.Enum.Parse(Autodesk.Revit.DB.FillPatternHostOrientation, IN[2])

#Creates and returns a new fill grid
def CreateGrid(angle, origin, shift, offset, *segments) :
	fillGrid = FillGrid()
	fillGrid.Angle = angle
	fillGrid.Origin = origin
	fillGrid.Shift = shift
	fillGrid.Offset = offset
	segmentsList = List[float]()
	for d in segments :
		segmentsList.Add(d)
	fillGrid.SetSegments(segmentsList)
	return fillGrid

#Create the fill pattern
fillPattern = FillPattern(patternName, fillPatternTarget, fillPatternHostOrientation)
#Add grids
lstGrids = List[FillGrid]()

#The arguments: angle, origin, shift (delta between location of start point per line), offset (vertical distance between lines) 
#The last two arguments are the segments: e.g. 1.0 units on, 0.1 units off (units are Revit units (ft))
for angle, x_origin, y_origin, shift, offset, segment1, segment2 in zip(angles, x_origins, y_origins, shifts, offsets, segments1, segments2):
	lstGrids.Add(CreateGrid(UnitUtils.ConvertToInternalUnits(angle, ut_degrees), UV(UnitUtils.ConvertToInternalUnits(x_origin,UIunit), UnitUtils.ConvertToInternalUnits(y_origin,UIunit)), UnitUtils.ConvertToInternalUnits(shift,UIunit), UnitUtils.ConvertToInternalUnits(offset,UIunit), UnitUtils.ConvertToInternalUnits(segment1,UIunit), UnitUtils.ConvertToInternalUnits(abs(segment2),UIunit)))
	
fillPattern.SetFillGrids(lstGrids)
#Create the fill pattern element.
TransactionManager.Instance.EnsureInTransaction(doc)
patternElement = FillPatternElement.Create(doc, fillPattern)
TransactionManager.Instance.TransactionTaskDone()

OUT=patternElement
# ----------------------------------------
FillPatternElement = Output(python_script)
