# Dynamo custom node Create Line Pattern.dyf (Dynamo 2.6.1.8786)
# category: GeniusLoci.Graphics
# Creates a new LinePatternElement.
# A line pattern is made of dashes, dots alternating with spaces. A space must end the sequence.

Name = Input(Name: string[]..[])
types = Input(types: string[]..[])  # Dash, Dot or Space
values = Input(values: double[]..[])  # Lengths in Document units
python_script = Python(IN[0]=Name, IN[1]=types, IN[2]=values)
# ---------- python_script.python (59 lines) ----------
#Alban de Chasteigner 2018
#twitter : @geniusloci_bim
#geniusloci.bim@gmail.com

import clr
clr.AddReference('RevitNodes')
import Revit
clr.ImportExtensions(Revit.GeometryConversion)
clr.ImportExtensions(Revit.Elements)

# Import DocumentManager and TransactionManager
clr.AddReference('RevitServices')
import RevitServices
from RevitServices.Persistence import DocumentManager
from RevitServices.Transactions import TransactionManager
doc = DocumentManager.Instance.CurrentDBDocument
uiapp = DocumentManager.Instance.CurrentUIApplication
app = uiapp.Application
version=int(app.VersionNumber)

clr.AddReference('RevitAPI')
import Autodesk
from Autodesk.Revit.DB import *

import sys
pyt_path = r'C:\Program Files (x86)\IronPython 2.7\Lib'
sys.path.append(pyt_path)
import System
from System.Collections.Generic import *

if version < 2021:
	UIunit = doc.GetUnits().GetFormatOptions(UnitType.UT_Length).DisplayUnits
else:
	UIunit = doc.GetUnits().GetFormatOptions(SpecTypeId.Length).GetUnitTypeId()

patternName = IN[0]
types = IN[1]
values = IN[2]
lstSegments =  List[LinePatternSegment]()

for type,value in zip(types,values):
	if type == "Dash":
		lstSegments.Add(LinePatternSegment(LinePatternSegmentType.Dash,UnitUtils.ConvertToInternalUnits(value,UIunit)))
		
	elif type == "Space":
		lstSegments.Add(LinePatternSegment(LinePatternSegmentType.Space,UnitUtils.ConvertToInternalUnits(value,UIunit)))
	
	elif type == "Dot":
		lstSegments.Add(LinePatternSegment(LinePatternSegmentType.Dot,0))

linePattern = LinePattern(patternName)
linePattern.SetSegments(lstSegments)

#Create a linepattern element
TransactionManager.Instance.EnsureInTransaction(doc)
linePatternElement = LinePatternElement.Create(doc, linePattern)
TransactionManager.Instance.TransactionTaskDone()

OUT=linePatternElement
# ----------------------------------------
LinePatternElement = Output(python_script)
