# Dynamo custom node Create Note Block Schedule.dyf (Dynamo 2.6.1.8786)
# category: GeniusLoci.Schedule
# Create a Note Block Schedule of Generic Annotations with Count and Type fields.

family = Input(family: var[]..[] = null)
note_block = Python(IN[0]=family)
# ---------- note_block.python (35 lines) ----------
#Alban de Chasteigner 2018
#twitter : @geniusloci_bim
#geniusloci.bim@gmail.com
import clr
clr.AddReference('RevitAPI')
import Autodesk
from Autodesk.Revit.DB import *

clr.AddReference("RevitNodes")
import Revit
clr.ImportExtensions(Revit.Elements)

clr.AddReference("RevitServices")
import RevitServices
from RevitServices.Persistence import DocumentManager
from RevitServices.Transactions import TransactionManager

doc = DocumentManager.Instance.CurrentDBDocument
family=UnwrapElement(IN[0])

TransactionManager.Instance.EnsureInTransaction(doc)
if family ==None:
	noteblockFamilies = ViewSchedule.GetValidFamiliesForNoteBlock(doc)
	symbolId = noteblockFamilies[0]
else :
	symbolId=family.Id
if symbolId !=(ElementId.InvalidElementId) :
	noteBlockSchedule = ViewSchedule.CreateNoteBlock(doc, symbolId)
TransactionManager.Instance.TransactionTaskDone()
fields = noteBlockSchedule.Definition.GetSchedulableFields()
fieldList=[]
for f in fields:
	name=f.GetName(doc) 
	fieldList.append(name)
OUT = noteBlockSchedule,fieldList,fields
# ----------------------------------------
code_block = CodeBlock(x=note_block) { x[0]; x[2]; }
code_block_2 = CodeBlock(x=code_block.out1) { x[0..1]; }
addFields = Python(IN[0]=code_block.out0, IN[1]=code_block_2)  # "ScheduleView.AddFields"
# ---------- addFields.python (28 lines) ----------
#Alban de Chasteigner 2018
#twitter : @geniusloci_bim
#geniusloci.bim@gmail.com
import clr
clr.AddReference('RevitAPI')
import Autodesk
from Autodesk.Revit.DB import *

clr.AddReference("RevitNodes")
import Revit
clr.ImportExtensions(Revit.Elements)

clr.AddReference("RevitServices")
import RevitServices
from RevitServices.Persistence import DocumentManager
from RevitServices.Transactions import TransactionManager

doc = DocumentManager.Instance.CurrentDBDocument

viewSchedule = UnwrapElement(IN[0])
schedulableFields = UnwrapElement(IN[1])

TransactionManager.Instance.EnsureInTransaction(doc)
for schedulableField in schedulableFields:
	viewSchedule.Definition.AddField(schedulableField) 
TransactionManager.Instance.TransactionTaskDone()

OUT = viewSchedule
# ----------------------------------------
ViewSchedule = Output(addFields)
