# Dynamo custom node Create Phase Filter.dyf (Dynamo 2.6.1.8786)
# category: GeniusLoci.Phase
# Creates a new phase filter with default status presentation.
# The default status presentation is ShowByCategory for New status, and ShowOverriden for Existing, Demolished and Temporary statuses.

name = Input(name: string[]..[])
python_script = Python(IN[0]=name)
# ---------- python_script.python (24 lines) ----------
import clr
# Import RevitAPI Classes
clr.AddReference('RevitAPI')
import Autodesk
from Autodesk.Revit.DB import *

# Import DocumentManager and TransactionManager
clr.AddReference("RevitServices")
import RevitServices
from RevitServices.Persistence import DocumentManager
from RevitServices.Transactions import TransactionManager

doc = DocumentManager.Instance.CurrentDBDocument

names = IN[0] if isinstance(IN[0],list) else [IN[0]]
phaseFilters = []

TransactionManager.Instance.EnsureInTransaction(doc)
for name in names:
	phaseFilters.append(PhaseFilter.Create(doc, name))
TransactionManager.Instance.TransactionTaskDone()

if isinstance(IN[0], list): OUT = phaseFilters
else: OUT = phaseFilters[0]
# ----------------------------------------
Phase_Filter = Output(python_script)
