# Dynamo custom node Create PipeConnector.dyf (Dynamo 2.12.1.8246)
# category: GeniusLoci.ConnectorElement
# In a familyDocument, creates a new pipe ConnectorElement.

familyDocument = Input(familyDocument: var[]..[] = null)  # Autodesk.Revit.DB.Document Optional input
pipeSystemType = Input(pipeSystemType: var[]..[])  # Autodesk.Revit.DB.Plumbing.PipeSystemType or string
reference = Input(reference: var[]..[])  # Autodesk.Revit.DB.Reference
create_pipeconnector = Python(IN[0]=familyDocument, IN[1]=pipeSystemType, IN[2]=reference)  # IronPython2
# ---------- create_pipeconnector.python (36 lines) ----------
#Alban de Chasteigner 2022
#twitter : @geniusloci_bim
#geniusloci.bim@gmail.com
#https://github.com/albandechasteigner/GeniusLociForDynamo

import clr
clr.AddReference('RevitAPI')
import Autodesk
from Autodesk.Revit.DB import *

clr.AddReference('RevitServices')
import RevitServices
from RevitServices.Persistence import DocumentManager
from RevitServices.Transactions import TransactionManager

import System

inputdoc = UnwrapElement(IN[0]) if isinstance(IN[0],list) else [UnwrapElement(IN[0])]
mepSystemTypes = IN[1] if isinstance(IN[1],list) else [IN[1]]
references = IN[2] if isinstance(IN[2],list) else [IN[2]]
connector=[]
if inputdoc[0] == None and (DocumentManager.Instance.CurrentDBDocument).IsFamilyDocument :
	doc = DocumentManager.Instance.CurrentDBDocument
else : doc = inputdoc[0]

TransactionManager.Instance.ForceCloseTransaction()
TransactionManager.Instance.EnsureInTransaction(doc)
for mepSystemType, ref in zip(mepSystemTypes, references):
	if isinstance(mepSystemType, Autodesk.Revit.DB.Plumbing.PipeSystemType):
		mepSys=mepSystemType
	else:
		mepSys=System.Enum.Parse(Autodesk.Revit.DB.Plumbing.PipeSystemType, mepSystemType)
	connector.append(ConnectorElement.CreatePipeConnector(doc, mepSys, ref))
TransactionManager.Instance.TransactionTaskDone()

OUT = connector if isinstance(IN[2], list) else connector[0]
# ----------------------------------------
ConnectorElement = Output(create_pipeconnector)
