# Dynamo custom node Create Shared Parameter.dyf (Dynamo 2.6.2.15705)
# category: GeniusLoci.Parameter
# Create shared parameters in the shared parameter file and then add it to the project.
# It is possible to use an existing GUID to recreate an identical shared parameter in a new SP file. Or use the GUID input to simply add the shared parameters to the project.
# Inspired by archilab

ParameterName = Input(ParameterName: string[]..[])
GroupName = Input(GroupName: string[]..[])  # Group of the shared parameter
ParameterType = Input(ParameterType: var[]..[])  # String, DB.ParameterType or Spec Type Name
ParameterGroup = Input(ParameterGroup: var[]..[])  # String, DB.BuiltInParameterGroup or Group Type Name
IsInstance = Input(IsInstance: bool[]..[] = true)  # Is instance parameter, otherwise it's a type parameter
IsVisible = Input(IsVisible: bool[]..[] = true)
GUID = Input(GUID: var[]..[] = null)  # Optional input. String or System Guid
category = Input(category: var[]..[])  # List level of the category list must match that of the ParameterName (In case of sublists)
python_script = Python(IN[0]=ParameterName, IN[1]=GroupName, IN[2]=ParameterType, IN[3]=ParameterGroup, IN[4]=IsInstance, IN[5]=IsVisible, IN[6]=GUID, IN[7]=category)
# ---------- python_script.python (131 lines) ----------
#Inspired by an archilab node, by Konrad Sobon
#Modifications by Alban de Chasteigner 2020
#twitter : @geniusloci_bim
#geniusloci.bim@gmail.com
#https://github.com/albandechasteigner/GeniusLociForDynamo
#Fix by Cyril Poupin for Revit 2022+

import clr
clr.AddReference("RevitAPI")
import Autodesk
from Autodesk.Revit.DB import *

clr.AddReference("RevitServices")
import RevitServices
from RevitServices.Persistence import DocumentManager
from RevitServices.Transactions import TransactionManager
doc = DocumentManager.Instance.CurrentDBDocument
uiapp = DocumentManager.Instance.CurrentUIApplication
app = uiapp.Application
version=int(app.VersionNumber)

import System
from System.Collections.Generic import List
from System import Guid

_paramName = IN[0] if isinstance(IN[0],list) else [IN[0]]
_groupName = IN[1]
parameterTypes = IN[2] if isinstance(IN[2],list) else [IN[2]]
parameterGroups = IN[3] if isinstance(IN[3],list) else [IN[3]]
_instance = IN[4] if isinstance(IN[4],list) else [IN[4]]
_visible = IN[5] if isinstance(IN[5],list) else [IN[5]]
guids = IN[6] if isinstance(IN[6],list) else [IN[6]]
_categories = IN[7] if isinstance(IN[7],list) else [IN[7]]

paramTypes_len = len(parameterTypes) == 1
paramGroups_len = len(parameterGroups) == 1
instance_len = len(_instance) == 1
visible_len = len(_visible) == 1
guid_len = len(guids) == 1

if version < 2023 :
	_paramGroup = [System.Enum.Parse(Autodesk.Revit.DB.BuiltInParameterGroup, parameterGroup) if isinstance(parameterGroup, basestring) else parameterGroup for parameterGroup in parameterGroups]
	_paramType = [System.Enum.Parse(Autodesk.Revit.DB.ParameterType, parameterType) if isinstance(parameterType, basestring) else parameterType for parameterType in parameterTypes]
else:
	_paramGroup = [group for parameterGroup in parameterGroups for group in ParameterUtils.GetAllBuiltInGroups() if parameterGroup == LabelUtils.GetLabelForGroup(group) and isinstance(parameterGroup, basestring)]
	_paramType=[spec for parameterType in parameterTypes for spec in SpecUtils.GetAllSpecs() if (parameterType == LabelUtils.GetLabelForSpec(spec) and isinstance(parameterType, basestring))] #and UnitUtils.IsMeasurableSpec(spec)
	
_guid = [Guid(guid) if isinstance(guid, basestring) else guid for guid in guids]

def IsEqualTo_ParameterType(para_def, paraType):
	#check if ParameterType of a definition is Equal to a other ParameterType (or SpecTypeId)
	if version < 2023 :
		return para_def.ParameterType == paraType
	else:
		return para_def.GetDataType() == paraType
		
def ParamBindingExists(_doc, _paramName, _paramType):
	map = doc.ParameterBindings
	iterator = map.ForwardIterator()
	iterator.Reset()
	while iterator.MoveNext():
		if iterator.Key != None and iterator.Key.Name == _paramName and IsEqualTo_ParameterType(iterator.Key, _paramType) :
			paramExists = True
			break
		else:
			paramExists = False
	return paramExists

def RemoveParamBinding(_doc, _paramName, _paramType):
	map = doc.ParameterBindings
	iterator = map.ForwardIterator()
	iterator.Reset()
	while iterator.MoveNext():
		if iterator.Key != None and iterator.Key.Name == _paramName and iterator.Key.ParameterType == _paramType:
			definition = iterator.Key
			break
	message = None
	if definition != None:
		map.Remove(definition)
		message = "Success"
	return message

def addParam(doc, _paramName, _paramType, _visible, _instance, _guid, _groupName, _paramGroup,_categories):
	message = None
	if ParamBindingExists(doc, _paramName, _paramType):
		if not RemoveParamBinding(doc, _paramName, _paramType) == "Success":
			message = "Param Binding Not Removed Successfully"
		else:
			message = None		
	group = app.OpenSharedParameterFile().Groups.get_Item(_groupName)
	if group == None:
		group = file.Groups.Create(_groupName)
	if group.Definitions.Contains(group.Definitions.Item[_paramName]):
		_def = group.Definitions.Item[_paramName]
	else:
		opt = ExternalDefinitionCreationOptions(_paramName, _paramType)
		opt.Visible = _visible
		if _guid != None:
			opt.GUID = _guid 
		_def = group.Definitions.Create(opt)
	cats=app.Create.NewCategorySet()
	builtInCategories=[doc.Settings.Categories.get_Item(System.Enum.ToObject(BuiltInCategory, _category.Id)) for _category in _categories]
	[cats.Insert(builtInCategory) for builtInCategory in builtInCategories]
	if _instance:
		bind=app.Create.NewInstanceBinding(cats)
	else:
		bind=app.Create.NewTypeBinding(cats)
	param = doc.ParameterBindings.Insert(_def, bind, _paramGroup)
	return message
	
TransactionManager.Instance.EnsureInTransaction(doc)
try:
	file = app.OpenSharedParameterFile()
except:
	message = "No Shared Parameter file found."
	pass

for number in xrange(len(_paramName)):
	t = 0 if paramTypes_len else number
	g = 0 if paramGroups_len else number
	i = 0 if instance_len else number
	v = 0 if visible_len else number
	d = 0 if guid_len else number
	message = addParam(doc, _paramName[number], _paramType[t], _visible[v], _instance[i], _guid[d], _groupName, _paramGroup[g],_categories)
		
TransactionManager.Instance.TransactionTaskDone()

if message == None:
	OUT = "Success"
else:
	OUT = message
# ----------------------------------------
Result = Output(python_script)
