# Dynamo custom node Create Sheet.dyf (Dynamo 2.6.1.8786)
# category: GeniusLoci.Sheet
# Creates new sheets.

sheetName = Input(sheetName: string[]..[])
sheetNumber = Input(sheetNumber: string[]..[])
titleBlock = Input(titleBlock: var[]..[])  # FamilyType
python_script = Python(IN[0]=sheetName, IN[1]=sheetNumber, IN[2]=titleBlock)
# ---------- python_script.python (43 lines) ----------
#From Dynamo Forum
import clr
clr.AddReference('RevitAPI')
from Autodesk.Revit.DB import ViewSheet

clr.AddReference("RevitNodes")
import Revit
clr.ImportExtensions(Revit.Elements)

clr.AddReference("RevitServices")
import RevitServices
from RevitServices.Persistence import DocumentManager
from RevitServices.Transactions import TransactionManager
doc = DocumentManager.Instance.CurrentDBDocument

def tolist(obj1):
	if hasattr(obj1,"__iter__"): return obj1
	else: return [obj1]

sheetnames = tolist(IN[0])
sheetnumbers = tolist(IN[1])
titleblock = tolist(UnwrapElement(IN[2]))
sheetList,notCreated = [], []

TransactionManager.Instance.EnsureInTransaction(doc) 
for number in range(len(sheetnumbers)):
	if len(titleblock) > 1:
		newsheet = ViewSheet.Create(doc,titleblock[number].Id)
		#new sheets with different titleblocks
	else:
		newsheet = ViewSheet.Create(doc,titleblock[0].Id) 
		#new sheets whith identical titleblock
	newsheet.Name = sheetnames[number]
	try:
		newsheet.SheetNumber = sheetnumbers[number]
		sheetList.append(newsheet.ToDSType(False))
	except:
		notCreated.append(number)
		doc.Delete(newsheet.Id)

TransactionManager.Instance.TransactionTaskDone()

OUT = sheetList, notCreated
# ----------------------------------------
code_block = CodeBlock(x=python_script) { x[0]; x[1]; }
Sheets = Output(code_block.out0)
Failed = Output(code_block.out1)
