# Dynamo custom node Create Tag (Deprecated).dyf (Dynamo 2.6.1.8786)
# category: GeniusLoci.Tag
# Note : This method is deprecated in Revit 2019.
# Creates a tag at a given location, of a given type and in a supplied view.
# Works also with linked rooms.
# Area tag, Multi Category tag and Material Tag have been added to the original node.
# Based on an archilab node

view = Input(view: var[]..[] = Revit.Application.Document.Current.ActiveView)  # View to tag in.
element = Input(element: var[]..[])  # Element to tag
TagLocation = Input(TagLocation: var[]..[])  # Point
TagType = Input(TagType: var[]..[])  # Family Type to use
horizontal = Input(horizontal: bool = true)  # Optional : Place tag horizontal, defaults to true
addLeader = Input(addLeader: bool = false)  # Optional : Add a leader, defaults to false
LinkInstance = Input(LinkInstance: var = null)  # For linked rooms
RunIt = Input(RunIt: bool = false)
python_script = Python(IN[0]=view, IN[1]=element, IN[2]=TagLocation, IN[3]=TagType, IN[4]=horizontal, IN[5]=addLeader, IN[6]=LinkInstance, IN[7]=RunIt)
# ---------- python_script.python (206 lines) ----------
#Copyright(c) 2015, Konrad K Sobon
# @arch_laboratory, http://archi-lab.net
#This node is an update to Create Annotation Tag node that can be found in archi-lab package. Thanks to Konrad K Sobon for making the original one.
# Additions by Kulkul, T_Pover, Fcampojr and Alban de Chasteigner

import clr
# Import RevitAPI
clr.AddReference("RevitAPI")
import Autodesk
from Autodesk.Revit.DB import *
# Import Element wrapper extension methods
clr.AddReference("RevitNodes")
import Revit
# Import geometry conversion extension methods
clr.ImportExtensions(Revit.GeometryConversion)

# Import DocumentManager and TransactionManager
clr.AddReference("RevitServices")
import RevitServices
from RevitServices.Persistence import DocumentManager
from RevitServices.Transactions import TransactionManager
doc = DocumentManager.Instance.CurrentDBDocument

import sys
sys.path.append(r"C:\Program Files (x86)\IronPython 2.7\Lib")

views = UnwrapElement(IN[0])
elements = UnwrapElement(IN[1]) if isinstance(IN[1],list) else [UnwrapElement(IN[1])]
locationPts = UnwrapElement(IN[2]) if isinstance(IN[2],list) else [UnwrapElement(IN[2])]
tagType = UnwrapElement(IN[3])

tagOrientation = IN[4]
if tagOrientation == True :
	tagOrientation = TagOrientation.Horizontal
	spTagOrientation = SpatialElementTagOrientation.Horizontal
elif tagOrientation == False :
	tagOrientation = TagOrientation.Vertical
	spTagOrientation = SpatialElementTagOrientation.Vertical

leader = IN[5]

if IN[6] != None:
	link = UnwrapElement(IN[6])
else:
	link = None
	
RunIt = IN[7]

def toRvtPoint(point):
	return point.ToXyz()

def toRvtId(_id):
	if isinstance(_id, int) or isinstance(_id, str):
		id = ElementId(int(_id))
		return id
	elif isinstance(_id, ElementId):
		return _id

tagTypeId = toRvtId(tagType.Id)
chk = []
try:
	errorReport = None
	if RunIt:
		if tagType.Category.Id == ElementId(BuiltInCategory.OST_RoomTags):
			roomTags = []
			if isinstance(IN[0], list):
				for j in views:
					for i, k in zip(elements, locationPts):
						TransactionManager.Instance.EnsureInTransaction(doc)
						#added the if statement to get roomId from the linked element.
						if link != None:
							roomId = LinkElementId(link.Id, i.Id)
						else:
							roomId = LinkElementId(i.Id)
						location = Autodesk.Revit.DB.UV(toRvtPoint(k).X, toRvtPoint(k).Y)
						roomTag = doc.Create.NewRoomTag(roomId, location, j.Id)
						roomTag.RoomTagType = tagType
						roomTag.TagOrientation = spTagOrientation
						roomTag.HasLeader = leader
						chk.append(roomId)
						roomTags.append(roomTag)
						TransactionManager.Instance.TransactionTaskDone()
			else:
				TransactionManager.Instance.EnsureInTransaction(doc)
				for i, j in zip(elements, locationPts):
					if link != None:
						roomId = LinkElementId(link.Id, i.Id)
					else:
						roomId = LinkElementId(i.Id)
					location = Autodesk.Revit.DB.UV(toRvtPoint(j).X, toRvtPoint(j).Y)
					roomTag = doc.Create.NewRoomTag(roomId, location, views.Id)
					roomTag.RoomTagType = tagType
					roomTag.TagOrientation = spTagOrientation
					roomTag.HasLeader = leader
					roomTags.append(roomTag)
				TransactionManager.Instance.TransactionTaskDone()
			result = roomTags
		elif tagType.Category.Id == ElementId(BuiltInCategory.OST_MEPSpaceTags):
			TransactionManager.Instance.EnsureInTransaction(doc)
			roomTags = []
			if isinstance(IN[0], list):
				for j in views:
					for i, k in zip(elements, locationPts):
						location = Autodesk.Revit.DB.UV(toRvtPoint(k).X, toRvtPoint(k).Y)
						spaceTag = doc.Create.NewSpaceTag(i, location, j)
						spaceTag.SpaceTagType = tagType
						spaceTag.TagOrientation = spTagOrientation
						spaceTag.HasLeader = leader
						roomTags.append(spaceTag)
			else:
				for i, j in zip(elements, locationPts):
					location = Autodesk.Revit.DB.UV(toRvtPoint(j).X, toRvtPoint(j).Y)
					spaceTag = doc.Create.NewSpaceTag(i,location, views)
					spaceTag.SpaceTagType = tagType
					spaceTag.TagOrientation = spTagOrientation
					spaceTag.HasLeader = leader
					roomTags.append(spaceTag)
			TransactionManager.Instance.TransactionTaskDone()
			result = roomTags
		elif tagType.Category.Id == ElementId(BuiltInCategory.OST_AreaTags):
			TransactionManager.Instance.EnsureInTransaction(doc)
			roomTags = []
			if isinstance(IN[0], list):
				for j in views:
					for i,k in zip(elements, locationPts):
						location = Autodesk.Revit.DB.UV(toRvtPoint(k).X, toRvtPoint(k).Y)
						areaTag = doc.Create.NewAreaTag(j,i, location)
						areaTag.AreaTagType = tagType
						areaTag.TagOrientation = spTagOrientation
						areaTag.HasLeader = leader
						roomTags.append(areaTag)
			else:
				for i, j in zip(elements, locationPts):
					location = Autodesk.Revit.DB.UV(toRvtPoint(j).X, toRvtPoint(j).Y)
					areaTag = doc.Create.NewAreaTag(views,i,location)
					areaTag.AreaTagType = tagType
					areaTag.TagOrientation = spTagOrientation
					areaTag.HasLeader = leader
					roomTags.append(areaTag)
			TransactionManager.Instance.TransactionTaskDone()
			result = roomTags
		elif tagType.Category.Id == ElementId(BuiltInCategory.OST_MultiCategoryTags):
			TransactionManager.Instance.EnsureInTransaction(doc)
			multitags = []
			if isinstance(IN[0], list):
				for j in views:
					for i, k in zip(elements, locationPts):
						location = toRvtPoint(k)
						tag = doc.Create.NewTag(j, i, leader, TagMode.TM_ADDBY_MULTICATEGORY, tagOrientation, location)
						tag.ChangeTypeId(tagTypeId)
						multitags.append(tag)
			else:
				for i, j in zip(elements, locationPts):
					location = toRvtPoint(j)
					tag = doc.Create.NewTag(views, i, leader, TagMode.TM_ADDBY_MULTICATEGORY, tagOrientation, location)
					tag.ChangeTypeId(tagTypeId)
					multitags.append(tag)
			TransactionManager.Instance.TransactionTaskDone()
			result = multitags
		elif tagType.Category.Id == ElementId(BuiltInCategory.OST_MaterialTags):
			TransactionManager.Instance.EnsureInTransaction(doc)
			Mattags = []
			if isinstance(IN[0], list):
				for j in views:
					for i, k in zip(elements, locationPts):
						tag = doc.Create.NewTag(j, i, leader, TagMode.TM_ADDBY_MATERIAL, tagOrientation, location)
						tag.ChangeTypeId(tagTypeId)
						Mattags.append(tag)
			else:
				for i, j in zip(elements, locationPts):
					location = toRvtPoint(j)
					tag = doc.Create.NewTag(views, i, leader, TagMode.TM_ADDBY_MATERIAL, tagOrientation, location)
					tag.ChangeTypeId(tagTypeId)
					Mattags.append(tag)
			TransactionManager.Instance.TransactionTaskDone()
			result = Mattags
		else:
			TransactionManager.Instance.EnsureInTransaction(doc)
			tags = []
			if isinstance(IN[0], list):
				for j in views:
					for i, k in zip(elements, locationPts):
						location = toRvtPoint(k)
						tag = doc.Create.NewTag(j, i, leader, TagMode.TM_ADDBY_CATEGORY, tagOrientation, location)
						tag.ChangeTypeId(tagTypeId)
						tags.append(tag)
			else:
				for i, j in zip(elements, locationPts):
					location = toRvtPoint(j)
					tag = doc.Create.NewTag(views, i, leader, TagMode.TM_ADDBY_CATEGORY, tagOrientation, location)
					tag.ChangeTypeId(tagTypeId)
					tags.append(tag)
			TransactionManager.Instance.TransactionTaskDone()
			result = tags
	else:
		result = "RunIt is set to False."
except:
	# if error accurs anywhere in the process catch it
	import traceback
	errorReport = traceback.format_exc()

#Assign your output to the OUT variable
if errorReport == None:
	OUT = result
else:
	OUT = errorReport
# ----------------------------------------
Tag = Output(python_script)
