# Dynamo custom node Create Tag.dyf
# category: GeniusLoci.Tag
# Works only in Revit 2018 and later.
# Creates a tag at a given location, of given type and in a supplied view.
# The node also works with Linked Elements (except space and area), Multi Category tag and Material Tag.
# Based on an archilab node

view = Input(view: var[]..[] = Revit.Application.Document.Current.ActiveView)  # View to tag in.
element = Input(element: var[]..[])  # Element to tag
TagLocation = Input(TagLocation: var[]..[])  # Point
TagType = Input(TagType: var[]..[])  # Family Type to use
horizontal = Input(horizontal: bool = true)  # Optional : Place tag horizontal, defaults to true
addLeader = Input(addLeader: bool = false)  # Optional : Add a leader, defaults to false
LinkInstance = Input(LinkInstance: var = null)
RunIt = Input(RunIt: bool = false)
python = Python(IN[0]=view, IN[1]=element, IN[2]=TagLocation, IN[3]=TagType, IN[4]=horizontal, IN[5]=addLeader, IN[6]=LinkInstance, IN[7]=RunIt)  # IronPython2
# ---------- python.python (296 lines) ----------
#Copyright(c) 2015, Konrad K Sobon
# @arch_laboratory, http://archi-lab.net
#This node is an update to Create Annotation Tag node that can be found in archi-lab package. Thanks to Konrad K Sobon for making the original one.
# Ability to tag Linked elements by Alban de Chasteigner

import clr
# Import RevitAPI
clr.AddReference("RevitAPI")
import Autodesk
from Autodesk.Revit.DB import *
# Import Element wrapper extension methods
clr.AddReference("RevitNodes")
import Revit
# Import geometry conversion extension methods
clr.ImportExtensions(Revit.GeometryConversion)

import sys
sys.path.append(r"C:\Program Files (x86)\IronPython 2.7\Lib")

# Import DocumentManager and TransactionManager
clr.AddReference("RevitServices")
import RevitServices
from RevitServices.Persistence import DocumentManager
from RevitServices.Transactions import TransactionManager
doc = DocumentManager.Instance.CurrentDBDocument
uiapp = DocumentManager.Instance.CurrentUIApplication
app = uiapp.Application
version=int(app.VersionNumber)

views = UnwrapElement(IN[0])
elements = UnwrapElement(IN[1]) if isinstance(IN[1],list) else [UnwrapElement(IN[1])]
locationPts = UnwrapElement(IN[2]) if isinstance(IN[2],list) else [UnwrapElement(IN[2])]
tagType = UnwrapElement(IN[3])

tagOrientation = IN[4]
if tagOrientation == True :
	tagOrientation = TagOrientation.Horizontal
	spTagOrientation = SpatialElementTagOrientation.Horizontal
elif tagOrientation == False :
	tagOrientation = TagOrientation.Vertical
	spTagOrientation = SpatialElementTagOrientation.Vertical

leader = IN[5]

if IN[6] != None:
	link = UnwrapElement(IN[6])
else:
	link = None
	
RunIt = IN[7]

#ueWrapper from Dimitar Venkov
ueWrapper = None
wrappers = clr.GetClrType(Revit.Elements.ElementWrapper).GetMethods()
for w in wrappers:
	if w.ToString().startswith("Revit.Elements.UnknownElement"):
		ueWrapper = w
		break
				
def toRvtPoint(point):
	return point.ToXyz()

def toRvtId(_id):
	if isinstance(_id, int) or isinstance(_id, str):
		id = ElementId(int(_id))
		return id
	elif isinstance(_id, ElementId):
		return _id

tagTypeId = toRvtId(tagType.Id)
chk = []
try:
	errorReport = None
	if RunIt:
		if tagType.Category.Id == ElementId(BuiltInCategory.OST_RoomTags):
			roomTags = []
			if isinstance(IN[0], list):
				for j in views:
					for i,k in zip(elements, locationPts):
						TransactionManager.Instance.EnsureInTransaction(doc)
						#added the if statement to get roomId from the linked element.
						if link != None:
							roomId = LinkElementId(link.Id, i.Id)
						else:
							roomId = LinkElementId(i.Id)
						location = Autodesk.Revit.DB.UV(toRvtPoint(k).X, toRvtPoint(k).Y)
						roomTag = doc.Create.NewRoomTag(roomId, location, j.Id)
						roomTag.RoomTagType = tagType
						roomTag.TagOrientation = spTagOrientation
						roomTag.HasLeader = leader
						chk.append(roomId)
						roomTags.append(roomTag)
						TransactionManager.Instance.TransactionTaskDone()
			else:
				TransactionManager.Instance.EnsureInTransaction(doc)
				for i, j in zip(elements, locationPts):
					if link != None:
						roomId = LinkElementId(link.Id, i.Id)
					else:
						roomId = LinkElementId(i.Id)
					location = Autodesk.Revit.DB.UV(toRvtPoint(j).X, toRvtPoint(j).Y)
					roomTag = doc.Create.NewRoomTag(roomId, location, views.Id)
					roomTag.RoomTagType = tagType
					roomTag.TagOrientation = spTagOrientation
					roomTag.HasLeader = leader
					roomTags.append(roomTag)
				TransactionManager.Instance.TransactionTaskDone()
			result = roomTags
		elif tagType.Category.Id == ElementId(BuiltInCategory.OST_MEPSpaceTags):
			TransactionManager.Instance.EnsureInTransaction(doc)
			roomTags = []
			if isinstance(IN[0], list):
				for j in views:
					for i,k in zip(elements, locationPts):
						location = Autodesk.Revit.DB.UV(toRvtPoint(k).X, toRvtPoint(k).Y)
						spaceTag = doc.Create.NewSpaceTag(i, location, j)
						spaceTag.SpaceTagType = tagType
						spaceTag.TagOrientation = spTagOrientation
						spaceTag.HasLeader = leader
						roomTags.append(spaceTag)
			else:
				for i, j in zip(elements, locationPts):
					location = Autodesk.Revit.DB.UV(toRvtPoint(j).X, toRvtPoint(j).Y)
					spaceTag = doc.Create.NewSpaceTag(i,location, views)
					spaceTag.SpaceTagType = tagType
					spaceTag.TagOrientation = spTagOrientation
					spaceTag.HasLeader = leader
					roomTags.append(spaceTag)
			TransactionManager.Instance.TransactionTaskDone()
			result = roomTags
		elif tagType.Category.Id == ElementId(BuiltInCategory.OST_AreaTags):
			TransactionManager.Instance.EnsureInTransaction(doc)
			roomTags = []
			if isinstance(IN[0], list):
				for j in views:
					for i,k in zip(elements, locationPts):
						location = Autodesk.Revit.DB.UV(toRvtPoint(k).X, toRvtPoint(k).Y)
						areaTag = doc.Create.NewAreaTag(j,i, location)
						areaTag.AreaTagType = tagType
						areaTag.TagOrientation = spTagOrientation
						areaTag.HasLeader = leader
						roomTags.append(areaTag)
			else:
				for i, j in zip(elements, locationPts):
					location = Autodesk.Revit.DB.UV(toRvtPoint(j).X, toRvtPoint(j).Y)
					areaTag = doc.Create.NewAreaTag(views,i,location)
					areaTag.AreaTagType = tagType
					areaTag.TagOrientation = spTagOrientation
					areaTag.HasLeader = leader
					roomTags.append(areaTag)
			TransactionManager.Instance.TransactionTaskDone()
			result = roomTags
		elif tagType.Category.Id == ElementId(BuiltInCategory.OST_MultiCategoryTags):
			TransactionManager.Instance.EnsureInTransaction(doc)
			multitags = []
			if isinstance(IN[0], list):
				for j in views:
					for i,k in zip(elements, locationPts):
						if link != None:
							reference = Reference(i).CreateLinkReference(link)
						else:
							reference = Reference(i)
						location = toRvtPoint(k)
						tag = IndependentTag.Create(doc,j.Id, reference, 	leader, TagMode.TM_ADDBY_MULTICATEGORY, 	tagOrientation, location)
						tag.ChangeTypeId(tagTypeId)
						if link == None:
							multitags.append(tag)
						else:
							multitags.append(ueWrapper.Invoke(None,(tag, True)))
			else:
				for i, j in zip(elements, locationPts):
					if link != None:
						reference = Reference(i).CreateLinkReference(link)
					else:
						reference = Reference(i)
					location = toRvtPoint(j)
					tag = IndependentTag.Create(doc, views.Id, reference, leader, TagMode.TM_ADDBY_MULTICATEGORY, tagOrientation, location)
					tag.ChangeTypeId(tagTypeId)
					if link == None:
						multitags.append(tag)
					else:
						multitags.append(ueWrapper.Invoke(None,(tag, True)))
			TransactionManager.Instance.TransactionTaskDone()
			result = multitags
		elif tagType.Category.Id == ElementId(BuiltInCategory.OST_MaterialTags):
			TransactionManager.Instance.EnsureInTransaction(doc)
			Mattags = []
			if isinstance(IN[0], list):
				for j in views:
					for i,k in zip(elements, locationPts):
						if link != None:
							reference = Reference(i).CreateLinkReference(link)
						else:
							reference = Reference(i)
						location = toRvtPoint(k)
						tag = IndependentTag.Create(doc, j.Id, reference, leader, TagMode.TM_ADDBY_MATERIAL, tagOrientation, location)
						tag.ChangeTypeId(tagTypeId)
						if link == None:
							Mattags.append(tag)
						else:
							Mattags.append(ueWrapper.Invoke(None,(tag, True)))
			else:
				for i, j in zip(elements, locationPts):
					if link != None:
						reference = Reference(i).CreateLinkReference(link)
					else:
						reference = Reference(i)
					location = toRvtPoint(j)
					tag = IndependentTag.Create(doc, views.Id, reference, leader, TagMode.TM_ADDBY_MATERIAL, tagOrientation, location)
					tag.ChangeTypeId(tagTypeId)
					if link == None:
						Mattags.append(tag)
					else:
						Mattags.append(ueWrapper.Invoke(None,(tag, True)))
			TransactionManager.Instance.TransactionTaskDone()
			result = Mattags
		elif tagType.Category.Id == ElementId(BuiltInCategory.OST_RebarTags) and version >= 2023:
			TransactionManager.Instance.EnsureInTransaction(doc)
			tags = []
			if isinstance(IN[0], list):
				for j in views:
					for i,k in zip(elements, locationPts):
						subelement = i.GetSubelements()[0]
						if link != None:
							reference = subelement.GetReference().CreateLinkReference(link)
						else:
							reference = subelement.GetReference()
						location = toRvtPoint(k)
						tag = IndependentTag.Create(doc, j.Id, reference, leader, TagMode.TM_ADDBY_CATEGORY, tagOrientation, location)
						tag.ChangeTypeId(tagTypeId)
						if link == None:
							tags.append(tag)
						else:
							tags.append(ueWrapper.Invoke(None,(tag, True)))
				TransactionManager.Instance.TransactionTaskDone()
				result = tags
			else:
				for i, j in zip(elements, locationPts):
					subelement = i.GetSubelements()[0]
					if link != None:
						reference = subelement.GetReference().CreateLinkReference(link)
					else:
						reference = subelement.GetReference()
					location = toRvtPoint(j)
					tag = IndependentTag.Create(doc, views.Id, reference, leader, TagMode.TM_ADDBY_CATEGORY, tagOrientation, location)
					tag.ChangeTypeId(tagTypeId)
					if link == None:
						tags.append(tag)
					else:
						tags.append(ueWrapper.Invoke(None,(tag, True)))
			TransactionManager.Instance.TransactionTaskDone()
			result = tags
		else:
			TransactionManager.Instance.EnsureInTransaction(doc)
			tags = []
			if isinstance(IN[0], list):
				for j in views:
					for i,k in zip(elements, locationPts):
						if link != None:
							reference = Reference(i).CreateLinkReference(link)
						else:
							reference = Reference(i)
						location = toRvtPoint(k)
						tag = IndependentTag.Create(doc, j.Id, reference, leader, TagMode.TM_ADDBY_CATEGORY, tagOrientation, location)
						tag.ChangeTypeId(tagTypeId)
						if link == None:
							tags.append(tag)
						else:
							tags.append(ueWrapper.Invoke(None,(tag, True)))
			else:
				for i, j in zip(elements, locationPts):
					if link != None:
						reference = Reference(i).CreateLinkReference(link)
					else:
						reference = Reference(i)
					location = toRvtPoint(j)
					tag = IndependentTag.Create(doc, views.Id, reference, leader, TagMode.TM_ADDBY_CATEGORY, tagOrientation, location)
					tag.ChangeTypeId(tagTypeId)
					if link == None:
						tags.append(tag)
					else:
						tags.append(ueWrapper.Invoke(None,(tag, True)))
			TransactionManager.Instance.TransactionTaskDone()
			result = tags
	else:
		result = "RunIt is set to False."
except:
	# if error accurs anywhere in the process catch it
	import traceback
	errorReport = traceback.format_exc()

#Assign your output to the OUT variable
if errorReport == None:
	OUT = result
else:
	OUT = errorReport
# ----------------------------------------
Tag = Output(python)
