# Dynamo custom node Curves FromHatch.dyf (Dynamo 2.12.1.8246)
# category: GeniusLoci.CAD Import
# Gets the boundaries of the hatches from a CAD link or import.
# By Cyril Poupin on the Dynamo Forum

importInstance = Input(importInstance: var[]..[])
layerName = Input(layerName: var[]..[] = null)  # Optional input
python_script = Python(IN[0]=importInstance, IN[1]=layerName)  # IronPython2
# ---------- python_script.python (52 lines) ----------
#By Cyril Poupin on the Dynamo Forum
#https://forum.dynamobim.com/t/get-face-from-cad-dwg/70043/3

import clr
clr.AddReference('ProtoGeometry')
from Autodesk.DesignScript.Geometry import *
import Autodesk.DesignScript.Geometry as DS

clr.AddReference('RevitAPI')
import Autodesk
from Autodesk.Revit.DB import *

clr.AddReference('RevitNodes')
import Revit
clr.ImportExtensions(Revit.GeometryConversion)

import System

assemblies = System.AppDomain.CurrentDomain.GetAssemblies()
dynamo_asm = next((a for a in assemblies if a.GetName().Name == 'DynamoCore'),None)
dynamo_version = str(dynamo_asm.GetName().Version)
dynamo_version = tuple(int(x) for x in dynamo_version.split("."))

importinstances = UnwrapElement(IN[0]) if isinstance(IN[0],list) else [UnwrapElement(IN[0])]

polycurves = []
opt = Options()
for importinstance in importinstances:
	geoSet = importinstance.get_Geometry(opt)
	for geo in geoSet:
		if isinstance(geo, GeometryInstance):
			for g in  geo.GetInstanceGeometry():
				if isinstance(g, Solid) and g.Volume == 0 :
					for f in g.Faces:
						gstyleName = importinstance.Document.GetElement(f.GraphicsStyleId).GraphicsStyleCategory.Name
						if gstyleName == IN[1] :
							for loopCurve in f.GetEdgesAsCurveLoops():
								if dynamo_version >= (2,16,0):
									ds_polycurv = DS.PolyCurve.ByJoinedCurves([x.ToProtoType() for x in loopCurve], 0.001, False, 0)
								else:
									ds_polycurv = DS.PolyCurve.ByJoinedCurves(x.ToProtoType() for x in loopCurve)
								polycurves.append(ds_polycurv)
						elif IN[1] == None :
							for loopCurve in f.GetEdgesAsCurveLoops():
								if dynamo_version >= (2,16,0):
									ds_polycurv = DS.PolyCurve.ByJoinedCurves([x.ToProtoType() for x in loopCurve], 0.001, False, 0)
								else:
									ds_polycurv = DS.PolyCurve.ByJoinedCurves(x.ToProtoType() for x in loopCurve)
								polycurves.append(ds_polycurv)
								
if isinstance(IN[0], list): OUT = polycurves 
else: OUT = polycurves[0]
# ----------------------------------------
PolyCurve = Output(python_script)
