# Dynamo custom node DeleteWorkset.dyf (Dynamo 2.12.1.8246)
# category: GeniusLoci.Workset
# Works only in Revit 2022.1 and later.
# Delete the given workset.
# Please checkout the workset before executing this method.
# The workset must be editable by the current user.

WorksetId = Input(WorksetId: int[]..[])  # Workset to delete
DeleteWorksetOption = Input(DeleteWorksetOption: string[]..[] = "MoveElementsToWorkset")  # MoveElementsToWorkset = Delete a workset, while moving the elements from the deleted workset to another workset. DeleteAllElements = Delete a workset together with all the elements in this workset.
WorksetId_2 = Input(WorksetId: int[]..[] = null)  # Optional input for MoveElementsToWorkset option Move the elements from the deleted workset to another workset
python_script = Python(IN[0]=WorksetId, IN[1]=DeleteWorksetOption, IN[2]=WorksetId_2)  # IronPython2
# ---------- python_script.python (37 lines) ----------
#Alban de Chasteigner 2021
#twitter : @geniusloci_bim
#geniusloci.bim@gmail.com
#https://github.com/albandechasteigner/GeniusLociForDynamo

import clr
clr.AddReference("RevitServices")
import RevitServices
from RevitServices.Persistence import DocumentManager
from RevitServices.Transactions import TransactionManager
doc = DocumentManager.Instance.CurrentDBDocument
# Import RevitAPI
clr.AddReference("RevitAPI")
import Autodesk
from Autodesk.Revit.DB import *

ids = IN[0] if isinstance(IN[0],list) else [IN[0]]
option = IN[1]
deleteId = IN[2] if isinstance(IN[2],list) else [IN[2]]
names = []

if option == "MoveElementsToWorkset" :
	deleteWorksetSettings = DeleteWorksetSettings(DeleteWorksetOption.MoveElementsToWorkset,WorksetId(deleteId[0]))
else:
	deleteWorksetSettings = DeleteWorksetSettings()

TransactionManager.Instance.EnsureInTransaction(doc)
for worksetId in ids :
	if WorksetTable.CanDeleteWorkset(doc,WorksetId(worksetId),deleteWorksetSettings):
		WorksetTable.DeleteWorkset(doc,WorksetId(worksetId),deleteWorksetSettings)
		names.append(doc.GetWorksetTable().GetWorkset(WorksetId(worksetId)).Name)
	else:
		names.append("The workset is not editable by the current user or is owned by other user")
TransactionManager.Instance.TransactionTaskDone()

if isinstance(IN[0], list): OUT = names
else: OUT = names[0]
# ----------------------------------------
DeletedWorksetName = Output(python_script)
