# Dynamo custom node Dimension ByReferences.dyf (Dynamo 2.12.0.5650)
# category: GeniusLoci.Dimension
# Creates a new linear dimension from at least two geometric references of an object.

view = Input(view: Revit.Elements.Views.View = Revit.Application.Document.Current.ActiveView)  # View to place dimension in
line = Input(line: Autodesk.DesignScript.Geometry.Curve[]..[])  # Location of the dimension
references = Input(references: var[]..[])  # Autodesk.Revit.DB.Reference
dimensionType = Input(dimensionType: var[]..[] = null)
dimensionWithReference = Python(IN[0]=view, IN[1]=line, IN[2]=references, IN[3]=dimensionType)  # IronPython2
# ---------- dimensionWithReference.python (57 lines) ----------
#Alban de Chasteigner 2019
#twitter : @geniusloci_bim
#geniusloci.bim@gmail.com

import clr
clr.AddReference('RevitAPI')
from Autodesk.Revit.DB import *

clr.AddReference('RevitNodes')
import Revit
clr.ImportExtensions(Revit.GeometryConversion)
clr.ImportExtensions(Revit.Elements)

clr.AddReference('RevitServices')
import RevitServices
from RevitServices.Persistence import DocumentManager
from RevitServices.Transactions import TransactionManager

doc = DocumentManager.Instance.CurrentDBDocument

def tolist(obj1):
    if hasattr(obj1,"__iter__"): return obj1
    else: return [obj1]

views = tolist(UnwrapElement(IN[0]))
lines = tolist(IN[1])
if any(isinstance(el, list) for el in IN[2]) : referenceList =  IN[2]
else : referenceList = [(IN[2])]
dimensionType = tolist(UnwrapElement(IN[3]))[0]
listRef,dimList = [], []

#Thanks to Gavin Crump for the list structure improvement
for references in referenceList :
	elementsRef = ReferenceArray()
	for reference in references :
		elementsRef.Append(reference)
	listRef.append(elementsRef)
	
TransactionManager.Instance.EnsureInTransaction(doc)
for view in views:
	dims = []
	for line,refer in zip(lines,listRef) :
		if doc.IsFamilyDocument == True :
			if IN[3]== None: 
				dims.append(doc.FamilyCreate.NewDimension(view, line.ToRevitType(), refer).ToDSType(True))
			else:
				dims.append(doc.FamilyCreate.NewDimension(view, line.ToRevitType(), refer, dimensionType).ToDSType(True))
		else:
			if IN[3]== None: 
				dims.append(doc.Create.NewDimension(view, line.ToRevitType(), refer).ToDSType(True))
			else:
				dims.append(doc.Create.NewDimension(view, line.ToRevitType(), refer, dimensionType).ToDSType(True))
	dimList.append(dims)
TransactionManager.Instance.TransactionTaskDone()

if isinstance(IN[0], list): OUT = dimList
else: OUT = dimList[0]
# ----------------------------------------
Dimension = Output(dimensionWithReference)
