# Dynamo custom node Dimension Properties.dyf (Dynamo 2.6.1.8786)
# category: GeniusLoci.Dimension
# Returns the origin of the dimension, the dimension's curve, the value, the text position, the prefix, the suffix, the value override and all elements that are referenced by the given dimension

dimension = Input(dimension: var[]..[])
python_script = Python(IN[0]=dimension)
# ---------- python_script.python (78 lines) ----------
#Alban de Chasteigner 2020
#twitter : @geniusloci_bim
#geniusloci.bim@gmail.com

import clr
clr.AddReference('RevitAPI')
import Autodesk
from Autodesk.Revit.DB import *

clr.AddReference("RevitNodes")
import Revit
clr.ImportExtensions(Revit.GeometryConversion)

clr.AddReference("RevitServices")
import RevitServices
from RevitServices.Persistence import DocumentManager
doc = DocumentManager.Instance.CurrentDBDocument
uiapp = DocumentManager.Instance.CurrentUIApplication
app = uiapp.Application
version=int(app.VersionNumber)

if version < 2021:
	UIunit = doc.GetUnits().GetFormatOptions(UnitType.UT_Length).DisplayUnits
else:
	UIunit = doc.GetUnits().GetFormatOptions(SpecTypeId.Length).GetUnitTypeId()

elements = UnwrapElement(IN[0]) if isinstance(IN[0],list) else [UnwrapElement(IN[0])]

segment,origin,txtPosition,values,curve,prefix,suffix,override,refe,refElements,label=[],[],[],[],[],[],[],[],[],[],[]

for elem in elements:
	if elem.DimensionShape == DimensionShape.Linear:
		direction = elem.Curve.Direction
	refElements.append([elem.Document.GetElement(ref.ElementId) for ref in elem.References])
	refe.append(elem.References)
	if doc.IsFamilyDocument == True :
		if elem.FamilyLabel != None:
			label.append(elem.FamilyLabel.Definition.Name)
		else:	
			label.append(None)
	else:
		label.append(None)
	if elem.NumberOfSegments ==0:
		origin.append(elem.Origin.ToPoint())
		if elem.DimensionShape == DimensionShape.Linear:
			txtPosition.append(elem.TextPosition.ToPoint())
			values.append(round(UnitUtils.ConvertFromInternalUnits(elem.Value,UIunit),10))
			start = elem.Origin.Subtract(direction.Multiply(elem.Value/2))
			end = elem.Origin.Subtract(direction.Multiply(-elem.Value/2))
			curve.append(Line.CreateBound(start,end).ToProtoType())
		prefix.append(elem.Prefix)
		suffix.append(elem.Suffix)
		if elem.ValueOverride !=None:
			override.append(elem.ValueOverride)
		else:
			override.append(False)
	else:
		for segment in elem.Segments:
			origin.append(segment.Origin.ToPoint())
			txtPosition.append(segment.TextPosition.ToPoint())
			value = round(UnitUtils.ConvertFromInternalUnits(segment.Value,UIunit),10)
			values.append(value)
			start = segment.Origin.Subtract(direction.Multiply(segment.Value/2))
			end = segment.Origin.Subtract(direction.Multiply(-segment.Value/2))
			if value != 0 :
				curve.append(Line.CreateBound(start,end).ToProtoType())
			else :
				curve.append(None)
			prefix.append(segment.Prefix)
			suffix.append(segment.Suffix)
			if segment.ValueOverride !=None:
				override.append(segment.ValueOverride)
			else:
				override.append(False)
			#leader.append(segment.LeaderEndPosition.ToPoint())

if isinstance(IN[0], list): OUT = origin,curve,values,txtPosition,prefix,suffix,override,refElements,refe, label
else: OUT = origin,curve,values,txtPosition,prefix,suffix,override,refElements[0],refe[0], label
# ----------------------------------------
code_block = CodeBlock(x=python_script) { x[0]; x[1]; x[2]; x[3]; x[4]; x[5]; x[6]; x[7]; x[8]; x[9]; }
Origin = Output(code_block.out0)
Curve = Output(code_block.out1)
Value = Output(code_block.out2)
TextPosition = Output(code_block.out3)
Prefix = Output(code_block.out4)
Suffix = Output(code_block.out5)
ValueOverride = Output(code_block.out6)
ReferencedElements = Output(code_block.out7)  # Returns all elements that are referenced by the dimension
References = Output(code_block.out8)  # Returns the geometric references to which the dimension is attached.
Label = Output(code_block.out9)  # Returns the associated family parameter of a dimension label (if any) in a family document
