# Dynamo custom node Dimension ReferencedElements.dyf (Dynamo 2.6.1.8786)
# category: GeniusLoci.Dimension
# Returns all elements that are referenced by a dimension. Works also for dimension of linked elements.

dimension = Input(dimension: var[]..[])
docOrRevitLinkInstance = Input(docOrRevitLinkInstance: var[]..[] = null)  # Use only if you want to query a linked model
python_script = Python(IN[0]=dimension, IN[1]=docOrRevitLinkInstance)
# ---------- python_script.python (31 lines) ----------
#Inspired by a script of Andreas Dieckmann
#Added the ability to retrieve linked Referenced Elements

import clr
clr.AddReference('RevitAPI')
from Autodesk.Revit.DB import *

clr.AddReference("RevitServices")
import RevitServices
from RevitServices.Persistence import DocumentManager

dimensions = UnwrapElement(IN[0])
inputdoc = UnwrapElement(IN[1]) if isinstance(IN[1],list) else [UnwrapElement(IN[1])][0]

if inputdoc == None:
	doc = DocumentManager.Instance.CurrentDBDocument
elif inputdoc.GetType().ToString() == "Autodesk.Revit.DB.Document":
	doc = inputdoc
elif inputdoc.GetType().ToString() == "Autodesk.Revit.DB.RevitLinkInstance":
	doc = inputdoc.GetLinkDocument()

def GetDimensionReferences(item):
	if hasattr(item, "References"):
		if inputdoc != None:	
			return [doc.GetElement(x.LinkedElementId) for x in item.References]
		else:
			return [item.Document.GetElement(x.ElementId) for x in item.References]
	else: return None
	
if isinstance(IN[0], list): OUT = [GetDimensionReferences(x) for x in dimensions]
else: OUT = GetDimensionReferences(dimensions)
# ----------------------------------------
Element = Output(python_script)
