# Dynamo custom node Duct Surfaces References.dyf (Dynamo 2.6.1.8786)
# category: GeniusLoci.Reference
# Retrieve the top, bottom, sides, ends surfaces and their associated references of the rectangular duct or the cable Tray.

element = Input(element: var[]..[])  # rectangular duct or cable tray
python_script = Python(IN[0]=element)
# ---------- python_script.python (50 lines) ----------
#Alban de Chasteigner 2020
#twitter : @geniusloci_bim
#geniusloci.bim@gmail.com

import clr
clr.AddReference('RevitAPI')
from Autodesk.Revit.DB import *
import Autodesk

clr.AddReference('RevitNodes')
import Revit
clr.ImportExtensions(Revit.GeometryConversion)

items  = UnwrapElement(IN[0]) if isinstance(IN[0],list) else [UnwrapElement(IN[0])]

ends,refEnds,sides,refSides,top,refTop,bottom,refBot = [],[],[],[],[],[],[],[]
opt = Options()
opt.ComputeReferences = True

for item in items:
	#System families
	if hasattr(item, "FindInserts") :
		faceList,faceArray = [],[]
		for obj in item.get_Geometry(opt):
			for face in obj.Faces: 
				faceList.append(face.ToProtoType()[0])
				faceArray.append(face.Reference)
			if isinstance(item, Mechanical.Duct):
				ends.append(faceList[:2])
				refEnds.append(faceArray[:2])
				sides.append(faceList[3:6:2])
				refSides.append(faceArray[3:6:2])
				top.append(faceList[4])
				refTop.append(faceArray[4])
				bottom.append(faceList[2])
				refBot.append(faceArray[2])
			elif isinstance(item, Electrical.CableTray):
				ends.append(faceList[:2])
				refEnds.append(faceArray[:2])
				sides.append(faceList[2:5:2])
				refSides.append(faceArray[2:5:2])
				top.append(faceList[3])
				refTop.append(faceArray[3])
				bottom.append(faceList[5])
				refBot.append(faceArray[5])
	else:
		pass
		
if isinstance(IN[0], list): OUT = top,refTop,bottom,refBot,sides,refSides,ends,refEnds
else: OUT = top[0],refTop[0],bottom[0],refBot[0],sides[0],refSides[0],ends[0],refEnds[0]
# ----------------------------------------
code_block = CodeBlock(x=python_script) { x[0]; x[1]; x[2]; x[3]; x[4]; x[5]; x[6]; x[7]; }
Top_Surface = Output(code_block.out0)
Top_Reference = Output(code_block.out1)
Bottom_Surface = Output(code_block.out2)
Bottom_Reference = Output(code_block.out3)
Sides_Surfaces = Output(code_block.out4)
Sides_References = Output(code_block.out5)
Ends_Surface = Output(code_block.out6)
Ends_References = Output(code_block.out7)
