# Dynamo custom node Element ChangeType.dyf (Dynamo 2.12.1.8246)
# category: GeniusLoci.Element
# Changes the type of the given instance to the specified type.

element = Input(element: var[]..[])
elementType = Input(elementType: var[]..[])
python_script = Python(IN[0]=element, IN[1]=elementType)  # IronPython2
# ---------- python_script.python (63 lines) ----------
#Cyril Poupin on Dynamo Forum https://forum.dynamobim.com/t/change-pipe-type-error/71196/6
import clr
clr.AddReference('RevitAPI')
import Autodesk
from Autodesk.Revit.DB import *

clr.AddReference('RevitServices')
import RevitServices
from RevitServices.Persistence import DocumentManager
from RevitServices.Transactions import TransactionManager
doc = DocumentManager.Instance.CurrentDBDocument

toList = lambda x : x if hasattr(x, '__iter__') else [x]
lstElems = toList(UnwrapElement(IN[0]))
newType = toList(UnwrapElement(IN[1]))
ftp_len = len(newType) == 1

lstErrorElementIds,lstSuccessElements = [],[]

class CreateFailureAdvancedHandler(IFailuresPreprocessor): #You can get information out, but you would need to create your own class to store the information. IFailurePreprocessor is more for resolving the messages beforehand.
	def __init__(self):
		self.lstErrorElementIds = []
		
	def PreprocessFailures(self, failuresAccessor): #The implementation of the PreprocessFailures method has an argument failuresAccessor which is used for reviewing and dealing with failure messages.
		failMessages = failuresAccessor.GetFailureMessages()
		if failMessages.Count == 0:
			return FailureProcessingResult.Continue
		transName = failuresAccessor.GetTransactionName()  #Retrieves the name of the transaction for which failures are being processed.
		if transName == "ChangeType":
			# if alert is an warn remove it 
			if failuresAccessor.GetSeverity() == FailureSeverity.Warning:
				for currentMessage in failMessages:	
					failuresAccessor.DeleteWarning(currentMessage)  
				return FailureProcessingResult.Continue
			# if alert is an error resolve it (by delete elements or by split group etc...)       
			elif failuresAccessor.GetSeverity() == FailureSeverity.Error:
				for currentMessage in failMessages:
					self.lstErrorElementIds.extend(currentMessage.GetFailingElementIds())
					failuresAccessor.ResolveFailure(currentMessage)
				return FailureProcessingResult.ProceedWithCommit
			else:
				pass      
		return FailureProcessingResult.Continue

TransactionManager.Instance.ForceCloseTransaction()
with Transaction(doc) as t:
	t.Start("ChangeType")
	failureOptions = t.GetFailureHandlingOptions() 
	handler = CreateFailureAdvancedHandler()
	failureOptions.SetFailuresPreprocessor(handler)
	t.SetFailureHandlingOptions(failureOptions)
	try:
		for i in xrange(len(lstElems)):
			e = lstElems[i]
			j = 0 if ftp_len else i
			e.ChangeTypeId(newType[j].Id)
	except:pass
	t.Commit()

lstSuccessElements = [x for x in lstElems if x.IsValidObject and  x.Id not in handler.lstErrorElementIds]
lstErrorElements = [x for x in lstElems if x.IsValidObject and  x.Id in handler.lstErrorElementIds]

OUT = lstSuccessElements,lstErrorElements
# ----------------------------------------
code_block = CodeBlock(x=python_script) { x[0]; x[1]; }
SuccessElements = Output(code_block.out0)
ErrorElements = Output(code_block.out1)
