# Dynamo custom node Element Duplicate.dyf (Dynamo 2.6.1.8786)
# category: GeniusLoci.Element
# Duplicates the given element (view, element type).

element = Input(element: var)
name = Input(name: var)
python_script = Python(IN[0]=element, IN[1]=name)
# ---------- python_script.python (29 lines) ----------
import clr
clr.AddReference('RevitAPI')
import Autodesk
from Autodesk.Revit.DB import *

clr.AddReference('RevitServices')
import RevitServices
from RevitServices.Persistence import DocumentManager
from RevitServices.Transactions import TransactionManager
from System.Collections.Generic import*

doc = DocumentManager.Instance.CurrentDBDocument

elements = UnwrapElement(IN[0]) if isinstance(IN[0],list) else [UnwrapElement(IN[0])]
names = IN[1] if isinstance(IN[1],list) else [IN[1]]
newElems=[]

idList = List[ElementId]([elem.Id for elem in elements])

TransactionManager.Instance.EnsureInTransaction(doc)
copyid = ElementTransformUtils.CopyElements(doc, idList, doc, Transform.Identity, CopyPasteOptions())
for id,name in zip(copyid,names) :
	newElem = doc.GetElement(id)
	newElem.Name = unicode(name)
	newElems.append(newElem)
TransactionManager.Instance.TransactionTaskDone()

if isinstance(IN[0], list): OUT = newElems
else: OUT = newElems[0]
# ----------------------------------------
element_2 = Output(python_script)  # "element"
