# Dynamo custom node Element Elevation.dyf (Dynamo 2.6.1.8786)
# category: GeniusLoci.Element
# Return the elevation (Z value) of the given element.

element = Input(element: var[]..[])
python_script = Python(IN[0]=element)
# ---------- python_script.python (69 lines) ----------
#Alban de Chasteigner 202
#twitter : @geniusloci_bim
#geniusloci.bim@gmail.com
#https://github.com/albandechasteigner/GeniusLociForDynamo

import clr
# Import RevitAPI Classes
clr.AddReference('RevitAPI')
import Autodesk
from Autodesk.Revit.DB import *

clr.AddReference("RevitNodes")
import Revit
clr.ImportExtensions(Revit.GeometryConversion)

clr.AddReference("RevitServices")
import RevitServices
from RevitServices.Persistence import DocumentManager
from RevitServices.Transactions import TransactionManager
doc = DocumentManager.Instance.CurrentDBDocument

elements = UnwrapElement(IN[0]) if isinstance(IN[0],list) else [UnwrapElement(IN[0])]
result=[]

for element in elements :
	if hasattr(element, "Location"):
		loc = element.Location
		if loc:	
			# point-based elements (e.g. most loadable families)
			if isinstance(loc,LocationPoint):
				loca=loc.Point
			# line-based elements (e.g. walls)
			elif isinstance(loc,LocationCurve):
				try:loca=loc.Curve.Evaluate(0.5,True)
				except:loca=loc.Curve.Evaluate(0.5, False)
			elif isinstance(element,Instance):
				loca = element.GetTotalTransform().Origin
			elif hasattr(element, "Origin"):
				loca = element.Origin
			##Section Marker and ReferenceElevationMarker(Doesn't work for ReferenceElevationMarker)
			elif ElementId(BuiltInCategory.OST_Viewers) == element.Category.Id :
				viewSection = doc.GetElement(ElementId(element.Id.IntegerValue + 1))
				loca = viewSection.Origin
			#Elevation Marker
			elif isinstance(element,Autodesk.Revit.DB.ElevationMarker) :
				marker = doc.GetElement(ElementId(element.Id.IntegerValue + 1))
				box=marker.BoundingBox[doc.ActiveView]
				loca = (box.Min+box.Max)/2
			# Grid	
			elif isinstance(element,Autodesk.Revit.DB.Grid):
				loca=element.Curve.Evaluate(0.5,True)
			# view specific elements (e.g. filled regions)
			elif hasattr(element, "OwnerViewId") and element.OwnerViewId != ElementId.InvalidElementId :
				view=element.Document.GetElement(element.OwnerViewId)
				box = element.BoundingBox[view]
				loca = (box.Min+box.Max)/2
			# sketch-based elements (e.g. floors)
			else :
				box = element.get_BoundingBox(None)
				loca = (box.Min+box.Max)/2
			result.append(loca.ToPoint().Z)
	elif hasattr(element, "OwnerViewId"):
		view=element.Document.GetElement(element.OwnerViewId)
		box = element.BoundingBox[view]
		loca = (box.Min+box.Max)/2
		result.append(loca.ToPoint().Z)

if isinstance(IN[0], list): OUT = result
else: OUT = result[0]
# ----------------------------------------
double = Output(python_script)
