# Dynamo custom node Element GetLoadableFamily.dyf (Dynamo 2.6.2.15705)
# category: GeniusLoci.Family
# Get the loadable family from the given element.

element = Input(element: var[]..[])
python_script = Python(IN[0]=element)
# ---------- python_script.python (27 lines) ----------
#Alban de Chasteigner 2020
#twitter : @geniusloci_bim
#geniusloci.bim@gmail.com
#https://github.com/albandechasteigner/GeniusLociForDynamo

import clr
clr.AddReference("RevitAPI")
import Autodesk
from Autodesk.Revit.DB import FilteredElementCollector, Family

elements = UnwrapElement(IN[0]) if isinstance(IN[0],list) else [UnwrapElement(IN[0])]
families,familyNames = [],[]

for elem in elements :
	if elem :
		doc = elem.Document
		try:
			familyName = doc.GetElement(elem.GetTypeId()).FamilyName
			coll=FilteredElementCollector(doc).OfClass(Family).ToElements().Find(lambda x :  x.Name == familyName)
			families.append(coll)
			familyNames.append(familyName)
		except:
			families.append(None)
			familyNames.append(None)
	
if isinstance(IN[0], list): OUT = families,familyNames
else: OUT = families[0],familyNames[0]
# ----------------------------------------
code_block = CodeBlock(x=python_script) { x[0]; x[1]; }
Family = Output(code_block.out0)
FamilyName = Output(code_block.out1)
