# Dynamo custom node Element GetRotation.dyf (Dynamo 2.6.1.8786)
# category: GeniusLoci.Element
# Calculates the rotation angle between the given element and the X axis.
# Works for point/ line/ sketch based elements and link instances.

element = Input(element: var[]..[])  # element or Dynamo line
python_script = Python(IN[0]=element)
# ---------- python_script.python (82 lines) ----------
#Alban de Chasteigner 2020
#twitter : @geniusloci_bim
#geniusloci.bim@gmail.com
#https://github.com/albandechasteigner/GeniusLociForDynamo

import clr
import math
clr.AddReference('RevitAPI')
import Autodesk
from Autodesk.Revit.DB import *
clr.AddReference('RevitNodes')
import Revit
clr.ImportExtensions(Revit.GeometryConversion)

items = UnwrapElement(IN[0]) if isinstance(IN[0],list) else [UnwrapElement(IN[0])]

def GetRotation(item):
	# Dynamo lines
	if hasattr(item, "Explode"):
		vector = item.ToRevitType().Direction
		rotationAngle = math.degrees(vector.AngleOnPlaneTo(XYZ.BasisX, XYZ.BasisZ))
	# CropBox	
	elif item.Category == None :
		view=item.Document.GetElement(item.get_Parameter(BuiltInParameter.ID_PARAM).AsElementId())
		line=view.GetCropRegionShapeManager().GetCropShape()
		vector = [l.Direction for l in line[0]]
		rotationAngle = math.degrees(vector[1].AngleOnPlaneTo(XYZ.BasisX, XYZ.BasisZ))
	elif hasattr(item, "Location"):
		loc = item.Location
		if loc:	
			# Generic Annotation, importInstance and linkInstance
			if hasattr(item, "GetTotalTransform"):
				trans=item.GetTotalTransform()
				rotationAngle = math.degrees(trans.BasisX.AngleOnPlaneTo(XYZ.BasisX, XYZ.BasisZ))
				rotationAngle=abs(rotationAngle-360)
			# point-based elements (e.g. most loadable families)
			elif isinstance(loc,LocationPoint):
				if hasattr(loc, "Rotation"):
					rotationAngle = math.degrees(loc.Rotation)
				# Group, assembly
				else:rotationAngle = 0
			elif isinstance(item,MEPCurve):
				for c in item.ConnectorManager.Connectors :
					rotationAngle = math.asin(c.CoordinateSystem.BasisY.X) * 180/math.pi
			elif isinstance(item,Grid):
				vector = item.Curve.Direction
				rotationAngle = abs(math.degrees(vector.AngleOnPlaneTo(XYZ.BasisX, XYZ.BasisZ))-180)
			elif isinstance(item,ReferencePlane):
				doc=item.Document
				view = doc.ActiveView
				for crv in item.GetCurvesInView(DatumExtentType.ViewSpecific,view):
					vector = crv.Direction
				rotationAngle = abs(math.degrees(vector.AngleOnPlaneTo(XYZ.BasisX, XYZ.BasisZ))-360)
			# line-based elements (e.g. walls)
			elif isinstance(loc,LocationCurve):
				vector = loc.Curve.Direction
				rotationAngle = abs(math.degrees(vector.AngleOnPlaneTo(XYZ.BasisX, XYZ.BasisZ))-360)
			else:
				# sketch-based elements (ceiling, floor and roof)
				if hasattr(item, "FindInserts"):
					for ref in HostObjectUtils.GetTopFaces(item):
						geomFace=item.GetGeometryObjectFromReference(ref)
						#Get BoundingBox max UV point
						maxUV = geomFace.GetBoundingBox().Max
						#Get transform
						trans=geomFace.ComputeDerivatives(maxUV)
						if isinstance(item,Ceiling):
							rotationAngle = math.degrees(abs(trans.BasisZ.AngleOnPlaneTo(XYZ.BasisX, XYZ.BasisZ)-2*math.pi))
						else:
							rotationAngle = math.degrees(abs(trans.BasisY.AngleOnPlaneTo(XYZ.BasisX, XYZ.BasisZ)-math.pi))
				else:
					rotationAngle=0
		else:
			rotationAngle=0
	if round(rotationAngle,3)==360:
		rotationAngle=0
	return round(rotationAngle,3)
	
rotations = [GetRotation(x) for x in items]

if isinstance(IN[0], list): OUT = rotations
else: OUT = rotations[0]
# ----------------------------------------
Degree = Output(python_script)  # Angle
