# Dynamo custom node Element Host.dyf (Dynamo 2.6.1.8786)
# category: GeniusLoci.Element
# Gets the host of the element.
# Unlike the OOTB node FamilyInstance.GetHost, it also works for elements hosted by a linked document, wall sweeps, foundations, railings and builing pads.
# Based on a Clockwork's node

element = Input(element: var[]..[])
python_script = Python(IN[0]=element)
# ---------- python_script.python (41 lines) ----------
import clr
clr.AddReference('RevitAPI')
import Autodesk
from Autodesk.Revit.DB import *

def GetHost(item):
	# family instance
	if hasattr(item, "Host") and item.Host != None and item.Host.ToString() != "Autodesk.Revit.DB.RevitLinkInstance" : return item.Host
	# element hosted by linked document
	elif hasattr(item, "Host") and item.Host != None and item.Host.ToString() == "Autodesk.Revit.DB.RevitLinkInstance":  
		linkdoc = item.Host.GetLinkDocument()
		return linkdoc.GetElement(item.HostFace.LinkedElementId)
	# Wall sweeps
	elif hasattr(item, "GetHostIds"): return [item.Document.GetElement(x) for x in item.GetHostIds()]
	# Wall foundations
	elif hasattr(item, "WallId"): return item.Document.GetElement(item.WallId)
	# railings, building pads
	elif hasattr(item, "HostId"): return item.Document.GetElement(item.HostId)
	# insulation
	elif hasattr(item, "HostElementId"): return item.Document.GetElement(item.HostElementId)
	# Rebar
	elif isinstance(item, Autodesk.Revit.DB.Structure.Rebar): return item.Document.GetElement(item.GetHostId())
	# parkings
	elif ElementId(BuiltInCategory.OST_Parking) == item.Category.Id and not item.get_Parameter(BuiltInParameter.INSTANCE_FREE_HOST_PARAM).AsString().startswith("Level")  : return item.get_Parameter(BuiltInParameter.INSTANCE_FREE_HOST_PARAM).AsString()
	#if item is work plane based
	elif not isinstance(item,Autodesk.Revit.DB.FamilyInstance) and item.get_Parameter(BuiltInParameter.SKETCH_PLANE_PARAM):
		try: 
			collector = FilteredElementCollector(item.Document).OfClass(Level).ToElements()
			return [level for level in collector if item.get_Parameter(BuiltInParameter.SKETCH_PLANE_PARAM).AsString().split(": ")[-1] == level.Name][0]
		except: 
			try:
				collector = FilteredElementCollector(item.Document).OfClass(ReferencePlane).ToElements()
				return [refP for refP in collector if item.get_Parameter(BuiltInParameter.SKETCH_PLANE_PARAM).AsString().split(": ")[-1] == refP.Name][0]
			except:	return item.get_Parameter(BuiltInParameter.SKETCH_PLANE_PARAM).AsString()
	#family instance hosted by a level	
	elif hasattr(item, "Host") and item.Host == None and hasattr(item, "LevelId"): return item.Document.GetElement(item.LevelId)
	else: return None

items = UnwrapElement(IN[0])
if isinstance(IN[0], list): OUT = [GetHost(x) for x in items]
else: OUT = GetHost(items)
# ----------------------------------------
Host = Output(python_script)
