# Dynamo custom node Element Level.dyf (Dynamo 2.6.1.8786)
# category: GeniusLoci.Level
# Gets an element's level.
# Based on a Clockwork's node

element = Input(element: var[]..[])
python_script = Python(IN[0]=element)
# ---------- python_script.python (77 lines) ----------
import clr
clr.AddReference('RevitAPI')
from Autodesk.Revit.DB import *

clr.AddReference("RevitNodes")
import Revit
clr.ImportExtensions(Revit.Elements)

#Definition by Daniel Woodcock
def get_sketch_ids(item):
	eIds = []
	t = Transaction(item.Document, "Temp")
	t.Start()   
	eIds = item.Document.Delete(item.Id) 
	t.RollBack()  
	return eIds
	
#Inspired by Clockwork
def GetLevel(item):
	val = None
	doc = item.Document
	if hasattr(item, "LevelId"): 
		val = doc.GetElement(item.LevelId)
		if val: return val
	if hasattr(item, "Level"):
		val = item.Level
		if val: return val
	if hasattr(item, "GenLevel"):
		val = item.GenLevel
		if val: return val
	if (item.GetType().ToString() in ("Autodesk.Revit.DB.Architecture.StairsRun", "Autodesk.Revit.DB.Architecture.StairsLanding")):
		item = item.GetStairs()
	if (item.GetType().ToString() == "Autodesk.Revit.DB.Architecture.Stairs") or item.Category.Id == ElementId(BuiltInCategory.OST_Ramps):
		try: return doc.GetElement(item.get_Parameter(BuiltInParameter.STAIRS_BASE_LEVEL_PARAM).AsElementId())
		except: pass
	if (item.GetType().ToString() == "Autodesk.Revit.DB.ExtrusionRoof"):
		try: return doc.GetElement(item.get_Parameter(BuiltInParameter.ROOF_CONSTRAINT_LEVEL_PARAM).AsElementId())
		except: pass
	if (item.GetType().ToString() == "Autodesk.Revit.DB.Mechanical.Duct" or "Autodesk.Revit.DB.Electrical.Conduit"):
		try: return doc.GetElement(item.get_Parameter(BuiltInParameter.RBS_START_LEVEL_PARAM).AsElementId())
		except: pass
	if hasattr(item, "OwnerViewId"):
		view = doc.GetElement(item.OwnerViewId)
		if hasattr(view, "GenLevel"):
			val = view.GenLevel
			if val: return val
	if not val:
		collector = FilteredElementCollector(doc).OfClass(Level).ToElements()
		if isinstance(item,FamilyInstance) and item.Symbol.Family.IsInPlace:
			ids = get_sketch_ids(item)
			elems = [doc.GetElement(id) for id in ids]
			lName = next((ex.get_Parameter(BuiltInParameter.SKETCH_PLANE_PARAM).AsString() for ex in elems if ex.GetType() == Extrusion), None)
			try: return [level for level in FilteredElementCollector(doc).OfClass(Level).ToElements() if lName.split(": ")[-1] == level.Name][0]
			except: return None
		else:
			try: return doc.GetElement(item.get_Parameter(BuiltInParameter.INSTANCE_REFERENCE_LEVEL_PARAM).AsElementId())
			except: 
				try: return doc.GetElement(item.get_Parameter(BuiltInParameter.INSTANCE_SCHEDULE_ONLY_LEVEL_PARAM).AsElementId())
				except: 
					try: return doc.GetElement(item.get_Parameter(BuiltInParameter.SCHEDULE_LEVEL_PARAM).AsElementId())
					except:
						#if item is work plane based
						try: return [level for level in collector if item.get_Parameter(BuiltInParameter.SKETCH_PLANE_PARAM).AsString().split(": ")[-1] == level.Name][0]
						except: return None

ProcessLists = lambda function, lists: [ProcessLists(function, item) if isinstance(item, list) else function(item) for item in lists]
ApplyFunction = lambda func, objs: ProcessLists(func, objs) if isinstance(objs, list) else [func(objs)]

def Unwrap(item):
    return UnwrapElement(item)
    
if isinstance(IN[0], list):
	items = ProcessLists(Unwrap, IN[0])
else:
	items = Unwrap(IN[0])

OUT=ApplyFunction(GetLevel,items)
# ----------------------------------------
level = Output(python_script)
