# Dynamo custom node Element Points References.dyf (Dynamo 2.6.1.8786)
# category: GeniusLoci.Reference
# Returns the references to the start and the end points of the curve based element.
# (Works best with coarse detail level for cable trays and conduits categories)

linearElement = Input(linearElement: var[]..[])  # Curve based element
python_script = Python(IN[0]=linearElement)
# ---------- python_script.python (35 lines) ----------
import clr
clr.AddReference('RevitAPI')
import Autodesk
from Autodesk.Revit.DB import Options,ReferenceArray,Line

clr.AddReference('RevitNodes')
import Revit
clr.ImportExtensions(Revit.GeometryConversion)

clr.AddReference('RevitServices')
import RevitServices
from RevitServices.Persistence import DocumentManager
doc = DocumentManager.Instance.CurrentDBDocument

items = UnwrapElement(IN[0]) if isinstance(IN[0],list) else [UnwrapElement(IN[0])]
	
allReferences,allPoints =[],[]

opt = Options()
opt.ComputeReferences = True
opt.IncludeNonVisibleObjects = True
opt.View = doc.ActiveView
for item in items:
	references = ReferenceArray()
	points=[]
	for obj in item.get_Geometry(opt):
		if isinstance(obj, Line):
			gline = obj
			references=gline.GetEndPointReference(0),gline.GetEndPointReference(1)
			points=gline.GetEndPoint(0).ToPoint(),gline.GetEndPoint(1).ToPoint()
	allReferences.append(references)
	allPoints.append(points)

if isinstance(IN[0], (list)): OUT = allReferences,allPoints
else: OUT = allReferences[0],allPoints[0]
# ----------------------------------------
code_block = CodeBlock(x=python_script) { x[0]; x[1]; }
References = Output(code_block.out0)
Points = Output(code_block.out1)
