# Dynamo custom node Element Reference.dyf (Dynamo 2.6.1.8786)
# category: GeniusLoci.Reference
# Gets the reference of a geometric object or a dimension or a reference plane.

element = Input(element: var[]..[])
python_script = Python(IN[0]=element)
# ---------- python_script.python (24 lines) ----------
import clr
clr.AddReference('RevitAPI')
import Autodesk
from Autodesk.Revit.DB import *

clr.AddReference("RevitServices")
import RevitServices
from RevitServices.Persistence import DocumentManager
doc = DocumentManager.Instance.CurrentDBDocument

elements = UnwrapElement(IN[0]) if isinstance(IN[0],list) else [UnwrapElement(IN[0])]

ref=[]
for element in elements:
	if isinstance (element, Autodesk.Revit.DB.Dimension):
		ref.append(element.References)
	elif isinstance (element, Autodesk.Revit.DB.ReferencePlane):
		ref.append(element.GetReference())
	elif isinstance (element, Autodesk.Revit.DB.Grid) and element.Document.Title != doc.Title :
		ref.append(element.Curve.Reference)
	else : ref.append(Reference(element))

if isinstance(IN[0], list): OUT = ref
else: OUT = ref[0]
# ----------------------------------------
Reference = Output(python_script)
