# Dynamo custom node Element SetLocation.dyf (Dynamo 2.6.1.8786)
# category: GeniusLoci.Element
# Modify the location of the given element.
# (Same as the Move command in Revit.)
# Works for point/ line/ sketch based elements, view-specific elements, groups and link instances.

element = Input(element: var)
location = Input(location: var)  # Point
python_script = Python(IN[0]=element, IN[1]=location)
# ---------- python_script.python (72 lines) ----------
#Alban de Chasteigner 2020
#twitter : @geniusloci_bim
#geniusloci.bim@gmail.com
#https://github.com/albandechasteigner/GeniusLociForDynamo

import clr
# Import RevitAPI Classes
clr.AddReference('RevitAPI')
import Autodesk
from Autodesk.Revit.DB import *

clr.AddReference("RevitNodes")
import Revit
clr.ImportExtensions(Revit.GeometryConversion)

clr.AddReference("RevitServices")
import RevitServices
from RevitServices.Persistence import DocumentManager
from RevitServices.Transactions import TransactionManager
doc = DocumentManager.Instance.CurrentDBDocument

elements = UnwrapElement(IN[0]) if isinstance(IN[0],list) else [UnwrapElement(IN[0])]
locations = IN[1] if isinstance(IN[1],list) else [IN[1]]

TransactionManager.Instance.EnsureInTransaction(doc)
for element,location in zip(elements,locations):
	if hasattr(element, "Location"):
		loc = element.Location
		if loc:	
			# point-based elements (e.g. most loadable families)
			if isinstance(loc,LocationPoint):
				loca=loc.Point
			# line-based elements (e.g. walls)
			elif isinstance(loc,LocationCurve):
				loca=loc.Curve.Evaluate(0.5,True)
			elif isinstance(element,Instance):
				loca = element.GetTotalTransform().Origin
			elif hasattr(element, "Origin"):
				loca = element.Origin
			##Section Marker and ReferenceElevationMarker(Doesn't work for ReferenceElevationMarker)
			elif ElementId(BuiltInCategory.OST_Viewers) == element.Category.Id :
				viewSection = doc.GetElement(ElementId(element.Id.IntegerValue + 1))
				loca = viewSection.Origin
			#Elevation Marker
			elif isinstance(element,Autodesk.Revit.DB.ElevationMarker) :
				marker = doc.GetElement(ElementId(element.Id.IntegerValue + 1))
				box=marker.BoundingBox[doc.ActiveView]
				loca = (box.Min+box.Max)/2
			# Grid	
			elif isinstance(element,Autodesk.Revit.DB.Grid):
				loca=element.Curve.Evaluate(0.5,True)
			# view specific elements (e.g. filled regions)
			elif hasattr(element, "OwnerViewId") and element.OwnerViewId != ElementId.InvalidElementId :
				view=element.Document.GetElement(element.OwnerViewId)
				box = element.BoundingBox[view]
				loca = (box.Min+box.Max)/2
			# sketch-based elements (e.g. floors)
			else :
				box = element.get_BoundingBox(None)
				loca = (box.Min+box.Max)/2
			ElementTransformUtils.MoveElement(doc,element.Id,location.ToRevitType()-loca)
	elif hasattr(element, "OwnerViewId"):
		view=element.Document.GetElement(element.OwnerViewId)
		box = element.BoundingBox[view]
		loca = (box.Min+box.Max)/2
		ElementTransformUtils.MoveElement(doc,element.Id,location.ToRevitType()-loca)
	elif isinstance(element,Leader):
		element.End=location.ToXyz()
TransactionManager.Instance.TransactionTaskDone()

if isinstance(IN[0], list): OUT = elements
else: OUT = elements[0]
# ----------------------------------------
Element = Output(python_script)
