# Dynamo custom node Element Surfaces References.dyf (Dynamo 2.12.0.5650)
# category: GeniusLoci.Reference
# Retrieve the top, bottom, side surfaces and their associated references of the system family.
# This doesn't work with cylindrical system families (pipe...)

element = Input(element: var[]..[])
python_script = Python(IN[0]=element)  # IronPython2
# ---------- python_script.python (150 lines) ----------
#Suggestion by Mark.Ackerley
#Alban de Chasteigner 2019
#twitter : @geniusloci_bim
#geniusloci.bim@gmail.com

import clr
clr.AddReference('RevitAPI')
from Autodesk.Revit.DB import *
import Autodesk

clr.AddReference('RevitNodes')
import Revit
clr.ImportExtensions(Revit.GeometryConversion)

items  = UnwrapElement(IN[0]) if isinstance(IN[0],list) else [UnwrapElement(IN[0])]

horizontaldown,horizontalup,verticals,refDown,refUp,refVer,XAxisList, XAxisRef, _XAxisList, _XAxisRef,YAxisList, YAxisRef, _YAxisList, _YAxisRef = [],[],[],[],[],[],[],[],[],[],[],[],[],[]
opt = Options()
opt.ComputeReferences = True

for item in items:
	#System families
	if hasattr(item, "FindInserts") or isinstance(item, Extrusion):
		downList,upList,vertical, XAxis, _XAxis, YAxis, _YAxis = [],[],[],[],[],[],[]
		downArray,upArray,verArray, XAxisArray, _XAxisArray, YAxisArray, _YAxisArray = ReferenceArray(),ReferenceArray(),ReferenceArray(),ReferenceArray(),ReferenceArray(),ReferenceArray(),ReferenceArray()
		for obj in item.get_Geometry(opt):
			for face in obj.Faces:
				faceNormal = face.FaceNormal
				if face.FaceNormal.IsAlmostEqualTo(XYZ(0,0,-1)):
					downList.append(face.ToProtoType()[0])
					downArray.Append(face.Reference)
				elif faceNormal.IsAlmostEqualTo(XYZ(0,0,1)):
					upList.append(face.ToProtoType()[0])
					upArray.Append(face.Reference)
				elif faceNormal.IsAlmostEqualTo(XYZ(1,0,0)):
					XAxis.append(face.ToProtoType()[0])
					XAxisArray.Append(face.Reference)
				elif faceNormal.IsAlmostEqualTo(XYZ(-1,0,0)):
					_XAxis.append(face.ToProtoType()[0])
					_XAxisArray.Append(face.Reference)
				elif faceNormal.IsAlmostEqualTo(XYZ(0,1,0)):
					YAxis.append(face.ToProtoType()[0])
					YAxisArray.Append(face.Reference)
				elif faceNormal.IsAlmostEqualTo(XYZ(0,-1,0)):
					_YAxis.append(face.ToProtoType()[0])
					_YAxisArray.Append(face.Reference)
				elif faceNormal.Z >= (0 - 1.0e-09) and faceNormal.Z <= (0 + 1.0e-09):
					vertical.append(face.ToProtoType()[0])
					verArray.Append(face.Reference)
			horizontaldown.append(downList)
			refDown.append(downArray)
			horizontalup.append(upList)
			refUp.append(upArray)
			XAxisList.append(XAxis)
			XAxisRef.append(XAxisArray)
			_XAxisList.append(_XAxis)
			_XAxisRef.append(_XAxisArray)
			YAxisList.append(YAxis)
			YAxisRef.append(YAxisArray)
			_YAxisList.append(_YAxis)
			_YAxisRef.append(_YAxisArray)
			verticals.append(vertical)
			refVer.append(verArray)
	elif isinstance(item, FamilyInstance) or isinstance(item, ImportInstance):
		downList,upList,vertical, XAxis, _XAxis, YAxis, _YAxis = [],[],[],[],[],[],[]
		downArray,upArray,verArray, XAxisArray, _XAxisArray, YAxisArray, _YAxisArray = ReferenceArray(),ReferenceArray(),ReferenceArray(),ReferenceArray(),ReferenceArray(),ReferenceArray(),ReferenceArray()
		for obj in item.get_Geometry(opt):
			if isinstance(obj,Solid) and obj.Volume > 0 :	
				for face in obj.Faces:
					faceNormal = face.FaceNormal
					if faceNormal.IsAlmostEqualTo(XYZ(0,0,-1)):
						downList.append(face.ToProtoType()[0])
						downArray.Append(face.Reference)
					elif faceNormal.IsAlmostEqualTo(XYZ(0,0,1)):
						upList.append(face.ToProtoType()[0])
						upArray.Append(face.Reference)
					elif faceNormal.IsAlmostEqualTo(XYZ(1,0,0)):
						XAxis.append(face.ToProtoType()[0])
						XAxisArray.Append(face.Reference)
					elif faceNormal.IsAlmostEqualTo(XYZ(-1,0,0)):
						_XAxis.append(face.ToProtoType()[0])
						_XAxisArray.Append(face.Reference)
					elif faceNormal.IsAlmostEqualTo(XYZ(0,1,0)):
						YAxis.append(face.ToProtoType()[0])
						YAxisArray.Append(face.Reference)
					elif faceNormal.IsAlmostEqualTo(XYZ(0,-1,0)):
						_YAxis.append(face.ToProtoType()[0])
						_YAxisArray.Append(face.Reference)
					elif faceNormal.Z >= (0 - 1.0e-09) and faceNormal.Z <= (0 + 1.0e-09):
						vertical.append(face.ToProtoType()[0])
						verArray.Append(face.Reference)
				horizontaldown.append(downList)
				refDown.append(downArray)
				horizontalup.append(upList)
				refUp.append(upArray)
				XAxisList.append(XAxis)
				XAxisRef.append(XAxisArray)
				_XAxisList.append(_XAxis)
				_XAxisRef.append(_XAxisArray)
				YAxisList.append(YAxis)
				YAxisRef.append(YAxisArray)
				_YAxisList.append(_YAxis)
				_YAxisRef.append(_YAxisArray)
				verticals.append(vertical)
				refVer.append(verArray)
			elif isinstance(obj, GeometryInstance) :
				for symbIns in obj.GetInstanceGeometry() :
					if isinstance(symbIns,Solid) and symbIns.Volume > 0 :
						for face in symbIns.Faces:
							faceNormal = face.FaceNormal
							if faceNormal.IsAlmostEqualTo(XYZ(0,0,-1)):
								downList.append(face.ToProtoType()[0])
								downArray.Append(face.Reference)
							elif faceNormal.IsAlmostEqualTo(XYZ(0,0,1)):
								upList.append(face.ToProtoType()[0])
								upArray.Append(face.Reference)
							elif faceNormal.IsAlmostEqualTo(XYZ(1,0,0)):
								XAxis.append(face.ToProtoType()[0])
								XAxisArray.Append(face.Reference)
							elif faceNormal.IsAlmostEqualTo(XYZ(-1,0,0)):
								_XAxis.append(face.ToProtoType()[0])
								_XAxisArray.Append(face.Reference)
							elif faceNormal.IsAlmostEqualTo(XYZ(0,1,0)):
								YAxis.append(face.ToProtoType()[0])
								YAxisArray.Append(face.Reference)
							elif faceNormal.IsAlmostEqualTo(XYZ(0,-1,0)):
								_YAxis.append(face.ToProtoType()[0])
								_YAxisArray.Append(face.Reference)
							elif faceNormal.Z >= (0 - 1.0e-09) and 	faceNormal.Z <= (0 + 1.0e-09):
								vertical.append(face.ToProtoType()[0])
								verArray.Append(face.Reference)
						horizontaldown.append(downList[0])
						refDown.append(downArray[0])
						horizontalup.append(upList[0])
						refUp.append(upArray[0])
						XAxisList.append(XAxis[0])
						XAxisRef.append(XAxisArray[0])
						_XAxisList.append(_XAxis[0])
						_XAxisRef.append(_XAxisArray[0])
						YAxisList.append(YAxis[0])
						YAxisRef.append(YAxisArray[0])
						_YAxisList.append(_YAxis[0])
						_YAxisRef.append(_YAxisArray[0])
						verticals.append(vertical)
						refVer.append(verArray)		
	else:
		pass
		
if isinstance(IN[0], list): OUT = horizontalup,refUp,horizontaldown,refDown,XAxisList, XAxisRef,_XAxisList, _XAxisRef,YAxisList, YAxisRef,_YAxisList,_YAxisRef,verticals,refVer
else: OUT = horizontalup[0],refUp[0],horizontaldown[0],refDown[0],XAxisList[0], XAxisRef[0],_XAxisList[0], _XAxisRef[0],YAxisList[0], YAxisRef[0],_YAxisList[0], _YAxisRef[0],verticals[0],refVer[0]
# ----------------------------------------
code_block = CodeBlock(x=python_script) { x[0]; x[1]; x[2]; x[3]; x[4]; x[5]; x[6]; x[7]; x[8]; x[9]; x[10]; x[11]; x[12]; x[13]; }
Top_Surface = Output(code_block.out0)
Top_Reference = Output(code_block.out1)
Bottom_Surface = Output(code_block.out2)
Bottom_Reference = Output(code_block.out3)
XAxis_Surface = Output(code_block.out4)
XAxis_Reference = Output(code_block.out5)
XAxis_Surface_2 = Output(code_block.out6)  # "-XAxis Surface"
XAxis_Reference_2 = Output(code_block.out7)  # "-XAxis  Reference"
YAxis_Surface = Output(code_block.out8)
YAxis_Reference = Output(code_block.out9)
YAxis_Surface_2 = Output(code_block.out10)  # "-YAxis Surface"
YAxis_Reference_2 = Output(code_block.out11)  # "-YAxis Reference"
Vertical_Surface = Output(code_block.out12)
Vertical_Reference = Output(code_block.out13)
