# Dynamo custom node Element ToDocument.dyf (Dynamo 2.6.1.8786)
# category: GeniusLoci.Element
# Returns the Document in which the Element resides and the document's filename.

element = Input(element: var[]..[])
python_script = Python(IN[0]=element)
# ---------- python_script.python (13 lines) ----------
import clr
clr.AddReference('RevitAPI')
from Autodesk.Revit.DB import Document

elements = UnwrapElement(IN[0]) if isinstance(IN[0],list) else [UnwrapElement(IN[0])]

docs,titles = [],[]
for element in elements:
    docs.append(element.Document)
    titles.append(element.Document.Title)

if isinstance(IN[0], (list)): OUT = docs,titles
else: OUT = docs[0],titles[0]
# ----------------------------------------
code_block = CodeBlock(x=python_script) { x[0]; x[1]; }
Document = Output(code_block.out0)
FileName = Output(code_block.out1)
