# Dynamo custom node Element ToLinkInstance.dyf (Dynamo 2.6.1.8786)
# category: GeniusLoci.Element
# Returns the RevitLinkInstance in which the linked Element resides.

element = Input(element: var[]..[])  # Linked element
python_script = Python(IN[0]=element)
# ---------- python_script.python (22 lines) ----------
#Alban de Chasteigner 2021
#twitter : @geniusloci_bim
#geniusloci.bim@gmail.com
#https://github.com/albandechasteigner/GeniusLociForDynamo

import clr
clr.AddReference('RevitAPI')
import Autodesk
from Autodesk.Revit.DB import *

clr.AddReference('RevitServices')
import RevitServices
from RevitServices.Persistence import DocumentManager
doc = DocumentManager.Instance.CurrentDBDocument

elements = UnwrapElement(IN[0]) if isinstance(IN[0],list) else [UnwrapElement(IN[0])]

instances=[FilteredElementCollector(doc).OfClass(RevitLinkInstance).ToElements().Find(lambda x : doc.GetElement(x.GetTypeId()).IsLoaded(doc, x.GetTypeId()) and x.GetLinkDocument().Title == elem.Document.Title) for elem in elements]
names=[elem.Document.Title for elem in elements]

if isinstance(IN[0], list): OUT = instances,names
else: OUT = instances[0],names[0]
# ----------------------------------------
code_block = CodeBlock(x=python_script) { x[0]; x[1]; }
RevitLinkInstance = Output(code_block.out0)
LinkInstanceName = Output(code_block.out1)
