# Dynamo custom node Element ToRebar.dyf
# category: GeniusLoci.Rebar
# Returns all Rebar elements hosted by the referenced element.

element = Input(element: var[]..[])
python = Python(IN[0]=element)  # CPython3
# ---------- python.python (17 lines) ----------
#Alban de Chasteigner 2023
#twitter : @geniusloci_bim
#geniusloci.bim@gmail.com
#https://github.com/albandechasteigner/GeniusLociForDynamo
 
import clr
clr.AddReference('RevitAPI')
import Autodesk
from Autodesk.Revit.DB.Structure import *

elements = UnwrapElement(IN[0]) if isinstance(IN[0],list) else [UnwrapElement(IN[0])]
rebarsInHost=[]

for elem in elements:
    rebarsInHost.append(RebarHostData.GetRebarHostData(elem).GetRebarsInHost())

OUT = rebarsInHost
# ----------------------------------------
Rebar = Output(python)
