# Dynamo custom node Element ToSpace.dyf (Dynamo 2.12.1.8246)
# category: GeniusLoci.Room
# Reports the space of the current or linked model in which the element of the current document is located.
# Please note : The custom node maps the element phase to the space phase using the phase name.

element = Input(element: var[]..[])  # Element of current document
RevitLinksInstance = Input(RevitLinksInstance: var[]..[] = null)  # Optional input to retrieve linked spaces
python_script = Python(IN[0]=element, IN[1]=RevitLinksInstance)  # IronPython2
# ---------- python_script.python (58 lines) ----------
#Alban de Chasteigner 2021
#twitter : @geniusloci_bim
#geniusloci.bim@gmail.com
#https://github.com/albandechasteigner/GeniusLociForDynamo
 
import clr
clr.AddReference('RevitAPI')
import Autodesk
from Autodesk.Revit.DB import *
clr.AddReference("RevitServices")
import RevitServices
from RevitServices.Persistence import DocumentManager

clr.AddReference("RevitNodes")
import Revit
clr.ImportExtensions(Revit.Elements)
from Revit.Elements import *

doc = DocumentManager.Instance.CurrentDBDocument

Elements = UnwrapElement(IN[0]) if isinstance(IN[0],list) else [UnwrapElement(IN[0])]
inputdoc = (UnwrapElement(IN[1]) if isinstance(IN[1],list) else [UnwrapElement(IN[1])])[0]
spaces=[]

for e in Elements:
	phase = doc.GetElement(e.CreatedPhaseId)
	loc = e.Location
	if type(loc) == LocationPoint:
		pt=loc.Point
	elif type(loc) == LocationCurve:
		pt=loc.Curve.Evaluate(0.5, True)
	# sketch-based elements (ceiling, floor and roof)
	elif isinstance(e, CeilingAndFloor) or isinstance(e,RoofBase) :
		for ref in HostObjectUtils.GetTopFaces(e):
			geomFace=e.GetGeometryObjectFromReference(ref)
			#Get UV BoundingBox
			bbox = geomFace.GetBoundingBox()
			uv=(bbox.Min+bbox.Max)/2
			pt=geomFace.Evaluate(uv)
	if not isinstance(inputdoc, RevitLinkInstance):
		try:
			if isinstance (e, FamilyInstance):
				spaces.append(e.Space[phase].ToDSType(True))
			else: 
				spaces.append(doc.GetSpaceAtPoint(pt,phase).ToDSType(True))
		except:spaces.append(None)
	elif isinstance (inputdoc, RevitLinkInstance):
		try:
			doc2 = inputdoc.GetLinkDocument()
			phaseName = phase.Name
			phase2 = FilteredElementCollector(doc2).OfClass(Phase).ToElements().Find(lambda x : x.Name == phaseName)
			transform = inputdoc.GetTotalTransform()
			locationPoint = transform.Inverse.OfPoint(pt)
			spaces.append(doc2.GetSpaceAtPoint(locationPoint,phase2).ToDSType(True))
		except:spaces.append(None)
	else:spaces.append(None)
	
OUT = spaces
# ----------------------------------------
Space = Output(python_script)  # Space of current document or linked model
