# Dynamo custom node Element Workset.dyf (Dynamo 2.6.1.8786)
# category: GeniusLoci.Workset
# Returns the workset of the given element.

element = Input(element: var[]..[])
python_script = Python(IN[0]=element)
# ---------- python_script.python (17 lines) ----------
import clr
clr.AddReference('RevitAPI')
from Autodesk.Revit.DB import *

items = UnwrapElement(IN[0]) if isinstance(IN[0],list) else [UnwrapElement(IN[0])]
worksets,names=[],[]
for item in items:
	if hasattr(item, "WorksetId"):
		workset=item.Document.GetWorksetTable().GetWorkset(item.WorksetId)
		worksets.append(workset)
		names.append(workset.Name)
	else: 
		worksets.append(None)
		names.append(None)

if isinstance(IN[0], list): OUT = worksets,names
else: OUT = worksets[0],names[0]
# ----------------------------------------
code_block = CodeBlock(x=python_script) { x[0]; x[1]; }
Workset = Output(code_block.out0)
Workset_Name = Output(code_block.out1)
