# Dynamo custom node ElementFilter ByName DoesNotContain.dyf (Dynamo 2.6.1.8786)
# category: GeniusLoci.Element
# Filter elements by part of their name.

element = Input(element: var[]..[])  # Element to filter by name doesn't contain
searchString = Input(searchString: string[]..[])  # The string value to filter by
ignoreCase = Input(ignoreCase: bool = false)
python_script = Python(IN[0]=element, IN[1]=searchString, IN[2]=ignoreCase)
# ---------- python_script.python (32 lines) ----------
#Alban de Chasteigner 2020
#twitter : @geniusloci_bim
#geniusloci.bim@gmail.com

import clr
clr.AddReference("RevitAPI")
from Autodesk.Revit.DB import Element
clr.AddReference("RevitNodes")
import Revit
clr.ImportExtensions(Revit.Elements)

elements = UnwrapElement(IN[0]) if isinstance(IN[0],list) else [UnwrapElement(IN[0])]
names = IN[1] if isinstance(IN[1],list) else [IN[1]]
bool = IN[2]
outList=[]

for elem in elements:
	if isinstance(IN[1],list):
		if bool:
			if all(name.lower() not in elem.ToDSType(True).Name.lower() for name in names):
				outList.append(elem)
		else:
			if all(name not in elem.ToDSType(True).Name for name in names):
				outList.append(elem)
	else:
		if bool:
			outList=[elem for elem in elements if not IN[1].lower() in elem.ToDSType(True).Name.lower()]
		else:
			outList=[elem for elem in elements if not IN[1] in elem.ToDSType(True).Name]
	
if isinstance(IN[0], list): OUT = outList
else: OUT = outList[0]
# ----------------------------------------
Element = Output(python_script)
