# Dynamo custom node ElementFilter ByName Equals.dyf (Dynamo 2.6.1.8786)
# category: GeniusLoci.Element
# Filter elements by given name.

element = Input(element: var[]..[])  # Element to filter by name equals
searchString = Input(searchString: string)  # The string value to filter by
ignoreCase = Input(ignoreCase: bool = false)
python_script = Python(IN[0]=element, IN[1]=searchString, IN[2]=ignoreCase)
# ---------- python_script.python (23 lines) ----------
#Alban de Chasteigner 2020
#twitter : @geniusloci_bim
#geniusloci.bim@gmail.com

import clr
clr.AddReference("RevitAPI")
from Autodesk.Revit.DB import Element

clr.AddReference("RevitNodes")
import Revit
clr.ImportExtensions(Revit.Elements)

elements = UnwrapElement(IN[0]) if isinstance(IN[0],list) else [UnwrapElement(IN[0])]
name = IN[1]
bool = IN[2]

if bool:
	outList=[elem for elem in elements if elem.ToDSType(True).Name.lower() == name.lower()]
else:
	outList=[elem for elem in elements if elem.ToDSType(True).Name == name]

if isinstance(IN[0], list): OUT = outList
else: OUT = outList[0]
# ----------------------------------------
Element = Output(python_script)  # Filtered element
