# Dynamo custom node Enumerate DuctSystemType.dyf (Dynamo 2.12.0.5650)
# category: GeniusLoci.ConnectorElement
# Enumerates all the possible duct system types for a ConnectorElement.
# For use with the Create DuctConnector node.

enumerate_ductsystemtype = Python()  # IronPython2; graph input
# ---------- enumerate_ductsystemtype.python (12 lines) ----------
#Alban de Chasteigner 2022
#twitter : @geniusloci_bim
#geniusloci.bim@gmail.com
#https://github.com/albandechasteigner/GeniusLociForDynamo

import clr
clr.AddReference("RevitAPI")
import Autodesk
from Autodesk.Revit.DB import Mechanical
import System

OUT = System.Enum.GetValues(Autodesk.Revit.DB.Mechanical.DuctSystemType)
# ----------------------------------------
DuctSystemType = Output(enumerate_ductsystemtype)
