# Dynamo custom node Enumerate ElectricalSystemType.dyf (Dynamo 2.12.0.5650)
# category: GeniusLoci.ConnectorElement
# Enumerates all the possible electrical system types for a ConnectorElement.
# For use with the Create ElectricalConnector node.

enumerate_electricalsystemtype = Python()  # IronPython2; graph input
# ---------- enumerate_electricalsystemtype.python (11 lines) ----------
#Alban de Chasteigner 2022
#twitter : @geniusloci_bim
#geniusloci.bim@gmail.com
#https://github.com/albandechasteigner/GeniusLociForDynamo
import clr
clr.AddReference("RevitAPI")
import Autodesk
from Autodesk.Revit.DB import Electrical
import System

OUT = System.Enum.GetValues(Autodesk.Revit.DB.Electrical.ElectricalSystemType)
# ----------------------------------------
ElectricalSystemType = Output(enumerate_electricalsystemtype)
