# Dynamo custom node Enumerate ElementOnPhaseStatus.dyf (Dynamo 2.6.1.8786)
# category: GeniusLoci.Phase
# The statuses that an element can have with respect to a given phase.

python_script = Python()
# ---------- python_script.python (9 lines) ----------
import clr
# Import RevitAPI
clr.AddReference("RevitAPI")
import Autodesk
from Autodesk.Revit.DB import *
import System

#Assign your output to the OUT variable
OUT = System.Enum.GetValues(Autodesk.Revit.DB.ElementOnPhaseStatus)
# ----------------------------------------
ElementOnPhaseStatus = Output(python_script)
