# Dynamo custom node Enumerate Flow Conversion Methods.dyf (Dynamo 2.6.1.8786)
# category: GeniusLoci.MEP
# Enumerates the possible flow conversion modes for piping calculations.
# For use with the "Set SystemType Properties" node.

python_script = Python()  # graph input
# ---------- python_script.python (7 lines) ----------
import clr
clr.AddReference("RevitAPI")
import Autodesk
from Autodesk.Revit.DB import Plumbing
import System

OUT = System.Enum.GetValues(Autodesk.Revit.DB.Plumbing.FlowConversionMode)
# ----------------------------------------
FlowConversionMethods = Output(python_script)
