# Dynamo custom node Enumerate LayerFunction.dyf (Dynamo 2.6.1.8786)
# category: GeniusLoci.CompoundStructure
# Enumerate the functions of the layers of the Compound System Family.

python_script = Python()  # graph input
# ---------- python_script.python (9 lines) ----------
import clr
# Import RevitAPI
clr.AddReference("RevitAPI")
import Autodesk
from Autodesk.Revit.DB import *
import System

#Assign your output to the OUT variable
OUT = System.Enum.GetValues(Autodesk.Revit.DB.MaterialFunctionAssignment)
# ----------------------------------------
LayerFunction = Output(python_script)
