# Dynamo custom node Enumerate MEPSystemClassification.dyf (Dynamo 2.12.0.5650)
# category: GeniusLoci.ConnectorElement
# Enumerates all the possible system types for a ConnectorElement.
# For use with the Set Connector Properties node.

enumerate = Python()  # "Enumerate MEPSystemClassification"; IronPython2; graph input
# ---------- enumerate.python (11 lines) ----------
#Alban de Chasteigner 2022
#twitter : @geniusloci_bim
#geniusloci.bim@gmail.com
#https://github.com/albandechasteigner/GeniusLociForDynamo
import clr
clr.AddReference('RevitAPI')
import Autodesk
from Autodesk.Revit.DB import MEPSystemClassification
import System

OUT = System.Enum.GetValues(Autodesk.Revit.DB.MEPSystemClassification)
# ----------------------------------------
MEPSystemClassification = Output(enumerate)
