# Dynamo custom node Enumerate PhaseStatusPresentation.dyf (Dynamo 2.6.1.8786)
# category: GeniusLoci.Phase
# An enumerated type listing the options for element display in a phase filter.

python_script = Python()
# ---------- python_script.python (9 lines) ----------
import clr
# Import RevitAPI
clr.AddReference("RevitAPI")
import Autodesk
from Autodesk.Revit.DB import *
import System

#Assign your output to the OUT variable
OUT = System.Enum.GetValues(Autodesk.Revit.DB.PhaseStatusPresentation)
# ----------------------------------------
Phase_Status_Presentation = Output(python_script)
