# Dynamo custom node Enumerate PipeSystemType.dyf (Dynamo 2.12.0.5650)
# category: GeniusLoci.ConnectorElement
# Enumerates all the possible pipe system types for a ConnectorElement.
# For use with the Create PipeConnector node.

enumerate_pipesystemtype = Python()  # IronPython2; graph input
# ---------- enumerate_pipesystemtype.python (12 lines) ----------
#Alban de Chasteigner 2022
#twitter : @geniusloci_bim
#geniusloci.bim@gmail.com
#https://github.com/albandechasteigner/GeniusLociForDynamo

import clr
clr.AddReference('RevitAPI')
import Autodesk
from Autodesk.Revit.DB import Plumbing
import System

OUT = System.Enum.GetValues(Autodesk.Revit.DB.Plumbing.PipeSystemType)
# ----------------------------------------
PipeSystemType = Output(enumerate_pipesystemtype)
