# Dynamo custom node Enumerate TextNoteLeaderTypes.dyf (Dynamo 2.6.1.8786)
# category: GeniusLoci.TextNote
# Enumerates the types of text-note leaders.
# For use with the TextNote AddLeader node.

python_script = Python()  # graph input
# ---------- python_script.python (7 lines) ----------
import clr
clr.AddReference('RevitAPI')
import Autodesk
from Autodesk.Revit.DB import TextNoteLeaderTypes
import System

OUT = System.Enum.GetValues(Autodesk.Revit.DB.TextNoteLeaderTypes)
# ----------------------------------------
TextNoteLeaderTypes = Output(python_script)
