# Dynamo custom node Export DWG in Document.dyf (Dynamo 2.6.1.8786)
# category: GeniusLoci.CAD Export
# Export views to DWG with export setup in the active or given document.
# Based on a script by Konrad K Sobon.

docOrRevitLinkInstance = Input(docOrRevitLinkInstance: var = null)  # Use only if you want to query other document
DirectoryPath = Input(DirectoryPath: var[]..[])
view = Input(view: var[]..[])
Filename = Input(Filename: var[]..[])
ExportSetup = Input(ExportSetup: string = null)  # Optional input : ExportDWGSetting's name
SharedCoords = Input(SharedCoords: bool = true)
MergeViews = Input(MergeViews: bool = true)
RunIt = Input(RunIt: bool = false)
export_dwg_from_directory = Python(IN[0]=docOrRevitLinkInstance, IN[1]=DirectoryPath, IN[2]=view, IN[3]=Filename, IN[4]=ExportSetup, IN[5]=SharedCoords, IN[6]=MergeViews, IN[7]=RunIt)
# ---------- export_dwg_from_directory.python (89 lines) ----------
#Based on a script by Konrad K Sobon, @arch_laboratory, http://archi-lab.net

# Import Element wrapper extension methods
import clr
clr.AddReference("RevitNodes")
import Revit
clr.ImportExtensions(Revit.Elements)

# Import DocumentManager and TransactionManager
clr.AddReference("RevitServices")
import RevitServices
from RevitServices.Persistence import DocumentManager

# Import RevitAPI
clr.AddReference("RevitAPI")
import Autodesk
from Autodesk.Revit.DB import *

import System
from System.Collections.Generic import *

import sys
pyt_path = r'C:\Program Files (x86)\IronPython 2.7\Lib'
sys.path.append(pyt_path)

def ProcessList(_func, _list):
    return map( lambda x: ProcessList(_func, x) if type(x)==list else _func(x), _list )

def ProcessParallelLists(_func, *lists):
	return map( lambda *xs: ProcessParallelLists(_func, *xs) if all(type(x) is list for x in xs) else _func(*xs), *lists )

def Unwrap(item):
	return UnwrapElement(item)

if isinstance(IN[0], list) : inputdoc = ProcessList(Unwrap, IN[0])
else : inputdoc = [Unwrap(IN[0])]
#Inputdoc : Part of script by Andreas Dieckmann
if inputdoc[0] == None:
	doc = DocumentManager.Instance.CurrentDBDocument
elif isinstance (inputdoc[0], Document) :
	doc = inputdoc[0]
elif isinstance (inputdoc[0], RevitLinkInstance) :
	doc = inputdoc[0].GetLinkDocument()
else: doc = DocumentManager.Instance.CurrentDBDocument

folderPath = IN[1]

if isinstance(IN[2], list) : views = ProcessList(Unwrap, IN[2])
else : views = [Unwrap(IN[2])]

if isinstance(IN[3], list) : names = IN[3]
else : names = [IN[3]]

if isinstance(IN[4], list) : Predef = IN[4]
else : Predef = [IN[4]]

RunIt = IN[7]

def ExportDwg(name, view, folder = folderPath):
	options = DWGExportOptions()
	if Predef[0] == None:
		pass
	else:
		options = options.GetPredefinedOptions(doc, Predef[0])
	options.SharedCoords = IN[5]
	options.MergedViews = IN[6]
	views = List[ElementId]()
	views.Add(view.Id)
	result = doc.Export(folder, name, views, options)
	return result

if RunIt:
	try:
		errorReport = None
		# run export
		ProcessParallelLists(ExportDwg, names, views)
		
	except:
		# if error accurs anywhere in the process catch it
		import traceback
		errorReport = traceback.format_exc()
else:
	errorReport = "Please set the RunIt to True!"

#Assign your output to the OUT variable
if errorReport == None:
	OUT = "Success"
else:
	OUT = errorReport
# ----------------------------------------
Result = Output(export_dwg_from_directory)
