# Dynamo custom node Export IFC.dyf (Dynamo 2.6.2.15705)
# category: GeniusLoci.Export
# Export View to IFC file in the active document.
# For use with the Select Phase node.
# Some other IFC options are embedded inside the python script.

DirectoryPath = Input(DirectoryPath: var[]..[])
# note: IFC Version :
# "IFC2x2";
# "IFC2x3";
# "IFC2x3CV2";
# "IFC2x2";
# "IFC4";
# "IFCBCA";
# "IFCCOBIE";
view = Input(view: var[]..[] = Revit.Application.Document.Current.ActiveView)
Filename = Input(Filename: var[]..[])
code_block = CodeBlock(item=Filename) { DSCore.List.Flatten(item,-1); }
IFCversion = Input(IFCversion: string = "IFC2x3")  # IFC Version
ProjectOrigin = Input(ProjectOrigin: string = "3")  # SharedCoordinates ="0", SiteSurveyPoint ="1", ProjectBasePoint="2", InternalCoordinates="3"
phase = Input(phase: var[]..[] = null)  # If no phase is connected, export Default phase
UserDefinedPSet = Input(UserDefinedPSet: var[]..[] = "")  # FilePath
RevitInternalPset = Input(RevitInternalPset: bool = true)
WallAndColumnSplitting = Input(WallAndColumnSplitting: bool = false)
ExportBaseQuantities = Input(ExportBaseQuantities: bool = false)
export_ifc = Python(IN[0]=DirectoryPath, IN[1]=view, IN[2]=code_block, IN[3]=IFCversion, IN[4]=ProjectOrigin, IN[5]=phase, IN[6]=UserDefinedPSet, IN[7]=RevitInternalPset, IN[8]=WallAndColumnSplitting, IN[9]=ExportBaseQuantities)
# ---------- export_ifc.python (142 lines) ----------
#Based on a Nicklas Verdier Østergaard's script, nvo@niras.dk
#https://github.com/Autodesk/revit-ifc/tree/2810c479e27819da97656759a1dda28cbdde0538/Source
#Revised by Alban de Chasteigner

import clr
clr.AddReference("RevitServices")
import RevitServices
from RevitServices.Persistence import DocumentManager
from RevitServices.Transactions import TransactionManager
# Import RevitAPI
clr.AddReference("RevitAPI")
import Autodesk
from Autodesk.Revit.DB import *

def tolist(obj1):
    if hasattr(obj1,"__iter__"): return obj1
    else: return [obj1]

doc = DocumentManager.Instance.CurrentDBDocument
uiapp = DocumentManager.Instance.CurrentUIApplication
app = uiapp.Application
uidoc=DocumentManager.Instance.CurrentUIApplication.ActiveUIDocument

folder=UnwrapElement(IN[0])
view = tolist(UnwrapElement(IN[1]))
name=tolist(UnwrapElement(IN[2]))
fileversion = IN[3]
Projectorigin = IN[4]
inputPhase = UnwrapElement(IN[5])
userDefinedPset = IN[6]
revitInternalPset = IN[7]
wallandcolumnsplitting = IN[8]
exportbasequantities = IN[9]

if inputPhase != None:
	phaseString=str(inputPhase.Id)
else:
	pass

if userDefinedPset != "":
	userDefPsetBool= "true"
else:
	userDefPsetBool= "false"

if revitInternalPset ==True:
	revitInternalPset= "true"
else:
	revitInternalPset= "false"

TransactionManager.Instance.EnsureInTransaction(doc)
result = []

for i,v in enumerate(view):
	options=IFCExportOptions()
	
	#if fileversion != None:
	#	options.FileVersion = fileversion
	if fileversion == "IFC4":
		options.FileVersion = IFCVersion.IFC4
	if fileversion == "IFC4RV":
		options.FileVersion = IFCVersion.IFC4RV
	if fileversion == "IFC4DTV":
		options.FileVersion = IFCVersion.IFC4DTV
	if fileversion == "IFC2x2":
		options.FileVersion = IFCVersion.IFC2x2
	if fileversion == "IFC2x3":
		options.FileVersion = IFCVersion.IFC2x3
	if fileversion == "IFC2x3CV2":
		options.FileVersion = IFCVersion.IFC2x3CV2
	if fileversion == "IFC2x3BFM":
		options.FileVersion = IFCVersion.IFC2x3BFM
	if fileversion == "IFC2x3FM":
		options.FileVersion = IFCVersion.IFC2x3FM
	if fileversion == "IFCBCA":
		options.FileVersion = IFCVersion.IFCBCA
	if fileversion == "IFCCOBIE":
		options.FileVersion = IFCVersion.IFCCOBIE
	if fileversion == "":
		options.FileVersion = IFCVersion.Default
		
	options.WallAndColumnSplitting = wallandcolumnsplitting
	#options.AddOption("IncludeSteelElements", "true")
	
	options.FilterViewId = v.Id
	
	if inputPhase != None:
		options.AddOption("ActivePhase", phaseString)
	else:
		pass
	options.AddOption("SitePlacement", IN[4])
	options.AddOption("SpaceBoundaries ", "0")
	
	#### "Additional Content" Tab ####
	options.AddOption("Export2DElements", "false")
	options.AddOption("ExportRoomsInView", "false")	
	options.AddOption("VisibleElementsOfCurrentView ", "true")
	#True doesn't work. It would be necessary to use OpenInBackground method.
	options.AddOption("ExportLinkedFiles", "false")
	
	#### "Property Sets" Tab ####
	options.ExportBaseQuantities = exportbasequantities
	options.AddOption("ExportInternalRevitPropertySets",revitInternalPset)
	options.AddOption("ExportIFCCommonPropertySets","true")	
	options.AddOption("ExportSchedulesAsPsets", "false")
	options.AddOption("ExportSpecificSchedules", "false")
	options.AddOption("ExportUserDefinedPsets",userDefPsetBool)
	if userDefinedPset != "":
		options.AddOption("ExportUserDefinedPsetsFileName",userDefinedPset)	
	else:
		pass
	#	options.AddOption("ClassificationName","x")
	#	options.AddOption("ClassificationFieldName","x")

	#### "Advanced" Tab ####	
	options.AddOption("Use2DRoomBoundaryForVolume ", "false")
	options.AddOption("UseFamilyAndTypeNameForReference ", "false")
	options.AddOption("ExportPartsAsBuildingElements", "false")
	options.AddOption("ExportBoundingBox", "false")
	options.AddOption("ExportSolidModelRep", "true")
	options.AddOption("StoreIFCGUID", "true")
	options.AddOption("UseActiveViewGeometry", "true")
	options.AddOption("IncludeSiteElevation","true")
	options.AddOption("ExportAnnotations ","true")
	
	options.AddOption("TessellationLevelOfDetail", "0,5")
	
	#options.AddOption("IFCFileType", "0") # "File type"
	#  0 = IFC
	#  1 = IFC XML
	#  2 = Zipped IFC
	#  3 = Zipped IFC XML
	
	c=doc.Export(folder, name[i], options)
	result.append(c)

# End Transaction
TransactionManager.Instance.TransactionTaskDone()

if fileversion == "":
	OUT="Default settings used"
else:
	OUT='Success'
# ----------------------------------------
Succeed = Output(export_ifc)
