# Dynamo custom node Export NWC in Document.dyf (Dynamo 2.13.1.3887)
# category: GeniusLoci.Export
# !! This node needs Navisworks Exporters for Revit to export NWC.
# This node exports Views to NWC files in the active or given document.
# Navisworks options are embedded inside the python script.

document = Input(document: var[]..[] = null)  # Use only if you want to query other document
DirectoryPath = Input(DirectoryPath: var[]..[])
view = Input(view: var[]..[])
start = Revit.Transaction.Transaction.Start(input=view)
end = Revit.Transaction.Transaction.End(input=start)
Filename = Input(Filename: string[]..[])
exportScope = Input(exportScope: var[]..[] = tTypedIdent0)  # ExportScope = View, Model, SelectedElements
chooseCoordinates = Input(chooseCoordinates: var[]..[] = tTypedIdent0)  # ChooseCoordinates = Shared or Internal
ExportLinks = Input(ExportLinks: bool = false)
RunIt = Input(RunIt: bool = false)
export_nwc = Python(IN[0]=document, IN[1]=DirectoryPath, IN[2]=end, IN[3]=Filename, IN[4]=exportScope, IN[5]=chooseCoordinates, IN[6]=ExportLinks, IN[7]=RunIt)  # IronPython2
# ---------- export_nwc.python (89 lines) ----------
#Alban de Chasteigner 2018
#twitter : @geniusloci_bim
#geniusloci.bim@gmail.com

#ProcessParallelLists definition by Konrad K Sobon

import clr
# Import DocumentManager and TransactionManager
clr.AddReference("RevitServices")
import RevitServices
from RevitServices.Persistence import DocumentManager

# Import RevitAPI
clr.AddReference("RevitAPI")
import Autodesk
from Autodesk.Revit.DB import *

import sys
pyt_path = r'C:\Program Files (x86)\IronPython 2.7\Lib'
sys.path.append(pyt_path)

def ProcessList(_func, _list):
    return map( lambda x: ProcessList(_func, x) if type(x)==list else _func(x), _list )

def ProcessParallelLists(_func, *lists):
	return map( lambda *xs: ProcessParallelLists(_func, *xs) if all(type(x) is list for x in xs) else _func(*xs), *lists )

def Unwrap(item):
	return UnwrapElement(item)

if isinstance(IN[0], list) : inputdoc = ProcessList(Unwrap, IN[0])
else : inputdoc = [Unwrap(IN[0])]
#Inputdoc : Part of script by Andreas Dieckmann
if inputdoc[0] == None:
	doc = DocumentManager.Instance.CurrentDBDocument
elif inputdoc[0].GetType().ToString() == "Autodesk.Revit.DB.Document":
	doc = inputdoc[0]
else: doc = DocumentManager.Instance.CurrentDBDocument

folderpath = IN[1]

if isinstance(IN[2], list) : views = ProcessList(Unwrap, IN[2])
else : views = [Unwrap(IN[2])]

if isinstance(IN[3], list) : names = IN[3]
else : names = [IN[3]]

NWCExportScope = IN[4]
ChooseCoordinates = IN[5]
Linksbool = IN[6]
RunIt = IN[7]

def ExportNWC(name, view, folder = folderpath):
	options = NavisworksExportOptions()
	options.ViewId=view.Id
	#All,Elements, or None
	#options.NavisworksParameters = Enumeration
	options.ExportScope = NWCExportScope
	options.ExportLinks=Linksbool
	options.Coordinates=ChooseCoordinates
	options.ExportParts = False
	options.ExportElementIds = True
	options.ConvertElementProperties = True
	options.ExportRoomAsAttribute = True
	options.ExportRoomGeometry = False
	options.ExportUrls  = True
	options.DivideFileIntoLevels = False
	options.FindMissingMaterials = True
	result = doc.Export(folder, name, options)
	return result

if RunIt:
	try:
		errorReport = None
		# run export
		ProcessParallelLists(ExportNWC, names, views)
		
	except:
		# if error accurs anywhere in the process catch it
		import traceback
		errorReport = traceback.format_exc()
else:
	errorReport = "Please set the RunIt to True!"

#Assign your output to the OUT variable
if errorReport == None:
	OUT = "Success",doc
else:
	OUT = errorReport
# ----------------------------------------
code_block = CodeBlock(x=export_nwc) { x[0]; x[1]; }
Result = Output(code_block.out0)
Document = Output(code_block.out1)
