# Dynamo custom node Extract Numbers from String.dyf (Dynamo 2.6.1.8786)
# category: GeniusLoci.Utilities
# Extracts a number or a list of numbers from a string and converts it to double.

strings = Input(strings: var[]..[])
python_script = Python(IN[0]=strings)
# ---------- python_script.python (15 lines) ----------
#https://www.geeksforgeeks.org/find-all-the-numbers-in-a-string-using-regular-expression-in-python/

import re 
# Function to extract all the numbers from the given string 
def getNumbers(str): 
    array = re.findall(r'[-+]\d*\.\d+|\d+', str)
    double=[float(x) for x in array]
    return double

strings = IN[0] if isinstance(IN[0],list) else [IN[0]]

array=[getNumbers(x) for x in strings]

if isinstance(IN[0], list): OUT = array 
else: OUT = array[0]
# ----------------------------------------
double = Output(python_script)
