# Dynamo custom node Family Properties.dyf (Dynamo 2.12.1.8246)
# category: GeniusLoci.Family
# Queries the family properties. (IsInPlace, IsShared...)

family = Input(family: var[]..[])
python_script = Python(IN[0]=family)  # IronPython2
# ---------- python_script.python (31 lines) ----------
#Alban de Chasteigner 2020
#twitter : @geniusloci_bim
#geniusloci.bim@gmail.com
#https://github.com/albandechasteigner/GeniusLociForDynamo

import clr
clr.AddReference('RevitAPI')
from Autodesk.Revit.DB import *
clr.AddReference('RevitNodes')
import Revit
clr.AddReference('RevitServices')
import RevitServices
from RevitServices.Persistence import DocumentManager
doc=DocumentManager.Instance.CurrentDBDocument

families=UnwrapElement(IN[0]) if isinstance(IN[0],list) else [UnwrapElement(IN[0])]

categories,names,placements,hosting,shared,inPlace,calculation = [],[],[],[],[],[],[]

for fam in families:
	try:categories.append(Revit.Elements.Category.ById(fam.FamilyCategoryId.IntegerValue))
	except:categories.append(None)
	names.append(fam.Name)
	placements.append(fam.FamilyPlacementType)
	hosting.append(fam.get_Parameter(BuiltInParameter.FAMILY_HOSTING_BEHAVIOR).AsValueString())
	shared.append(fam.get_Parameter(BuiltInParameter.FAMILY_SHARED).AsValueString())
	inPlace.append(fam.IsInPlace)
	calculation.append(fam.get_Parameter(BuiltInParameter.ROOM_CALCULATION_POINT).AsValueString())
	
if isinstance(IN[0], list): OUT = categories,names,placements,hosting,shared,inPlace,calculation
else: OUT = categories[0],names[0],placements[0],hosting[0],shared[0],inPlace[0],calculation[0]
# ----------------------------------------
code_block = CodeBlock(x=python_script) { x[0]; x[1]; x[2]; x[3]; x[4]; x[5]; x[6]; }
Category = Output(code_block.out0)
Name = Output(code_block.out1)
PlacementType = Output(code_block.out2)  # Type of placement required
HostingBehavior = Output(code_block.out3)  # Expected host class (if any)
IsShared = Output(code_block.out4)
IsInPlace = Output(code_block.out5)  # Is it an in-place family ?
HasRoomCalculationPoint = Output(code_block.out6)  # Is the room calculation point activated ?
