# Dynamo custom node FamilyDocument Edit.dyf (Dynamo 2.12.0.5650)
# category: GeniusLoci.Family
# Gets the familyDocument by family or family instance. (Edits the family in the background)
# Use the "FamilyDocument Close" node to close the familyDocument.

FamilyOrFamilyInstance = Input(FamilyOrFamilyInstance: var[]..[])
python_script = Python(IN[0]=FamilyOrFamilyInstance)  # IronPython2
# ---------- python_script.python (30 lines) ----------
#Alban de Chasteigner 2020
#twitter : @geniusloci_bim
#geniusloci.bim@gmail.com
#https://github.com/albandechasteigner/GeniusLociForDynamo

import clr
clr.AddReference('RevitAPI')
import Autodesk
from Autodesk.Revit.DB import *

clr.AddReference("RevitServices")
import RevitServices
from RevitServices.Transactions import TransactionManager
from RevitServices.Persistence import DocumentManager
doc = DocumentManager.Instance.CurrentDBDocument

families = UnwrapElement(IN[0]) if isinstance(IN[0],list) else [UnwrapElement(IN[0])]
famDoc=[]

TransactionManager.Instance.ForceCloseTransaction()
for fam in families:
	if isinstance(fam, Autodesk.Revit.DB.FamilyInstance) and fam.Symbol.Family.IsEditable :
		famDoc.append(Document.EditFamily(doc,fam.Symbol.Family))
	else:
		if fam.IsEditable :
		#if fam.IsInPlace == False :
			famDoc.append(Document.EditFamily(doc,fam))

if isinstance(IN[0], list): OUT = famDoc
else: OUT = famDoc[0]
# ----------------------------------------
familyDocument = Output(python_script)
