# Dynamo custom node FamilyDocument Load.dyf (Dynamo 2.12.1.8246)
# category: GeniusLoci.Family
# Load the family as familyDocument, existing family will be overwritten.
# Use the "FamilyDocument Close" node to close the familyDocument.

familyDocument = Input(familyDocument: var[]..[])  # Autodesk.Revit.DB.Document or FilePath
python_script = Python(IN[0]=familyDocument)  # IronPython2
# ---------- python_script.python (37 lines) ----------
#Alban de Chasteigner 2020
#twitter : @geniusloci_bim
#geniusloci.bim@gmail.com
#https://github.com/albandechasteigner/GeniusLociForDynamo

import clr
clr.AddReference('RevitAPI')
from Autodesk.Revit.DB import Document, FamilySource, IFamilyLoadOptions

clr.AddReference('RevitServices')
from RevitServices.Persistence import DocumentManager
from RevitServices.Transactions import TransactionManager
doc = DocumentManager.Instance.CurrentDBDocument

famDocs = IN[0] if isinstance(IN[0],list) else [IN[0]]
output = []
#Ensure loaded families can overwrite existing families.
class FamilyOption(IFamilyLoadOptions):
	def OnFamilyFound(self, familyInUse, overwriteParameterValues):
		overwriteParameterValues = True
		return True

	def OnSharedFamilyFound(self, sharedFamily, familyInUse, source, overwriteParameterValues):
		source = FamilySource.Family
		overwriteParameterValues = True
		return True

for famDoc in famDocs:
	if isinstance(famDoc, basestring):
		TransactionManager.Instance.EnsureInTransaction(doc)
		output.append(doc.LoadFamily(famDoc,FamilyOption()))
		TransactionManager.Instance.TransactionTaskDone()
	else:
		TransactionManager.Instance.ForceCloseTransaction()
		output.append(famDoc.LoadFamily(doc, FamilyOption()))
	
OUT = output
# ----------------------------------------
Family = Output(python_script)
