# Dynamo custom node FamilyDocument SubCategory.dyf (Dynamo 2.12.1.8246)
# category: GeniusLoci.Family
# Retrieves the family document category and subcategories.

familydocument = Input(familydocument: var[]..[] = null)  # Use only to query a Family Document (Autodesk.Revit.DB.Document)
python_script = Python(IN[0]=familydocument)  # IronPython2
# ---------- python_script.python (39 lines) ----------
#Alban de Chasteigner 2021
#twitter : @geniusloci_bim
#geniusloci.bim@gmail.com

import clr
clr.AddReference('RevitAPI')
import Autodesk
from Autodesk.Revit.DB import Family, Document

clr.AddReference('RevitServices')
import RevitServices
from RevitServices.Persistence import DocumentManager

clr.AddReference('RevitNodes')
import Revit
clr.ImportExtensions(Revit.Elements)

inputdocs = UnwrapElement(IN[0]) if isinstance(IN[0],list) else [UnwrapElement(IN[0])]
fCat,subCategory = [],[]

for inputdoc in inputdocs :
	if inputdoc == None:
		doc = DocumentManager.Instance.CurrentDBDocument
	elif isinstance (inputdoc,Autodesk.Revit.DB.Document):
		doc = inputdoc
	else: doc = DocumentManager.Instance.CurrentDBDocument
	if doc.IsFamilyDocument:
		cate=Revit.Elements.Category.ById((doc.OwnerFamily.FamilyCategoryId).IntegerValue)
		category = doc.OwnerFamily.FamilyCategory
		subcat=category.SubCategories
		for i in subcat:
			try:
				subCategory.append(Revit.Elements.Category.ById(i.Id.IntegerValue))
			except:subCategory.append(None)
		fCat.append(cate)	
	else:pass
	
if isinstance(IN[0], list): OUT = fCat,subCategory
else: OUT = fCat[0],subCategory
# ----------------------------------------
code_block = CodeBlock(x=python_script) { x[0]; x[1]; }
Category = Output(code_block.out0)
SubCategory = Output(code_block.out1)
