# Dynamo custom node FamilyDocument Types.dyf (Dynamo 2.12.1.8246)
# category: GeniusLoci.Family
# Retrieves the family type names in the family document.

familydocument = Input(familydocument: var[]..[] = null)  # Use only to query a Family Document (Autodesk.Revit.DB.Document)
python_script = Python(IN[0]=familydocument)  # IronPython2
# ---------- python_script.python (26 lines) ----------
import clr
clr.AddReference('RevitAPI')
import Autodesk
from Autodesk.Revit.DB import Document

clr.AddReference('RevitServices')
import RevitServices
from RevitServices.Persistence import DocumentManager

inputdocs = UnwrapElement(IN[0]) if isinstance(IN[0],list) else [UnwrapElement(IN[0])]
typeList=[]

for inputdoc in inputdocs :
	if inputdoc == None:
		doc = DocumentManager.Instance.CurrentDBDocument
	elif isinstance (inputdoc,Autodesk.Revit.DB.Document):
		doc = inputdoc
	else: doc = DocumentManager.Instance.CurrentDBDocument
	types = []
	if doc.IsFamilyDocument:
		for type in doc.FamilyManager.Types :
			types.append(type.Name)
		typeList.append(types)

if isinstance(IN[0], list): OUT = typeList 
else: OUT = typeList[0]
# ----------------------------------------
TypeName = Output(python_script)
