# Dynamo custom node FamilyInstance ByFaceReference.dyf (Dynamo 2.6.1.8786)
# category: GeniusLoci.Family
# Inserts a new instance of the given family type onto a surface referenced by the input Reference, using a line for its position.
# Note : The FamilyPlacementType must be CurveBased and the input surface reference must be created from a Revit face.

familyType = Input(familyType: var[]..[])
reference = Input(reference: var[]..[])  # Autodesk.Revit.DB.Reference Reference surface geometry derived from a Revit face
line = Input(line: Autodesk.DesignScript.Geometry.Curve[]..[])  # A line on the face defining where the instance is to be placed
python_script = Python(IN[0]=familyType, IN[1]=reference, IN[2]=line)
# ---------- python_script.python (46 lines) ----------
#Inspired by Springs package, Dimitar Venkov

import clr
clr.AddReference("RevitServices")
import RevitServices
from RevitServices.Persistence import DocumentManager
from RevitServices.Transactions import TransactionManager
doc = DocumentManager.Instance.CurrentDBDocument

clr.AddReference("RevitAPI")
import Autodesk

clr.AddReference("RevitNodes")
import Revit
clr.ImportExtensions(Revit.Elements)
clr.ImportExtensions(Revit.GeometryConversion)

import sys
sys.path.append(r"C:\Program Files (x86)\IronPython 2.7\Lib")

def tolist(obj1):
	if hasattr(obj1,"__iter__"): return obj1
	else: return [obj1]

familyType, reference, line = map(tolist, UnwrapElement(IN))

OUT = []
ftp_len = len(familyType) == 1
ref_len = len(reference) == 1

TransactionManager.Instance.EnsureInTransaction(doc)
for i in xrange(len(line)):
	l = line[i].ToRevitType()
	j = 0 if ftp_len else i
	k = 0 if ref_len else i
	try:
		errorReport = None
		if not familyType[j].IsActive : familyType[j].Activate()	
		nf = doc.Create.NewFamilyInstance(reference[k],l,familyType[j])
		OUT.append(nf.ToDSType(False))
	except:
		# if error accurs anywhere in the process catch it
		import traceback
		errorReport = traceback.format_exc()
		OUT.append(errorReport)
TransactionManager.Instance.TransactionTaskDone()
# ----------------------------------------
FamilyInstance = Output(python_script)
