# Dynamo custom node FamilyInstance Get Mirrored.dyf (Dynamo 2.6.1.8786)
# category: GeniusLoci.Family
# Gets the mirrored family instances.

familyInstance = Input(familyInstance: var[]..[])
python_script = Python(IN[0]=familyInstance)
# ---------- python_script.python (17 lines) ----------
import clr
clr.AddReference('RevitAPI')
from Autodesk.Revit.DB import Element

elements = UnwrapElement(IN[0]) if isinstance(IN[0],list) else [UnwrapElement(IN[0])]

mirroredElements,items = [],[]

for element in elements:
	if hasattr(element, "Mirrored"):
		if element.Mirrored is True:
			mirroredElements.append(element)
		else:
			items.append(element)
	else:items.append(element)
	
OUT = mirroredElements, items
# ----------------------------------------
code_block = CodeBlock(x=python_script) { x[0]; x[1]; }
Mirrored = Output(code_block.out0)
Others = Output(code_block.out1)
