# Dynamo custom node FamilyInstance HostFace Reference.dyf (Dynamo 2.6.1.8786)
# category: GeniusLoci.Reference
# Get the reference to the host face of the given family instance.

familyInstance = Input(familyInstance: var[]..[])
python_script = Python(IN[0]=familyInstance)
# ---------- python_script.python (41 lines) ----------
#Alban de Chasteigner 2022
#twitter : @geniusloci_bim
#geniusloci.bim@gmail.com
#https://github.com/albandechasteigner/GeniusLociForDynamo
import clr
clr.AddReference('RevitAPI')
import Autodesk
from Autodesk.Revit.DB import *

clr.AddReference('RevitServices')
import RevitServices
from RevitServices.Persistence import DocumentManager
from RevitServices.Transactions import TransactionManager
doc = DocumentManager.Instance.CurrentDBDocument

clr.AddReference('RevitNodes')
import Revit
clr.ImportExtensions(Revit.GeometryConversion)

references, planeList = [],[]

Elements = UnwrapElement(IN[0]) if isinstance(IN[0],list) else [UnwrapElement(IN[0])]

for item in Elements :
	reference=item.HostFace
	references.append(reference)
	try :
		TransactionManager.Instance.EnsureInTransaction(doc)
		trans1 = SubTransaction(doc)
		trans1.Start()
		sketch=SketchPlane.Create(doc,reference)
		plane = sketch.GetPlane().ToPlane(True)
		sketch.Dispose()
		trans1.RollBack()
		TransactionManager.Instance.TransactionTaskDone()
	except :
		plane=None
	planeList.append(plane)

if isinstance(IN[0], list): OUT = references,planeList
else: OUT = references[0],planeList[0]
# ----------------------------------------
code_block = CodeBlock(x=python_script) { x[0]; x[1]; }
Reference = Output(code_block.out0)
Plane = Output(code_block.out1)
