# Dynamo custom node FamilyInstance Origin Reference.dyf (Dynamo 2.6.1.8786)
# category: GeniusLoci.Reference
# Retrieves the origin point of the family instance.

element = Input(element: var[]..[])
python_script = Python(IN[0]=element)
# ---------- python_script.python (30 lines) ----------
#Alban de Chasteigner 2020
#twitter : @geniusloci_bim
#geniusloci.bim@gmail.com

import clr
clr.AddReference('RevitAPI')
from Autodesk.Revit.DB import *

clr.AddReference('RevitNodes')
import Revit
clr.ImportExtensions(Revit.GeometryConversion)

items = UnwrapElement(IN[0]) if isinstance(IN[0],list) else [UnwrapElement(IN[0])]

locationPoint,locRef = [],[]
refArr = ReferenceArray()

for item in items:
	doc = item.Document
	if isinstance(item, FamilyInstance):
		refArr.Append(Reference.ParseFromStableRepresentation(doc, item.UniqueId + ":0:INSTANCE:" + item.Symbol.UniqueId + ":1:SURFACE"))
		location = item.Location
		if isinstance(location,LocationPoint):
			locationPoint.append(location.Point.ToPoint())
		else:
			locationPoint.append(None)
	else : refArr.Append(None), locationPoint.append(None)
	
if isinstance(IN[0], list): OUT = refArr,locationPoint
else: OUT = refArr[0],locationPoint[0]
# ----------------------------------------
code_block = CodeBlock(x=python_script) { x[0]; x[1]; }
Reference = Output(code_block.out0)
Point = Output(code_block.out1)
