# Dynamo custom node FamilyInstance Reference ByName.dyf (Dynamo 2.6.1.8786)
# category: GeniusLoci.Reference
# Works only in Revit 2018.1 and later.
# Gets the reference corresponding to the named reference plane in the instance's family.

familyInstance = Input(familyInstance: var[]..[])
name = Input(name: string = "Center (Left/Right)")  # Reference Plane Name
python_script = Python(IN[0]=familyInstance, IN[1]=name)
# ---------- python_script.python (42 lines) ----------
#Alban de Chasteigner 2019
#twitter : @geniusloci_bim
#geniusloci.bim@gmail.com

import clr
clr.AddReference('RevitServices')
import RevitServices
from RevitServices.Persistence import DocumentManager
from RevitServices.Transactions import TransactionManager
doc = DocumentManager.Instance.CurrentDBDocument

clr.AddReference('RevitAPI')
import Autodesk
from Autodesk.Revit.DB import *

clr.AddReference('RevitNodes')
import Revit
clr.ImportExtensions(Revit.GeometryConversion)

elements = UnwrapElement(IN[0]) if isinstance(IN[0],list) else [UnwrapElement(IN[0])]
names = IN[1] if isinstance(IN[1],list) else [IN[1]]	
references, planeList = [],[]

for elem in elements:
	for name in names:
		reference=elem.GetReferenceByName(name)
		references.append(reference)
		try :
			TransactionManager.Instance.EnsureInTransaction(doc)
			trans1 = SubTransaction(doc)
			trans1.Start()
			sketch=SketchPlane.Create(doc,reference)
			plane = sketch.GetPlane().ToPlane(True)
			sketch.Dispose()
			trans1.RollBack()
			TransactionManager.Instance.TransactionTaskDone()
		except :
			plane=None
		planeList.append(plane)
		
if not isinstance(IN[0], list) and not isinstance(IN[1], list): OUT = references[0],planeList[0]
else: OUT = references,planeList
# ----------------------------------------
code_block = CodeBlock(x=python_script) { x[0]; x[1]; }
Reference = Output(code_block.out0)
Plane = Output(code_block.out1)
