# Dynamo custom node FamilyInstance ReferenceType.dyf (Dynamo 2.6.1.8786)
# category: GeniusLoci.Reference
# Works only in Revit 2018.1 and later.
# Identifies references of family instances corresponding to reference planes and reference lines in the family.

familyInstanceReferenceType = Python()
# ---------- familyInstanceReferenceType.python (13 lines) ----------
#Alban de Chasteigner 2019
#twitter : @geniusloci_bim
#geniusloci.bim@gmail.com

import clr
# Import RevitAPI
clr.AddReference("RevitAPI")
import Autodesk
from Autodesk.Revit.DB import *
import System

#Assign your output to the OUT variable
OUT = System.Enum.GetValues(Autodesk.Revit.DB.FamilyInstanceReferenceType)
# ----------------------------------------
ReferenceType = Output(familyInstanceReferenceType)
