# Dynamo custom node FamilyInstance References.dyf (Dynamo 2.6.1.8786)
# category: GeniusLoci.Reference
# Returns all references and references names.

familyInstance = Input(familyInstance: var[]..[])
python_script = Python(IN[0]=familyInstance)
# ---------- python_script.python (48 lines) ----------
#Alban de Chasteigner 2020
#twitter : @geniusloci_bim
#geniusloci.bim@gmail.com

import clr
clr.AddReference('RevitAPI')
import Autodesk
from Autodesk.Revit.DB import *
import System

clr.AddReference('RevitServices')
import RevitServices
from RevitServices.Persistence import DocumentManager
from RevitServices.Transactions import TransactionManager
doc = DocumentManager.Instance.CurrentDBDocument

clr.AddReference('RevitNodes')
import Revit
clr.ImportExtensions(Revit.GeometryConversion)

elements = UnwrapElement(IN[0]) if isinstance(IN[0],list) else [UnwrapElement(IN[0])]
referenceList,refnameList,planeList=[],[],[]

instanceReferenceType = System.Enum.GetValues(FamilyInstanceReferenceType)

#Get Reference Planes from Families
for element in elements:
	references,planes=[],[]
	for referenceType in instanceReferenceType:
		references.extend(element.GetReferences(referenceType))
		refname=[element.GetReferenceName(reference) for reference in references]
		try:
			TransactionManager.Instance.EnsureInTransaction(doc)
			trans1 = SubTransaction(doc)
			trans1.Start()
			sketchPlane = [Autodesk.Revit.DB.SketchPlane.Create(doc, reference) for reference in references]
			planes = [sketch.GetPlane().ToPlane(True) for sketch in sketchPlane]
			[sketch.Dispose() for sketch in sketchPlane]
			trans1.RollBack()
			TransactionManager.Instance.TransactionTaskDone()
		except:
			planes.append(None)
	referenceList.append(references)
	refnameList.append(refname)
	planeList.append(planes)
	
if isinstance(IN[0], list): OUT = referenceList,refnameList,planeList
else: OUT = referenceList[0],refnameList[0],planeList[0]
# ----------------------------------------
code_block = CodeBlock(x=python_script) { x[0]; x[1]; x[2]; }
Reference = Output(code_block.out0)
ReferenceName = Output(code_block.out1)
Plane = Output(code_block.out2)
