# Dynamo custom node FamilyType Preview.dyf (Dynamo 2.6.1.8786)
# category: GeniusLoci.Family
# Get the preview image of an element.
# This image is similar to what is seen in the Revit UI when selecting the type of an element.
# Inspired by Forum Dynamo

familyInstanceOrFamilyType = Input(familyInstanceOrFamilyType: var[]..[])
python_script = Python(IN[0]=familyInstanceOrFamilyType)
# ---------- python_script.python (22 lines) ----------
#Inspired by Sean Page
#https://forum.dynamobim.com/t/export-families-in-isometric-view-as-an-image-to-excel/45962/10
import clr
clr.AddReference('RevitAPI')
import Autodesk

clr.AddReference("System.Drawing")
from System.Drawing import Size

elements = UnwrapElement(IN[0]) if isinstance(IN[0],list) else [UnwrapElement(IN[0])]

images = []
size = Size(1000,1000)
for elem in elements:
	if isinstance(elem, Autodesk.Revit.DB.ElementType):
		elemType=elem
	else :
		elemType = elem.Document.GetElement(elem.GetTypeId())
	images.Add(elemType.GetPreviewImage(size))

if isinstance(IN[0], list): OUT = images
else: OUT = images[0]
# ----------------------------------------
Image = Output(python_script)
