# Dynamo custom node FilenameToFilePaths.dyf (Dynamo 2.6.1.8786)
# category: GeniusLoci.Printing
# Add directory and .pdf extension to filenames.
# Be careful with forbidden characters in filenames  (* . " / \ : ;)
# For use with the "Remove Special Characters from String" node.

DirectoryPath = Input(DirectoryPath: var[]..[])
Filenames = Input(Filenames: var[]..[])  # Filenames as list
code_block = CodeBlock(Directorypath=DirectoryPath, Filename=Filenames) { Directorypath+"\\"+Filename+".pdf"; }
FilePaths = Output(code_block)
