# Dynamo custom node Fill Pattern HostOrientation.dyf (Dynamo 2.6.1.8786)
# category: GeniusLoci.FillPattern
# Enumerates the types of orientations for fill patterns (OrientToView, KeepReadable, AlignWithHost).
# To use with the Create FillPattern node.

python_script = Python()  # graph input
# ---------- python_script.python (7 lines) ----------
import clr
clr.AddReference("RevitAPI")
import Autodesk
from Autodesk.Revit.DB import *
import System

OUT = System.Enum.GetValues(Autodesk.Revit.DB.FillPatternHostOrientation)
# ----------------------------------------
code_block = CodeBlock(x=python_script) { x[0]; x[1]; x[2]; }
OrientToView = Output(code_block.out0)
KeepReadable = Output(code_block.out1)
AlignWithHost = Output(code_block.out2)
