# Dynamo custom node Fill Pattern Properties.dyf (Dynamo 2.6.1.8786)
# category: GeniusLoci.FillPattern
# Returns the target, orientation, angles, origins, shifts, offsets, dashes and spaces of a given fill pattern.

fillPatternElement = Input(fillPatternElement: var[]..[])
python_script = Python(IN[0]=fillPatternElement)
# ---------- python_script.python (40 lines) ----------
#Alban de Chasteigner 2020
#twitter : @geniusloci_bim
#geniusloci.bim@gmail.com

import clr
clr.AddReference('RevitAPI')
import Autodesk
from Autodesk.Revit.DB import *

clr.AddReference('RevitServices')
import RevitServices
from RevitServices.Persistence import DocumentManager
uiapp = DocumentManager.Instance.CurrentUIApplication
app = uiapp.Application
version=int(app.VersionNumber)
	
target,orientation,gridcount,result,seg=[],[],[],[],[]
fillPatterns = UnwrapElement(IN[0]) if isinstance(IN[0],list) else [UnwrapElement(IN[0])]

for fillPattern in fillPatterns:
	if version < 2021:
		ut_degrees = DisplayUnitType.DUT_DECIMAL_DEGREES
		UIunit = fillPattern.Document.GetUnits().GetFormatOptions(UnitType.UT_Length).DisplayUnits
	else:
		ut_degrees = UnitTypeId.Degrees
		UIunit = fillPattern.Document.GetUnits().GetFormatOptions(SpecTypeId.Length).GetUnitTypeId()
	pattern=fillPattern.GetFillPattern()
	target.append(pattern.Target)
	orientation.append(pattern.HostOrientation)
	gridcount.append(pattern.GridCount)
	fillgrids=pattern.GetFillGrids()
	for fillG in fillgrids:
		result.append([UnitUtils.ConvertFromInternalUnits(fillG.Angle,ut_degrees),UnitUtils.ConvertFromInternalUnits(fillG.Origin.U,UIunit),UnitUtils.ConvertFromInternalUnits(fillG.Origin.V,UIunit),UnitUtils.ConvertFromInternalUnits(fillG.Shift,UIunit), UnitUtils.ConvertFromInternalUnits(fillG.Offset,UIunit)])
		if fillG.GetSegments():
			seg.append([UnitUtils.ConvertFromInternalUnits(fill,UIunit) for fill in fillG.GetSegments()])
		else:
			seg.append([None,None])

if isinstance(IN[0], list): OUT = target,orientation,gridcount,map(list, zip(*result)),map(list, zip(*seg))
else: OUT = target[0],orientation[0],gridcount[0],map(list, zip(*result)),map(list, zip(*seg))
# ----------------------------------------
code_block = CodeBlock(x=python_script) { x[0]; x[1]; x[2]; x[3][0]; x[3][1]; x[3][2]; x[3][3]; x[3][4]; x[4][0]; x[4][1]; }
Target = Output(code_block.out0)  # Target of this fill pattern applied to.
HostOrientation = Output(code_block.out1)  # Orientation to host layer.
GridCount = Output(code_block.out2)  # Gets the count of the fill grids in this fill pattern.
Angles = Output(code_block.out3)  # Degrees
X_Origins = Output(code_block.out4)
Y_Origins = Output(code_block.out5)
Shifts = Output(code_block.out6)
Offsets = Output(code_block.out7)
Dashes = Output(code_block.out8)
Spaces = Output(code_block.out9)
