# Dynamo custom node FilledRegion LineStyle Change.dyf (Dynamo 2.6.1.8786)
# category: GeniusLoci.Graphics
# Change the linestyle of the boundaries of a Filled Region to another given linestyle.

filledRegion = Input(filledRegion: var[]..[])
lineStyle = Input(lineStyle: var[]..[])  # GraphicsStyle
python_script = Python(IN[0]=filledRegion, IN[1]=lineStyle)
# ---------- python_script.python (31 lines) ----------
#Alban de Chasteigner, 2019
#twitter : @geniusloci_bim
#geniusloci.bim@gmail.com

import clr
clr.AddReference('RevitAPI')
import Autodesk
from Autodesk.Revit.DB import *

clr.AddReference('RevitServices')
import RevitServices
from RevitServices.Persistence import DocumentManager
from RevitServices.Transactions import TransactionManager
doc = DocumentManager.Instance.CurrentDBDocument

def tolist(obj1):
	if hasattr(obj1,"__iter__"): return obj1
	else: return [obj1]

filledRegion = tolist(UnwrapElement(IN[0]))
lineStyle = tolist(UnwrapElement(IN[1]))

TransactionManager.Instance.EnsureInTransaction(doc)
for fillR, lineS in zip(filledRegion, lineStyle):
	if FilledRegion.IsValidLineStyleIdForFilledRegion(doc,lineS.Id):
		boundaries=fillR.SetLineStyleId(lineS.Id)
	else :
		pass
TransactionManager.Instance.TransactionTaskDone()

OUT = filledRegion
# ----------------------------------------
FilledRegion = Output(python_script)
