# Dynamo custom node FilledRegion Properties Change.dyf (Dynamo 2.6.1.8786)
# category: GeniusLoci.Graphics
# Assigns Pattern, Color and Line Weight to the given Filled Region or to a Filled Region Type.
# Note : Prior to Revit 2019, the materials have only one surface pattern and one cut pattern.

FilledRegion_OrType = Input(FilledRegion_OrType: var[]..[])
ForegroundPattern = Input(ForegroundPattern: var[]..[] = null)
ForegroundPatternColor = Input(ForegroundPatternColor: var[]..[] = null)  # Dynamo Color
BackgroundPattern = Input(BackgroundPattern: var[]..[] = null)  # Drafting pattern
BackgroundPatternColor = Input(BackgroundPatternColor: var[]..[] = null)  # Dynamo Color
IsMasking = Input(IsMasking: var[]..[] = null)  # Boolean
LineWeight = Input(LineWeight: var[]..[] = null)  # Integer within the range 1-16
python_script = Python(IN[0]=FilledRegion_OrType, IN[1]=ForegroundPattern, IN[2]=ForegroundPatternColor, IN[3]=BackgroundPattern, IN[4]=BackgroundPatternColor, IN[5]=IsMasking, IN[6]=LineWeight)
# ---------- python_script.python (91 lines) ----------
#Alban de Chasteigner, 2018
#twitter : @geniusloci_bim
#geniusloci.bim@gmail.com

import clr
clr.AddReference('RevitAPI')
import Autodesk
from Autodesk.Revit.DB import *

clr.AddReference('RevitServices')
import RevitServices
from RevitServices.Persistence import DocumentManager
from RevitServices.Transactions import TransactionManager
doc = DocumentManager.Instance.CurrentDBDocument
uiapp = DocumentManager.Instance.CurrentUIApplication
app = uiapp.Application
version=int(app.VersionNumber)

def tolist(obj1):
	if hasattr(obj1,"__iter__"): return obj1
	else: return [obj1]
	
def ConvertColor(e):
	return Autodesk.Revit.DB.Color(e.Red, e.Green, e.Blue)

filledRegions = tolist(UnwrapElement(IN[0]))
foregroundPatterns=tolist(UnwrapElement(IN[1]))
foreColors = tolist(IN[2])
backgroundPatterns=tolist(UnwrapElement(IN[3]))
backColors = tolist(IN[4])
maskings = tolist(IN[5])
lineWeights = tolist(IN[6])
filledRegionTypes=[]

TransactionManager.Instance.EnsureInTransaction(doc)
for foregroundPattern,foreColor,backgroundPattern,backColor,masking,lineWeight,fillR in zip(foregroundPatterns,foreColors,backgroundPatterns,backColors,maskings,lineWeights,filledRegions) :
	if isinstance(fillR, Autodesk.Revit.DB.ElementType):
		filledRegionType=fillR
	else :
		filledRegionType = doc.GetElement(fillR.GetTypeId())
	filledRegionTypes.append(filledRegionType)
	if version < 2019 :
		if foregroundPattern == None:
			pass
		else:
			filledRegionType.FillPatternId=foregroundPattern.Id
		if backgroundPattern == None:
			pass
		else:
			filledRegionType.FillPatternId=backgroundPattern.Id
		if foreColor == None:
			pass
		else:
			filledRegionType.Color=ConvertColor(foreColor)
		if backColor == None:
			pass
		else:
			filledRegionType.Color=ConvertColor(backColor)	
		if lineWeight == None:
			pass
		else:
			filledRegionType.LineWeight=lineWeight	
	else:
		if foregroundPattern == None:
			pass
		else:
			filledRegionType.ForegroundPatternId=foregroundPattern.Id
		if backgroundPattern == None:
			pass
		else:
			filledRegionType.BackgroundPatternId=backgroundPattern.Id
		if foreColor == None:
			pass
		else:
			filledRegionType.ForegroundPatternColor = ConvertColor(foreColor)
		if backColor == None:
			pass
		else:
			filledRegionType.BackgroundPatternColor = ConvertColor(backColor)
		if masking == None:
			pass
		else:
			filledRegionType.IsMasking=masking
		if lineWeight == None:
			pass
		else:
			filledRegionType.LineWeight=lineWeight	
TransactionManager.Instance.TransactionTaskDone()

if isinstance(IN[0], list): OUT = filledRegionTypes
else: OUT = filledRegionTypes[0]
# ----------------------------------------
FilledRegionType = Output(python_script)
