# Dynamo custom node Get AllDocuments.dyf (Dynamo 2.6.1.8786)
# category: GeniusLoci.Document
# Get documents (linked and opened in background). The first document is the active document.

python_script = Python()  # graph input
# ---------- python_script.python (25 lines) ----------
#Alban de Chasteigner 2020
#twitter : @geniusloci_bim
#geniusloci.bim@gmail.com
#https://github.com/albandechasteigner/GeniusLociForDynamo

import clr
clr.AddReference("RevitServices")
import RevitServices
from RevitServices.Persistence import DocumentManager
doc = DocumentManager.Instance.CurrentDBDocument
uiapp = DocumentManager.Instance.CurrentUIApplication
app = uiapp.Application
docs = app.Documents

titles,documents = [],[]

for dc in docs:
	if dc.Title != doc.Title:
		documents.Add(dc)
		titles.Add(dc.Title)
	else:
		docu=dc
		titl=dc.Title

OUT = [docu]+documents,[titl]+titles
# ----------------------------------------
code_block = CodeBlock(x=python_script) { x[0]; x[1]; }
Document = Output(code_block.out0)
FileName = Output(code_block.out1)
