# Dynamo custom node Get Category Properties.dyf (Dynamo 2.6.1.8786)
# category: GeniusLoci.Graphics
# Get the Line Patterns, weights, colors and materials for a given category.

category = Input(category: var[]..[])
python_script = Python(IN[0]=category)
# ---------- python_script.python (49 lines) ----------
#Alban de Chasteigner 2018
#twitter : @geniusloci_bim
#geniusloci.bim@gmail.com

import clr
clr.AddReference('RevitAPI')
from Autodesk.Revit.DB import *

clr.AddReference("RevitNodes")
import Revit
clr.ImportExtensions(Revit.Elements)

clr.AddReference('DSCoreNodes')
import DSCore
from DSCore import Color

clr.AddReference("RevitServices")
import RevitServices
from RevitServices.Persistence import DocumentManager
doc = DocumentManager.Instance.CurrentDBDocument

cat = UnwrapElement(IN[0]) if isinstance(IN[0],list) else [UnwrapElement(IN[0])]

subcat = cat[0].SubCategories

subCategory,listGraph,listPattern,patname,listpatid,lineProjWeight,lineProjCut,listRGB,listMaterial = [],[],[],[],[],[],[],[],[]

for i in subcat:
	subCategory.append(Revit.Elements.Category.ById(i.Id.IntegerValue))
	id = i.GetLinePatternId(GraphicsStyleType.Projection)
	pat = LinePatternElement.GetLinePattern(doc,id)
	projWeight = i.GetLineWeight(GraphicsStyleType.Projection)
	cutWeight = i.GetLineWeight(GraphicsStyleType.Cut)
	rgb = DSCore.Color.ByARGB(255,i.LineColor.Red, i.LineColor.Green, i.LineColor.Blue)
	listMaterial.append(i.Material)
	listRGB.append(rgb)
	lineProjWeight.append(projWeight)
	lineProjCut.append(cutWeight)
	listPattern.append(pat)
	listpatid.append(doc.GetElement(id))
	try:
		patname.append(pat.Name)
	except:
		patname.append("Solid")
		
	style = i.GetGraphicsStyle(GraphicsStyleType.Projection)
	listGraph.append(style)

OUT = listGraph, subCategory, listpatid, patname, lineProjWeight, lineProjCut,listRGB,listMaterial
# ----------------------------------------
code_block = CodeBlock(x=python_script) { x[0]; x[1]; x[2]; x[3]; x[4]; x[5]; x[6]; x[7]; }
Graphic_Style = Output(code_block.out0)
SubCategory = Output(code_block.out1)
Line_Pattern = Output(code_block.out2)
Line_Pattern_Name = Output(code_block.out3)
Projection_Line_Weight = Output(code_block.out4)
Cut_Line_Weight = Output(code_block.out5)
Line_Colors = Output(code_block.out6)
Material = Output(code_block.out7)
