# Dynamo custom node Get Compound Thickness.dyf (Dynamo 2.6.1.8786)
# category: GeniusLoci.CompoundStructure
# Obtains the thickness of the wall, floor, roof or ceiling instance or Type.

ElementOrFamilyType = Input(ElementOrFamilyType: var[]..[])
python_script = Python(IN[0]=ElementOrFamilyType)
# ---------- python_script.python (66 lines) ----------
#Alban de Chasteigner 2021
#twitter : @geniusloci_bim
#geniusloci.bim@gmail.com
#https://github.com/albandechasteigner/GeniusLociForDynamo

import clr
clr.AddReference('RevitAPI')
import Autodesk
from Autodesk.Revit.DB import *

clr.AddReference('RevitServices')
import RevitServices
from RevitServices.Persistence import DocumentManager
uiapp = DocumentManager.Instance.CurrentUIApplication
app = uiapp.Application
version=int(app.VersionNumber)

elements = UnwrapElement(IN[0]) if isinstance(IN[0],list) else [UnwrapElement(IN[0])]
	
thickness = []
for elem in elements :
	famTypes= []
	doc =  elem.Document
	if version < 2021:
		UIunit = doc.GetUnits().GetFormatOptions(UnitType.UT_Length).DisplayUnits
	else:
		UIunit = doc.GetUnits().GetFormatOptions(SpecTypeId.Length).GetUnitTypeId()
	if isinstance(elem, ElementType) or isinstance(elem, FamilySymbol) :
		famTypes.append(elem)
	elif isinstance(elem, Wall):
		famTypes.append(elem.WallType)
	elif isinstance(elem, Floor):
		famTypes.append(elem.FloorType)
	elif isinstance(elem, FootPrintRoof) or isinstance(elem, ExtrusionRoof) or isinstance(elem, RoofBase) :
		famTypes.append(elem.RoofType)
	elif isinstance(elem, Ceiling) or isinstance(elem, FaceWall) :
		famTypes.append(doc.GetElement(elem.GetTypeId()))
	elif isinstance(elem,FamilyInstance) and elem.Category.Id == ElementId(BuiltInCategory.OST_StructuralFraming) and elem.Symbol.Family.CanHaveStructuralSection() and hasattr(elem.Symbol.GetStructuralSection(), "Width"):
		famTypes.append(elem.Symbol)
	else:
		thickness.append(None)
		#try:
			#bb = elem.get_BoundingBox(None)
			#min = bb.Min
			#max = bb.Max
			#w = abs(min.X - max.X)
			#l = abs(min.Y - max.Y)
			#if w < l :
			#	thickness.append(round(UnitUtils.ConvertFromInternalUnits(w,UIunit),3))
			#else : thickness.append(round(UnitUtils.ConvertFromInternalUnits(l,UIunit),3))
		#except:
			#thickness.append(None)
	for famType in famTypes:
		if isinstance(famType, WallType):
			thickness.append(UnitUtils.ConvertFromInternalUnits(famType.get_Parameter(BuiltInParameter.WALL_ATTR_WIDTH_PARAM).AsDouble(),UIunit))
		elif isinstance(famType, FloorType):
			thickness.append(UnitUtils.ConvertFromInternalUnits(famType.get_Parameter(BuiltInParameter.FLOOR_ATTR_DEFAULT_THICKNESS_PARAM).AsDouble(),UIunit))
		elif isinstance(famType, RoofType):
			thickness.append(UnitUtils.ConvertFromInternalUnits(famType.get_Parameter(BuiltInParameter.ROOF_ATTR_DEFAULT_THICKNESS_PARAM).AsDouble(),UIunit))
		elif isinstance(famType, CeilingType):
			thickness.append(UnitUtils.ConvertFromInternalUnits(famType.get_Parameter(BuiltInParameter.CEILING_THICKNESS).AsDouble(),UIunit))
		elif isinstance(famType,FamilySymbol) and famType.Category.Id == ElementId(BuiltInCategory.OST_StructuralFraming) :
			thickness.append(round(UnitUtils.ConvertFromInternalUnits(famType.GetStructuralSection().Width,UIunit),3))
			
if isinstance(IN[0], (list)): OUT = thickness
else: OUT = thickness[0]
# ----------------------------------------
Thickness = Output(python_script)
