# Dynamo custom node Get DependentElements.dyf (Dynamo 2.6.1.8786)
# category: GeniusLoci.Element
# Returns all elements which are children of this Element and that will be deleted with it.

element = Input(element: var[]..[])
python_script = Python(IN[0]=element)
# ---------- python_script.python (23 lines) ----------
import clr
clr.AddReference('RevitAPI')
from Autodesk.Revit.DB import *

clr.AddReference("RevitServices")
import RevitServices
from RevitServices.Persistence import DocumentManager

doc = DocumentManager.Instance.CurrentDBDocument

if isinstance(IN[0], list) : elements = UnwrapElement(IN[0])
else : elements = [UnwrapElement(IN[0])]

depElems=[]
for elem in elements :
	depElem=[]
	dependentIds = elem.GetDependentElements(None)
	for id in dependentIds :
		depElem.append(doc.GetElement(id))
	depElems.append(depElem)
	
if isinstance(IN[0], list): OUT = depElems
else: OUT = depElems[0]
# ----------------------------------------
DependentElements = Output(python_script)
