# Dynamo custom node Get Element Worksharing Tooltip Info.dyf (Dynamo 2.6.1.8786)
# category: GeniusLoci.Element
# Returns worksharing informations (Creator, LastChangedBy, Owner) about element in the given document.

element = Input(element: var[]..[])
docOrRevitLinkInstance = Input(docOrRevitLinkInstance: var = null)  # Use only if you want to query a linked model
getWorksharingTooltipInfo = Python(IN[0]=element, IN[1]=docOrRevitLinkInstance)
# ---------- getWorksharingTooltipInfo.python (35 lines) ----------
#Alban de Chasteigner 2018
#twitter : @geniusloci_bim
#geniusloci.bim@gmail.com
#https://github.com/albandechasteigner/GeniusLociForDynamo

import clr
clr.AddReference("RevitServices")
import RevitServices
from RevitServices.Persistence import DocumentManager

clr.AddReference("RevitAPI")
from Autodesk.Revit.DB import *

elements = UnwrapElement(IN[0]) if isinstance(IN[0],list) else [UnwrapElement(IN[0])]

#Part of script from Clockwork
inputdoc = UnwrapElement(IN[1])
if inputdoc == None:
	doc = DocumentManager.Instance.CurrentDBDocument
elif isinstance (inputdoc, RevitLinkInstance) :
	doc = inputdoc.GetLinkDocument()
elif isinstance (inputdoc, Document) :
	doc = inputdoc
else: doc = None

creator,changer,owner,requester = [],[],[],[]

for element in elements:	
	tooltip = WorksharingUtils.GetWorksharingTooltipInfo(doc, element.Id)
	creator.append(tooltip.Creator)
	changer.append(tooltip.LastChangedBy)
	owner.append(tooltip.Owner)
	requester.append(tooltip.GetRequesters())

OUT = creator, changer, owner, requester
# ----------------------------------------
code_block = CodeBlock(x=getWorksharingTooltipInfo) { x[0]; x[1]; x[2]; x[3]; }
Creator = Output(code_block.out0)
LastChangedBy = Output(code_block.out1)
Owner = Output(code_block.out2)
Requester = Output(code_block.out3)
