# Dynamo custom node Get Elements Overrides.dyf (Dynamo 2.6.1.8786)
# category: GeniusLoci.Graphics
# Get the overrides applied to the elements in the given View.
# Note : Prior to Revit 2019, the materials have only one surface pattern and one cut pattern.

view = Input(view: var = Revit.Application.Document.Current.ActiveView)
element = Input(element: var[]..[])
python_script = Python(IN[0]=view, IN[1]=element)
# ---------- python_script.python (105 lines) ----------
#Alban de Chasteigner 2018
#twitter : @geniusloci_bim
#geniusloci.bim@gmail.com

import clr
clr.AddReference('RevitAPI')
from Autodesk.Revit.DB import *

clr.AddReference('RevitServices')
import RevitServices
from RevitServices.Persistence import DocumentManager
doc = DocumentManager.Instance.CurrentDBDocument
uiapp = DocumentManager.Instance.CurrentUIApplication
app = uiapp.Application
version=int(app.VersionNumber)

clr.AddReference('DSCoreNodes')
import DSCore
from DSCore import Color

view = UnwrapElement(IN[0])
elements = UnwrapElement(IN[1]) if isinstance(IN[1],list) else [UnwrapElement(IN[1])]

listprwe,listprojRGB,listprPat,listSurForPatRGB,listSurForPat,listSurBacPatRGB,listSurBacPat,listcutwe,listcutRGB,listcutPat,listCutForPatRGB,listCutForPat,listCutBacPatRGB,listCutBacPat,listtrans,listhalf, visible = [],[],[],[],[],[],[],[],[],[],[],[],[],[],[],[],[]

for element in elements:
	o = view.GetElementOverrides(element.Id)
	visible.append(not(element.IsHidden(view)))
	projCol = o.ProjectionLineColor
	if projCol.IsValid:
		projrgb = DSCore.Color.ByARGB(255, projCol.Red, projCol.Green, projCol.Blue)
	else:
		projrgb = None
	listprojRGB.Add(projrgb)
	
	cutCol= o.CutLineColor
	if cutCol.IsValid:
		cutrgb = DSCore.Color.ByARGB(255, cutCol.Red, cutCol.Green, cutCol.Blue)
	else:
		cutrgb = None
	listcutRGB.Add(cutrgb)
	listtrans.append(o.Transparency)
	listhalf.append(o.Halftone)
	listprwe.append(o.ProjectionLineWeight)
	listprPat.append(doc.GetElement(o.ProjectionLinePatternId))
	listcutwe.append(o.CutLineWeight)
	listcutPat.append(doc.GetElement(o.CutLinePatternId))
	
	if version < 2019 :
		projFillCol=o.ProjectionFillColor
		if projFillCol.IsValid:
			projfillrgb = DSCore.Color.ByARGB(255, projFillCol.Red, projFillCol.Green, projFillCol.Blue)
		else:
			projfillrgb = None
		listSurForPatRGB.Add(projfillrgb)
		listSurBacPatRGB.Add(projfillrgb)
		
		cutfillcolor=o.CutFillColor
		if cutfillcolor.IsValid:
			cutfillrgb = DSCore.Color.ByARGB(255, cutfillcolor.Red, cutfillcolor.Green, cutfillcolor.Blue)
		else:
			cutfillrgb = None
		listCutForPatRGB.Add(cutfillrgb)
		listCutBacPatRGB.Add(cutfillrgb)
		
		listSurForPat.append(doc.GetElement(o.ProjectionFillPatternId))
		listSurBacPat.append(doc.GetElement(o.ProjectionFillPatternId))
		listCutForPat.append(doc.GetElement(o.CutFillPatternId))
		listCutBacPat.append(doc.GetElement(o.CutFillPatternId))
		
	else:
		projFillCol=o.SurfaceForegroundPatternColor
		if projFillCol.IsValid:
			projfillrgb = DSCore.Color.ByARGB(255, projFillCol.Red, projFillCol.Green, projFillCol.Blue)
		else:
			projfillrgb = None
		listSurForPatRGB.Add(projfillrgb)
	
		SurBacCol=o.SurfaceBackgroundPatternColor
		if SurBacCol.IsValid:
			SurBacrgb = DSCore.Color.ByARGB(255, SurBacCol.Red, SurBacCol.Green, SurBacCol.Blue)
		else:
			SurBacrgb = None
		listSurBacPatRGB.Add(SurBacrgb)
	
		cutfillcolor=o.CutForegroundPatternColor
		if cutfillcolor.IsValid:
			cutfillrgb = DSCore.Color.ByARGB(255, cutfillcolor.Red, cutfillcolor.Green, cutfillcolor.Blue)
		else:
			cutfillrgb = None
		listCutForPatRGB.Add(cutfillrgb)
	
		cutBaccolor=o.CutBackgroundPatternColor
		if cutBaccolor.IsValid:
			cutBacrgb = DSCore.Color.ByARGB(255, cutBaccolor.Red, cutBaccolor.Green, cutBaccolor.Blue)
		else:
			cutBacrgb = None
		listCutBacPatRGB.Add(cutBacrgb)
		
		listSurForPat.append(doc.GetElement(o.SurfaceForegroundPatternId))
		listSurBacPat.append(doc.GetElement(o.SurfaceBackgroundPatternId))
		listCutForPat.append(doc.GetElement(o.CutForegroundPatternId))
		listCutBacPat.append(doc.GetElement(o.CutBackgroundPatternId))
	
OUT=listprPat,listprojRGB,listprwe,listSurForPat,listSurForPatRGB,listSurBacPat,listSurBacPatRGB,listcutPat,listcutRGB,listcutwe,listCutForPat,listCutForPatRGB,listCutBacPat,listCutBacPatRGB,listtrans,listhalf,visible
# ----------------------------------------
code_block = CodeBlock(x=python_script) { x[0]; x[1]; x[2]; x[3]; x[4]; x[5]; x[6]; x[7]; x[8]; x[9]; x[10]; x[11]; x[12]; x[13]; x[14]; x[15]; x[16]; }
ProjectionLinePattern = Output(code_block.out0)
ProjectionLineColor = Output(code_block.out1)
ProjectionLineWeight = Output(code_block.out2)
SurfaceForegroundPattern = Output(code_block.out3)
SurfaceForegroundPatternColor = Output(code_block.out4)
SurfaceBackgroundPattern = Output(code_block.out5)
SurfaceBackgroundPatternColor = Output(code_block.out6)
CutLinePattern = Output(code_block.out7)
CutLineColor = Output(code_block.out8)
CutLineWeight = Output(code_block.out9)
CutForegroundPattern = Output(code_block.out10)
CutForegroundPatternColor = Output(code_block.out11)
CutBackgroundPattern = Output(code_block.out12)
CutBackgroundPatternColor = Output(code_block.out13)
Transparency = Output(code_block.out14)
Halftone = Output(code_block.out15)
Visible = Output(code_block.out16)
