# Dynamo custom node Get Elements at Ends.dyf (Dynamo 2.6.1.8786)
# category: GeniusLoci.Element
# Get the two elements joining to the ends.

element = Input(element: var[]..[])  # Curve based element Longest lacing for several elements
python_script = Python(IN[0]=element)
# ---------- python_script.python (32 lines) ----------
#Alban de Chasteigner 2019
#twitter : @geniusloci_bim
#geniusloci.bim@gmail.com

import clr
clr.AddReference('RevitAPI')
from Autodesk.Revit.DB import *

clr.AddReference("RevitNodes")
import Revit
clr.ImportExtensions(Revit.GeometryConversion)
clr.ImportExtensions(Revit.Elements)
from Revit.Elements import *

from itertools import chain

items = UnwrapElement(IN[0])
if not hasattr(items, '__iter__'):
	items = [items]
	
join,result = [],[]

for item in items:
	loc = item.Location
	for ip in range(0, 2):
		join.append(loc.ElementsAtJoin[ip])
		flatlist = list(chain.from_iterable(join))
	for wall in flatlist :
		if wall.Id != item.Id :
			result.append(wall)

OUT = result
# ----------------------------------------
Elements = Output(python_script)
