# Dynamo custom node Get Filter Overrides.dyf (Dynamo 2.6.1.8786)
# category: GeniusLoci.Graphics
# Get the view filter and its overrides from the given view.
# Note : Prior to Revit 2019, the materials have only one surface pattern and one cut pattern.

view = Input(view: var[]..[] = Revit.Application.Document.Current.ActiveView)
get_colors_of_filters = Python(IN[0]=view)
# ---------- get_colors_of_filters.python (138 lines) ----------
#Alban de Chasteigner 2018
#twitter : @geniusloci_bim
#geniusloci.bim@gmail.com

import clr
clr.AddReference('DSCoreNodes')
import DSCore
from DSCore import Color

clr.AddReference('RevitAPI')
import Autodesk
from Autodesk.Revit.DB import *

clr.AddReference('RevitNodes')
import Revit

clr.AddReference('RevitServices')
import RevitServices
from RevitServices.Persistence import DocumentManager
doc = DocumentManager.Instance.CurrentDBDocument
uiapp = DocumentManager.Instance.CurrentUIApplication
app = uiapp.Application
version=int(app.VersionNumber)

views = UnwrapElement(IN[0]) if isinstance(IN[0],list) else [UnwrapElement(IN[0])]

projRGBList,cutRGBList, surForPatList, surBacPatList, cutForPatList, cutBacPatList, transList, halfList, prweList, prPatList, cutweList, cutPatList, surForList, surBacList, cutForList, cutBacList, elementList, nameList, visibilitiesList, categories = [],[],[],[],[],[],[],[],[],[],[],[],[],[],[],[],[],[],[],[]

for v in views:
	filters = v.GetFilters() # Get all the filter ids
	elements, elementName, visibilities, listprojRGB, listcutRGB, listtrans, listhalf, listprwe, listprPat, listcutwe, listcutPat, rgbsurForList, rgbsurBacList, rgbCutForList, rgbCutBacList, listSurForPat,listSurBacPat,listCutForPat,listCutBacPat,cats = [],[],[],[],[],[],[],[],[],[],[],[],[],[],[],[],[],[],[],[]
	
	for f in filters:
		visibilities.append(v.GetFilterVisibility(f))
		element=doc.GetElement(f)
		elements.append(element)
		elementName.append(element.Name)
		catid=[Revit.Elements.Category.ById(c.IntegerValue).Name for c in element.GetCategories()]
		cate = catid if len(catid)>1 else catid[0]
		cats.append(cate)
		filterObject = v.GetFilterOverrides(f)
		projCol = filterObject.ProjectionLineColor
		if projCol.IsValid:
			projrgb = DSCore.Color.ByARGB(255, projCol.Red, projCol.Green, projCol.Blue)
		else:
			projrgb = None
		listprojRGB.Add(projrgb)
	
		cutCol= filterObject.CutLineColor
		if cutCol.IsValid:
			cutrgb = DSCore.Color.ByARGB(255, cutCol.Red, cutCol.Green, cutCol.Blue)
		else:
			cutrgb = None
		listcutRGB.Add(cutrgb)
		listtrans.append(filterObject.Transparency)
		listhalf.append(filterObject.Halftone)
		listprwe.append(filterObject.ProjectionLineWeight)
		listprPat.append(doc.GetElement(filterObject.ProjectionLinePatternId))
		listcutwe.append(filterObject.CutLineWeight)
		listcutPat.append(doc.GetElement(filterObject.CutLinePatternId))
		if version < 2019 :
			col = filterObject.ProjectionFillColor
			if col.IsValid:
				rgbSurFor = DSCore.Color.ByARGB(255, col.Red, col.Green, col.Blue)
			else:
				rgbSurFor = None
			rgbsurForList.Add(rgbSurFor)
			rgbsurBacList.Add(rgbSurFor)
	
			cut = filterObject.CutFillColor
			if cut.IsValid:
				rgbcut = DSCore.Color.ByARGB(255, cut.Red, cut.Green, cut.Blue)
			else:
				rgbcut = None
			rgbCutForList.Add(rgbcut)
			rgbCutBacList.Add(rgbcut)
			listSurForPat.append(doc.GetElement(filterObject.ProjectionFillPatternId))
			listSurBacPat.append(doc.GetElement(filterObject.ProjectionFillPatternId))
			listCutForPat.append(doc.GetElement(filterObject.CutFillPatternId))
			listCutBacPat.append(doc.GetElement(filterObject.CutFillPatternId))
		else:
			col = filterObject.SurfaceForegroundPatternColor
			if col.IsValid:
				rgbSurFor = DSCore.Color.ByARGB(255, col.Red, col.Green, col.Blue)
			else:
				rgbSurFor = None
			rgbsurForList.Add(rgbSurFor)

			surBacCol = filterObject.SurfaceBackgroundPatternColor
			if surBacCol.IsValid:
				rgbSurBac = DSCore.Color.ByARGB(255, surBacCol.Red, surBacCol.Green, surBacCol.Blue)
			else:
				rgbSurBac = None
			rgbsurBacList.Add(rgbSurBac)
	
			cut = filterObject.CutForegroundPatternColor
			if cut.IsValid:
				rgbcut = DSCore.Color.ByARGB(255, cut.Red, cut.Green, cut.Blue)
			else:
				rgbcut = None
			rgbCutForList.Add(rgbcut)

			cutBac = filterObject.CutBackgroundPatternColor
			if cutBac.IsValid:
				rgbCutBac = DSCore.Color.ByARGB(255, cutBac.Red, cutBac.Green, cutBac.Blue)
			else:
				rgbCutBac = None
			rgbCutBacList.Add(rgbCutBac)
			listSurForPat.append(doc.GetElement(filterObject.SurfaceForegroundPatternId))
			listSurBacPat.append(doc.GetElement(filterObject.SurfaceBackgroundPatternId))
			listCutForPat.append(doc.GetElement(filterObject.CutForegroundPatternId))
			listCutBacPat.append(doc.GetElement(filterObject.CutBackgroundPatternId))
		
	prPatList.append(listprPat)
	projRGBList.Add(listprojRGB)
	prweList.append(listprwe)
	surForPatList.append(listSurForPat)
	surForList.Add(rgbsurForList)
	surBacPatList.append(listSurBacPat)
	surBacList.Add(rgbsurBacList)
	
	cutPatList.append(listcutPat)
	cutweList.append(listcutwe)
	cutRGBList.Add(listcutRGB)
	cutForPatList.append(listCutForPat)
	cutForList.Add(rgbCutForList)
	cutBacPatList.append(listCutBacPat)
	cutBacList.Add(rgbCutBacList)
	
	transList.Add(listtrans)
	halfList.Add(listhalf)
	visibilitiesList.append(visibilities)
	elementList.append(elements)
	nameList.append(elementName)
	categories.append(cats)
	
if isinstance(IN[0], list): OUT = prPatList, projRGBList, prweList, surForPatList, surForList, surBacPatList, surBacList, cutPatList, cutweList, cutRGBList, cutForPatList, cutForList, cutBacPatList, cutBacList, transList, halfList, visibilitiesList, elementList, nameList,categories
else: OUT = prPatList[0], projRGBList[0], prweList[0], surForPatList[0], surForList[0], surBacPatList[0], surBacList[0], cutPatList[0], cutweList[0], cutRGBList[0], cutForPatList[0], cutForList[0], cutBacPatList[0], cutBacList[0], transList[0], halfList[0],visibilitiesList[0], elementList[0], nameList[0],categories[0]
# ----------------------------------------
code_block = CodeBlock(x=get_colors_of_filters)
# ---------- code_block.designscript (20 lines) ----------
x[0];
x[1];
x[2];
x[3];
x[4];
x[5];
x[6];
x[7];
x[8];
x[9];
x[10];
x[11];
x[12];
x[13];
x[14];
x[15];
x[16];
x[17];
x[18];
x[19];
# ----------------------------------------
ProjectionLinePattern = Output(code_block.out0)
ProjectionLineColor = Output(code_block.out1)
ProjectionLineWeight = Output(code_block.out2)
SurfaceForegroundPattern = Output(code_block.out3)
SurfaceForegroundPatternColor = Output(code_block.out4)
SurfaceBackgroundPattern = Output(code_block.out5)
SurfaceBackgroundPatternColor = Output(code_block.out6)
CutLinePattern = Output(code_block.out7)
CutLineColor = Output(code_block.out8)
CutLineWeight = Output(code_block.out9)
CutForegroundPattern = Output(code_block.out10)
CutForegroundPatternColor = Output(code_block.out11)
CutBackgroundPattern = Output(code_block.out12)
CutBackgroundPatternColor = Output(code_block.out13)
Transparency = Output(code_block.out14)
Halftone = Output(code_block.out15)
Visibility = Output(code_block.out16)
ViewFilter = Output(code_block.out17)
ViewFilterName = Output(code_block.out18)
Categories = Output(code_block.out19)
