# Dynamo custom node Get Flipped Element.dyf (Dynamo 2.6.1.8786)
# category: GeniusLoci.Element
# Gets the flipped wall, hand flipped (hinge side) and facing flipped (interior wall side) doors.

element = Input(element: var[]..[])
python_script = Python(IN[0]=element)
# ---------- python_script.python (30 lines) ----------
import clr
clr.AddReference('RevitAPI')
from Autodesk.Revit.DB import Element

elements = UnwrapElement(IN[0]) if isinstance(IN[0],list) else [UnwrapElement(IN[0])]

flippedElements,items = [],[]

for element in elements:
	if hasattr(element, "Flipped"):
		if element.Flipped is True:
			flippedElements.append(element)
		else:
			items.append(element)
	elif hasattr(element, "HandFlipped"):
		if element.HandFlipped is True:
			flippedElements.append(element)
		else:
			items.append(element)
	elif hasattr(element, "IsWorkPlaneFlipped"):
		if element.IsWorkPlaneFlipped is True:
			flippedElements.append(element)
		else:
			items.append(element)
	elif hasattr(element, "FacingFlipped"):
		if element.FacingFlipped is True:
			flippedElements.append(element)
		else:
			items.append(element)
OUT = flippedElements, items
# ----------------------------------------
code_block = CodeBlock(x=python_script) { x[0]; x[1]; }
Flipped_element = Output(code_block.out0)
other_element = Output(code_block.out1)
