# Dynamo custom node Get Hidden Element.dyf (Dynamo 2.6.1.8786)
# category: GeniusLoci.Element
# Reports the hidden elements in the given view.

element = Input(element: var[]..[])
view = Input(view: var[]..[] = Revit.Application.Document.Current.ActiveView)
isHidden = Python(IN[0]=element, IN[1]=view)
# ---------- isHidden.python (21 lines) ----------
import clr
clr.AddReference('RevitAPI')
from Autodesk.Revit.DB import Element

def toList(obj):
    if hasattr(obj, '__iter__'): return obj
    else: return [obj]

elements = toList(UnwrapElement(IN[0]))
views = toList(UnwrapElement(IN[1]))
elementsHidden, elementsNotHidden = [], []

for view in views:
	for element in elements:
		if hasattr(element, 'IsHidden'):
			if element.IsHidden(view) is True:
				elementsHidden.append(element)
			else:
				elementsNotHidden.append(element)

OUT = elementsHidden, elementsNotHidden
# ----------------------------------------
code_block = CodeBlock(x=isHidden) { x[0]; x[1]; }
Hidden_element = Output(code_block.out0)
Not_hidden_element = Output(code_block.out1)
