# Dynamo custom node Get Joined Elements.dyf (Dynamo 2.6.1.8786)
# category: GeniusLoci.Element
# Returns all elements joined to the given element.

element = Input(element: var[]..[])  # Curve based element Longest lacing for several elements
python_script = Python(IN[0]=element)
# ---------- python_script.python (40 lines) ----------
#Alban de Chasteigner 2019
#twitter : @geniusloci_bim
#geniusloci.bim@gmail.com

import clr
clr.AddReference('RevitAPI')
from Autodesk.Revit.DB import *

clr.AddReference("RevitNodes")
import Revit
clr.ImportExtensions(Revit.GeometryConversion)
clr.ImportExtensions(Revit.Elements)
from Revit.Elements import *

# Import DocumentManager and TransactionManager
clr.AddReference("RevitServices")
import RevitServices
from RevitServices.Persistence import DocumentManager
doc = DocumentManager.Instance.CurrentDBDocument

from itertools import chain

items = UnwrapElement(IN[0])
if not hasattr(items, '__iter__'):
	items = [items]
	
join,result = [],[]

for item in items:
	loc = item.Location
	for ip in range(0, 2):
		join.append(loc.ElementsAtJoin[ip])
		flatlist = list(chain.from_iterable(join))
	for wall in flatlist :
		if wall.Id != item.Id :
			result.append(wall)
	joined=JoinGeometryUtils.GetJoinedElements(doc,item)
	for join in joined:
		result.append(doc.GetElement(join))
OUT = result
# ----------------------------------------
Elements = Output(python_script)
