# Dynamo custom node Get Phase Map.dyf (Dynamo 2.6.1.8786)
# category: GeniusLoci.Phase
# Works only in Revit 2019 and later.
# The node returns a mapping between phases in the host document and phases in the linked document.

RevitLinkInstance = Input(RevitLinkInstance: var[]..[])
getPhaseMap = Python(IN[0]=RevitLinkInstance)
# ---------- getPhaseMap.python (28 lines) ----------
#Alban de Chasteigner 2018
#twitter : @geniusloci_bim
#geniusloci.bim@gmail.com

import clr
clr.AddReference('RevitAPI')
import Autodesk

clr.AddReference("RevitServices")
import RevitServices
from RevitServices.Persistence import DocumentManager
doc = DocumentManager.Instance.CurrentDBDocument

revitlinkinstance = UnwrapElement(IN[0])
if not hasattr(revitlinkinstance, '__iter__'):
    revitlinkinstance = [revitlinkinstance]

phasemaps, values, keys = [],[],[]

linkedDoc = revitlinkinstance[0].GetLinkDocument()
revitlinktype=doc.GetElement(revitlinkinstance[0].GetTypeId())
phasemap=revitlinktype.GetPhaseMap()
for phase in phasemap:
	phasemaps.append(phase)
	keys.append(doc.GetElement(phase.Key))
	values.append(linkedDoc.GetElement(phase.Value))

OUT = revitlinktype,phasemaps,[[a,b] for a,b in zip(keys,values)],keys,values
# ----------------------------------------
code_block = CodeBlock(x=getPhaseMap) { x[0]; x[1]; x[2]; x[3]; x[4]; }
RevitLinkType = Output(code_block.out0)
Phase_Map_ID_KeyValuePair = Output(code_block.out1)
Phase_Map = Output(code_block.out2)
Phases_in_the_host = Output(code_block.out3)
Phases_in_the_link = Output(code_block.out4)
