# Dynamo custom node Get Phase Status Presentation.dyf (Dynamo 2.6.1.8786)
# category: GeniusLoci.Phase
# Gets the phase status presentation.

PhaseFilter = Input(PhaseFilter: var[]..[])
get_phase_presentation = Python(IN[0]=PhaseFilter)
# ---------- get_phase_presentation.python (25 lines) ----------
#Alban de Chasteigner 2018
#twitter : @geniusloci_bim
#geniusloci.bim@gmail.com

import clr
# Import DocumentManager
clr.AddReference('RevitServices')
import RevitServices
from RevitServices.Persistence import DocumentManager
doc = DocumentManager.Instance.CurrentDBDocument
# Import RevitAPI
clr.AddReference('RevitAPI')
import Autodesk
from Autodesk.Revit.DB import *

phases = UnwrapElement(IN[0]) if isinstance(IN[0],list) else [UnwrapElement(IN[0])]
new,existing,demolished,temporary=[],[],[],[]

for phase in phases :
	new.append(phase.GetPhaseStatusPresentation(ElementOnPhaseStatus.New))
	existing.append(phase.GetPhaseStatusPresentation(ElementOnPhaseStatus.Existing))
	demolished.append(phase.GetPhaseStatusPresentation(ElementOnPhaseStatus.Demolished))
	temporary.append(phase.GetPhaseStatusPresentation(ElementOnPhaseStatus.Temporary))

OUT = new,existing,demolished,temporary
# ----------------------------------------
Phase_Status_Presentation = Output(get_phase_presentation)
