# Dynamo custom node Get Pinned Element.dyf (Dynamo 2.6.1.8786)
# category: GeniusLoci.Element
# Identify the pinned elements.

element = Input(element: var[]..[])
get_pinned_elements = Python(IN[0]=element)
# ---------- get_pinned_elements.python (20 lines) ----------
import clr
import System
clr.AddReference('RevitAPI')
from Autodesk.Revit.DB import *

elements = UnwrapElement(IN[0])

if not hasattr(elements, '__iter__'):
	elements = [elements]

elementsPinned = []
elementsNotPinned = []

for element in elements:
	if element.Pinned is True:
		elementsPinned.append(element)
	else:
		elementsNotPinned.append(element)

OUT = elementsPinned, elementsNotPinned
# ----------------------------------------
code_block = CodeBlock(x=get_pinned_elements) { x[0]; x[1]; }
Pinned_element = Output(code_block.out0)
Unpinned_element = Output(code_block.out1)
