# Dynamo custom node Get RevitSelection.dyf (Dynamo 2.6.1.8786)
# category: GeniusLoci.Select
# Gets the selection from the Revit UI.
# Use a boolean to refresh the selection.

refresh = Input(refresh: bool = true)
python_script = Python(IN[0]=refresh)
# ---------- python_script.python (37 lines) ----------
# By Dimitar Venkov and Cyril Poupin
import clr
clr.AddReference('RevitNodes')
import Revit
clr.ImportExtensions(Revit.Elements)

clr.AddReference('RevitServices')
import RevitServices
from RevitServices.Persistence import DocumentManager

doc = DocumentManager.Instance.CurrentDBDocument
uiapp = DocumentManager.Instance.CurrentUIApplication
app = uiapp.Application
uidoc = uiapp.ActiveUIDocument

ueWrapper = None
wrappers = clr.GetClrType(Revit.Elements.ElementWrapper).GetMethods()
for w in wrappers:
	if w.ToString().startswith("Revit.Elements.UnknownElement"):
		ueWrapper = w
		break
		
output = []
selectElemId = uidoc.Selection.GetElementIds()
selectElem = [doc.GetElement(xId) for xId in selectElemId]

for i in selectElem:
	try:
		check = Revit.Elements.ElementWrapper.Wrap(i, True)
	except: check = None

	if check is None:
		output.append(ueWrapper.Invoke(None, (i, False)))
	else:
		output.append(i) 

OUT= output if len(output)>1 else output[0]
# ----------------------------------------
Element = Output(python_script)
