# Dynamo custom node Get RoutingPreferences.dyf (Dynamo 2.12.1.8246)
# category: GeniusLoci.MEP
# Obtains the routing preferences of the given duct or pipe.
# By Cyril Poupin on Dynamo Forum

elementOrElementType = Input(elementOrElementType: var[]..[])
python_script = Python(IN[0]=elementOrElementType)  # IronPython2
# ---------- python_script.python (38 lines) ----------
#By Cyril Poupin https://forum.dynamobim.com/t/getting-routing-preference-fittings-information/61916/5

import clr
import System
clr.AddReference('RevitAPI')
import Autodesk
from Autodesk.Revit.DB import *

clr.AddReference('RevitServices')
import RevitServices
from RevitServices.Persistence import DocumentManager
doc = DocumentManager.Instance.CurrentDBDocument

dictPrefEnum = dict(zip(System.Enum.GetNames(RoutingPreferenceRuleGroupType), System.Enum.GetValues(RoutingPreferenceRuleGroupType)))

elements = UnwrapElement(IN[0]) if isinstance(IN[0],list) else [UnwrapElement(IN[0])]

result = []
for element in elements:
	lstPreference = []
	if isinstance(element, MEPCurve):
		elemType = doc.GetElement(element.GetTypeId())
	elif isinstance(element, MEPCurveType):
		elemType = element
	routManager = elemType.RoutingPreferenceManager 
	for name, enumVal in dictPrefEnum.items():
		ruleCount = routManager.GetNumberOfRules(enumVal)
		temp = []
		for i in range(ruleCount):
			routeRule = routManager.GetRule(enumVal, i )
			mepId = doc.GetElement(routeRule.MEPPartId)
			temp.append(mepId)
		if temp:	
			lstPreference.append([name, temp]) 	
	result.append(lstPreference)

if isinstance(IN[0], list): OUT = result
else: OUT = result[0]
# ----------------------------------------
RoutingPreferences = Output(python_script)
