# Dynamo custom node Get ScheduleView.dyf (Dynamo 2.6.1.8786)
# category: GeniusLoci.Schedule
# Get Schedule View from ScheduleSheetInstance.

ScheduleSheetInstance = Input(ScheduleSheetInstance: var[]..[])
get_schedule_view = Python(IN[0]=ScheduleSheetInstance)
# ---------- get_schedule_view.python (15 lines) ----------
#Alban de Chasteigner 2018
#twitter : @geniusloci_bim
#geniusloci.bim@gmail.com

import clr
clr.AddReference('RevitAPI')
import Autodesk
from Autodesk.Revit.DB import ScheduleSheetInstance, Document

instances = UnwrapElement(IN[0]) if isinstance(IN[0],list) else [UnwrapElement(IN[0])]

schedules = [s.Document.GetElement(s.ScheduleId) for s in instances]
	
if isinstance(IN[0], list): OUT = schedules
else: OUT = schedules[0]
# ----------------------------------------
Schedule_View = Output(get_schedule_view)
