# Dynamo custom node Get SubCategories Properties.dyf (Dynamo 2.6.1.8786)
# category: GeniusLoci.Graphics
# Get the Line Patterns, weights, colors and materials for a given subcategory.

subCategory = Input(subCategory: var[]..[])
python_script = Python(IN[0]=subCategory)
# ---------- python_script.python (45 lines) ----------
import clr
clr.AddReference('RevitAPI')
from Autodesk.Revit.DB import *

clr.AddReference("RevitNodes")
import Revit
clr.ImportExtensions(Revit.Elements)

clr.AddReference('DSCoreNodes')
import DSCore
from DSCore import Color

clr.AddReference("RevitServices")
import RevitServices
from RevitServices.Persistence import DocumentManager
from RevitServices.Transactions import TransactionManager

doc = DocumentManager.Instance.CurrentDBDocument
subcat = UnwrapElement(IN[0])
if not hasattr(subcat, '__iter__'):
    subcat = [subcat]

listGraph,listPattern,patname,listpatid,lineProjWeight,lineProjCut,listRGB,listMaterial = [],[],[],[],[],[],[],[]

for i in subcat:
	id = i.GetLinePatternId(GraphicsStyleType.Projection)
	pat = LinePatternElement.GetLinePattern(doc,id)
	projWeight = i.GetLineWeight(GraphicsStyleType.Projection)
	cutWeight = i.GetLineWeight(GraphicsStyleType.Cut)
	rgb = DSCore.Color.ByARGB(255,i.LineColor.Red, i.LineColor.Green, i.LineColor.Blue)
	listMaterial.append(i.Material)
	listRGB.append(rgb)
	lineProjWeight.append(projWeight)
	lineProjCut.append(cutWeight)
	listPattern.append(pat)
	listpatid.append(doc.GetElement(id))
	try:
		patname.append(pat.Name)
	except:
		patname.append("Solid")
		
	style = i.GetGraphicsStyle(GraphicsStyleType.Projection)
	listGraph.append(style)

OUT = listGraph, listpatid, patname, lineProjWeight, lineProjCut,listRGB,listMaterial
# ----------------------------------------
code_block = CodeBlock(x=python_script) { x[0]; x[1]; x[2]; x[3]; x[4]; x[5]; x[6]; }
Graphic_Style = Output(code_block.out0)
Line_Pattern = Output(code_block.out1)
Line_Pattern_Name = Output(code_block.out2)
Projection_Line_Weight = Output(code_block.out3)
Cut_Line_Weight = Output(code_block.out4)
Line_Colors = Output(code_block.out5)
Material = Output(code_block.out6)
