# Dynamo custom node Get SystemType Graphics.dyf (Dynamo 2.6.2.15705)
# category: GeniusLoci.MEP
# Returns the Mechanical or Piping System Type, the classification, the abbreviation, the line pattern, line weight, line color and the material.

ElementOrSystemType = Input(ElementOrSystemType: var[]..[])
systemtype_properties = Python(IN[0]=ElementOrSystemType)
# ---------- systemtype_properties.python (62 lines) ----------
#Alban de Chasteigner 2019
#twitter : @geniusloci_bim
#geniusloci.bim@gmail.com

import clr
clr.AddReference('RevitServices')
import RevitServices
from RevitServices.Persistence import DocumentManager
doc = DocumentManager.Instance.CurrentDBDocument

clr.AddReference('RevitAPI')
import Autodesk
from Autodesk.Revit.DB import *

clr.AddReference('RevitNodes')
import Revit
clr.ImportExtensions(Revit.Elements)

clr.AddReference('DSCoreNodes')
import DSCore
from DSCore import Color

elements = UnwrapElement(IN[0]) if isinstance(IN[0],list) else [UnwrapElement(IN[0])]

systype,name,classification,abbreviation,lineWeight,lineColor,linePattern,material,types,category=[],[],[],[],[],[],[],[],[],[]

for elem in elements:
	if isinstance(elem, Autodesk.Revit.DB.ElementType):
		systype=elements
	else:
		if elem.get_Parameter(BuiltInParameter.RBS_PIPING_SYSTEM_TYPE_PARAM) : #and hasattr(elem,"MEPSystem"):
			system = elem.get_Parameter(BuiltInParameter.RBS_PIPING_SYSTEM_TYPE_PARAM).AsElementId()
			#try: types.append(elem.PipeType)
			#except : types.append(elem.FlexPipeType)
		elif elem.get_Parameter(BuiltInParameter.RBS_DUCT_SYSTEM_TYPE_PARAM) : #and hasattr(elem,"MEPSystem"):
			system = elem.get_Parameter(BuiltInParameter.RBS_DUCT_SYSTEM_TYPE_PARAM).AsElementId()
			#try: types.append(elem.DuctType)
			#except : types.append(elem.FlexDuctType)
		systype.append(doc.GetElement(system))
	category.append(Revit.Elements.Category.ById(elem.Category.Id.IntegerValue))
		
for i in systype :
	if i != None :# UndefinedSystem
		name.append(i.ToDSType(True).Name)
		classification.append(i.SystemClassification)
		abbreviation.append(i.Abbreviation)
		linePattern.append(doc.GetElement(i.LinePatternId))
		try:lineColor.append(DSCore.Color.ByARGB(255, i.LineColor.Red, i.LineColor.Green, i.LineColor.Blue))#No color value
		except:lineColor.append(None)
		lineWeight.append(i.LineWeight)
		material.append(doc.GetElement(i.MaterialId))
	else :
		name.append(None)
		classification.append(None)
		abbreviation.append(None)
		linePattern.append(None)
		lineColor.append(None)
		lineWeight.append(None)
		material.append(None)
	
if isinstance(IN[0], (list)): OUT = systype,name,classification,abbreviation,linePattern,lineColor,lineWeight,material, category#, types
else: OUT = systype[0],name[0],classification[0],abbreviation[0],linePattern[0],lineColor[0],lineWeight[0],material[0], category[0]#, types[0]
# ----------------------------------------
code_block = CodeBlock(x=systemtype_properties) { x[0]; x[1]; x[2]; x[3]; x[4]; x[5]; x[6]; x[7]; x[8]; }
SystemType = Output(code_block.out0)
SystemTypeName = Output(code_block.out1)
Classification = Output(code_block.out2)
Abbreviation = Output(code_block.out3)
LinePattern = Output(code_block.out4)
LineColor = Output(code_block.out5)
LineWeight = Output(code_block.out6)
Material = Output(code_block.out7)
Category = Output(code_block.out8)
code_block_2 = CodeBlock()  # unwired: MEPCurveType
# ---------- code_block_2.designscript (2 lines) ----------
//For input duct or pipe
MEPCurveType;
# ----------------------------------------
