# Dynamo custom node Get SystemType Properties.dyf (Dynamo 2.6.1.8786)
# category: GeniusLoci.MEP
# Returns the Calculations, Fluid Type, Fluid Temperature and Flow Conversion Method of the given System Type.

SystemType = Input(SystemType: var[]..[])
get_systemtype_properties = Python(IN[0]=SystemType)
# ---------- get_systemtype_properties.python (40 lines) ----------
#Alban de Chasteigner 2021
#twitter : @geniusloci_bim
#geniusloci.bim@gmail.com
#https://github.com/albandechasteigner/GeniusLociForDynamo

import clr
clr.AddReference("RevitServices")
import RevitServices
from RevitServices.Persistence import DocumentManager
from RevitServices.Transactions import TransactionManager
doc = DocumentManager.Instance.CurrentDBDocument
uiapp = DocumentManager.Instance.CurrentUIApplication
app = uiapp.Application
version=int(app.VersionNumber)

clr.AddReference("RevitAPI")
import Autodesk
from Autodesk.Revit.DB import *

if version < 2021:
	UIunit = doc.GetUnits().GetFormatOptions(UnitType.UT_Piping_Temperature).DisplayUnits
else:
	UIunit = doc.GetUnits().GetFormatOptions(SpecTypeId.PipingTemperature).GetUnitTypeId()
	
elements = UnwrapElement(IN[0]) if isinstance(IN[0],list) else [UnwrapElement(IN[0])]
calculations,fluids,temp,flow=[],[],[],[]

for elem in elements:
	calculations.append(elem.CalculationLevel)
	if isinstance(elem,Autodesk.Revit.DB.Plumbing.PipingSystemType):
		fluids.append(doc.GetElement(elem.FluidType))
		temp.append(round(UnitUtils.ConvertFromInternalUnits(elem.FluidTemperature,UIunit),4))
		flow.append(elem.FlowConversionMethod)
	else:
		fluids.append(None)
		temp.append(None)
		flow.append(None)
		
if isinstance(IN[0], list): OUT = calculations,fluids,temp,flow
else: OUT = calculations[0],fluids[0],temp[0],flow[0]
# ----------------------------------------
code_block = CodeBlock(x=get_systemtype_properties) { x[0]; x[1]; x[2]; x[3]; }
Calculations = Output(code_block.out0)
FluidType = Output(code_block.out1)
FluidTemperature = Output(code_block.out2)
FlowConversionMethod = Output(code_block.out3)
