# Dynamo custom node Get Wall JoinType.dyf (Dynamo 2.6.1.8786)
# category: GeniusLoci.CompoundStructure
# Get the type of the join at the ends of the wall.

wall = Input(wall: var[]..[])
python_script = Python(IN[0]=wall)
# ---------- python_script.python (20 lines) ----------
#Alban de Chasteigner 2020
#twitter : @geniusloci_bim
#geniusloci.bim@gmail.com

import clr
clr.AddReference('RevitAPI')
import Autodesk
from Autodesk.Revit.DB import *

items = UnwrapElement(IN[0]) if isinstance(IN[0],list) else [UnwrapElement(IN[0])]
joinList = []

for item in items:
	join = []
	loc = item.Location
	for ip in range(0, 2):
		join.append(loc.JoinType[ip])
	joinList.append(join)

OUT = items,joinList
# ----------------------------------------
code_block = CodeBlock(x=python_script) { x[0]; x[1]; }
Wall = Output(code_block.out0)
JoinType = Output(code_block.out1)
