# Dynamo custom node Get Wall Member.dyf (Dynamo 2.6.1.8786)
# category: GeniusLoci.CompoundStructure
# Returns the wall type, the sub walls of the stacked wall and the wall panel of the curtain wall.

wall = Input(wall: var[]..[])
python_script = Python(IN[0]=wall)
# ---------- python_script.python (37 lines) ----------
#Alban de Chasteigner 2019
#twitter : @geniusloci_bim
#geniusloci.bim@gmail.com

import clr
clr.AddReference('RevitAPI')
from Autodesk.Revit.DB import *

elements = UnwrapElement(IN[0])
if not hasattr(elements, '__iter__'):
	elements = [elements]

famType,walls=[],[]
for elem in elements :
	doc=elem.Document
	if isinstance(elem, Wall) :
		if elem.IsStackedWall== True:
			for sub in elem.GetStackedWallMemberIds():
				walls.append(doc.GetElement(sub))
				famType.append(doc.GetElement(sub).WallType)
		else: 
			familyType = elem.WallType
			if familyType.Kind == WallKind.Curtain :
				panels=[doc.GetElement(x) for x in elem.CurtainGrid.GetPanelIds()]
				hostpanelids=[panel.FindHostPanel() for panel in panels if hasattr(panel, "FindHostPanel")]
				for id in hostpanelids:
					walls.append(doc.GetElement(id))
				#famType.append(doc.GetElement(id).WallType)
				famType.append(doc.GetElement(familyType.get_Parameter(BuiltInParameter.AUTO_PANEL_WALL).AsElementId()))
			else: 
				famType.append(elem.WallType)
				walls.append(elem)
	else:
		famType.append(None)
		walls.append(None)
		
OUT = famType,walls
# ----------------------------------------
code_block = CodeBlock(x=python_script) { x[0]; x[1]; }
WallType = Output(code_block.out0)
Walls = Output(code_block.out1)
