# Dynamo custom node GetSurroundingElements in Document.dyf (Dynamo 2.6.1.8786)
# category: GeniusLoci.Element
# Get Surrounding Elements by Categories, group them as List. Tolerance distance available in linked document.
# Based on a SteamNodes node

element = Input(element: var[]..[])
code_block = CodeBlock(item=element) { Flatten([item]); }
ElementCheck = Input(ElementCheck: var[]..[])
code_block_2 = CodeBlock(item=ElementCheck) { Flatten([item]); }
Tolerance = Input(Tolerance: double = 0)
docOrRevitLinkInstance = Input(docOrRevitLinkInstance: var = null)  # Use only if you want to query other document
# note: From SteamNodes
modified_tool = Python(IN[0]=code_block, IN[1]=code_block_2, IN[2]=Tolerance, IN[3]=docOrRevitLinkInstance)  # "Modified Tool.GetSurroundingElements"
# ---------- modified_tool.python (68 lines) ----------
#python nodes in dynamo 1.0
#proposed by Julien Benoit @jbenoit44 
#http://aecuandme.wordpress.com/
import clr
clr.AddReference('ProtoGeometry')
from Autodesk.DesignScript.Geometry import *
# Import ToDSType(bool) extension method
clr.AddReference("RevitNodes")
import Revit
clr.ImportExtensions(Revit.Elements)
# Import geometry conversion extension methods
clr.ImportExtensions(Revit.GeometryConversion)
# Import DocumentManager and TransactionManager
clr.AddReference("RevitServices")
import RevitServices
from RevitServices.Persistence import DocumentManager
from RevitServices.Transactions import TransactionManager
from System.Collections.Generic import *
# Import RevitAPI
clr.AddReference("RevitAPI")
import Autodesk
from Autodesk.Revit.DB import *
import itertools
import operator
document = DocumentManager.Instance.CurrentDBDocument
activeV=document.ActiveView

if isinstance(IN[3], list) : inputdoc = UnwrapElement(IN[3])
else : inputdoc = [UnwrapElement(IN[3])]

#Inputdoc : Part of script by Andreas Dieckmann
if inputdoc[0] == None:
	doc = DocumentManager.Instance.CurrentDBDocument
elif inputdoc[0].GetType().ToString() == "Autodesk.Revit.DB.Document":
	doc = inputdoc[0]
elif inputdoc[0].GetType().ToString() == "Autodesk.Revit.DB.RevitLinkInstance":
	doc = inputdoc[0].GetLinkDocument()
else: doc = DocumentManager.Instance.CurrentDBDocument

host = []
finst=[]
finstID=[]
for i in IN[0]:
	host.append(UnwrapElement(i))
for i in IN[1]:
	finst.append(UnwrapElement(i))
for i in IN[1]:
	finstID.append(UnwrapElement(i).Id)	

superset=[]
hloop=[]

for h in host:
	collection = List[ElementId](finstID)
	collector=FilteredElementCollector(doc,collection)
	a=h.BoundingBox[activeV]
	c=Outline (a.Min,a.Max)
	d=BoundingBoxIntersectsFilter(c,float(IN[2]))
	e=collector.WherePasses(d).ToElements()
	setlist=[]
	hostlist=[]
	hostlist.append(h)
	setlist.append(e)
	all_lists = [hostlist,setlist]
	c=reduce(operator.add, all_lists)
	superset.append(c)
		
OUT=superset
# ----------------------------------------
code_block_3 = CodeBlock(t3=modified_tool) { t2 = DSCore.List.Flatten(t3<1L>, 1); t4 = DSCore.List.Count(t2<1L>); t5 = t4 > 1; }
filterByBoolMask = List.FilterByBoolMask(list=code_block_3.t2, mask=code_block_3.t5)
Set_of_elements = Output(filterByBoolMask.in)
