# Dynamo custom node Group Parallel Lines.dyf (Dynamo 2.6.1.8786)
# category: GeniusLoci.Geometry
# Groups parallel lines or linear elements together.

lines = Input(lines: var[]..[])  # Dynamo line or straight curved elements
python_script = Python(IN[0]=lines)
# ---------- python_script.python (51 lines) ----------
#Strongly inspired by Maciek Glowka http://lubim.co

import clr
# Import RevitAPI Classes
clr.AddReference('RevitAPI')
import Autodesk
from Autodesk.Revit.DB import *

# Import ToDSType extension method
clr.AddReference("RevitNodes")
import Revit
clr.ImportExtensions(Revit.GeometryConversion)

def isParallel(v1,v2):
  return v1.CrossProduct(v2).IsAlmostEqualTo(XYZ(0,0,0))
  
lineElements = UnwrapElement(IN[0])

directions = []
lines_groups = []
#group parallel lines together
for item in lineElements:
	if hasattr(item, "Explode"):
		l=item.ToRevitType()
	elif hasattr(item, "GeometryCurve"): 		
		l=item.GeometryCurve
	elif hasattr(item, "Curve"):
		l = item.Curve
	elif hasattr(item, "FullCurve"):
		l = item.FullCurve
	elif hasattr(item, "LocationCurve"):
		l = item.LocationCurve
	elif hasattr(item, "Location") and isinstance(item.Location,Autodesk.Revit.DB.LocationCurve):
		l = item.Location.Curve
		
	d = l.GetEndPoint(1)-l.GetEndPoint(0)
	idx = -1
	for i in range(len(directions)):
		if isParallel(d,directions[i]):
			idx = i
			break
    
	if idx!=-1:
		lines_groups[idx].append(item)
	else:
		directions.append(d)
		new_group = []
		new_group.append(item)
		lines_groups.append(new_group)
      
OUT = lines_groups
# ----------------------------------------
Grouped_Lines = Output(python_script)
