# Dynamo custom node Import DWG.dyf (Dynamo 2.12.1.8246)
# category: GeniusLoci.CAD Import
# Import DWGs in views with options.
# Use with the Enumerate DWG import options node.
# Based on an archilab's script.

document = Input(document: var[]..[] = null)  # Autodesk.Revit.DB.Document Optional input
Filepaths = Input(Filepaths: var[]..[])
views = Input(views: var[]..[] = Revit.Application.Document.Current.ActiveView)  # As many Views as FilePaths
CustomScale = Input(CustomScale: double = 0)  # Warning : If this is defined, it takes preference over units
Colormode = Input(Colormode: var[]..[] = null)
Placement = Input(Placement: var[]..[] = null)
unit = Input(unit: var[]..[] = null)
AllView = Input(AllView: bool = false)  # DWG visible in all views ? Option not available in 3D views
DrawLayer = Input(DrawLayer: int = 0)  # Draw layer : Foreground (0) or Background (1)
python_script = Python(IN[0]=document, IN[1]=Filepaths, IN[2]=views, IN[3]=CustomScale, IN[4]=Colormode, IN[5]=Placement, IN[6]=unit, IN[7]=AllView, IN[8]=DrawLayer)  # IronPython2
# ---------- python_script.python (64 lines) ----------
#Based on a Konrad Sobon script
#Additions by Alban de Chasteigner 2018
#Suggestion of Ryan Lenihan

import clr
# Import DocumentManager and TransactionManager
clr.AddReference('RevitServices')
import RevitServices
from RevitServices.Persistence import DocumentManager
from RevitServices.Transactions import TransactionManager

# Import RevitAPI
clr.AddReference('RevitAPI')
import Autodesk
from Autodesk.Revit.DB import *

inputdoc = UnwrapElement(IN[0]) if isinstance(IN[0],list) else [UnwrapElement(IN[0])]
filePaths = IN[1] if isinstance(IN[01],list) else [IN[1]]
views = UnwrapElement(IN[2]) if isinstance(IN[2],list) else [UnwrapElement(IN[2])]
customscale = IN[3]
colormode = IN[4]
placement = IN[5]
unit = IN[6]
allView = IN[7]
order = IN[8]

if inputdoc[0] == None :
	doc = DocumentManager.Instance.CurrentDBDocument
else : doc = inputdoc[0]
viewsplaced,outName,CADlinktype,importinstance = [],[],[],[]

options = DWGImportOptions()
options.AutoCorrectAlmostVHLines = True
options.OrientToView = True
if allView :options.ThisViewOnly = False
else: options.ThisViewOnly = True
options.VisibleLayersOnly = True
options.CustomScale = customscale
if colormode == None: ImportColorMode.Preserved
else: options.ColorMode = colormode
if placement == None: ImportPlacement.Shared
else :options.Placement= placement
if unit == None : ImportUnit.Default
else : options.Unit = unit

# Create ElementId / .NET object
linkedElem = clr.Reference[ElementId]()

TransactionManager.Instance.ForceCloseTransaction()
TransactionManager.Instance.EnsureInTransaction(doc)
for view in range(len(views)):
	doc.Import(filePaths[view], options, views[view], linkedElem)
	viewsplaced.append(views[view])
	importinst = doc.GetElement(linkedElem.Value)
	importinstance.append(importinst)
	CADLink = doc.GetElement(importinst.GetTypeId())
	CADlinktype.append(CADLink)
	outName.append(Element.Name.GetValue(CADLink))
	if not allView :
		importinst.get_Parameter(BuiltInParameter.IMPORT_BACKGROUND).Set(order)
TransactionManager.Instance.TransactionTaskDone()

if isinstance(IN[0], list): OUT = viewsplaced,outName,CADlinktype,importinstance
else: OUT = viewsplaced[0],outName[0],CADlinktype[0],importinstance[0]
# ----------------------------------------
code_block = CodeBlock(x=python_script) { x[0]; x[1]; x[2]; x[3]; }
Views = Output(code_block.out0)
Name = Output(code_block.out1)
CADLinkType = Output(code_block.out2)
ImportInstance = Output(code_block.out3)
