# Dynamo custom node InsertAtIndex.dyf (Dynamo 2.6.1.8786)
# category: GeniusLoci.Utilities
# Inserts items into lists at specified indices.

list = Input(list: var[])
element = Input(element: var[])  # As many elements as the maximum number of indexes
index = Input(index: var[])
python_script = Python(IN[0]=list, IN[1]=element, IN[2]=index)
# ---------- python_script.python (9 lines) ----------
import clr
originalList = IN[0]
newItems = IN[1]
indices = IN[2]

for newItem,index in zip(newItems,indices):
	originalList.insert(index,newItem)

OUT = originalList
# ----------------------------------------
list_2 = Output(python_script)  # "list"
