# Dynamo custom node Link DWF.dyf (Dynamo 2.6.1.8786)
# category: GeniusLoci.DWF
# Link DWF in given sheet.
# This API method doesn't work with DWF containing multiple sheets.

filePath = Input(filePath: var)
sheet = Input(sheet: var)
python_script = Python(IN[0]=filePath, IN[1]=sheet)
# ---------- python_script.python (38 lines) ----------
#Alban de Chasteigner 2020
#twitter : @geniusloci_bim
#geniusloci.bim@gmail.com

import clr
# Import DocumentManager and TransactionManager
clr.AddReference('RevitServices')
import RevitServices
from RevitServices.Persistence import DocumentManager
from RevitServices.Transactions import TransactionManager
doc = DocumentManager.Instance.CurrentDBDocument

# Import RevitAPI
clr.AddReference('RevitAPI')
import Autodesk
from Autodesk.Revit.DB import *

from System.Collections.Generic import List
import System

filePaths = IN[0] if isinstance(IN[0],list) else [IN[0]]
sheets = UnwrapElement(IN[1]) if isinstance(IN[1],list) else [UnwrapElement(IN[1])]

def LinkDwf(filePath):
	sheetViews = List[ElementId](s.Id for s in sheets)
	options = DWFImportOptions(sheetViews)
	result = doc.Link(filePath, options)
	return result

#sheets = options.GetSheetViews()
#options.SetSheetViews(sheets)

for sheet in range(len(sheets)):
	TransactionManager.Instance.EnsureInTransaction(doc)
	markups=[doc.GetElement(r) for r in LinkDwf(filePaths[sheet])]
	TransactionManager.Instance.TransactionTaskDone()

OUT = markups
# ----------------------------------------
DWFMarkup = Output(python_script)
