# Dynamo custom node List Clean.dyf (Dynamo 2.6.1.8786)
# category: GeniusLoci.Utilities
# Removes all Null, Empty and Blank from a list or nested list of lists.

list = Input(list: var[]..[])
python_script = Python(IN[0]=list)
# ---------- python_script.python (17 lines) ----------
#https://stackoverflow.com/questions/30488751/clean-list-or-list-of-lists-of-all-none-or-empty-lists-in-python

def ClearList(primList):
    result = []
    for sublist in primList:
        if sublist is "":
            continue
        elif sublist is None:
            continue 
        if isinstance(sublist, list):
             sublist = ClearList(sublist)
             if not sublist:
                 continue
        result.append(sublist)
    return result

OUT = ClearList(IN[0])
# ----------------------------------------
list_2 = Output(python_script)  # "list"
