# Dynamo custom node List SortNatural.dyf (Dynamo 2.13.1.3887)
# category: GeniusLoci.Utilities
# Sorts a specified list in natural order in either ascending or descending order.

list = Input(list: var[]..[])
ascending = Input(ascending: bool = true)
python_script = Python(IN[0]=list, IN[1]=ascending)  # IronPython2
# ---------- python_script.python (33 lines) ----------
#Alban de Chasteigner 2022
#twitter : @geniusloci_bim
#geniusloci.bim@gmail.com
#https://github.com/albandechasteigner/GeniusLociForDynamo

import clr
clr.AddReference('RevitAPI')
import Autodesk
from Autodesk.Revit.DB import Element

import re

data = UnwrapElement(IN[0])
boolean = not IN[1]

def natural_sort(x):
	convertText = lambda text: int(text) if text.isdigit() else text.lower()
	# Doesn't work with mixed lists
	for l in x:
		if isinstance(l, Autodesk.Revit.DB.ElementType):
			alphanum = lambda key: [convertText(c) for c in re.split('([0-9]+)', key.FamilyName)]
			result = sorted(x, key = alphanum, reverse = boolean)
		elif isinstance(l, Autodesk.Revit.DB.Element) :
			alphanum = lambda key: [convertText(c) for c in re.split('([0-9]+)', key.Name)]
			result = sorted(x, key = alphanum, reverse = boolean)
		else:
			toStr = [str(l) for l in x]
			alphanum = lambda key: [convertText(c) for c in re.split('([0-9]+)', key)]
			result = sorted(toStr, key = alphanum, reverse = boolean)
	return result

if all(type(x) is list for x in IN[0]) : OUT = [natural_sort(d) for d in data]
else: OUT = natural_sort(data)
# ----------------------------------------
list_2 = Output(python_script)  # "list"
