# Dynamo custom node Lock ByReferences.dyf (Dynamo 2.6.1.8786)
# category: GeniusLoci.Dimension
# Add a new locked alignment through elements References.
# Paired references must be already geometrically aligned (this function will not force them to become aligned).

view = Input(view: Revit.Elements.Views.View = Revit.Application.Document.Current.ActiveView)  # View to place dimension in
reference1 = Input(reference1: var[]..[])  # Aligned Autodesk.Revit.DB.Reference
reference2 = Input(reference2: var[]..[])  # Aligned Autodesk.Revit.DB.Reference
python_script = Python(IN[0]=view, IN[1]=reference1, IN[2]=reference2)
# ---------- python_script.python (34 lines) ----------
#Alban de Chasteigner 2021
#twitter : @geniusloci_bim
#geniusloci.bim@gmail.com
#https://github.com/albandechasteigner/GeniusLociForDynamo

import clr
# Import RevitAPI Classes
clr.AddReference('RevitAPI')
import Autodesk
from Autodesk.Revit.DB import Document
# Import DocumentManager and TransactionManager
clr.AddReference("RevitServices")
import RevitServices
from RevitServices.Persistence import DocumentManager
from RevitServices.Transactions import TransactionManager
doc = DocumentManager.Instance.CurrentDBDocument

def tolist(obj1):
    if hasattr(obj1,"__iter__"): return obj1
    else: return [obj1]

view = tolist(UnwrapElement(IN[0]))[0]
references1 = tolist(IN[1])
references2 = tolist(IN[2])
align=[]

TransactionManager.Instance.EnsureInTransaction(doc)
for ref1, ref2 in zip(references1,references2):
	align.append(doc.Create.NewAlignment(view, ref1, ref2))
	#align.IsLocked = True
TransactionManager.Instance.TransactionTaskDone()

if isinstance(IN[1], list): OUT = align
else: OUT = align[0]
# ----------------------------------------
Dimension = Output(python_script)
