# Dynamo custom node LogoGeniusLoci.dyf (Dynamo 2.6.1.8786)
# category: GeniusLoci.Logo
# Display logo Genius Loci.
# The logo picture will be created in directory
# C:\ProgramData\Dynamo

python_script = Python()  # graph input
# ---------- python_script.python (1 lines) ----------
OUT = """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"""
# ----------------------------------------
python_script_2 = Python(IN[0]=python_script)
# ---------- python_script_2.python (28 lines) ----------
#From Simon Lepagetrudeau
import clr
import binascii
clr.AddReference("DSCoreNodes")
import DSCore
from DSCore import *
import sys
sys.path.append(r'C:\Program Files (x86)\IronPython 2.7\Lib')
import os
import errno


BinStr = binascii.a2b_base64(IN[0])

#https://stackoverflow.com/questions/12517451/automatically-creating-directories-with-file-output
cwd = dir_path = os.path.dirname(os.path.realpath(__file__))
filename = "C:\ProgramData\Dynamo\Logo Genius loci.png"
if not os.path.exists(os.path.dirname(filename)):
    try:
        os.makedirs(os.path.dirname(filename))
    except OSError as exc: # Guard against race condition
        if exc.errno != errno.EEXIST:
            raise

logo = open(filename,"wb")
logo.write(BinStr)
logo.close()
OUT = filename
# ----------------------------------------
fromPath = FileObject(path=python_script_2)  # "File.FromPath"
readFromFile = Image.ReadFromFile(file=fromPath)
Watch_Image = Output(readFromFile)
