# Dynamo custom node MEP LocationCurve.dyf (Dynamo 2.6.1.8786)
# category: GeniusLoci.MEP
# MEP LocationCurve
# Gets the curve geometry from the MEP element (pipe, duct, cabletray, conduit, fitting, accessory).
# By Cyril Poupin on the Dynamo Forum

element = Input(element: var[]..[])  # Ducts or pipes, cable trays, conduits Fittings and accessories
python_script = Python(IN[0]=element)
# ---------- python_script.python (55 lines) ----------
#By Cyril Poupin on the Dynamo Forum
#https://forum.dynamobim.com/t/get-curves-from-piping/61867/2

import clr
clr.AddReference('ProtoGeometry')
from Autodesk.DesignScript.Geometry import *

clr.AddReference('RevitAPI')
import Autodesk
from Autodesk.Revit.DB import *
import Autodesk.Revit.DB as DB

clr.AddReference('RevitNodes')
import Revit
clr.ImportExtensions(Revit.GeometryConversion)

import System
from System.Collections.Generic import List

toList = lambda x : x if hasattr(x, '__iter__') else [x]
lstElemNetWork = toList(UnwrapElement(IN[0]))

lstDS_Geo = [] 
for e in lstElemNetWork:
	if isinstance(e.Location, LocationCurve):
		rvtCurve = e.Location.Curve
		lstDS_Geo.append(rvtCurve.ToProtoType())
	else:
		lstLines = []
		locPt = e.Location.Point
		connSet = e.MEPModel.ConnectorManager.Connectors
		lstConn = list(connSet)
		if connSet.Size == 1:
			lstDS_Geo.append(None)
		elif connSet.Size == 2:
			try:
				line = DB.Line.CreateBound(lstConn[0].Origin, lstConn[1].Origin)
				lstDS_Geo.append(line.ToProtoType())
			except:  
				# Unable to create Line. Points are likely coincident
				pline = DB.PolyLine.Create(List[XYZ]([lstConn[0].Origin, locPt, lstConn[1].Origin]))
				lstDS_Geo.append(pline.ToProtoType())
		elif connSet.Size == 3 and [con for con in connSet if con.Domain != Domain.DomainElectrical].Count == 2 :
			lstConn2=[con for con in connSet if con.Domain != Domain.DomainElectrical]
			line = DB.Line.CreateBound(lstConn2[0].Origin, lstConn2[1].Origin)
			lstDS_Geo.append(line.ToProtoType())		
		else:
			for con in connSet:
				#doc.Application.ShortCurveTolerance :
				if locPt.DistanceTo(con.Origin) > 0.00256026455729167 and con.Domain != Domain.DomainElectrical : 
					line = DB.Line.CreateBound(locPt, con.Origin)
					lstLines.append(line.ToProtoType())
			lstDS_Geo.append(lstLines)
			
OUT = lstDS_Geo
# ----------------------------------------
Curve = Output(python_script)
