# Dynamo custom node Manage Worksets of RevitLinkInstance.dyf (Dynamo 2.6.1.8786)
# category: GeniusLoci.Workset
# Indicates the worksets to close in the Revit link and reloads it.

RevitLinkInstance = Input(RevitLinkInstance: var[]..[])
WorksetName = Input(WorksetName: string[]..[])  # UserWorksetName or part of UserWorksetName to close
manage_worksets_of = Python(IN[0]=RevitLinkInstance, IN[1]=WorksetName)  # "Manage Worksets of RevitLinksInstance"
# ---------- manage_worksets_of.python (44 lines) ----------
import clr
# Import DocumentManager and TransactionManager
clr.AddReference("RevitServices")
import RevitServices
from RevitServices.Persistence import DocumentManager
from RevitServices.Transactions import TransactionManager
# Import RevitAPI
clr.AddReference("RevitAPI")
import Autodesk
from Autodesk.Revit.DB import *

docu = DocumentManager.Instance.CurrentDBDocument

def tolist(obj1):
    if hasattr(obj1,"__iter__"): return obj1
    else: return [obj1]

linkInstance = tolist(UnwrapElement(IN[0]))
worksetNames = tolist(IN[1])

doc = linkInstance[0].GetLinkDocument()

closedWks,openWks = [],[]

#Collect worksets
userWorksets = FilteredWorksetCollector(doc).OfKind(WorksetKind.UserWorkset).ToWorksets()
for userWks in userWorksets:
	wName=userWks.Name
	for wksName in worksetNames :
		if wksName.lower() in wName.lower() :
			closedWks.append(wName)
	if wName not in closedWks :
		openWks.append(userWks.Id)

#WorksetConfig=WorksetConfiguration()
WorksetConfig=WorksetConfiguration(WorksetConfigurationOption.CloseAllWorksets)
WorksetConfig.Open(openWks)

TransactionManager.Instance.ForceCloseTransaction()
RevitLinkType = docu.GetElement(linkInstance[0].GetTypeId())
filepath = RevitLinkType.GetExternalFileReference().GetAbsolutePath()
RevitLinkType.LoadFrom(filepath,WorksetConfig)

OUT = RevitLinkType,closedWks
# ----------------------------------------
code_block = CodeBlock(x=manage_worksets_of) { x[0]; x[1]; }
RevitLinkType = Output(code_block.out0)
ClosedWorkset = Output(code_block.out1)
