# Dynamo custom node Material Add Image.dyf (Dynamo 2.6.1.8786)
# category: GeniusLoci.Material
# Works only in Revit 2018.1 and later.
# Adds an image to a material.
# Please note that it is not possible to add a texture to some material schemas.

material = Input(material: var[]..[])
FilePath = Input(FilePath: var[]..[])
python_script = Python(IN[0]=material, IN[1]=FilePath)
# ---------- python_script.python (62 lines) ----------
#Alban de Chasteigner 2020
#twitter : @geniusloci_bim
#geniusloci.bim@gmail.com

import clr
clr.AddReference('RevitAPI')
from Autodesk.Revit.DB import *
clr.AddReference('RevitServices')
import RevitServices
from RevitServices.Persistence import DocumentManager
from RevitServices.Transactions import TransactionManager
doc = DocumentManager.Instance.CurrentDBDocument

def toList(obj):
    if hasattr(obj, '__iter__'): return obj
    else: return [obj]
    
mats = toList(UnwrapElement(IN[0]))
paths = toList(IN[1])

for mat, texturePath in zip(mats, paths):
	appearanceAssetId = mat.AppearanceAssetId
	assetElem = doc.GetElement(appearanceAssetId)
	TransactionManager.Instance.EnsureInTransaction(doc)
	with Visual.AppearanceAssetEditScope(doc) as editScope:
		editableAsset = editScope.Start(assetElem.Id)
		if (editableAsset.FindByName("BaseSchema")).Value == "GenericSchema":
			property = editableAsset.FindByName("generic_diffuse")
		elif (editableAsset.FindByName("BaseSchema")).Value == "CeramicSchema":
			property = editableAsset.FindByName("ceramic_color")
		elif (editableAsset.FindByName("BaseSchema")).Value == "ConcreteSchema":
			property = editableAsset.FindByName("concrete_color")
		elif (editableAsset.FindByName("BaseSchema")).Value == "MetallicPaintSchema":
			property = editableAsset.FindByName("metallicpaint_base_color")
		elif (editableAsset.FindByName("BaseSchema")).Value == "MasonryCMUSchema":
			property = editableAsset.FindByName("masonrycmu_color")	
		elif (editableAsset.FindByName("BaseSchema")).Value == "PlasticVinylSchema":
			property = editableAsset.FindByName("plasticvinyl_color")
		elif (editableAsset.FindByName("BaseSchema")).Value == "HardwoodSchema":
			property = editableAsset.FindByName("hardwood_color")
		elif (editableAsset.FindByName("BaseSchema")).Value == "StoneSchema":
			property = editableAsset.FindByName("stone_color")	
		elif (editableAsset.FindByName("BaseSchema")).Value == "SolidGlassSchema":
			property = editableAsset.FindByName("solidglass_transmittance_custom_color")
		elif (editableAsset.FindByName("BaseSchema")).Value == "PrismLayeredSchema":
			property = editableAsset.FindByName("layered_diffuse")
		elif (editableAsset.FindByName("BaseSchema")).Value == "PrismMetalSchema":
			property = editableAsset.FindByName("surface_roughness")			
		elif (editableAsset.FindByName("BaseSchema")).Value == "PrismOpaqueSchema":
			property = editableAsset.FindByName("opaque_albedo")
		elif (editableAsset.FindByName("BaseSchema")).Value == "PrismTransparentSchema":
			property = editableAsset.FindByName("surface_roughness")
		if property.NumberOfConnectedProperties == 0 :
			property.AddConnectedAsset("UnifiedBitmapSchema")
			connectedAsset = property.GetConnectedProperty(0)
			path = connectedAsset.FindByName("unifiedbitmap_Bitmap")
			path.Value = texturePath
			editScope.Commit(True)
	TransactionManager.Instance.TransactionTaskDone()

if isinstance(IN[0], list): OUT = mats
else: OUT = mats[0]
# ----------------------------------------
Material = Output(python_script)
