# Dynamo custom node Material Create and Add AppearanceAssetElement.dyf (Dynamo 2.6.1.8786)
# category: GeniusLoci.Material
# Works only in Revit 2018.1 and later.
# Requires a material called Default.
# Duplicates the Appearance Asset Element of the "Default" material, give him a chosen name, and applies it to the given material.

material = Input(material: var[]..[])
Name = Input(Name: string[]..[])  # Name of the new Appearance Asset
create_asset = Python(IN[0]=material, IN[1]=Name)
# ---------- create_asset.python (44 lines) ----------
#Alban de Chasteigner 2018
#twitter : @geniusloci_bim
#geniusloci.bim@gmail.com
import clr
# Import RevitAPI
clr.AddReference("RevitAPI")
import Autodesk
from Autodesk.Revit.DB import *

# Import DocumentManager and TransactionManager
clr.AddReference("RevitServices")
import RevitServices
from RevitServices.Persistence import DocumentManager
from RevitServices.Transactions import TransactionManager

doc =  DocumentManager.Instance.CurrentDBDocument
app =  DocumentManager.Instance.CurrentUIApplication.Application

def toList(obj):
    if hasattr(obj, '__iter__'): return obj
    else: return [obj]

mats = toList(UnwrapElement(IN[0]))
assetElemNames = toList(IN[1])

duplicateAssetElements=[]
collector = FilteredElementCollector(doc).OfClass(Material)
for i in collector :
	if i.Name == "Default":
		default=i
	else:
		continue

assetElem = doc.GetElement(default.AppearanceAssetId)

TransactionManager.Instance.EnsureInTransaction(doc)
for assetElemName in assetElemNames:
	duplicateAssetElements.append(assetElem.Duplicate(assetElemName))
	for mat,duplicateAssetElement in zip(mats,duplicateAssetElements):
		mat.AppearanceAssetId = duplicateAssetElement.Id
TransactionManager.Instance.TransactionTaskDone()

if isinstance(IN[0], list): OUT = mats
else: OUT = mats[0]
# ----------------------------------------
Material = Output(create_asset)
