# Dynamo custom node Material Create.dyf (Dynamo 2.12.1.8246)
# category: GeniusLoci.Material
# Create new materials or overwrite properties of existing materials.
# (All graphics inputs are optional)

document = Input(document: var[]..[] = null)  # Autodesk.Revit.DB.Document Optional input
Name = Input(Name: string[]..[])
color = Input(color: var[]..[] = null)  # Dynamo Color
SurfaceForegroundPattern = Input(SurfaceForegroundPattern: var[]..[] = null)  # Pattern as String or FillPatternElement
SurfaceForegroundPatternColor = Input(SurfaceForegroundPatternColor: var[]..[] = null)  # Dynamo Color
CutForegroundPattern = Input(CutForegroundPattern: var[]..[] = null)  # Pattern (Drafting) as String or FillPatternElement
CutForegroundPatternColor = Input(CutForegroundPatternColor: var[]..[] = null)  # Dynamo Color
Transparency = Input(Transparency: var[]..[] = null)  # Integer
create_material = Python(IN[0]=document, IN[1]=Name, IN[2]=color, IN[3]=SurfaceForegroundPattern, IN[4]=SurfaceForegroundPatternColor, IN[5]=CutForegroundPattern, IN[6]=CutForegroundPatternColor, IN[7]=Transparency)  # IronPython2
# ---------- create_material.python (189 lines) ----------
#By GregX, David Dória and Alban de Chasteigner, 2018
#twitter : @geniusloci_bim
#geniusloci.bim@gmail.com

import clr
clr.AddReference('RevitAPI')
import Autodesk
from Autodesk.Revit.DB import *
clr.AddReference('RevitServices')
import RevitServices
from RevitServices.Persistence import DocumentManager
from RevitServices.Transactions import TransactionManager
uiapp = DocumentManager.Instance.CurrentUIApplication
app = uiapp.Application
version=int(app.VersionNumber)

def toList(obj):
    if hasattr(obj, '__iter__'): return obj
    else: return [obj]

inputdoc = toList(UnwrapElement(IN[0]))[0]
names = toList(IN[1])
colors = toList(IN[2])
surfPat = toList(UnwrapElement(IN[3]))
surfPatCl = toList(IN[4])
cutPat = toList(UnwrapElement(IN[5]))
cutPatCl = toList(IN[6])
transparency = toList(IN[7])
newMaterials = []

col_len = len(colors) == 1
surfP_len = len(surfPat) == 1
surfC_len = len(surfPatCl) == 1
cut_len = len(cutPat) == 1
cutP_len = len(cutPatCl) == 1
trans_len = len(transparency) == 1

if inputdoc == None :
	doc = DocumentManager.Instance.CurrentDBDocument
else : doc = inputdoc

def ToRevitColor(dynamoColor):
	return Color(dynamoColor.Red, dynamoColor.Green, dynamoColor.Blue)
tar = FillPatternTarget.Drafting

fillPattern = FilteredElementCollector(doc).OfClass(Autodesk.Revit.DB.FillPatternElement)

TransactionManager.Instance.ForceCloseTransaction()
TransactionManager.Instance.EnsureInTransaction(doc)
#Iterate through the input names list
for i in xrange(len(names)):
	c = 0 if col_len else i
	s = 0 if surfP_len else i
	sc = 0 if surfC_len else i
	cp = 0 if cut_len else i
	cc = 0 if cutP_len else i
	t = 0 if trans_len else i
	#Check if the material with the specified name already exists
	if Material.IsNameUnique(doc,names[i]):
		#If name is unique, create material
		new_mat_id = Material.Create(doc, names[i])
		new_mat = doc.GetElement(new_mat_id)
		if colors[c] == None:
			pass
		else:
			new_mat.Color = ToRevitColor(colors[c])
		if transparency[t] == None:
			pass
		else:	
			new_mat.Transparency = transparency[t]
		if version < 2019 :
			if surfPat[s] == None:
				pass
			else:
				if surfPat[s].GetType().ToString()	== "System.String" :
					spId=[elem for elem in fillPattern if elem.Name.lower() == surfPat[s].lower()][0].Id
					new_mat.SurfacePatternId = spId
				else:
					new_mat.SurfacePatternId = surfPat[s].Id
			if surfPatCl[sc] == None:
				pass
			else:
				new_mat.SurfacePatternColor = ToRevitColor(surfPatCl[sc])
			if cutPat[cp] == None:
				pass
			else:
				if cutPat[cp].GetType().ToString()	== "System.String" :
					new_mat.CutPatternId = FillPatternElement.GetFillPatternElementByName(doc, FillPatternTarget.Drafting,cutPat[cp]).Id
				else:
					new_mat.CutPatternId = cutPat[cp].Id
			if cutPatCl[cc] == None:
				pass
			else:
				new_mat.CutPatternColor = ToRevitColor(cutPatCl[cc])
		else:
			if surfPat[s] == None:
				pass
			else:
				if surfPat[s].GetType().ToString()	== "System.String" :
					spId=[elem for elem in fillPattern if elem.Name.lower() == surfPat[s].lower()][0].Id
					new_mat.SurfaceForegroundPatternId = spId
				else:
					new_mat.SurfaceForegroundPatternId = surfPat[s].Id
			if surfPatCl[sc] == None:
				pass
			else:
				new_mat.SurfaceForegroundPatternColor = ToRevitColor(surfPatCl[sc])
			if cutPat[cp] == None:
				pass
			else:
				if cutPat[cp].GetType().ToString()	== "System.String" :
					new_mat.CutForegroundPatternId = FillPatternElement.GetFillPatternElementByName(doc, FillPatternTarget.Drafting,cutPat[cp]).Id
				else:
					new_mat.CutForegroundPatternId = cutPat[cp].Id
			if cutPatCl[cc] == None:
				pass
			else:
				new_mat.CutForegroundPatternColor = ToRevitColor(cutPatCl[cc])
		newMaterials.append(new_mat)
	else:
		#If it already exists, collect it and modify it
		namePar = ParameterValueProvider(ElementId(BuiltInParameter.MATERIAL_NAME))
		fRule = FilterStringRule(namePar,FilterStringEquals(),names[i], True)
		filter = ElementParameterFilter(fRule)
		exist_mat = FilteredElementCollector(doc).OfClass(Material).WherePasses(filter).ToElements()
		#Iteration is necessary because the output of exist_mat is invariably a list
		for em in exist_mat:
			#Modify the Material Properties and Parameters
			if colors[c] == None:
				pass
			else:	
				em.Color = ToRevitColor(colors[c])
			if trans == None:
				pass
			else:	
				em.Transparency = trans
			if version < 2019 :
				if surfPat[s]== None:
					pass
				else:
					if surfPat[s].GetType().ToString()	== "System.String" :
						spId=[elem for elem in fillPattern if elem.Name.lower() == surfPat[s].lower()][0].Id
						em.SurfacePatternId = spId
					else:
						em.SurfacePatternId = surfPat[s].Id
				if surfPatCl[sc] == None:
					pass
				else:
					em.SurfacePatternColor = ToRevitColor(surfPatCl[sc])
				if cutPat[cp] == None:
					pass
				else:
					if cutPat[cp].GetType().ToString()	== "System.String" :
						em.CutPatternId = FillPatternElement.GetFillPatternElementByName(doc, FillPatternTarget.Drafting,cutPat[cp]).Id
					else:
						em.CutPatternId = cutPat[cp].Id
				if cutPatCl[cc] == None:
					pass
				else:
					em.CutPatternColor = ToRevitColor(cutPatCl[cc])
			else:	
				if surfPat[s] == None:
					pass
				else:
					if surfPat[s].GetType().ToString()	== "System.String" :
						spId=[elem for elem in fillPattern if elem.Name.lower() == surfPat[s].lower()][0].Id
						em.SurfaceForegroundPatternId = spId
					else:
						em.SurfaceForegroundPatternId = surfPat[s].Id
				if surfPatCl[sc] == None:
					pass
				else:
					em.SurfaceForegroundPatternColor = ToRevitColor(surfPatCl[sc])
				if cutPat[cp] == None:
					pass
				else:
					if cutPat[cp].GetType().ToString() == "System.String" :
						em.CutForegroundPatternId = FillPatternElement.GetFillPatternElementByName(doc, FillPatternTarget.Drafting,cutPat[cp]).Id
					else:
						em.CutForegroundPatternId = cutPat[cp].Id
				if cutPatCl[cc] == None:
					pass
				else:
					em.CutForegroundPatternColor = ToRevitColor(cutPatCl[cc])
			newMaterials.append(em)
TransactionManager.Instance.TransactionTaskDone()

if isinstance(IN[1], list): OUT = newMaterials
else: OUT = newMaterials[0]
# ----------------------------------------
Material = Output(create_material)
