# Dynamo custom node Material Find Texture Path.dyf (Dynamo 2.6.1.8786)
# category: GeniusLoci.Material
# Works only in Revit 2018.1 and later.
# Find the texture paths of the materials (if any).

material = Input(material: var)
python_script = Python(IN[0]=material)
# ---------- python_script.python (40 lines) ----------
#Alban de Chasteigner 2020
#twitter : @geniusloci_bim
#geniusloci.bim@gmail.com

import clr
clr.AddReference('RevitAPI')
import Autodesk
from Autodesk.Revit.DB import *

clr.AddReference('RevitServices')
import RevitServices
from RevitServices.Persistence import DocumentManager
doc = DocumentManager.Instance.CurrentDBDocument

mat = UnwrapElement(IN[0])
paths,propertyName,library=[],[],[]

assetElem = doc.GetElement(mat.AppearanceAssetId)
if assetElem:
	with Visual.AppearanceAssetEditScope(doc) as editScope:
		asset = editScope.Start(assetElem.Id)
		for idx in range(0, asset.Size):
		#idx=0
		#while idx < asset.Size:
			property=asset.Get(idx)
			#if property.NumberOfConnectedProperties < 1 :
			connectedAsset=property.GetSingleConnectedAsset()
			if connectedAsset:
				if connectedAsset.Name == "UnifiedBitmapSchema":
					#path.append(connectedAsset["unifiedbitmap_Bitmap"].Value)
					#path.append(connectedAsset.FindByName("unifiedbitmap_Bitmap").Value)
					paths.append(connectedAsset.FindByName("unifiedbitmap_Bitmap").Value)
				elif connectedAsset.Name == "BumpMapSchema":	
					paths.append(connectedAsset.FindByName("bumpmap_Bitmap").Value)
				path=filter(None,paths)
					#propertyName.append(property.Name) 
					#library.append(connectedAsset.LibraryName)
			#idx += 1

OUT= path if len(path)>1 else path[0]
# ----------------------------------------
FilePath = Output(python_script)
