# Dynamo custom node Material Get AppearanceAsset.dyf (Dynamo 2.6.1.8786)
# category: GeniusLoci.Material
# Works only in Revit 2018.1 and later.
# Retrieves the AppearanceAsset Elements of the given material and its Rendering Asset.

material = Input(material: var[]..[])
get_asset = Python(IN[0]=material)
# ---------- get_asset.python (37 lines) ----------
#Inspired by Boris Shafiro from Autodesk
#Alban de Chasteigner 2018
#twitter : @geniusloci_bim
#geniusloci.bim@gmail.com

import clr
clr.AddReference('RevitAPI')
from Autodesk.Revit.DB import *
clr.AddReference('RevitServices')
import RevitServices
from RevitServices.Persistence import DocumentManager
doc = DocumentManager.Instance.CurrentDBDocument
 
mats = UnwrapElement(IN[0]) if isinstance(IN[0],list) else [UnwrapElement(IN[0])]
assetElems,names,assets,assetTypes,titles=[],[],[],[],[]

for mat in mats:
	appearanceAssetId = mat.AppearanceAssetId
	if appearanceAssetId != ElementId.InvalidElementId:
		assetElem = doc.GetElement(appearanceAssetId)
	else:
		assetElem = ElementId.InvalidElementId
	if hasattr(assetElem, 'GetRenderingAsset'):
		asset = assetElem.GetRenderingAsset()
	else:
		asset = None
	assetElems.append(assetElem)
	assets.append(asset)
	if hasattr(asset, 'AssetType'):
		assetType, title, name = asset.AssetType, asset.Title, asset.Name
	else:
		assetType, title, name = None, None, None
	assetTypes.append(assetType)
	titles.append(title)
	names.append(name)

OUT = assetElems,assets,assetTypes,titles,names
# ----------------------------------------
code_block = CodeBlock(x=get_asset) { x[0]; x[1]; x[2]; x[3]; x[4]; }
AppearanceAsset = Output(code_block.out0)
Asset = Output(code_block.out1)
Asset_Type = Output(code_block.out2)
Asset_Title = Output(code_block.out3)
Schema = Output(code_block.out4)
