# Dynamo custom node Material Remove Texture.dyf (Dynamo 2.12.1.8246)
# category: GeniusLoci.Material
# Works only in Revit 2018.1 and later.
# Removes the assigned texture of the given material.
# Works only with the "main" image.(In the Generic/Wood/Masonry/... Properties tab)

material = Input(material: var[]..[])
python_script = Python(IN[0]=material)  # IronPython2
# ---------- python_script.python (55 lines) ----------
#Alban de Chasteigner 2022
#twitter : @geniusloci_bim
#geniusloci.bim@gmail.com

import clr
clr.AddReference('RevitAPI')
from Autodesk.Revit.DB import *
clr.AddReference('RevitServices')
import RevitServices
from RevitServices.Persistence import DocumentManager
from RevitServices.Transactions import TransactionManager

mats = UnwrapElement(IN[0]) if isinstance(IN[0],list) else [UnwrapElement(IN[0])]

TransactionManager.Instance.ForceCloseTransaction()
for mat in mats:
	doc = mat.Document
	appearanceAssetId = mat.AppearanceAssetId
	assetElem = doc.GetElement(appearanceAssetId)
	TransactionManager.Instance.EnsureInTransaction(doc)
	with Visual.AppearanceAssetEditScope(doc) as editScope:
		editableAsset = editScope.Start(assetElem.Id)
		if (editableAsset.FindByName("BaseSchema")).Value == "GenericSchema":
			property = editableAsset.FindByName("generic_diffuse")
		elif (editableAsset.FindByName("BaseSchema")).Value == "CeramicSchema":
			property = editableAsset.FindByName("ceramic_color")
		elif (editableAsset.FindByName("BaseSchema")).Value == "ConcreteSchema":
			property = editableAsset.FindByName("concrete_color")
		elif (editableAsset.FindByName("BaseSchema")).Value == "MetallicPaintSchema":
			property = editableAsset.FindByName("metallicpaint_base_color")
		elif (editableAsset.FindByName("BaseSchema")).Value == "MasonryCMUSchema":
			property = editableAsset.FindByName("masonrycmu_color")	
		elif (editableAsset.FindByName("BaseSchema")).Value == "PlasticVinylSchema":
			property = editableAsset.FindByName("plasticvinyl_color")
		elif (editableAsset.FindByName("BaseSchema")).Value == "HardwoodSchema":
			property = editableAsset.FindByName("hardwood_color")
		elif (editableAsset.FindByName("BaseSchema")).Value == "StoneSchema":
			property = editableAsset.FindByName("stone_color")	
		elif (editableAsset.FindByName("BaseSchema")).Value == "SolidGlassSchema":
			property = editableAsset.FindByName("solidglass_transmittance_custom_color")
		elif (editableAsset.FindByName("BaseSchema")).Value == "PrismLayeredSchema":
			property = editableAsset.FindByName("layered_diffuse")
		elif (editableAsset.FindByName("BaseSchema")).Value == "PrismMetalSchema":
			property = editableAsset.FindByName("surface_roughness")			
		elif (editableAsset.FindByName("BaseSchema")).Value == "PrismOpaqueSchema":
			property = editableAsset.FindByName("opaque_albedo")
		elif (editableAsset.FindByName("BaseSchema")).Value == "PrismTransparentSchema":
			property = editableAsset.FindByName("surface_roughness")
		if property.IsEditable() :
			property.RemoveConnectedAsset() 
		editScope.Commit(IFailuresPreprocessor)
	TransactionManager.Instance.TransactionTaskDone()

if isinstance(IN[0], list): OUT = mats
else: OUT = mats[0]
# ----------------------------------------
Material = Output(python_script)
