# Dynamo custom node Material Set Appearance Keyword.dyf (Dynamo 2.6.2.15705)
# category: GeniusLoci.Material
# Set the material appearance keywords.

material = Input(material: var[]..[])
keyword = Input(keyword: string[]..[])
material_set_appareance_keyword = Python(IN[0]=material, IN[1]=keyword)
# ---------- material_set_appareance_keyword.python (35 lines) ----------
#Alban de Chasteigner 2023
#twitter : @geniusloci_bim
#geniusloci.bim@gmail.com

import clr
clr.AddReference('RevitAPI')
from Autodesk.Revit.DB import *

clr.AddReference('RevitServices')
import RevitServices
from RevitServices.Persistence import DocumentManager
from RevitServices.Transactions import TransactionManager
doc = DocumentManager.Instance.CurrentDBDocument

def toList(obj):
    if hasattr(obj, '__iter__'): return obj
    else: return [obj]
    
mats = toList(UnwrapElement(IN[0]))
value = toList(IN[1])[0]

for mat in mats :
	appearanceAssetId = mat.AppearanceAssetId
	assetElem = doc.GetElement(appearanceAssetId)
	TransactionManager.Instance.EnsureInTransaction(doc)
	with Visual.AppearanceAssetEditScope(assetElem.Document) as editScope:
		editableAsset = editScope.Start(assetElem.Id)
		key = editableAsset.FindByName("keyword")
		if key.IsValidValue(value):
			key.Value = value
		editScope.Commit(True)
	TransactionManager.Instance.TransactionTaskDone()

if isinstance(IN[0], list): OUT = mats
else: OUT = mats[0]
# ----------------------------------------
Material = Output(material_set_appareance_keyword)
