# Dynamo custom node Material Set AppearanceAsset.dyf (Dynamo 2.12.1.8246)
# category: GeniusLoci.Material
# Set the AppearanceAsset Element of the given material.

material = Input(material: var[]..[])
appearanceAsset = Input(appearanceAsset: var[]..[])
set_material_appearanceasset = Python(IN[0]=material, IN[1]=appearanceAsset)  # IronPython2
# ---------- set_material_appearanceasset.python (33 lines) ----------
#Alban de Chasteigner 2018
#twitter : @geniusloci_bim
#geniusloci.bim@gmail.com

import clr
clr.AddReference('RevitAPI')
from Autodesk.Revit.DB import *

clr.AddReference("RevitNodes")
import Revit
clr.ImportExtensions(Revit.Elements)

clr.AddReference("RevitServices")
import RevitServices
from RevitServices.Persistence import DocumentManager
from RevitServices.Transactions import TransactionManager

def toList(obj):
    if hasattr(obj, '__iter__'): return obj
    else: return [obj]
    
mats = toList(UnwrapElement(IN[0]))
assetElements = toList(UnwrapElement(IN[1]))

TransactionManager.Instance.ForceCloseTransaction()
for mat,assetElement in zip(mats,assetElements):
	doc = mat.Document
	TransactionManager.Instance.EnsureInTransaction(doc)
	mat.AppearanceAssetId = assetElement.Id
	TransactionManager.Instance.TransactionTaskDone()

if isinstance(IN[0], list): OUT = mats
else: OUT = mats[0]
# ----------------------------------------
Material = Output(set_material_appearanceasset)
