# Dynamo custom node Material Set Class.dyf (Dynamo 2.6.1.8786)
# category: GeniusLoci.Material
# Set the material class name (Visible in the Identity tab).

material = Input(material: var[]..[])
className = Input(className: var[]..[])  # String. The new material class name
python_script = Python(IN[0]=material, IN[1]=className)
# ---------- python_script.python (21 lines) ----------
import clr
clr.AddReference('RevitAPI')
import Autodesk
from Autodesk.Revit.DB import Material

clr.AddReference("RevitServices")
import RevitServices
from RevitServices.Persistence import DocumentManager
from RevitServices.Transactions import TransactionManager
doc = DocumentManager.Instance.CurrentDBDocument

materials = UnwrapElement(IN[0]) if isinstance(IN[0],list) else [UnwrapElement(IN[0])]
names = IN[1] if isinstance(IN[1],list) else [IN[1]]

TransactionManager.Instance.EnsureInTransaction(doc)
for mat, name in zip(materials,names):
	mat.MaterialClass = name
TransactionManager.Instance.TransactionTaskDone()

if isinstance(IN[0], list): OUT = materials
else: OUT = materials[0]
# ----------------------------------------
Material = Output(python_script)
