# Dynamo custom node Material Set Tint Color.dyf (Dynamo 2.6.1.8786)
# category: GeniusLoci.Material
# Works only in Revit 2018.1 and later.
# Enable the Tint Color Property and set the Tint Color in the Appearance Asset Element of the given material.

material = Input(material: var[]..[])
color = Input(color: var[]..[] = DSCore.Color.ByARGB(0, 0, 0, 0))  # Dynamo Color
enable_tint_color_and_add_colors = Python(IN[0]=material, IN[1]=color)
# ---------- enable_tint_color_and_add_colors.python (38 lines) ----------
#Inspired by Boris Shafiro from Autodesk
#Alban de Chasteigner 2018
#twitter : @geniusloci_bim
#geniusloci.bim@gmail.com

import clr
clr.AddReference('RevitAPI')
from Autodesk.Revit.DB import *
clr.AddReference('RevitServices')
import RevitServices
from RevitServices.Persistence import DocumentManager
from RevitServices.Transactions import TransactionManager
doc = DocumentManager.Instance.CurrentDBDocument

def toList(obj):
    if hasattr(obj, '__iter__'): return obj
    else: return [obj]
    
mats = toList(UnwrapElement(IN[0]))
colors = toList(IN[1])

def ToRevitColor(dynamoColor):
	return Color(dynamoColor.Red, dynamoColor.Green, dynamoColor.Blue)

for mat, color in zip(mats, colors):
	appearanceAssetId = mat.AppearanceAssetId
	assetElem = doc.GetElement(appearanceAssetId)
	TransactionManager.Instance.EnsureInTransaction(doc)
	with Visual.AppearanceAssetEditScope(assetElem.Document) as editScope:
		editableAsset = editScope.Start(assetElem.Id)
		tintToggleProp = editableAsset["common_Tint_toggle"]
		tintColorProp = editableAsset["common_Tint_color"]
		tintToggleProp.Value = True
		tintColorProp.SetValueAsColor(ToRevitColor(color))
		editScope.Commit(True)
	TransactionManager.Instance.TransactionTaskDone()
	
OUT = mats
# ----------------------------------------
Material = Output(enable_tint_color_and_add_colors)
