# Dynamo custom node Materials Reset Properties.dyf (Dynamo 2.6.1.8786)
# category: GeniusLoci.Material
# Clear the pattern and color of a material using a boolean True.
# (All inputs are optional)

material = Input(material: var[]..[])
color = Input(color: var[]..[] = false)
SurfaceForegroundPattern = Input(SurfaceForegroundPattern: var[]..[] = false)
SurfaceForegroundPatternColor = Input(SurfaceForegroundPatternColor: var[]..[] = false)
SurfaceBackgroundPattern = Input(SurfaceBackgroundPattern: var[]..[] = false)
SurfaceBackgroundPatternColor = Input(SurfaceBackgroundPatternColor: var[]..[] = false)
CutForegroundPattern = Input(CutForegroundPattern: var[]..[] = false)
CutForegroundPatternColor = Input(CutForegroundPatternColor: var[]..[] = false)
CutBackgroundPattern = Input(CutBackgroundPattern: var[]..[] = false)
CutBackgroundPatternColor = Input(CutBackgroundPatternColor: var[]..[] = false)
python_script = Python(IN[0]=material, IN[1]=color, IN[2]=SurfaceForegroundPattern, IN[3]=SurfaceForegroundPatternColor, IN[4]=SurfaceBackgroundPattern, IN[5]=SurfaceBackgroundPatternColor, IN[6]=CutForegroundPattern, IN[7]=CutForegroundPatternColor, IN[8]=CutBackgroundPattern, IN[9]=CutBackgroundPatternColor)
# ---------- python_script.python (122 lines) ----------
#Alban de Chasteigner 2020
#twitter : @geniusloci_bim
#geniusloci.bim@gmail.com

import clr
clr.AddReference('RevitAPI')
import Autodesk
from Autodesk.Revit.DB import *

clr.AddReference("RevitNodes")
import Revit
clr.ImportExtensions(Revit.Elements)

clr.AddReference("RevitServices")
import RevitServices
from RevitServices.Persistence import DocumentManager
from RevitServices.Transactions import TransactionManager

def tolist(obj1):
    if hasattr(obj1,"__iter__"): return obj1
    else: return [obj1]

doc = DocumentManager.Instance.CurrentDBDocument
uiapp = DocumentManager.Instance.CurrentUIApplication
app = uiapp.Application
version=int(app.VersionNumber)

materials = tolist(UnwrapElement(IN[0]))
shadingColors=tolist(IN[1])
surfaceForegroundPatterns=tolist(UnwrapElement(IN[2]))
surfaceForegroundPatternColors=tolist(IN[3])
surfaceBackgroundPatterns=tolist(UnwrapElement(IN[4]))
surfaceBackgroundPatternColors=tolist(IN[5])
cutForegroundPatterns=tolist(UnwrapElement(IN[6]))
cutForegroundPatternColors=tolist(IN[7])
cutBackgroundPatterns=tolist(UnwrapElement(IN[8]))
cutBackgroundPatternColors=tolist(IN[9])
# "Start" the transaction
TransactionManager.Instance.EnsureInTransaction(doc)
for material,shadingColor,surfaceForegroundPattern,surfaceForegroundPatternColor,surfaceBackgroundPattern, surfaceBackgroundPatternColor,cutForegroundPattern,cutForegroundPatternColor,cutBackgroundPattern,cutBackgroundPatternColor in zip(materials,shadingColors,surfaceForegroundPatterns,surfaceForegroundPatternColors,surfaceBackgroundPatterns,surfaceBackgroundPatternColors,cutForegroundPatterns,cutForegroundPatternColors,cutBackgroundPatterns,cutBackgroundPatternColors):
	if version < 2019 :
		if shadingColor == False:
			pass
		else:
			material.UseRenderAppearanceForShading = False
			material.Color = Autodesk.Revit.DB.Color.InvalidColorValue
		if surfaceForegroundPattern == False:
			pass
		else:	
			material.SurfacePatternId = surfaceForegroundPattern.Id
		if surfaceForegroundPatternColor == False:
			pass
		else:
			material.SurfacePatternColor = Autodesk.Revit.DB.Color.InvalidColorValue
		if surfaceBackgroundPattern == False:
			pass
		else:
			material.SurfacePatternId = ElementId.InvalidElementId
		if surfaceBackgroundPatternColor == False:
			pass
		else:
			material.SurfacePatternColor = Autodesk.Revit.DB.Color.InvalidColorValue
		if cutForegroundPattern == False:
			pass
		else:	
			material.CutPatternId = ElementId.InvalidElementId
		if cutForegroundPatternColor == False:
			pass
		else:
			material.CutPatternColor = Autodesk.Revit.DB.Color.InvalidColorValue
		if cutBackgroundPattern == False:
			pass
		else:
			material.CutPatternId = ElementId.InvalidElementId
		if cutBackgroundPatternColor == False:
			pass
		else:
			material.CutPatternColor = Autodesk.Revit.DB.Color.InvalidColorValue

	else:
		if shadingColor == False:
			pass
		else:
			material.UseRenderAppearanceForShading = False
			material.Color = Autodesk.Revit.DB.Color.InvalidColorValue
		if surfaceForegroundPattern == False:
			pass
		else:	
			material.SurfaceForegroundPatternId = ElementId.InvalidElementId
		if surfaceForegroundPatternColor == False:
			pass
		else:
			material.SurfaceForegroundPatternColor = Autodesk.Revit.DB.Color.InvalidColorValue
		if surfaceBackgroundPattern == False:
			pass
		else:
			material.SurfaceBackgroundPatternId = ElementId.InvalidElementId
		if surfaceBackgroundPatternColor == False:
			pass
		else:
			material.SurfaceBackgroundPatternColor = Autodesk.Revit.DB.Color.InvalidColorValue
		if cutForegroundPattern == False:
			pass
		else:	
			material.CutForegroundPatternId = ElementId.InvalidElementId
		if cutForegroundPatternColor == False:
			pass
		else:
			material.CutForegroundPatternColor = Autodesk.Revit.DB.Color.InvalidColorValue
		if cutBackgroundPattern == False:
			pass
		else:
			material.CutBackgroundPatternId = ElementId.InvalidElementId
		if cutBackgroundPatternColor == False:
			pass
		else:
			material.CutBackgroundPatternColor = Autodesk.Revit.DB.Color.InvalidColorValue
# "End" the transaction
TransactionManager.Instance.TransactionTaskDone()

if isinstance(IN[0], list): OUT = materials
else: OUT = materials[0]
# ----------------------------------------
Material = Output(python_script)
