# Dynamo custom node Merge DuctsOrPipes.dyf (Dynamo 2.6.1.8786)
# category: GeniusLoci.MEP
# Turns pipe or duct segments into a single straight one.
# By Cyril Poupin on the Dynamo Forum

DuctsOrPipes = Input(DuctsOrPipes: var[]..[])
python_script = Python(IN[0]=DuctsOrPipes)
# ---------- python_script.python (57 lines) ----------
#By Cyril Poupin https://forum.dynamobim.com/t/turn-pipe-segments-into-single-pipe/55159/2

import clr
clr.AddReference('RevitAPI')
import Autodesk
from Autodesk.Revit.DB import *

clr.AddReference('RevitServices')
import RevitServices
from RevitServices.Persistence import DocumentManager
from RevitServices.Transactions import TransactionManager

import System
from System.Collections.Generic import List

doc = DocumentManager.Instance.CurrentDBDocument

def getConnectTo(connector):
    elemOwner = connector.Owner
    for refCon in connector.AllRefs:
        if  refCon.Owner.Id != elemOwner.Id and refCon.ConnectorType == ConnectorType.End:
            return refCon
    return None     

def getConnecDistant(group):
    lstCon = []
    for elem in group:
        if isinstance(elem, MEPCurve):
            connects = elem.ConnectorManager.Connectors
        else:
            connects = elem.MEPModel.ConnectorManager.Connectors        
        lstCon.extend(connects)
    pairLst = [[x, y] for x in lstCon for y in lstCon ]
    pairLst.sort(key = lambda x : x[0].Origin.DistanceTo(x[1].Origin))
    return  pairLst[-1]

toGroup = lambda x : x if hasattr(x[0] , '__iter__') else [x]
lstGoupPipe = toGroup(UnwrapElement(IN[0]))

TransactionManager.Instance.EnsureInTransaction(doc)
for group in lstGoupPipe:
    con2DistanA, con2DistanB = getConnecDistant(group)
    pipeA = con2DistanA.Owner 
    #prepare list to delete
    lstgroupId = List[ElementId]([x.Id for x in group if x.Id != pipeA.Id])
    #get connector to move
    seconConPipeA = [ x for x in pipeA.ConnectorManager.Connectors if x.Id !=  con2DistanA.Id][0]
    conToConnect = getConnectTo(con2DistanB)
    if conToConnect:
        seconConPipeA.ConnectTo(conToConnect)
        seconConPipeA.Origin = conToConnect.Origin
    else:
        seconConPipeA.Origin = con2DistanB.Origin   
    doc.Delete(lstgroupId)          
TransactionManager.Instance.TransactionTaskDone()

OUT = pipeA
# ----------------------------------------
DuctOrPipe = Output(python_script)
