# Dynamo custom node Parse PAT File.dyf (Dynamo 2.6.1.8786)
# category: GeniusLoci.FillPattern
# Returns the target, angles, origins, shifts, offsets, dashes and spaces of a .pat (pattern) file.
# To use with the Create Fill Pattern node.

filePath = Input(filePath: var)  # Revit .pat file
python_script = Python(IN[0]=filePath)
# ---------- python_script.python (48 lines) ----------
#Alban de Chasteigner 2020
#twitter : @geniusloci_bim
#geniusloci.bim@gmail.com

import clr
clr.AddReference('RevitAPI')
import Autodesk
from Autodesk.Revit.DB import *

clr.AddReference('RevitServices')
import RevitServices
from RevitServices.Persistence import DocumentManager
doc = DocumentManager.Instance.CurrentDBDocument
uiapp = DocumentManager.Instance.CurrentUIApplication
app = uiapp.Application
version=int(app.VersionNumber)

import sys
sys.path.append(r'C:\Program Files (x86)\IronPython 2.7\Lib')
import codecs
import re

if version < 2021:
	UIUnits = doc.GetUnits().GetFormatOptions(UnitType.UT_Length).DisplayUnits
	inches = DisplayUnitType.DUT_FEET_FRACTIONAL_INCHES
	millimeters = DisplayUnitType.DUT_MILLIMETERS
else:
	UIUnits = doc.GetUnits().GetFormatOptions(SpecTypeId.Length).GetUnitTypeId()
	inches = UnitTypeId.FeetFractionalInches
	millimeters = UnitTypeId.Millimeters
	
filepath = IN[0]

with codecs.open(filepath, 'r', encoding = 'UTF-8') as file:
	lines=[re.sub(r"\s+", "", line) for line in file.read().splitlines() if not re.match(r'^\s*$', line)]
	lines2=map(list, zip(*[re.split(',', line) for line in lines[4:]]))
	numb=[map(float, line) for line in lines2]
	if ";%UNITS=INCH" in lines:
		current=[map(lambda x: UnitUtils.Convert(x, inches, UIUnits),line) for line in numb[1:]]
	else:
		current=[map(lambda x: UnitUtils.Convert(x, millimeters, UIUnits),line) for line in numb[1:]]
	if ";%TYPE=DRAFTING" in lines:
		target="Drafting"
	else:
		target="Model"
	final=[target]+[numb[0]]+current

OUT = final
# ----------------------------------------
code_block = CodeBlock(x=python_script) { x[0]; x[1]; x[2]; x[3]; x[4]; x[5]; x[6]; x[7]; }
Target = Output(code_block.out0)  # Target of this fill pattern applied to.
Angles = Output(code_block.out1)  # Degrees
X_Origins = Output(code_block.out2)
Y_Origins = Output(code_block.out3)
Shifts = Output(code_block.out4)
Offsets = Output(code_block.out5)
Dashes = Output(code_block.out6)
Spaces = Output(code_block.out7)
