# Dynamo custom node Print PDF (multiple formats).dyf (Dynamo 2.6.1.8786)
# category: GeniusLoci.Printing
# Initiate a printing routine from a set of views/sheets, filename, printer name, print settings with many formats and print range.
# Note: With identical names, existing PDF files will be overwritten.
# Based on an archilab node.

FilePaths = Input(FilePaths: var[]..[])  # As many filepaths as views Must include : Directory + name + .pdf extension
views = Input(views: var[]..[])
PrintSetting = Input(PrintSetting: var[]..[])  # As many printsettings as views
PrinterName = Input(PrinterName: var[]..[])  # String
PrintRange = Input(PrintRange: string = "Select")  # Select, Current, Visible
RunIt = Input(RunIt: bool = false)
python_script = Python(IN[0]=FilePaths, IN[1]=views, IN[2]=PrintSetting, IN[3]=PrinterName, IN[4]=PrintRange, IN[5]=RunIt)
# ---------- python_script.python (153 lines) ----------
#Copyright(c) 2015, Konrad K Sobon
# @arch_laboratory, http://archi-lab.net
# Revised by viktor_kuzev
# Revised by Michael Park
# Revised by Alban de Chasteigner

import clr
# Import DocumentManager and TransactionManager
clr.AddReference("RevitServices")
import RevitServices
from RevitServices.Persistence import DocumentManager
from RevitServices.Transactions import TransactionManager
doc = DocumentManager.Instance.CurrentDBDocument

# Import RevitAPI
clr.AddReference("RevitAPI")
import Autodesk
from Autodesk.Revit.DB import *

import System
import sys
sys.path.append(r"C:\Program Files (x86)\IronPython 2.7\Lib")
import os

filePath = IN[0]
sheets = IN[1]
printSettings = IN[2]
printerName = IN[3]
pRange = System.Enum.Parse(Autodesk.Revit.DB.PrintRange, IN[4])
combined = True
runIt = IN[5]

if isinstance(filePath, list):
	s_length = len(sheets)
	fp_length = len(filePath)
	if len(sheets) == len(filePath):
		pass
	else:
		filePath = filePath * (s_length / fp_length)
		if len(filePath) == len(sheets):
			pass
		else:
			OUT = "Filepaths and Sheets weren't the same length"
			exit()

elif isinstance(filePath, str):
	filePath = [filePath] * len(sheets)

if isinstance(sheets, list):
	viewSheets = []
	for i in sheets:
		viewSheets.append(UnwrapElement(i))
else:
	viewSheets = UnwrapElement(sheets)

if isinstance(printSettings, list):
	printSetting = []
	for i in printSettings:
		printSetting.append(UnwrapElement(i))
else:
	printSetting = UnwrapElement(printSettings)

TransactionManager.Instance.EnsureInTransaction(doc)
printManager = doc.PrintManager		
printSetup = printManager.PrintSetup
printManager.SelectNewPrintDriver(printerName)
if isinstance(printSettings, list):
	printSetup.CurrentPrintSetting = printSetting[0]
else:
	printSetup.CurrentPrintSetting = printSetting
printManager.Apply()
TransactionManager.Instance.TransactionTaskDone()

def PrintView(doc, sheet, pRange, printerName, combined, filePath, printSetting):
	# create view set
	viewSet = ViewSet()
	viewSet.Insert(sheet)
	# determine print range
	printManager = doc.PrintManager
	printManager.PrintRange = pRange
	printManager.Apply()
	# make new view set current
	viewSheetSetting = printManager.ViewSheetSetting
	viewSheetSetting.CurrentViewSheetSet.Views = viewSet
	# set printer
	printManager.SelectNewPrintDriver(printerName)
	printManager.Apply()
	# set combined and print to file
	if printManager.IsVirtual:
		printManager.CombinedFile = combined
		printManager.Apply()
		printManager.PrintToFile = True
		printManager.Apply()
	else:
		printManager.CombinedFile = combined
		printManager.Apply()
		printManager.PrintToFile = False
		printManager.Apply()
	# set file path
	printManager.PrintToFileName = filePath
	# delete file. will prevent prompt for override existing
	if os.path.exists(filePath):
		os.remove(filePath)
	printManager.Apply()
	# apply print setting
	try:
		printSetup = printManager.PrintSetup
		printSetup.CurrentPrintSetting = printSetting
		printManager.Apply()
	except:
		pass
	# save settings and submit print
	TransactionManager.Instance.EnsureInTransaction(doc)
	viewSheetSetting.SaveAs("tempSetName")
	printManager.Apply()
	printManager.SubmitPrint()
	viewSheetSetting.Delete()
	TransactionManager.Instance.TransactionTaskDone()
	return True

try:
	viewSets = FilteredElementCollector(doc).OfClass(ViewSheetSet)
	for i in viewSets:
		if i.Name == "tempSetName":
			TransactionManager.Instance.EnsureInTransaction(doc)
			doc.Delete(i.Id)
			TransactionManager.Instance.ForceCloseTransaction()
		else:
			continue

	errorReport = None
	message = "Success"
	if runIt:
		if isinstance(viewSheets, list) and isinstance(printSetting, list):
			for i, j, fp in zip(viewSheets, printSetting, filePath):
				PrintView(doc, i, pRange, printerName, combined, fp, j)
		elif isinstance(viewSheets, list) and not isinstance(printSetting, list):
			for i, fp in zip(viewSheets, filePath):
				PrintView(doc, i, pRange, printerName, combined, fp, printSetting)
		elif not isinstance(viewSheets, list) and not isinstance(printSetting, list):
			PrintView(doc, viewSheets, pRange, printerName, combined, filePath[0], printSetting)
	else:
		message = "Set RunIt to True"
except:
	# if error accurs anywhere in the process catch it
	import traceback
	errorReport = traceback.format_exc()

# Assign your output to the OUT variable
if errorReport is None:
	OUT = message
else:
	OUT = errorReport
# ----------------------------------------
Succeed = Output(python_script)
