# Dynamo custom node Print PDF in Document (multiple formats).dyf (Dynamo 2.6.1.8786)
# category: GeniusLoci.Printing
# Initiate a printing routine from a set of views/sheets, filename, printer name, print settings with many formats and print range from document open in the background.
# Note: With identical names, existing PDF files will be overwritten.
# Based on an archilab node.

document = Input(document: var[]..[])
FilePaths = Input(FilePaths: var[]..[])  # As many filepaths as views Must include : Directory + name + .pdf extension
views = Input(views: var[]..[])
PrintSetting = Input(PrintSetting: var[]..[])  # As many printsettings as views
PrinterName = Input(PrinterName: var[]..[])  # String
PrintRange = Input(PrintRange: string = "Select")  # Select, Current, Visible
RunIt = Input(RunIt: bool = false)
python_script = Python(IN[0]=document, IN[1]=FilePaths, IN[2]=views, IN[3]=PrintSetting, IN[4]=PrinterName, IN[5]=PrintRange, IN[6]=RunIt)
# ---------- python_script.python (135 lines) ----------
#Copyright(c) 2015, Konrad K Sobon
# @arch_laboratory, http://archi-lab.net
# Revised by Gustav Blom
# Revised by Michael Park
# Revised by Alban de Chasteigner

import clr
# Import DocumentManager and TransactionManager
clr.AddReference("RevitServices")
import RevitServices
from RevitServices.Persistence import DocumentManager
from RevitServices.Transactions import TransactionManager
doc = IN[0]

# Import RevitAPI
clr.AddReference("RevitAPI")
import Autodesk
from Autodesk.Revit.DB import *

import System
import sys
sys.path.append(r"C:\Program Files (x86)\IronPython 2.7\Lib")
import os

filePath = IN[1]
sheets = IN[2]
printSetting = IN[3]
printerName = IN[4]
pRange = System.Enum.Parse(Autodesk.Revit.DB.PrintRange, IN[5])
combined = True
runIt = IN[6]

if isinstance(filePath, list):
	s_length = len(sheets)
	fp_length = len(filePath)
	if len(sheets) == len(filePath):
		pass
	else:
		filePath = filePath * (s_length / fp_length)
		if len(filePath) == len(sheets):
			pass
		else:
			OUT = "Filepaths and Sheets weren't the same length"
			exit()

elif isinstance(filePath, str):
	filePath = [filePath] * len(sheets)

if isinstance(sheets, list):
	viewSheets = []
	for i in sheets:
		viewSheets.append(UnwrapElement(i))
else:
	viewSheets = UnwrapElement(sheets)

def PrintView(doc, sheet, pRange, printerName, combined, filePath, printSetting):
	# create view set
	viewSet = ViewSet()
	viewSet.Insert(sheet)
	# determine print range
	printManager = doc.PrintManager
	printManager.PrintRange = pRange
	printManager.Apply()
	# make new view set current
	viewSheetSetting = printManager.ViewSheetSetting
	viewSheetSetting.CurrentViewSheetSet.Views = viewSet
	# set printer
	printManager.SelectNewPrintDriver(printerName)
	printManager.Apply()
	# set combined and print to file
	if printManager.IsVirtual:
		printManager.CombinedFile = combined
		printManager.Apply()
		printManager.PrintToFile = True
		printManager.Apply()
	else:
		printManager.CombinedFile = combined
		printManager.Apply()
		printManager.PrintToFile = False
		printManager.Apply()
	# set file path
	printManager.PrintToFileName = filePath
	printManager.Apply()
	# apply print setting
	ps = FilteredElementCollector(doc).OfClass(PrintSetting)
	for k in ps:
		if k.Name == printSetting.Name:
			newPrintSetting = k
	# save settings and submit print
	t = Transaction(doc,'temp')
	t.Start()
	# delete file. will prevent prompt for override existing
	if os.path.exists(filePath):
		os.remove(filePath)
	printSetup = printManager.PrintSetup
	printSetup.CurrentPrintSetting = newPrintSetting
	printManager.Apply()
	viewSheetSetting.SaveAs("tempSetName")
	printManager.Apply()
	printManager.SubmitPrint()
	viewSheetSetting.Delete()
	t.Commit()
	return True

try:
	viewSets = FilteredElementCollector(doc).OfClass(ViewSheetSet)
	for i in viewSets:
		if i.Name == "tempSetName":
			doc.Delete(i.Id)
		else:
			continue

	errorReport = None
	message = "Success"
	if runIt:
		if isinstance(viewSheets, list) and isinstance(printSetting, list):
			for i, j, fp in zip(viewSheets, printSetting, filePath):
				PrintView(doc, i, pRange, printerName, combined, fp, j)
		elif isinstance(viewSheets, list) and not isinstance(printSetting, list):
			for i, fp in zip(viewSheets, filePath):
				PrintView(doc, i, pRange, printerName, combined, fp, printSetting)
		elif not isinstance(viewSheets, list) and not isinstance(printSetting, list):
			PrintView(doc, viewSheets, pRange, printerName, combined, filePath[0], printSetting)
	else:
		message = "Set RunIt to True"
except:
	# if error accurs anywhere in the process catch it
	import traceback
	errorReport = traceback.format_exc()

# Assign your output to the OUT variable
if errorReport is None:
	OUT = message
else:
	OUT = errorReport
# ----------------------------------------
Result = Output(python_script)
