# Dynamo custom node Print Settings ByName.dyf (Dynamo 2.6.1.8786)
# category: GeniusLoci.Printing
# Collect printsettings by given name in the active or given document.

printSettingsName = Input(printSettingsName: var[]..[])  # String
docOrRevitLinkInstance = Input(docOrRevitLinkInstance: var = null)  # Use only if you want to query a linked model
python_script = Python(IN[0]=printSettingsName, IN[1]=docOrRevitLinkInstance)
# ---------- python_script.python (33 lines) ----------
import clr
clr.AddReference("RevitServices")
from RevitServices.Persistence import DocumentManager
clr.AddReference("RevitAPI")
from Autodesk.Revit.DB import FilteredElementCollector, PrintSetting

# Part of script from Clockwork
inputdoc = UnwrapElement(IN[1])
if inputdoc == None:
	doc = DocumentManager.Instance.CurrentDBDocument
elif inputdoc.GetType().ToString() == "Autodesk.Revit.DB.RevitLinkInstance":
	doc = inputdoc.GetLinkDocument()
elif inputdoc.GetType().ToString() == "Autodesk.Revit.DB.Document":
	doc = inputdoc
else: 
	doc = DocumentManager.Instance.CurrentDBDocument

names = IN[0] if isinstance(IN[0],list) else [IN[0]]
outList = []

printSet = {}
printSettings = FilteredElementCollector(doc).OfClass(PrintSetting)
for ps in printSettings:
	printSet[ps.Name] = ps

for name in names:
	for key in printSet.keys():
		if key == name:
			outList.append(printSet[name])
			break

if isinstance(IN[0], list): OUT = outList
else: OUT = outList[0]
# ----------------------------------------
PrintSettings = Output(python_script)
