# Dynamo custom node Print Settings Properties.dyf (Dynamo 2.6.1.8786)
# category: GeniusLoci.Printing
# Returns the name, paper size, orientation, placement, zoom and colors of the given or collected print settings.

PrintSetting = Input(PrintSetting: var[]..[] = null)  # Collects all the print settings of the document with the default value
python_script = Python(IN[0]=PrintSetting)
# ---------- python_script.python (38 lines) ----------
#Alban de Chasteigner 2020
#twitter : @geniusloci_bim
#geniusloci.bim@gmail.com
 
import clr
# Import RevitAPI Classes
clr.AddReference('RevitAPI')
import Autodesk
from Autodesk.Revit.DB import FilteredElementCollector, PrintSetting, PrintParameters

# Import DocumentManager and TransactionManager
clr.AddReference("RevitServices")
import RevitServices
from RevitServices.Persistence import DocumentManager

doc = DocumentManager.Instance.CurrentDBDocument
elements = UnwrapElement(IN[0]) if isinstance(IN[0],list) else [UnwrapElement(IN[0])]
sizes,orientations,names,sources,placements,zooms,hidden,colors=[],[],[],[],[],[],[],[]

if IN[0] == None:
	prinsettings = FilteredElementCollector(doc).OfClass(PrintSetting).WhereElementIsNotElementType().ToElements()
else:prinsettings = elements

for col in prinsettings:
	names.append(col.Name)
	try :
		sizes.append(col.PrintParameters.PaperSize.Name)
	except:
		sizes.append(None)
	orientations.append(col.PrintParameters.PageOrientation)
	sources.append(col.PrintParameters.PaperSource.Name)
	placements.append(col.PrintParameters.PaperPlacement)
	zooms.append(col.PrintParameters.ZoomType)
	hidden.append(col.PrintParameters.HiddenLineViews)
	colors.append(col.PrintParameters.ColorDepth)

if isinstance(IN[0], list) or IN[0] == None : OUT = names,sizes,orientations,sources,placements,zooms,hidden,colors
else: OUT = names[0],sizes[0],orientations[0],sources[0],placements[0],zooms[0],hidden[0],colors[0]
# ----------------------------------------
code_block = CodeBlock(x=python_script) { x[0]; x[1]; x[2]; x[3]; x[4]; x[5]; x[6]; x[7]; }
PrintSetting_s_Name = Output(code_block.out0)  # "PrintSetting's Name"
PaperSize = Output(code_block.out1)
PageOrientation = Output(code_block.out2)
PaperSource = Output(code_block.out3)
PaperPlacement = Output(code_block.out4)
Zoom = Output(code_block.out5)
HiddenLineViews = Output(code_block.out6)
Colors = Output(code_block.out7)
