# Dynamo custom node Railing SetPath.dyf (Dynamo 2.6.1.8786)
# category: GeniusLoci.Element
# Modify the path of an existing railing.

Railing = Input(Railing: var[]..[])
curve = Input(curve: var[]..[])  # Dynamo curve
python_script = Python(IN[0]=Railing, IN[1]=curve)
# ---------- python_script.python (32 lines) ----------
#Alban de Chasteigner 2018
#twitter : @geniusloci_bim
#geniusloci.bim@gmail.com

import clr
clr.AddReference('RevitAPI')
from Autodesk.Revit.DB import *

clr.AddReference("RevitNodes")
import Revit
clr.ImportExtensions(Revit.Elements)
clr.ImportExtensions(Revit.GeometryConversion)

clr.AddReference("RevitServices")
import RevitServices
from RevitServices.Persistence import DocumentManager
from RevitServices.Transactions import TransactionManager
doc = DocumentManager.Instance.CurrentDBDocument

railing = UnwrapElement(IN[0])
curves = UnwrapElement(IN[1]) if isinstance(IN[1],list) else [UnwrapElement(IN[1])]

TransactionManager.Instance.EnsureInTransaction(doc)
revitCurves=[]
for curve in curves:
	revitCurves.append(curve.ToRevitType())

curveloop = CurveLoop.Create(revitCurves)
rpath = railing.SetPath(curveloop)
TransactionManager.Instance.TransactionTaskDone()

OUT = railing
# ----------------------------------------
Railing_2 = Output(python_script)  # "Railing"
