# Dynamo custom node Rebar RebarShape.dyf
# category: GeniusLoci.Rebar
# Returns the RebarShape element that defines the shape of the rebar.

rebar = Input(rebar: var[]..[])
python = Python(IN[0]=rebar)  # CPython3
# ---------- python.python (22 lines) ----------
#Alban de Chasteigner 2023
#twitter : @geniusloci_bim
#geniusloci.bim@gmail.com
#https://github.com/albandechasteigner/GeniusLociForDynamo
 
import clr
clr.AddReference('RevitAPI')
import Autodesk
from Autodesk.Revit.DB.Structure import *

clr.AddReference("RevitServices")
import RevitServices
from RevitServices.Persistence import DocumentManager
doc = DocumentManager.Instance.CurrentDBDocument

elements = UnwrapElement(IN[0]) if isinstance(IN[0],list) else [UnwrapElement(IN[0])]
shapes=[]

for elem in elements:
    shapes.append(doc.GetElement(elem.GetShapeId()))

OUT = shapes
# ----------------------------------------
RebarShape = Output(python)
