# Dynamo custom node Reference Element.dyf (Dynamo 2.6.1.8786)
# category: GeniusLoci.Reference
# Returns the Revit Element from a reference in the given document.

reference = Input(reference: var[]..[])  # Autodesk.DB.Reference
docOrRevitLinkInstance = Input(docOrRevitLinkInstance: var = null)  # Use only if you want to query a linked model
python_script = Python(IN[0]=reference, IN[1]=docOrRevitLinkInstance)
# ---------- python_script.python (35 lines) ----------
#Alban de Chasteigner 2021
#twitter : @geniusloci_bim
#geniusloci.bim@gmail.com
#https://github.com/albandechasteigner/GeniusLociForDynamo
 
import clr
clr.AddReference('RevitAPI')
import Autodesk
from Autodesk.Revit.DB import *

clr.AddReference("RevitServices")
import RevitServices
from RevitServices.Persistence import DocumentManager

references = UnwrapElement(IN[0]) if isinstance(IN[0],list) else [UnwrapElement(IN[0])]
inputdoc = UnwrapElement(IN[1]) if isinstance(IN[1],list) else [UnwrapElement(IN[1])][0]

#Inspired by Clockwork
if inputdoc == None:
    doc = DocumentManager.Instance.CurrentDBDocument
elif isinstance (inputdoc, Document):
    doc = inputdoc
elif isinstance (inputdoc, RevitLinkInstance):
    doc = inputdoc.GetLinkDocument()
else: doc = DocumentManager.Instance.CurrentDBDocument

elements =[]
for reference in references:
	try:
		elem = doc.GetElement(reference)
		elements.append(elem)
	except:elements.append(None)

if isinstance(IN[0], list): OUT = elements
else: OUT = elements[0]
# ----------------------------------------
Element = Output(python_script)
