# Dynamo custom node Reference ReferenceType.dyf (Dynamo 2.6.1.8786)
# category: GeniusLoci.Reference
# Obtains the type of the given reference. (Element, subelement, curve, face, mesh...)

# note: Enumeration available on : https://apidocs.co/apps/revit/2022.1/f664c172-bb88-463b-d8ad-5dd70a11dd5a.htm
reference = Input(reference: var[]..[])  # Autodesk.Revit.DB.Reference
python_script = Python(IN[0]=reference)
# ---------- python_script.python (20 lines) ----------
#Alban de Chasteigner 2021
#twitter : @geniusloci_bim
#geniusloci.bim@gmail.com
#https://github.com/albandechasteigner/GeniusLociForDynamo
 
import clr
clr.AddReference('RevitAPI')
import Autodesk
from Autodesk.Revit.DB import *

references = UnwrapElement(IN[0]) if isinstance(IN[0],list) else [UnwrapElement(IN[0])]

refTypes =[]
for reference in references:
	try:
		refTypes.append(reference.ElementReferenceType)
	except:refTypes.append(None)

if isinstance(IN[0], list): OUT = refTypes
else: OUT = refTypes[0]
# ----------------------------------------
ReferenceType = Output(python_script)
