# Dynamo custom node Reference Surface.dyf (Dynamo 2.6.1.8786)
# category: GeniusLoci.Reference
# Obtains the Revit surface from a reference in the given document.

reference = Input(reference: var[]..[])
docOrRevitLinkInstance = Input(docOrRevitLinkInstance: var = null)  # Use only if you want to query a linked model
python_script = Python(IN[0]=reference, IN[1]=docOrRevitLinkInstance)
# ---------- python_script.python (39 lines) ----------
#Alban de Chasteigner 2021
#twitter : @geniusloci_bim
#geniusloci.bim@gmail.com
#https://github.com/albandechasteigner/GeniusLociForDynamo
 
import clr
clr.AddReference('RevitAPI')
import Autodesk
from Autodesk.Revit.DB import *

clr.AddReference("RevitServices")
import RevitServices
from RevitServices.Persistence import DocumentManager

clr.AddReference("RevitNodes")
import Revit
clr.ImportExtensions(Revit.GeometryConversion)

references = UnwrapElement(IN[0]) if isinstance(IN[0],list) else [UnwrapElement(IN[0])]
inputdoc = UnwrapElement(IN[1]) if isinstance(IN[1],list) else [UnwrapElement(IN[1])][0]

#Inspired by Clockwork
if inputdoc == None:
    doc = DocumentManager.Instance.CurrentDBDocument
elif isinstance (inputdoc, Document):
    doc = inputdoc
elif isinstance (inputdoc, RevitLinkInstance):
    doc = inputdoc.GetLinkDocument()
else: doc = DocumentManager.Instance.CurrentDBDocument

faces =[]
for reference in references:
	try:
		face = doc.GetElement(reference).GetGeometryObjectFromReference(reference)
		faces.append(face.ToProtoType()[0])
	except:faces.append(None)

if isinstance(IN[0], list): OUT = faces
else: OUT = faces[0]
# ----------------------------------------
Surface = Output(python_script)  # Dynamo Surface
