# Dynamo custom node Reload CAD ImportInstance.dyf (Dynamo 2.6.1.8786)
# category: GeniusLoci.CAD Import
# Reloads the CAD link instance provided.

importInstance = Input(importInstance: var[]..[])
python_script = Python(IN[0]=importInstance)
# ---------- python_script.python (26 lines) ----------
#Alban de Chasteigner 2019
#twitter : @geniusloci_bim
#geniusloci.bim@gmail.com

import clr
clr.AddReference('RevitAPI')
from Autodesk.Revit.DB import *

clr.AddReference("RevitServices")
import RevitServices
from RevitServices.Persistence import DocumentManager
from RevitServices.Transactions import TransactionManager
doc = DocumentManager.Instance.CurrentDBDocument

linkInst = UnwrapElement(IN[0])
if not hasattr(linkInst, '__iter__'):
    linkInst = [linkInst]

TransactionManager.Instance.EnsureInTransaction(doc)
for link in linkInst:
	linkType = doc.GetElement(link.GetTypeId())
	linkType.Reload()
TransactionManager.Instance.TransactionTaskDone()

if isinstance(IN[0], list): OUT = linkInst
else: OUT = linkInst[0]
# ----------------------------------------
CAD_importInstance = Output(python_script)
