# Dynamo custom node Reload CADLinks.dyf (Dynamo 2.6.1.8786)
# category: GeniusLoci.CAD Import
# Reload imported CAD from its current location.
# Works only in Revit 2018 and later.

reload_cadlinks = Python()
# ---------- reload_cadlinks.python (33 lines) ----------
#Alban de Chasteigner, 2018
#geniusloci.bim@gmail.com

import clr
clr.AddReference("RevitServices")
import RevitServices
from RevitServices.Persistence import DocumentManager
from RevitServices.Transactions import TransactionManager
# Import RevitAPI
clr.AddReference("RevitAPI")
import Autodesk
from Autodesk.Revit.DB import *
doc = DocumentManager.Instance.CurrentDBDocument

outName, CADlinktype, importinst = [], [], []

importInstances = FilteredElementCollector(doc).OfClass(Autodesk.Revit.DB.ImportInstance).ToElements()

#Start the transaction
TransactionManager.Instance.EnsureInTransaction(doc)

for importins in importInstances :
	if importins.IsLinked:
		CADLink = doc.GetElement(importins.GetTypeId())
		CADLink.Reload()
		importinst.append(importins)
		CADlinktype.append(CADLink)
		name = Element.Name.GetValue(CADLink)
		outName.append(name)

TransactionManager.Instance.TransactionTaskDone()
#Assign your output to the OUT variable.
OUT = outName,CADlinktype,importinst
# ----------------------------------------
code_block = CodeBlock(x=reload_cadlinks) { x[0]; x[1]; x[2]; }
Name = Output(code_block.out0)
CADLinkType = Output(code_block.out1)
ImportInstance = Output(code_block.out2)
