# Dynamo custom node Reload RevitLinkInstance.dyf (Dynamo 2.6.1.8786)
# category: GeniusLoci.Import
# Reloads the Revit link provided.

RevitLinkInstance = Input(RevitLinkInstance: var[]..[])
reload_link = Python(IN[0]=RevitLinkInstance)
# ---------- reload_link.python (21 lines) ----------
import clr
clr.AddReference('RevitAPI')
from Autodesk.Revit.DB import *

clr.AddReference("RevitServices")
import RevitServices
from RevitServices.Persistence import DocumentManager
from RevitServices.Transactions import TransactionManager

doc = DocumentManager.Instance.CurrentDBDocument

linkInst = UnwrapElement(IN[0]) if isinstance(IN[0],list) else [UnwrapElement(IN[0])]

TransactionManager.Instance.ForceCloseTransaction()

for link in linkInst:
	linkType = doc.GetElement(link.GetTypeId())
	linkType.Reload()

if isinstance(IN[0], list): OUT = linkInst
else: OUT = linkInst[0]
# ----------------------------------------
RevitLinkInstance_2 = Output(reload_link)  # "RevitLinkInstance"
