# Dynamo custom node Remove Special Characters from String.dyf (Dynamo 2.6.1.8786)
# category: GeniusLoci.Utilities
# Useful for removing invalid characters from filenames.
# For use with the FilenameToFilePaths node.

strings = Input(strings: var[]..[])
remove_forbidden_ascii = Python(IN[0]=strings)  # "Remove forbidden ASCII characters"
# ---------- remove_forbidden_ascii.python (11 lines) ----------
import re
strings = IN[0] if isinstance(IN[0],list) else [IN[0]]

result = []
for char in strings:
	#remove spaces
	#result.append(''.join(c for c in char if c.isalnum()))
	result.append("".join(re.findall(r"[a-zA-Z0-9 _éè-]+", char) ))
	
if isinstance(IN[0], list): OUT = result 
else: OUT = result[0]
# ----------------------------------------
String = Output(remove_forbidden_ascii)
