# Dynamo custom node Repath CAD ImportInstance.dyf (Dynamo 2.6.1.8786)
# category: GeniusLoci.CAD Import
# Reloads the CAD link from the input path.

importInstance = Input(importInstance: var[]..[])
FilePath = Input(FilePath: var[]..[])
python_script = Python(IN[0]=importInstance, IN[1]=FilePath)
# ---------- python_script.python (27 lines) ----------
#Alban de Chasteigner 2019
#twitter : @geniusloci_bim
#geniusloci.bim@gmail.com

import clr
clr.AddReference("RevitServices")
import RevitServices
from RevitServices.Persistence import DocumentManager
from RevitServices.Transactions import TransactionManager
doc = DocumentManager.Instance.CurrentDBDocument

def tolist(obj1):
    if hasattr(obj1,"__iter__"): return obj1
    else: return [obj1]

linkInstances = tolist(UnwrapElement(IN[0]))
paths = tolist(IN[1])
reloadedlinks = []

TransactionManager.Instance.EnsureInTransaction(doc)	
for i,j in zip(linkInstances,paths):
	RevitLinkType  = doc.GetElement(i.GetTypeId())
	RevitLinkType.LoadFrom(j)
	reloadedlinks.append(RevitLinkType)
TransactionManager.Instance.TransactionTaskDone()

OUT= reloadedlinks
# ----------------------------------------
CADLinkType = Output(python_script)
