# Dynamo custom node Repath RevitLinkInstance.dyf (Dynamo 2.6.1.8786)
# category: GeniusLoci.Import
# Reloads the Revit link from the input path.

RevitLinkInstance = Input(RevitLinkInstance: var[]..[])
FilePath = Input(FilePath: var[]..[])
python_script = Python(IN[0]=RevitLinkInstance, IN[1]=FilePath)
# ---------- python_script.python (27 lines) ----------
import clr
clr.AddReference("RevitServices")
import RevitServices
from RevitServices.Persistence import DocumentManager
from RevitServices.Transactions import TransactionManager
clr.AddReference('RevitAPI')
import Autodesk
from Autodesk.Revit.DB import *
from System.Collections.Generic import *
doc = DocumentManager.Instance.CurrentDBDocument

def tolist(obj1):
    if hasattr(obj1,"__iter__"): return obj1
    else: return [obj1]

linkInstances = tolist(UnwrapElement(IN[0]))
paths = tolist(IN[1])
reloadedlinks = []

TransactionManager.Instance.ForceCloseTransaction()
for i,j in zip(linkInstances,paths):
	filepaths = FilePath(j)
	RevitLinkType  = doc.GetElement(i.GetTypeId())
	RevitLinkType.LoadFrom(filepaths,None)
	reloadedlinks.append(RevitLinkType)

OUT= reloadedlinks
# ----------------------------------------
RevitLinkType = Output(python_script)
