# Dynamo custom node Repath RevitLinkType.dyf (Dynamo 2.6.1.8786)
# category: GeniusLoci.Import
# Reloads the linked Revit file(s) from a folder.

RunIt = Input(RunIt: bool = false)
DirectoryPath = Input(DirectoryPath: var[]..[])
python_script = Python(IN[0]=RunIt, IN[1]=DirectoryPath)
# ---------- python_script.python (33 lines) ----------
#Based on a Nick Boyts's script.
import clr
# Import DocumentManager and TransactionManager
clr.AddReference("RevitServices")
import RevitServices
from RevitServices.Persistence import DocumentManager

# Import RevitAPI
clr.AddReference("RevitAPI")
import Autodesk
from Autodesk.Revit.DB import *

doc = DocumentManager.Instance.CurrentDBDocument

linkInstances = Autodesk.Revit.DB.FilteredElementCollector(doc).OfClass(Autodesk.Revit.DB.RevitLinkInstance)
toggle = IN[0]
folderpath = IN[1]
reloadedlinks= []

if toggle == True:
	for i in linkInstances:
		name = i.Name
		path = folderpath + "\\" + name
		paths = path.rsplit(' : ',2)[0]
		filepath = FilePath(paths)
		RevitLinkType=doc.GetElement(i.GetTypeId())
		try:
			RevitLinkType.LoadFrom(filepath,None)
		except:
			pass
		reloadedlinks.append(RevitLinkType)

OUT= reloadedlinks
# ----------------------------------------
RevitLinkType = Output(python_script)
