# Dynamo custom node Reset SystemType Graphics.dyf (Dynamo 2.6.1.8786)
# category: GeniusLoci.MEP
# Clear the line pattern, line weight, line color and  material of the given System Type.

SystemType = Input(SystemType: var[]..[])
reset_systemtype_properties = Python(IN[0]=SystemType)
# ---------- reset_systemtype_properties.python (30 lines) ----------
import clr
clr.AddReference('RevitAPI')
import Autodesk
from Autodesk.Revit.DB import *

clr.AddReference("RevitNodes")
import Revit
clr.ImportExtensions(Revit.Elements)

clr.AddReference("RevitServices")
import RevitServices
from RevitServices.Persistence import DocumentManager
from RevitServices.Transactions import TransactionManager

def tolist(obj1):
    if hasattr(obj1,"__iter__"): return obj1
    else: return [obj1]

doc = DocumentManager.Instance.CurrentDBDocument
systypes = tolist(UnwrapElement(IN[0]))

TransactionManager.Instance.EnsureInTransaction(doc)
for systype in systypes:
	systype.LineColor = Autodesk.Revit.DB.Color.InvalidColorValue
	systype.LineWeight = -1
	systype.LinePatternId = ElementId.InvalidElementId
	systype.MaterialId = ElementId.InvalidElementId
TransactionManager.Instance.TransactionTaskDone()

OUT = systypes
# ----------------------------------------
SystemType_2 = Output(reset_systemtype_properties)  # "SystemType"
