# Dynamo custom node RevisionCloud ToSheet.dyf (Dynamo 2.6.1.8786)
# category: GeniusLoci.Sheet
# Returns the ViewSheets where this RevisionCloud appears.

revisionCloud = Input(revisionCloud: var[]..[])
python_script = Python(IN[0]=revisionCloud)
# ---------- python_script.python (35 lines) ----------
import clr
# Import RevitAPI Classes
clr.AddReference('RevitAPI')
import Autodesk

import System
# Load System.Core assembly that contains HashSet
clr.AddReference("System.Core")
from System.Collections.Generic import HashSet

def flatten_list(a, result=None):
	if result is None:
		result = []
	for x in a:
		for y in x:
			if isinstance(y, list):
				flatten_list(y, result)
			else:
				result.append(y)
	return result

revisions = UnwrapElement(IN[0]) if isinstance(IN[0],list) else [UnwrapElement(IN[0])]

iSet=[]
for elem in revisions:
	iSet.append(elem.GetSheetIds())
	sheets=[]
	for iSe in flatten_list(iSet):
		hashSet = HashSet[Autodesk.Revit.DB.ElementId]()
		hashSet.Add(iSe)
		for id in hashSet :
			sheets.append(elem.Document.GetElement(id))

if isinstance(IN[0], list): OUT = sheets
else: OUT = sheets[0]
# ----------------------------------------
Sheet = Output(python_script)
