# Dynamo custom node RevitLinkInstance ByPoint.dyf (Dynamo 2.6.1.8786)
# category: GeniusLoci.Import
# Link the Revit Instance to the given point. The input "Rotation" is optional.

revitLinkType = Input(revitLinkType: var[]..[])
location = Input(location: Autodesk.DesignScript.Geometry.Point[]..[])  # Point where the instance is to be placed
rotation = Input(rotation: var[]..[] = null)  # Optional input
python_script = Python(IN[0]=revitLinkType, IN[1]=location, IN[2]=rotation)
# ---------- python_script.python (36 lines) ----------
import clr
clr.AddReference('RevitNodes')
import Revit
clr.ImportExtensions(Revit.GeometryConversion)

clr.AddReference('RevitAPI')
from Autodesk.Revit.DB import *

clr.AddReference('RevitServices')
from RevitServices.Persistence import DocumentManager
from RevitServices.Transactions import TransactionManager
doc = DocumentManager.Instance.CurrentDBDocument

import math

links = UnwrapElement(IN[0]) if isinstance(IN[0],list) else [UnwrapElement(IN[0])]
links = links[0]
locations = IN[1] if isinstance(IN[1],list) else [IN[1]]
rotations = IN[2] if isinstance(IN[2],list) else [IN[2]]
instances, points = [], []
	
TransactionManager.Instance.EnsureInTransaction(doc)
for loc in locations:
	xyz=loc.ToXyz()
	points.append(xyz)
	linkInstance = RevitLinkInstance.Create(doc,links.Id,ImportPlacement.Origin)
	linkInstance.Location.Move(xyz)
	if rotations[0] == None:
		pass	
	else:
		axis = Line.CreateBound(xyz, XYZ(xyz.X,xyz.Y,xyz.Z +1))
		ElementTransformUtils.RotateElement(doc,linkInstance.Id,axis,rotations[points.index(xyz)]*math.pi/-180)
	instances.append(linkInstance)
TransactionManager.Instance.TransactionTaskDone()
	
OUT = instances
# ----------------------------------------
RevitLinkInstance = Output(python_script)
