# Dynamo custom node Rotate Fitting.dyf (Dynamo 2.6.1.8786)
# category: GeniusLoci.MEP
# Rotates a fitting, at specified degree, around the axis of the primary MEP system element (pipe, duct, cable tray, conduit...).
# By MEPover on forum.dynamobim.com

fitting = Input(fitting: var[]..[])
ConnectedElement = Input(ConnectedElement: var[]..[])  # Duct, pipe or conduit attached to the fitting (not connected to the primary connector)
Angle = Input(Angle: double[]..[])  # Degrees
python_script = Python(IN[0]=fitting, IN[1]=ConnectedElement, IN[2]=Angle)
# ---------- python_script.python (49 lines) ----------
#By T_Pover
import clr
clr.AddReference("RevitAPI")
import Autodesk
from Autodesk.Revit.DB import *

import math

clr.AddReference("RevitServices")
import RevitServices
from RevitServices.Persistence import DocumentManager
from RevitServices.Transactions import TransactionManager
doc = DocumentManager.Instance.CurrentDBDocument

inn = [UnwrapElement(IN[0]),UnwrapElement(IN[1])]
conns = [0,1]

def disconnect(curve):
	connectors = curve.ConnectorManager.Connectors
	for conn in connectors:
		if conn.IsConnected:
			for c in conn.AllRefs:
				if conn.IsConnectedTo(c):
					conns[0] = conn
					conns[1] = c
					conn.DisconnectFrom(c)

angle = (IN[2]*math.pi)/180

TransactionManager.Instance.EnsureInTransaction(doc)
connectors = inn[0].MEPModel.ConnectorManager.Connectors
for c in connectors:
	if c.GetMEPConnectorInfo().IsPrimary:
		primary = c
		break
	primary = c
	
loc = inn[0].Location
ductloc = inn[1].Location
center = primary.CoordinateSystem.BasisZ
centerrot = XYZ(center.X,center.Y,center.Z)
line = Autodesk.Revit.DB.Line.CreateUnbound(primary.Origin,center)
disconnect(inn[1])
ductloc.Rotate(line,angle)
loc.Rotate(line,angle)
conns[0].ConnectTo(conns[1])
TransactionManager.Instance.TransactionTaskDone()

OUT =  IN[0]
# ----------------------------------------
Fitting = Output(python_script)
