# Dynamo custom node Select Linked Element.dyf (Dynamo 2.6.1.8786)
# category: GeniusLoci.Select
# Selects the linked elements.

refresh = Input(refresh: bool = false)
python_script = Python(IN[0]=refresh)
# ---------- python_script.python (34 lines) ----------
#Alban de Chasteigner 2021, @geniusloci_bim 

import clr
clr.AddReference('RevitAPI')
import Autodesk
from Autodesk.Revit.DB import RevitLinkInstance

clr.AddReference('RevitAPIUI')
from Autodesk.Revit.UI import *
from Autodesk.Revit.UI.Selection import *

clr.AddReference('RevitServices')
import RevitServices
from RevitServices.Persistence import DocumentManager
doc = DocumentManager.Instance.CurrentDBDocument
uidoc = DocumentManager.Instance.CurrentUIApplication.ActiveUIDocument

clr.AddReference("RevitNodes")
import Revit
clr.ImportExtensions(Revit.GeometryConversion)

elemInLinks=[]

TaskDialog.Show("Selection", "Select the linked elements and press Finish")
reflnk = uidoc.Selection.PickObjects(ObjectType.LinkedElement, "Select linked elements")
for ref in reflnk :
	lnkinst=doc.GetElement(ref)
	tfLnk = lnkinst.GetTotalTransform().ToCoordinateSystem(1)
	doclnk =  lnkinst.GetLinkDocument()
	elemInLink = doclnk.GetElement(ref.LinkedElementId)
	elemInLinks.append(elemInLink)

if len(elemInLinks)>1: OUT = elemInLinks, lnkinst, tfLnk
else:OUT = elemInLinks[0], lnkinst, tfLnk
# ----------------------------------------
code_block = CodeBlock(x=python_script) { x[0]; x[1]; x[2]; }
Element = Output(code_block.out0)
RevitLinkInstance = Output(code_block.out1)
Transform = Output(code_block.out2)
