# Dynamo custom node SelectByCateOrType.dyf (Dynamo 2.6.1.8786)
# category: GeniusLoci.Select
# Collect elements by Category, Element Type or Family Type in the given document.
# The transform CS is returned only with a LinkInstance input.

CategoryOrType = Input(CategoryOrType: var[]..[])
docOrRevitLinkInstance = Input(docOrRevitLinkInstance: var = null)  # Use only if you want to query a linked model
selectByCategory = Python(IN[0]=CategoryOrType, IN[1]=docOrRevitLinkInstance)
# ---------- selectByCategory.python (75 lines) ----------
import clr
clr.AddReference('RevitNodes')
import Revit
clr.ImportExtensions(Revit.GeometryConversion)
clr.ImportExtensions(Revit.Elements)

clr.AddReference('RevitServices')
from RevitServices.Persistence import DocumentManager

clr.AddReference('RevitAPI')
from Autodesk.Revit.DB import Category, FilteredElementCollector, Document, RevitLinkInstance, ElementMulticategoryFilter,ElementMulticlassFilter, BuiltInCategory, ElementId, FamilySymbol, ParameterValueProvider, BuiltInParameter, FilterNumericEquals, ElementParameterFilter, FilterElementIdRule

import System
from System.Collections.Generic import List

def tolist(obj1):
	if hasattr(obj1,"__iter__"): return obj1
	else: return [obj1]

cats = tolist(UnwrapElement(IN[0]))
inputdocs = tolist(UnwrapElement(IN[1]))
elem, transforms = [], []

#Inspired by Clockwork
for inputdoc in inputdocs :
	if inputdoc == None:
		doc = DocumentManager.Instance.CurrentDBDocument
	elif isinstance (inputdoc, Document):
		doc = inputdoc
	elif isinstance (inputdoc, RevitLinkInstance):
		doc = inputdoc.GetLinkDocument()
		try:
			transforms.append(inputdoc.GetTotalTransform().ToCoordinateSystem(1))
		except: 
			transforms.append(None)
	else: doc = DocumentManager.Instance.CurrentDBDocument

#ueWrapper from Dimitar Venkov
ueWrapper = None
wrappers = clr.GetClrType(Revit.Elements.ElementWrapper).GetMethods()
for w in wrappers:
	if w.ToString().startswith("Revit.Elements.UnknownElement"):
		ueWrapper = w
		break

for cat in cats :
	if isinstance(cat, Category):
		catId = List[ElementId](x.Id for x in cats)
		filter = ElementMulticategoryFilter(catId)
		fec = FilteredElementCollector(doc).WhereElementIsNotElementType()
	elif isinstance(cat, BuiltInCategory):
		catBic = List[BuiltInCategory](x for x in cats)
		filter = ElementMulticategoryFilter(catBic)
		fec = FilteredElementCollector(doc).WhereElementIsNotElementType()
	elif isinstance(cat, System.Type):
		catId = List[System.Type](cats)
		filter = ElementMulticlassFilter(catId)	
		fec = FilteredElementCollector(doc)
	elif isinstance(cat, FamilySymbol):
		provider = ParameterValueProvider(ElementId(BuiltInParameter.ELEM_FAMILY_PARAM))
		evaluator = FilterNumericEquals()
		filter = ElementParameterFilter(FilterElementIdRule(provider, evaluator, cat.Id))	
		fec = FilteredElementCollector(doc).OfCategoryId(cat.Category.Id)
		
coll = fec.WherePasses(filter)
for c in coll :
	try:
		elem.append(c.ToDSType(True))
	except:
		if ueWrapper:
			elem.append(ueWrapper.Invoke(None,(c, True)))
	
OUT = elem,transforms
coll.Dispose()
filter.Dispose()
# ----------------------------------------
code_block = CodeBlock(x=selectByCategory) { x[0]; x[1]; }
Element = Output(code_block.out0)
Transform = Output(code_block.out1)
