# Dynamo custom node SelectByCateOrTypeAndView.dyf (Dynamo 2.12.1.8246)
# category: GeniusLoci.Select
# Collects elements by Category, Element Type or Family Type and View in the active or given document.

view = Input(view: var[]..[] = Revit.Application.Document.Current.ActiveView)  # View of current or given document
CategoryOrType = Input(CategoryOrType: var[]..[])
selectByCategoryAndView = Python(IN[0]=view, IN[1]=CategoryOrType)  # IronPython2
# ---------- selectByCategoryAndView.python (68 lines) ----------
#Alban de Chasteigner 2018
#twitter : @geniusloci_bim
#geniusloci.bim@gmail.com

import clr
clr.AddReference('RevitAPI')
import Autodesk
from Autodesk.Revit.DB import *

clr.AddReference('RevitServices')
import RevitServices
from RevitServices.Persistence import DocumentManager
import System

clr.AddReference('RevitNodes')
import Revit
clr.ImportExtensions(Revit.GeometryConversion)
clr.ImportExtensions(Revit.Elements)

def tolist(x):
    if hasattr(x,'__iter__'): return x
    else : return [x]

#ueWrapper from Dimitar Venkov
ueWrapper = None
wrappers = clr.GetClrType(Revit.Elements.ElementWrapper).GetMethods()
for w in wrappers:
	if w.ToString().startswith("Revit.Elements.UnknownElement"):
		ueWrapper = w
		break
		
views = tolist(UnwrapElement(IN[0]))
cats = tolist(UnwrapElement(IN[1]))

provider = ParameterValueProvider(ElementId(BuiltInParameter.ELEM_FAMILY_PARAM))
provider2 = ParameterValueProvider(ElementId(BuiltInParameter.ELEM_TYPE_PARAM))
evaluator = FilterNumericEquals()

elements = []
for view in views:
	elem = []
	doc=view.Document
	for cat in cats:
		if isinstance(cat, Category):
			collector = FilteredElementCollector(doc,view.Id).OfCategoryId(cat.Id)
		elif isinstance(cat, System.Type): 
			collector = FilteredElementCollector(doc,view.Id).OfClass(cat)
		elif isinstance(cat, FamilySymbol):
			filter = ElementParameterFilter(FilterElementIdRule(provider, evaluator, cat.Id))	
			collector = FilteredElementCollector(doc, view.Id).OfCategoryId(cat.Category.Id).WherePasses(filter)
		elif isinstance(cat, TextNoteType):
			collector = FilteredElementCollector(doc, view.Id).OfClass(TextNote).WhereElementIsNotElementType().ToElements().FindAll(lambda x : x.GetTypeId() == cat.Id)
		elif isinstance(cat, ModelTextType):
			collector = FilteredElementCollector(doc, view.Id).OfClass(ModelText).WhereElementIsNotElementType().ToElements().FindAll(lambda x : x.GetTypeId() == cat.Id)
		elif isinstance(cat, HostObjAttributes):
			filter = ElementParameterFilter(FilterElementIdRule(provider2, evaluator, cat.Id))	
			collector = FilteredElementCollector(doc, view.Id).OfCategoryId(cat.Category.Id).WherePasses(filter)
		for c in collector :
			try:
				elem.append(c.ToDSType(True))
			except:
				if ueWrapper:
					elem.append(ueWrapper.Invoke(None,(c, True)))
					
	elements.append(elem)
	
if isinstance(IN[0], list) : OUT = elements
else: OUT = elements[0]
# ----------------------------------------
Elements = Output(selectByCategoryAndView)
