# Dynamo custom node SelectByCategoryAndBoundingBox.dyf (Dynamo 2.6.1.8786)
# category: GeniusLoci.Select
# Collect elements by category from a BoundingBox.

category = Input(category: var[]..[])
boundingBox = Input(boundingBox: var[]..[])
docOrRevitLinkInstance = Input(docOrRevitLinkInstance: var = null)  # Use only if you want to query a linked model
python_script = Python(IN[0]=category, IN[1]=boundingBox, IN[2]=docOrRevitLinkInstance)
# ---------- python_script.python (62 lines) ----------
#By Einar_Raknes

import clr
clr.AddReference('RevitAPI')
clr.AddReference('System')
clr.AddReference('RevitNodes')
clr.AddReference('RevitServices')
import Revit
import RevitServices
from Autodesk.Revit.DB import *
from System.Collections.Generic import List
from RevitServices.Persistence import DocumentManager
clr.ImportExtensions(Revit.Elements)
clr.ImportExtensions(Revit.GeometryConversion)

#Functions for list handling
def ProcessList(_func, _list):
   return map( lambda x: ProcessList(_func, x) if type(x)==list else _func(x), _list )

#Preparing input from dynamo to revit
def ToRevit(item):
	return item.ToRevitType(True)

if isinstance(IN[0], list):
	cats = ProcessList(UnwrapElement, IN[0])
else:
	cats = [UnwrapElement(IN[0])]

if isinstance(IN[1], list):
	bblist = ProcessList(ToRevit, IN[1])
else:
	bblist = [ToRevit(IN[1])]

if isinstance(IN[0], list):
	inputdocs = ProcessList(UnwrapElement, IN[2])
else:
	inputdocs = [UnwrapElement(IN[2])]
	
#Part of script from Clockwork
for inputdoc in inputdocs :
	if inputdoc == None:
		doc = DocumentManager.Instance.CurrentDBDocument
	elif inputdoc.GetType().ToString() == "Autodesk.Revit.DB.Document":
		doc = inputdoc
	elif inputdoc.GetType().ToString() == "Autodesk.Revit.DB.RevitLinkInstance":
		doc = inputdoc.GetLinkDocument()
	else: doc = None

catlist = []
for cat in cats:
	catlist.append(cat.Id)
filtercats = List[ElementId](catlist)
catfilter = ElementMulticategoryFilter(filtercats)

def collectElementsInBB(bb):
	outline = Outline(bb.Min, bb.Max)
	bbfilter = BoundingBoxIntersectsFilter(outline)
	andfilter = LogicalAndFilter(catfilter,bbfilter)
	collector = FilteredElementCollector(doc).WherePasses(andfilter)
	return [e.ToDSType(True) for e in collector]

OUT = ProcessList(collectElementsInBB, bblist)[0]
# ----------------------------------------
Elements = Output(python_script)
