# Dynamo custom node SelectByCategoryAndDesignOption.dyf (Dynamo 2.6.1.8786)
# category: GeniusLoci.Select
# Select all elements by Design Option and category in the given document.
# Inspired by an archilab node.

designOption = Input(designOption: var[]..[])  # Collected DesignOption in active or linked document
category = Input(category: var[]..[])
selectByCategoryAndDesign = Python(IN[0]=designOption, IN[1]=category)
# ---------- selectByCategoryAndDesign.python (29 lines) ----------
#Inspired by Konrad K Sobon
# Archi-lab, http://wwww.archi-lab.net

# Default imports
import clr
clr.AddReference('RevitAPI')
import Autodesk
from Autodesk.Revit.DB import *
#Import Collections
from System.Collections.Generic import *
import System

def tolist(x):
    if hasattr(x,'__iter__'): return x
    else : return [x]

designOptions = tolist(UnwrapElement(IN[0]))
cats = tolist(IN[1])
catlist = []

for cat in cats:
	bic = System.Enum.ToObject(BuiltInCategory, cat.Id)
	for designOption in designOptions:
		doc = designOption.Document
		filterdesign = ElementDesignOptionFilter(designOption.Id)
		catlist.append(FilteredElementCollector(doc).WherePasses(filterdesign).OfCategory(bic).ToElements())		

if not isinstance(IN[0], list) and not isinstance(IN[1], list): OUT = catlist[0]
else: OUT = catlist
# ----------------------------------------
Element = Output(selectByCategoryAndDesign)
