# Dynamo custom node SelectByCategoryAndLevel.dyf (Dynamo 2.6.1.8786)
# category: GeniusLoci.Select
# Select Elements by Category and Level.
# With a document input, use the Collector of Levels node to get the level input.
# This API filter doesn't work with MEP and Structural Framing elements.

level = Input(level: var[]..[])  # Collected level in active or linked document
category = Input(category: var[]..[])
selectByCategoryAndLevel = Python(IN[0]=level, IN[1]=category)
# ---------- selectByCategoryAndLevel.python (34 lines) ----------
#Copyright(c) 2014, Konrad K Sobon
# Grimshaw Architects, http://grimshaw-architects.com/
# Archi-lab, http://wwww.archi-lab.net

import clr
clr.AddReference('RevitAPI')
import Autodesk
from Autodesk.Revit.DB import *
clr.AddReference('RevitServices')
import RevitServices
from RevitServices.Persistence import DocumentManager
clr.AddReference('RevitNodes')
import Revit
import System

def tolist(x):
    if hasattr(x,'__iter__'): return x
    else : return [x]

levelInput = tolist(UnwrapElement(IN[0]))
cats = tolist(IN[1])
catlist = []

for cat in cats:
	if isinstance(cat, Revit.Elements.Category): id=cat.Id
	else: id=cat.Id.IntegerValue
	bic = System.Enum.ToObject(BuiltInCategory, id)
	for levelIn in levelInput :
		doc=levelIn.Document
		levelFilter = ElementLevelFilter(levelIn.Id)
		catlist.append(FilteredElementCollector(doc).WherePasses(levelFilter).OfCategory(bic).ToElements())		

if not isinstance(IN[0], list) and not isinstance(IN[1], list): OUT = catlist[0]
else: OUT = catlist
# ----------------------------------------
Element = Output(selectByCategoryAndLevel)
