# Dynamo custom node SelectByCategoryInHostView.dyf (Dynamo 2.12.0.5650)
# category: GeniusLoci.Select
# Collects the elements of the given document by category and host view (3D view, Plan View or Section View).
# The transform CS is returned only with a LinkInstance input.

view = Input(view: var[]..[] = Revit.Application.Document.Current.ActiveView)  # View Plan, ThreeDView or Section View of the active document
category = Input(category: var[]..[])
docOrRevitLinkInstance = Input(docOrRevitLinkInstance: var[] = null)  # Use only if you want to query a linked model
byCategoryInHostView = Python(IN[0]=view, IN[1]=category, IN[2]=docOrRevitLinkInstance)  # IronPython2
# ---------- byCategoryInHostView.python (115 lines) ----------
#Alban de Chasteigner 2018
#twitter : @geniusloci_bim
#geniusloci.bim@gmail.com
#Plan view code snippet by Cyril Poupin on Dynamo Forum

import clr
clr.AddReference('RevitAPI')
import Autodesk
from Autodesk.Revit.DB import *

clr.AddReference('RevitServices')
import RevitServices
from RevitServices.Persistence import DocumentManager
from RevitServices.Transactions import TransactionManager
doc = DocumentManager.Instance.CurrentDBDocument

clr.AddReference('RevitNodes')
import Revit
clr.ImportExtensions(Revit.GeometryConversion)

clr.AddReference('System')
from System.Collections.Generic import List

def tolist(x):
    if hasattr(x,'__iter__'): return x
    else : return [x]

views = tolist(UnwrapElement(IN[0]))
cats = tolist(UnwrapElement(IN[1]))
inputdocs = tolist(UnwrapElement(IN[2]))
transforms,transf = [], []

for inputdoc in inputdocs :
	if inputdoc == None:
		doclnk = DocumentManager.Instance.CurrentDBDocument
	elif isinstance(inputdoc,Document):
		doclnk = inputdoc
	elif isinstance(inputdoc,RevitLinkInstance):
		doclnk = inputdoc.GetLinkDocument()
		try:
			transf = inputdoc.GetTotalTransform()
			transforms.append(transf.ToCoordinateSystem(1))
		except: 
			transforms.append(None)
	else: doclnk = DocumentManager.Instance.CurrentDBDocument

for view in views:
	if view.ViewType == ViewType.ThreeD:
		sectionbox = view.GetSectionBox()
		transform = sectionbox.Transform
		sboxoriginx = transform.Origin.X
		sboxoriginy = transform.Origin.Y
		sboxoriginz = transform.Origin.Z
		minx = sectionbox.Min.X + sboxoriginx
		maxx = sectionbox.Max.X + sboxoriginx
		miny = sectionbox.Min.Y + sboxoriginy
		maxy = sectionbox.Max.Y + sboxoriginy
		minz = sectionbox.Min.Z + sboxoriginz
		maxz = sectionbox.Max.Z + sboxoriginz
		outLine = Outline(XYZ(minx, miny, minz), XYZ(maxx, maxy, maxz))
		
	elif view.ViewType == ViewType.CeilingPlan or view.ViewType == ViewType.EngineeringPlan or view.ViewType == ViewType.FloorPlan :
		bbxView = view.CropBox
		if transf :
			bbxView.Transform = transf
		viewRange = view.GetViewRange() 
		topLevel = doc.GetElement(viewRange.GetLevelId(PlanViewPlane.TopClipPlane))
		topOffset = viewRange.GetOffset(PlanViewPlane.TopClipPlane)
	
		bttmLevel = doc.GetElement(viewRange.GetLevelId(PlanViewPlane.BottomClipPlane))
		bttmOffset = viewRange.GetOffset(PlanViewPlane.BottomClipPlane)

		cutLevel = doc.GetElement(viewRange.GetLevelId(PlanViewPlane.CutPlane))
		cutOffset = viewRange.GetOffset(PlanViewPlane.CutPlane)
		
		if bttmLevel : bbxView.Min = XYZ(bbxView.Min.X, bbxView.Min.Y, bttmLevel.ProjectElevation + bttmOffset)
		else:  bbxView.Min = XYZ(bbxView.Min.X, bbxView.Min.Y, cutLevel.ProjectElevation + bttmOffset)
		if topLevel :  bbxView.Max = XYZ(bbxView.Max.X, bbxView.Max.Y, topLevel.ProjectElevation + topOffset)
		else: bbxView.Max = XYZ(bbxView.Max.X, bbxView.Max.Y, cutLevel.ProjectElevation + cutOffset)
		
		outLine = Outline(bbxView.Min, bbxView.Max) 		
		
	elif view.ViewType == ViewType.Section :
		rightDir = view.RightDirection;
		angleSec = XYZ.BasisX.AngleOnPlaneTo(rightDir, XYZ.BasisZ);
		secOrigin = view.Origin;
		secMarkId = ElementId(view.Id.IntegerValue - 1);
		lineSec = Line.CreateBound(secOrigin, XYZ(secOrigin.X, secOrigin.Y, secOrigin.Z + 1));
		TransactionManager.Instance.EnsureInTransaction(doc)
		subTransaction = SubTransaction(doc);
		subTransaction.Start();
		ElementTransformUtils.RotateElement(doc, secMarkId, lineSec, -angleSec);
		rotatedView = doc.GetElement(ElementId(secMarkId.IntegerValue + 1))
		BBox = rotatedView.CropBox;
		if transf :
			secTransform = transf.Inverse.Multiply(BBox.Transform)
		else: secTransform = BBox.Transform
		secMin = secTransform.OfPoint(BBox.Min);
		secMax = secTransform.OfPoint(BBox.Max);
		outLine = Outline(XYZ(secMin.X, secMax.Y,secMin.Z),XYZ(secMax.X, secMin.Y,secMax.Z))
		subTransaction.RollBack();
		TransactionManager.Instance.TransactionTaskDone()		
			
catlist = [cat.Id for cat in cats]
filtercats = List[ElementId](catlist)
catfilter = ElementMulticategoryFilter(filtercats)
	
filterBbxInside = BoundingBoxIsInsideFilter(outLine)
filterBbxInters = BoundingBoxIntersectsFilter(outLine)
filterBbx = LogicalOrFilter(filterBbxInside, filterBbxInters)
andfilter = LogicalAndFilter(catfilter,filterBbx)

collector = FilteredElementCollector(doclnk).WherePasses(andfilter).ToElements()

OUT = collector, transforms
# ----------------------------------------
code_block = CodeBlock(x=byCategoryInHostView) { x[0]; x[1]; }
Elements = Output(code_block.out0)
Transform = Output(code_block.out1)
