# Dynamo custom node SelectByView.dyf (Dynamo 2.6.1.8786)
# category: GeniusLoci.Select
# Collects elements visible in the View of the active or given document.

view = Input(view: var[]..[] = Revit.Application.Document.Current.ActiveView)  # View of current or given document
python_script = Python(IN[0]=view)
# ---------- python_script.python (25 lines) ----------
#Alban de Chasteigner 2021
#twitter : @geniusloci_bim
#geniusloci.bim@gmail.com
#https://github.com/albandechasteigner/GeniusLociForDynamo

import clr
clr.AddReference('RevitAPI')
import Autodesk
from Autodesk.Revit.DB import FilteredElementCollector, Document, Category

def tolist(x):
    if hasattr(x,'__iter__'): return x
    else : return [x]

views = tolist(UnwrapElement(IN[0]))
elements = []

for view in views:
	doc=view.Document
	#Filter ExtentElem
	collector = FilteredElementCollector(doc, view.Id).ToElements().FindAll(lambda x :  x.Category != None)
	elements.append(collector)

if len(elements)>1 : OUT = elements
else: OUT = elements[0]
# ----------------------------------------
Elements = Output(python_script)
