# Dynamo custom node Set ColorFill Scheme Properties.dyf (Dynamo 2.12.1.8246)
# category: GeniusLoci.ColorScheme
# Works only in Revit 2022 and later.
# Sets the name, values, colors and fill patterns of the given Color Scheme.
# (All inputs are optional)

colorFillScheme = Input(colorFillScheme: var[]..[])  # ColorFillScheme element or ColorFillScheme Name
Name = Input(Name: string[]..[] = null)  # Color Scheme Name
ParameterName = Input(ParameterName: string[]..[] = null)
Title = Input(Title: string[]..[] = null)
ElementsFromLinks = Input(ElementsFromLinks: bool = null)
value = Input(value: var[]..[] = null)  # Only unused values ​​can be updated. A value can not be duplicated
color = Input(color: var[]..[] = null)
fillPatternElement = Input(fillPatternElement: var[]..[] = null)
IsVisible = Input(IsVisible: bool[]..[] = null)
python_script = Python(IN[0]=colorFillScheme, IN[1]=Name, IN[2]=ParameterName, IN[3]=Title, IN[4]=ElementsFromLinks, IN[5]=value, IN[6]=color, IN[7]=fillPatternElement, IN[8]=IsVisible)  # IronPython2
# ---------- python_script.python (108 lines) ----------
#Alban de Chasteigner 2021
#twitter : @geniusloci_bim
#geniusloci.bim@gmail.com
#https://github.com/albandechasteigner/GeniusLociForDynamo
 
import clr
clr.AddReference('RevitAPI')
import Autodesk
from Autodesk.Revit.DB import *
clr.AddReference('RevitNodes')
import Revit
clr.AddReference('RevitServices')
import RevitServices
from RevitServices.Persistence import DocumentManager
from RevitServices.Transactions import TransactionManager
doc = DocumentManager.Instance.CurrentDBDocument

def tolist(obj1):
    if hasattr(obj1,"__iter__"): return obj1
    else: return [obj1]

def ToRevitColor(dynamoColor):
	return Color(dynamoColor.Red, dynamoColor.Green, dynamoColor.Blue)

def getParam(scheme):
	catId = scheme.CategoryId
	category = Revit.Elements.Category.ById(catId.IntegerValue)
	fec = FilteredElementCollector(doc).OfCategoryId(catId).ToElements()
	try:
		#BuiltinParameter by Id
		BIP = (BuiltInParameter)(scheme.ParameterDefinition.IntegerValue)	
	except:
		#Parameter by Guid
		paramElem = doc.GetElement(scheme.ParameterDefinition)
		BIP = paramElem.GuidValue
	return fec[0].get_Parameter(BIP)

element = tolist(UnwrapElement(IN[0]))[0]
name = IN[1]
paramName = IN[2]
title=IN[3]
linked=IN[4]
values = tolist(UnwrapElement(IN[5]))
colors = tolist(IN[6])
fillPatt = tolist(UnwrapElement(IN[7]))
visibles = tolist(IN[8])
color_len = len(colors) == 1
fillPatt_len = len(fillPatt) == 1
visibles_len = len(visibles) == 1

unused=[]
if isinstance(element, Autodesk.Revit.DB.ColorFillScheme):
	scheme = element
elif isinstance(element, basestring):
	scheme = FilteredElementCollector(doc).OfCategory(BuiltInCategory.OST_ColorFillSchema).ToElements().Find(lambda x : x.Name == element)
entries = scheme.GetEntries()
	
TransactionManager.Instance.EnsureInTransaction(doc)
if name != None:
	scheme.Name = name
else: pass
if paramName != None:
	catId = scheme.CategoryId
	category = Revit.Elements.Category.ById(catId.IntegerValue)
	fec = FilteredElementCollector(doc).OfCategoryId(catId).ToElements()
	params=fec[0].Parameters
	scheme.ParameterDefinition = [param.Id for param in sorted(params, key = lambda x : x.Id) if param.Definition.Name == paramName][0]
else: pass
if title != None:
	scheme.Title = title
else: pass
if linked != None:
	scheme.IsLinkedFilesIncluded = linked
else: pass

for number in xrange(len(entries)):
	if IN[5] != None:
		#Only unused values ​​can be updated
		if entries[number].IsInUse == False:
			unused.append(entries[number])
			try:	
				for unus,value in zip(unused, values):
					if unus.StorageType == StorageType.ElementId:
						unus.SetElementIdValue(value)
					elif unus.StorageType == StorageType.Double:
						unus.SetDoubleValue(UnitUtils.ConvertToInternalUnits(value,getParam(scheme).GetUnitTypeId()))
					elif unus.StorageType == StorageType.Integer:
						unus.SetIntegerValue(UnitUtils.ConvertToInternalUnits(value,getParam(scheme).GetUnitTypeId()))
					elif unus.StorageType == StorageType.String:
						unus.SetStringValue(value)
			except:pass
	else: pass
	if IN[6] != None:	
		c = 0 if color_len else number
		entries[number].Color = ToRevitColor(colors[c])
	else: pass
	if IN[7] != None:
		f = 0 if fillPatt_len else number
		entries[number].FillPatternId = fillPatt[f].Id
	else: pass
	if IN[8] != None:
		v = 0 if visibles_len else number
		entries[number].IsVisible = visibles[v]
	else: pass
scheme.SetEntries(entries)
TransactionManager.Instance.TransactionTaskDone()

OUT = scheme
# ----------------------------------------
ColorFillScheme = Output(python_script)
