# Dynamo custom node Set Connector Properties.dyf (Dynamo 2.12.0.5650)
# category: GeniusLoci.ConnectorElement
# In a familyDocument, sets the properties of a given ConnectorElement.

connectorElement = Input(connectorElement: var[]..[])
MEPSystemClassification = Input(MEPSystemClassification: var[]..[] = null)  # Autodesk.Revit.DB.MEPSystemClassification or string
connectorProfileType = Input(connectorProfileType: var[]..[] = null)  # Autodesk.Revit.DB.ConnectorProfileType or string
width = Input(width: double[]..[] = null)
height = Input(height: double[]..[] = null)
radius = Input(radius: double[]..[] = null)
voltage = Input(voltage: double[]..[] = null)
set_connector_properties = Python(IN[0]=connectorElement, IN[1]=MEPSystemClassification, IN[2]=connectorProfileType, IN[3]=width, IN[4]=height, IN[5]=radius, IN[6]=voltage)  # IronPython2
# ---------- set_connector_properties.python (81 lines) ----------
#Alban de Chasteigner 2022
#twitter : @geniusloci_bim
#geniusloci.bim@gmail.com
#https://github.com/albandechasteigner/GeniusLociForDynamo

import clr
clr.AddReference('RevitAPI')
import Autodesk
from Autodesk.Revit.DB import *

import System

clr.AddReference("RevitServices")
import RevitServices
from RevitServices.Persistence import DocumentManager
from RevitServices.Transactions import TransactionManager
uiapp = DocumentManager.Instance.CurrentUIApplication
app = uiapp.Application
version=int(app.VersionNumber)

def tolist(obj1):
    if hasattr(obj1,"__iter__"): return obj1
    else: return [obj1]

connectors = tolist(UnwrapElement(IN[0]))
systemClassifications = tolist(IN[1])
shapes=tolist(IN[2])
widths=tolist(IN[3])
heights = tolist(IN[4])
radius = tolist(IN[5])
voltages = tolist(IN[6])

TransactionManager.Instance.ForceCloseTransaction()
for connector, systemClassification, shape, width, height, rad, voltage in zip(connectors, systemClassifications, shapes, widths, heights, radius, voltages):
	doc = connector.Document
	TransactionManager.Instance.EnsureInTransaction(doc)
	if version < 2021:
		UIunit = doc.GetUnits().GetFormatOptions(UnitType.UT_Length).DisplayUnits
		ElectricalUnit = doc.GetUnits().GetFormatOptions(UT_Electrical_Potential).DisplayUnits
	else:
		UIunit = doc.GetUnits().GetFormatOptions(SpecTypeId.Length).GetUnitTypeId()
		ElectricalUnit = doc.GetUnits().GetFormatOptions(SpecTypeId.ElectricalPotential).GetUnitTypeId()
	if systemClassification == None:
		pass
	else:
		if isinstance(systemClassification, Autodesk.Revit.DB.MEPSystemClassification):
			mepSys = systemClassification
		else:
			mepSys = System.Enum.Parse(Autodesk.Revit.DB.MEPSystemClassification, systemClassification)	
		connector.SystemClassification = mepSys
	if shape == None:
		pass
	else:
		if shape == ConnectorProfileType.Round :
			profile = 0
		elif shape == ConnectorProfileType.Rectangular :
			profile = 1
		elif shape == ConnectorProfileType.Oval :
			profile = 2
		elif shape == ConnectorProfileType.Invalid :
			profile = 3
		connector.get_Parameter(BuiltInParameter.CONNECTOR_PROFILE_TYPE).Set(profile)
	if width == None:
		pass
	else:
		connector.get_Parameter(BuiltInParameter.CONNECTOR_WIDTH).Set(UnitUtils.ConvertToInternalUnits(width,UIunit))
	if height == None:
		pass
	else:
		connector.get_Parameter(BuiltInParameter.CONNECTOR_HEIGHT).Set(UnitUtils.ConvertToInternalUnits(height,UIunit))
	if rad == None:
		pass
	else:
		connector.get_Parameter(BuiltInParameter.CONNECTOR_RADIUS).Set(UnitUtils.ConvertToInternalUnits(rad,UIunit))
	if voltage == None:
		pass
	else:
		connector.get_Parameter(BuiltInParameter.RBS_ELEC_VOLTAGE).Set(UnitUtils.ConvertToInternalUnits(voltage,ElectricalUnit))
	TransactionManager.Instance.TransactionTaskDone()

OUT = IN[0]
# ----------------------------------------
ConnectorElement = Output(set_connector_properties)
