# Dynamo custom node Set FamilyElementVisibility.dyf (Dynamo 2.12.1.8246)
# category: GeniusLoci.Family
# In familyDocument, sets the visibility parameters of family elements (coarse, medium and fine detail levels).

element = Input(element: var[]..[])
coarse = Input(coarse: var[]..[] = null)  # boolean
medium = Input(medium: var[]..[] = null)  # boolean
fine = Input(fine: var[]..[] = null)  # boolean
set_familyelementvisibility = Python(IN[0]=element, IN[1]=coarse, IN[2]=medium, IN[3]=fine)  # IronPython2
# ---------- set_familyelementvisibility.python (44 lines) ----------
#Alban de Chasteigner 2022
#twitter : @geniusloci_bim
#geniusloci.bim@gmail.com
#https://github.com/albandechasteigner/GeniusLociForDynamo
import clr
clr.AddReference('RevitServices')
from RevitServices.Persistence import DocumentManager
from RevitServices.Transactions import TransactionManager
clr.AddReference('RevitAPI')
from Autodesk.Revit.DB import * 

def tolist(obj1):
    if hasattr(obj1,"__iter__"): return obj1
    else: return [obj1]

elems = tolist(UnwrapElement(IN[0]))
coarses = tolist(IN[1])
mediums = tolist(IN[2])
fines = tolist(IN[3])

for elem, coarse, medium, fine in zip(elems, coarses, mediums, fines):
	TransactionManager.Instance.ForceCloseTransaction()
	TransactionManager.Instance.EnsureInTransaction(elem.Document)
	try:
		fev = FamilyElementVisibility(FamilyElementVisibilityType.Model)
		if isinstance(coarse, int) :
			fev.IsShownInCoarse = coarse
		if isinstance(medium, int) :
			fev.IsShownInMedium = medium
		if isinstance(fine, int) :
			fev.IsShownInFine = fine
		elem.SetVisibility(fev)
	except:
		fev = FamilyElementVisibility(FamilyElementVisibilityType.ViewSpecific)
		if isinstance(coarse, int) :
			fev.IsShownInCoarse = coarse
		if isinstance(coarse, int) :
			fev.IsShownInMedium = medium
		if isinstance(fine, int) :
			fev.IsShownInFine = fine
		elem.SetVisibility(fev)
	TransactionManager.Instance.TransactionTaskDone()
	
OUT = IN[0]
# ----------------------------------------
element_2 = Output(set_familyelementvisibility)  # "element"
