# Dynamo custom node Set Phase Status Presentation.dyf (Dynamo 2.6.1.8786)
# category: GeniusLoci.Phase
# Sets the phase status presentation.

PhaseFilter = Input(PhaseFilter: var[]..[])
elementOnPhaseStatus = Input(elementOnPhaseStatus: var[]..[])  # String or DB.ElementOnPhaseStatus
phaseStatusPresentation = Input(phaseStatusPresentation: var[]..[])  # String or DB.PhaseStatusPresentation
python_script = Python(IN[0]=PhaseFilter, IN[1]=elementOnPhaseStatus, IN[2]=phaseStatusPresentation)
# ---------- python_script.python (44 lines) ----------
#Alban de Chasteigner 2019
#twitter : @geniusloci_bim
#geniusloci.bim@gmail.com

import clr
clr.AddReference('RevitAPI')
import Autodesk
from Autodesk.Revit.DB import *
import System

# Import DocumentManager and TransactionManager
clr.AddReference("RevitServices")
import RevitServices
from RevitServices.Persistence import DocumentManager
from RevitServices.Transactions import TransactionManager
doc = DocumentManager.Instance.CurrentDBDocument

phasefilters = UnwrapElement(IN[0]) if isinstance(IN[0],list) else [UnwrapElement(IN[0])]
elementOnPhaseStatus = IN[1] if isinstance(IN[1],list) else [IN[1]]
phaseStatusPresentations = IN[2] if isinstance(IN[2],list) else [IN[2]]

OnPhaseStatus,StatusPresentations=[],[]
for x in elementOnPhaseStatus :
	if isinstance(x, basestring):
		OnPhaseStatus.append(System.Enum.Parse(Autodesk.Revit.DB.ElementOnPhaseStatus, x))
	else:
		OnPhaseStatus=elementOnPhaseStatus

for y in phaseStatusPresentations :
	if isinstance(y, basestring):
		StatusPresentations.append(System.Enum.Parse(Autodesk.Revit.DB.PhaseStatusPresentation, y))
	else:
		StatusPresentations=phaseStatusPresentations

phasefil = []
TransactionManager.Instance.EnsureInTransaction(doc)
for phasefilter in phasefilters:
	for elementOnPhase, phaseStatusPresentation in zip (OnPhaseStatus, StatusPresentations):
		phasefilter.SetPhaseStatusPresentation(elementOnPhase, phaseStatusPresentation)
	phasefil.append(phasefilter)
TransactionManager.Instance.TransactionTaskDone()

if isinstance(IN[0], list): OUT = phasefil
else: OUT = phasefil[0]
# ----------------------------------------
PhaseFilter_2 = Output(python_script)  # "PhaseFilter"
