# Dynamo custom node Set SketchPlane ByLine.dyf (Dynamo 2.6.1.8786)
# category: GeniusLoci.Geometry
# Works only in Revit 2016 and later.
# Selects a line, constructs a plane and assigns the sketch plane to the active view.
# An active sketch plane is required for model curve creation.

line = Input(line: var[]..[])  # Dynamo Curve
set_sketchplane_byline = Python(IN[0]=line)
# ---------- set_sketchplane_byline.python (44 lines) ----------
#Inspired by Konrad Sobon, archilab
import clr
clr.AddReference('RevitServices')
import RevitServices
from RevitServices.Persistence import DocumentManager
from RevitServices.Transactions import TransactionManager
doc = DocumentManager.Instance.CurrentDBDocument

clr.AddReference('RevitAPI')
import Autodesk
from Autodesk.Revit.DB import *

# Import ToDSType  (bool) extension method
clr.AddReference("RevitNodes")
import Revit
# Adds ToProtoType, ToRevitType geometry conversion extension methods to objects
clr.ImportExtensions(Revit.GeometryConversion)
# Import Element wrapper extension methods
clr.ImportExtensions(Revit.Elements)

curves = UnwrapElement(IN[0]).ToRevitType()

if not hasattr(curves, '__iter__'):
	curves = [curves]

for curve in curves:
	coord1 = curve.GetEndPoint(0)
	coord2 = curve.GetEndPoint(1)

	#process as vertical
	if (round(coord1.X, 4),round(coord1.Y, 4))== (round(coord2.X, 4),round(coord2.Y, 4)):
		line = Line.CreateBound(XYZ(coord1.X + 1, coord1.Y, coord1.Z), XYZ(coord1.X + 1, coord1.Y, coord2.Z))
		geomPlane = Plane.CreateByNormalAndOrigin(XYZ.BasisX, line.Evaluate(0.5, True))

	else:
	#process as horizontal
		line = Line.CreateBound(XYZ(coord1.X, coord1.Y + 1, coord1.Z), XYZ(coord2.X, coord2.Y + 1, coord1.Z));
		geomPlane = Plane.CreateByNormalAndOrigin(XYZ.BasisZ, line.Evaluate(0.5, True))

	TransactionManager.Instance.EnsureInTransaction(doc)
	plane = SketchPlane.Create(doc, geomPlane)
	doc.ActiveView.SketchPlane = plane
	TransactionManager.Instance.TransactionTaskDone()
OUT = plane
# ----------------------------------------
Active_SketchPlane = Output(set_sketchplane_byline)
