# Dynamo custom node Set SubCategory Properties.dyf (Dynamo 2.6.2.15705)
# category: GeniusLoci.Graphics
# Assigns Line Weight, Line Pattern and Line Color to the given subcategory.

document = Input(document: var[]..[] = null)  # Autodesk.Revit.DB.Document Optional input
subCategory = Input(subCategory: var[]..[])
linePatternElement = Input(linePatternElement: var[]..[] = null)  # LinePattern element
ProjectionLineWeight = Input(ProjectionLineWeight: int[]..[] = null)  # Integer
CutLineWeight = Input(CutLineWeight: int[]..[] = null)  # Integer
color = Input(color: DSCore.Color[]..[] = null)  # Dynamo Color
material = Input(material: var[]..[] = null)  # Autodesk.Revit.DB.Material or material name
python_script = Python(IN[0]=document, IN[1]=subCategory, IN[2]=linePatternElement, IN[3]=ProjectionLineWeight, IN[4]=CutLineWeight, IN[5]=color, IN[6]=material)
# ---------- python_script.python (69 lines) ----------
#Alban de Chasteigner 2018
#twitter : @geniusloci_bim
#geniusloci.bim@gmail.com

import clr
clr.AddReference('RevitAPI')
import Autodesk
from Autodesk.Revit.DB import *

clr.AddReference("RevitServices")
import RevitServices
from RevitServices.Persistence import DocumentManager
from RevitServices.Transactions import TransactionManager

def tolist(obj1):
    if hasattr(obj1,"__iter__"): return obj1
    else: return [obj1]

def ConvertColor(e):
	return Autodesk.Revit.DB.Color(e.Red, e.Green, e.Blue)

inputdoc = tolist(UnwrapElement(IN[0]))[0]
subcategory = tolist(UnwrapElement(IN[1]))
linePatterns=tolist(UnwrapElement(IN[2]))
projWeights=tolist(IN[3])
cutWeights=tolist(IN[4])
colors=tolist(IN[5])
materials = tolist(UnwrapElement(IN[6]))
listGraph = []
if inputdoc == None :
	doc = DocumentManager.Instance.CurrentDBDocument
else : doc = inputdoc

TransactionManager.Instance.ForceCloseTransaction()
TransactionManager.Instance.EnsureInTransaction(doc)
for subcat, projWeight, cutWeight,linePattern,color,material in zip(subcategory,projWeights,cutWeights,linePatterns,colors,materials):
	if linePattern :
		patternId = linePattern.Id
		subLinePattern = subcat.SetLinePatternId(patternId,GraphicsStyleType.Projection)
	else :
		#patternId=LinePatternElement.GetSolidPatternId()
		pass
	if projWeight :
		lineProjWeight = subcat.SetLineWeight(projWeight,GraphicsStyleType.Projection)
	else:
		pass
	if cutWeight:
		lineCutweight= subcat.SetLineWeight(cutWeight,GraphicsStyleType.Cut)
	else:
		pass
	if color:
		subcat.LineColor = Color(color.Red, color.Green, color.Blue)
	else:
		pass
	if material:
		if isinstance(material, Autodesk.Revit.DB.Material):
			subcat.Material = material
		else:
			namePar = ParameterValueProvider(ElementId(BuiltInParameter.MATERIAL_NAME))
			filter = ElementParameterFilter(FilterStringRule(namePar,FilterStringEquals(),material, True))
			stringMat = FilteredElementCollector(doc).OfClass(Material).WherePasses(filter).ToElements()[0]
			subcat.Material = stringMat
	else:
		pass
	style = subcat.GetGraphicsStyle(GraphicsStyleType.Projection)
	listGraph.append(style)
TransactionManager.Instance.TransactionTaskDone()

OUT = listGraph
# ----------------------------------------
GraphicStyle = Output(python_script)
