# Dynamo custom node Set SystemType Properties.dyf (Dynamo 2.6.1.8786)
# category: GeniusLoci.MEP
# Assigns Calculations, Fluid Type, Fluid Temperature and Flow Conversion Method to the given System Type.
# (All inputs are optional)

SystemType = Input(SystemType: var[]..[])
Calculations = Input(Calculations: var[]..[] = null)  # String or Revit.DB.Mechanical.SystemCalculationLevel
FluidType = Input(FluidType: var[]..[] = null)  # Element Type
FluidTemperature = Input(FluidTemperature: var[]..[] = null)  # Integer
FlowConversionMethod = Input(FlowConversionMethod: var[]..[] = null)  # String or Revit.DB.Plumbing.FlowConversionMode
set_systemtype_properties = Python(IN[0]=SystemType, IN[1]=Calculations, IN[2]=FluidType, IN[3]=FluidTemperature, IN[4]=FlowConversionMethod)
# ---------- set_systemtype_properties.python (54 lines) ----------
#Alban de Chasteigner 2020
#twitter : @geniusloci_bim
#geniusloci.bim@gmail.com
#https://github.com/albandechasteigner/GeniusLociForDynamo

import clr
clr.AddReference("RevitServices")
import RevitServices
from RevitServices.Persistence import DocumentManager
from RevitServices.Transactions import TransactionManager
doc = DocumentManager.Instance.CurrentDBDocument
uiapp = DocumentManager.Instance.CurrentUIApplication
app = uiapp.Application
version=int(app.VersionNumber)

clr.AddReference("RevitAPI")
import Autodesk
from Autodesk.Revit.DB import *
#import System

if version < 2021:
	UIunit = doc.GetUnits().GetFormatOptions(UnitType.UT_Piping_Temperature).DisplayUnits
else:
	UIunit = doc.GetUnits().GetFormatOptions(SpecTypeId.PipingTemperature).GetUnitTypeId()
	
elements = UnwrapElement(IN[0]) if isinstance(IN[0],list) else [UnwrapElement(IN[0])]
calculations = IN[1]
if isinstance(calculations, basestring):
	#_calculs = System.Enum.Parse(Autodesk.Revit.DB.Mechanical.SystemCalculationLevel, IN[1])
	exec("_calculs = Mechanical.SystemCalculationLevel.%s" % calculations)
else:
	_calculs = calculations
fluid = UnwrapElement(IN[2])
temperature = IN[3]
flowConversion = IN[4]
if isinstance(flowConversion, basestring):
	exec("method = Plumbing.FlowConversionMode.%s" % flowConversion)
else:
	method = flowConversion

TransactionManager.Instance.EnsureInTransaction(doc)
for elem in elements:
	if calculations == None: pass
	else: elem.CalculationLevel = _calculs
	if fluid == None: pass
	else: elem.FluidType = fluid.Id
	if temperature == None: pass
	else: elem.FluidTemperature = UnitUtils.ConvertToInternalUnits(temperature,UIunit)
	if method == None: pass
	else: elem.FlowConversionMethod = method
TransactionManager.Instance.TransactionTaskDone()

if isinstance(IN[0], list): OUT = elements
else: OUT = elements[0]
# ----------------------------------------
SystemType_2 = Output(set_systemtype_properties)  # "SystemType"
