# Dynamo custom node Set Wall JoinType.dyf (Dynamo 2.6.1.8786)
# category: GeniusLoci.CompoundStructure
# Change the type of the join at the ends.  (Wall Joins tool)
# If the type of join is set to None, the walls will be unjoined.
# Use with Enum JoinType node

wall = Input(wall: var[]..[])
JoinType = Input(JoinType: var[]..[])
python_script = Python(IN[0]=wall, IN[1]=JoinType)
# ---------- python_script.python (30 lines) ----------
#Alban de Chasteigner 2019
#twitter : @geniusloci_bim
#geniusloci.bim@gmail.com

import clr
clr.AddReference('RevitAPI')
import Autodesk
from Autodesk.Revit.DB import *
from Autodesk.Revit.DB import Structure

# Import DocumentManager and TransactionManager
clr.AddReference('RevitServices')
import RevitServices
from RevitServices.Persistence import DocumentManager
from RevitServices.Transactions import TransactionManager
doc = DocumentManager.Instance.CurrentDBDocument

items = UnwrapElement(IN[0])
if not hasattr(items, '__iter__'):
	items = [items]
joinType=IN[1]	
join = []
TransactionManager.Instance.EnsureInTransaction(doc)
for item in items:
	loc = item.Location
	for ip in range(0, 2):
		loc.JoinType[ip]=joinType
		join.append(loc.JoinType[ip])
TransactionManager.Instance.TransactionTaskDone()
OUT = items,join
# ----------------------------------------
code_block = CodeBlock(x=python_script) { x[0]; x[1]; }
Wall = Output(code_block.out0)
JoinType_2 = Output(code_block.out1)  # "JoinType"
