# Dynamo custom node Sheet HasView.dyf (Dynamo 2.6.1.8786)
# category: GeniusLoci.Sheet
# Checks if the sheet has a placed view.

sheet = Input(sheet: var[]..[])
python_script = Python(IN[0]=sheet)
# ---------- python_script.python (30 lines) ----------
#Alban de Chasteigner 2020
#twitter : @geniusloci_bim
#geniusloci.bim@gmail.com
#https://github.com/albandechasteigner/GeniusLociForDynamo

import clr
clr.AddReference('RevitAPI')
from Autodesk.Revit.DB import ViewSheet, FilteredElementCollector,ScheduleSheetInstance
clr.AddReference('RevitServices')
from RevitServices.Persistence import DocumentManager
doc = DocumentManager.Instance.CurrentDBDocument

sheets = UnwrapElement(IN[0]) if isinstance(IN[0],list) else [UnwrapElement(IN[0])]

withV, temp, without = [],[],[]

for s in sheets :
	viewsId = s.GetAllPlacedViews()
	if viewsId :
		withV.append(s)
	else:
		temp.append(s)
		sched=FilteredElementCollector(doc, s.Id).OfClass(ScheduleSheetInstance)
		sched2 = [sc for sc in sched if not sc.IsTitleblockRevisionSchedule]
		if sched2 :
			withV.append(s)
		else:
			without.append(s)

OUT = withV, without
# ----------------------------------------
code_block = CodeBlock(x=python_script) { x[0]; x[1]; }
WithView = Output(code_block.out0)
WithoutView = Output(code_block.out1)
