# Dynamo custom node Sheet PlacedViews.dyf (Dynamo 2.6.1.8786)
# category: GeniusLoci.Sheet
# Obtains viewports, views, schedules and legend from a given sheet.

sheet = Input(sheet: var[]..[])
python_script = Python(IN[0]=sheet)
# ---------- python_script.python (36 lines) ----------
#Alban de Chasteigner 2020
#twitter : @geniusloci_bim
#geniusloci.bim@gmail.com
#https://github.com/albandechasteigner/GeniusLociForDynamo

import clr
clr.AddReference('RevitAPI')
from Autodesk.Revit.DB import *

sheet = UnwrapElement(IN[0]) if isinstance(IN[0],list) else [UnwrapElement(IN[0])]
allViewports,allLegends,allOther,allShedules = [],[],[],[]

for s in sheet:
	legends,other=[],[]
	doc = s.Document
	viewportIds = s.GetAllViewports()
	viewports = [doc.GetElement(i) for i in viewportIds]
	allViewports.append(viewports)
#allViewports = [doc.GetElement(i) for s in sheet for i in s.GetAllViewports()]
	viewsid = s.GetAllPlacedViews()
	views = [doc.GetElement(v) for v in viewsid]
	for w in views:
		if w.ViewType == ViewType.Legend:
			legends.append(w)
		else:
			other.append(w)
	allLegends.append(legends)
	allOther.append(other)

	#scheduleInstances = FilteredElementCollector(doc, s.Id).OfCategory(BuiltInCategory.OST_ScheduleGraphics).ToElements()
	scheduleInstances = FilteredElementCollector(doc, s.Id).OfClass(ScheduleSheetInstance).ToElements()
	schedules = [s for s in scheduleInstances if s.IsTitleblockRevisionSchedule is False]
	allShedules.append(schedules)

if isinstance(IN[0], list): OUT = allViewports,allOther,allShedules, allLegends
else: OUT = allViewports[0],allOther[0],allShedules[0], allLegends[0]
# ----------------------------------------
code_block = CodeBlock(x=python_script) { x[0]; x[1]; x[2]; x[3]; }
Viewport = Output(code_block.out0)
View = Output(code_block.out1)
Schedule = Output(code_block.out2)
Legend = Output(code_block.out3)
