# Dynamo custom node Sheet Size.dyf (Dynamo 2.6.1.8786)
# category: GeniusLoci.Sheet
# Returns the width and the height of the given sheet.

sheet = Input(sheet: var[]..[])
python_script = Python(IN[0]=sheet)
# ---------- python_script.python (20 lines) ----------
#Alban de Chasteigner 2021
#twitter : @geniusloci_bim
#geniusloci.bim@gmail.com
#https://github.com/albandechasteigner/GeniusLociForDynamo

import clr
clr.AddReference('RevitAPI')
from Autodesk.Revit.DB import FilteredElementCollector,BuiltInParameter,BuiltInCategory

sheets = UnwrapElement(IN[0]) if isinstance(IN[0],list) else [UnwrapElement(IN[0])]

width,height=[],[]
for sheet in sheets:
	doc=sheet.Document
	title=FilteredElementCollector(doc,sheet.Id).OfCategory(BuiltInCategory.OST_TitleBlocks).FirstElement()
	width.append(title.get_Parameter(BuiltInParameter.SHEET_WIDTH).AsValueString())
	height.append(title.get_Parameter(BuiltInParameter.SHEET_HEIGHT).AsValueString())

if isinstance(IN[0], list): OUT = width,height
else: OUT = width[0],height[0]
# ----------------------------------------
code_block = CodeBlock(x=python_script) { x[0]; x[1]; }
Width = Output(code_block.out0)
Height = Output(code_block.out1)
