# Dynamo custom node Sheet ToRevision.dyf (Dynamo 2.6.1.8786)
# category: GeniusLoci.Sheet
# Returns the revision of the given sheet.

sheet = Input(sheet: var[]..[])
python_script = Python(IN[0]=sheet)
# ---------- python_script.python (28 lines) ----------
#Alban de Chasteigner 2021
#twitter : @geniusloci_bim
#geniusloci.bim@gmail.com
#https://github.com/albandechasteigner/GeniusLociForDynamo

import clr
clr.AddReference('RevitAPI')
import Autodesk
from Autodesk.Revit.DB import Revision, Document

sheets = UnwrapElement(IN[0]) if isinstance(IN[0],list) else [UnwrapElement(IN[0])]
revisions,names=[],[]

for sheet in sheets:
	revi,revName=[],[]
	doc=sheet.Document
	revIds = sheet.GetAllRevisionIds()
	for r in revIds:
		rev = doc.GetElement(r)
		if len(revIds)>1:revi.append(rev) 
		else : revi = rev
		if len(revIds)>1:revName.append(rev.Name)
		else : revName=rev.Name
	revisions.append(revi)
	names.append(revName)

if isinstance(IN[0], list): OUT = revisions,names
else: OUT = revisions[0],names[0]
# ----------------------------------------
code_block = CodeBlock(x=python_script) { x[0]; x[1]; }
Revision = Output(code_block.out0)
RevisionName = Output(code_block.out1)
