# Dynamo custom node Sheet ToTitleBlock.dyf (Dynamo 2.6.1.8786)
# category: GeniusLoci.Sheet
# Retrieves the titleblock from the given sheet in the active or given document.

sheet = Input(sheet: var[]..[])  # Sheet of active or given document
python_script = Python(IN[0]=sheet)
# ---------- python_script.python (20 lines) ----------
#Alban de Chasteigner 2019
#twitter : @geniusloci_bim
#geniusloci.bim@gmail.com

import clr
clr.AddReference('RevitAPI')
from Autodesk.Revit.DB import Document, FilteredElementCollector, BuiltInCategory

if isinstance(IN[0], list) : sheets = UnwrapElement(IN[0])
else : sheets = [UnwrapElement(IN[0])]

titleBlock=[]
for sheet in sheets:
	doc=sheet.Document
	titles=FilteredElementCollector(doc,sheet.Id).OfCategory(BuiltInCategory.OST_TitleBlocks).ToElements()
	title = titles if len(titles)>1 else titles[0]
	titleBlock.append(title)

if isinstance(IN[0], list): OUT = titleBlock
else: OUT = titleBlock[0]
# ----------------------------------------
TitleBlock = Output(python_script)
