# Dynamo custom node Show Element.dyf (Dynamo 2.6.1.8786)
# category: GeniusLoci.Element
# Shows the given elements by zoom to fit in a view and select them.

element = Input(element: var[]..[])
python_script = Python(IN[0]=element)
# ---------- python_script.python (22 lines) ----------
import clr
clr.AddReference('RevitAPI')
import Autodesk
from Autodesk.Revit.DB import ElementId

clr.AddReference('RevitAPIUI')
from Autodesk.Revit.UI import *

clr.AddReference('RevitServices')
import RevitServices
from RevitServices.Persistence import DocumentManager
uidoc = DocumentManager.Instance.CurrentUIApplication.ActiveUIDocument

import System
from System.Collections.Generic import List

elements = UnwrapElement(IN[0]) if isinstance(IN[0],list) else [UnwrapElement(IN[0])]

elemId = List[ElementId](x.Id for x in elements)
uidoc.ShowElements(elemId)
uidoc.Selection.SetElementIds(elemId)	
OUT = IN[0]
# ----------------------------------------
Element = Output(python_script)
