# Dynamo custom node Show Linked Element.dyf (Dynamo 2.6.1.8786)
# category: GeniusLoci.Element
# Shows the linked elements by zoom to fit in the current view.

element = Input(element: var[]..[])  # Linked element
python_script = Python(IN[0]=element)
# ---------- python_script.python (67 lines) ----------
#Inspired by Cyril Poupin
#Alban de Chasteigner 2021
#twitter : @geniusloci_bim
#geniusloci.bim@gmail.com
#https://github.com/albandechasteigner/GeniusLociForDynamo

import clr
clr.AddReference('RevitAPI')
import Autodesk
from Autodesk.Revit.DB import *

clr.AddReference('RevitAPIUI')
from Autodesk.Revit.UI import *

clr.AddReference('RevitServices')
import RevitServices
from RevitServices.Persistence import DocumentManager
doc = DocumentManager.Instance.CurrentDBDocument
uidoc = DocumentManager.Instance.CurrentUIApplication.ActiveUIDocument

uiviews = uidoc.GetOpenUIViews()
view = doc.ActiveView
uiview = [x for x in uiviews if x.ViewId == view.Id][0]

def SumBoxes(boxes):
	minx = min([b.Min.X for b in boxes])
	miny = min([b.Min.Y for b in boxes])
	minz = min([b.Min.Z for b in boxes])
	maxx = max([b.Max.X for b in boxes])
	maxy = max([b.Max.Y for b in boxes])
	maxz = max([b.Max.Z for b in boxes])
	bb = BoundingBoxXYZ()
	bb.Min = XYZ(minx,miny,minz)
	bb.Max = XYZ(maxx,maxy,maxz)
	return bb

elements = UnwrapElement(IN[0]) if isinstance(IN[0],list) else [UnwrapElement(IN[0])]
bbx=[]

for elem in elements :
	lnkinst=FilteredElementCollector(doc).OfClass(RevitLinkInstance).ToElements().Find(lambda x : doc.GetElement(x.GetTypeId()).IsLoaded(doc, x.GetTypeId()) and x.GetLinkDocument().Title == elem.Document.Title)
	tfLnk = lnkinst.GetTotalTransform()
	if not isinstance(elem,DatumPlane):
		box = elem.get_BoundingBox(None)
		box.Min = tfLnk.OfPoint(box.Min)
		box.Max = tfLnk.OfPoint(box.Max)
	elif isinstance(elem,Grid):
		line=elem.Curve
		start=line.GetEndPoint(0)
		end=line.GetEndPoint(1)    
		box=BoundingBoxXYZ()
		box.Min = tfLnk.OfPoint(start)
		box.Max = tfLnk.OfPoint(end)	
	elif isinstance(elem,ReferencePlane):
		view = doc.ActiveView
		for crv in elem.GetCurvesInView(DatumExtentType.ViewSpecific,view):
			line = crv
		start=line.GetEndPoint(0)
		end=line.GetEndPoint(1)    
		box = BoundingBoxXYZ()
		box.Min = tfLnk.OfPoint(start)
		box.Max = tfLnk.OfPoint(end)	
	bbx.append(box)
	sumBox = SumBoxes(bbx)	
	uiview.ZoomAndCenterRectangle(sumBox.Min, sumBox.Max)

OUT = elements
# ----------------------------------------
Element = Output(python_script)
