# Dynamo custom node SpotElevation ByReference.dyf (Dynamo 2.6.1.8786)
# category: GeniusLoci.Dimension
# Places a spot elevation at a given reference in a given view.
# Inspired by the Dynamo Forum

view = Input(view: var[]..[] = Revit.Application.Document.Current.ActiveView)  # The view in which the spot elevation is to be visible.
reference = Input(reference: var[]..[])  # Autodesk.Revit.DB.Reference The reference to which the spot elevation is to be bound.
point = Input(point: Autodesk.DesignScript.Geometry.Point[]..[])  # The Point which the Spot Elevation Evaluates
bend = Input(bend: var[]..[])  # The bend Point for the Spot Elevation
end = Input(end: var[]..[])  # The end Point for the Spot Elevation
hasLeader = Input(hasLeader: bool = false)
spotDimensionType = Input(spotDimensionType: var[]..[] = null)
python_script = Python(IN[0]=view, IN[1]=reference, IN[2]=point, IN[3]=bend, IN[4]=end, IN[5]=hasLeader, IN[6]=spotDimensionType)
# ---------- python_script.python (33 lines) ----------
#Dynamo Forum https://forum.dynamobim.com/t/place-spot-elevation-in-sectionview-and-change-type/72272/25
import clr
clr.AddReference('RevitAPI')
from Autodesk.Revit.DB import Document

clr.AddReference("RevitNodes")
import Revit
clr.ImportExtensions(Revit.GeometryConversion)

clr.AddReference("RevitServices")
import RevitServices
from RevitServices.Persistence import DocumentManager
from RevitServices.Transactions import TransactionManager

doc = DocumentManager.Instance.CurrentDBDocument
view = UnwrapElement(IN[0])[0] if isinstance(IN[0],list) else UnwrapElement(IN[0])
refs = UnwrapElement(IN[1]) if isinstance(IN[1],list) else [UnwrapElement(IN[1])]
origins = UnwrapElement(IN[2]) if isinstance(IN[2],list) else [UnwrapElement(IN[2])]
bends = UnwrapElement(IN[3]) if isinstance(IN[3],list) else [UnwrapElement(IN[3])]
ends = UnwrapElement(IN[4]) if isinstance(IN[4],list) else [UnwrapElement(IN[4])]
leader = UnwrapElement(IN[5]) if isinstance(IN[5],list) else [UnwrapElement(IN[5])]
type= UnwrapElement(IN[6])
elementlist = []

TransactionManager.Instance.EnsureInTransaction(doc)
for ref, pt, bend, end in zip(refs, origins, bends, ends):
	spot = doc.Create.NewSpotElevation(view, ref, pt.ToXyz(), bend.ToXyz(), end.ToXyz(), pt.ToXyz(), leader)
	elementlist.append(spot)
	if IN[6] != None: 
		spot.ChangeTypeId(type.Id)
TransactionManager.Instance.TransactionTaskDone()

OUT = elementlist
# ----------------------------------------
