# Dynamo custom node String PrintPDF.dyf (Dynamo 2.6.1.8786)
# category: GeniusLoci.Printing
# Write the text content to a PDF file specified by the path.
# By Keith Sowinski on Dynamo Forum

filePath = Input(filePath: var[]..[])  # Must include: Directory + name + .pdf extension
text = Input(text: string[]..[])
LeftMargins = Input(LeftMargins: var[]..[] = 1)
RightMargins = Input(RightMargins: var[]..[] = 1)
TopMargins = Input(TopMargins: var[]..[] = 1)
BottomMargins = Input(BottomMargins: var[]..[] = 1)
Font = Input(Font: var[]..[] = "Courier New")  # Monospaced font
FontSize = Input(FontSize: var[]..[] = 5)
RunIt = Input(RunIt: bool = false)
python_script = Python(IN[0]=filePath, IN[1]=text, IN[2]=LeftMargins, IN[3]=RightMargins, IN[4]=TopMargins, IN[5]=BottomMargins, IN[6]=Font, IN[7]=FontSize, IN[8]=RunIt)
# ---------- python_script.python (48 lines) ----------
#by Keith Sowinski on Dynamo Forum

import clr
import System
import math

clr.AddReference('System.Drawing')

from System.Drawing.Printing import *
from System.Drawing import Brushes, Font, StringFormat, SizeF, StringAlignment

file = IN[0]
string = IN[1]
ltMargin = IN[2]
rtMargin = IN[3]
tpMargin = IN[4]
btmMargin = IN[5]
font = IN[6]
size = IN[7]
run = IN[8]

def printPDF():
	pd = PrintDocument()
	pd.PrinterSettings.PrinterName = "Microsoft Print to PDF"
	pd.PrinterSettings.PrintToFile = True
	pd.PrinterSettings.PrintFileName = file
	pd.DefaultPageSettings.Margins.Left = ltMargin
	pd.DefaultPageSettings.Margins.Right = rtMargin
	pd.DefaultPageSettings.Margins.Top = tpMargin
	pd.DefaultPageSettings.Margins.Bottom = btmMargin
	pd.PrintPage += PrintPageEventHandler(print_page)
	pd.Print()
#	return file

def print_page(sender, e):
	global string
	
	fnt = Font(font, size)
	charactersOnPage = clr.Reference[System.Int32]()
	linesPerPage = clr.Reference[System.Int32]()
	e.Graphics.MeasureString(string, fnt, SizeF(e.MarginBounds.Size), StringFormat.GenericDefault, charactersOnPage, linesPerPage)
	
	e.Graphics.DrawString(string, fnt, Brushes.Black, e.MarginBounds)
	string = string.Substring(charactersOnPage.Value)
	e.HasMorePages = string.Length > 0

if run:
	OUT = printPDF()
# ----------------------------------------
void = Output(python_script)
