# Dynamo custom node Surface Reference.dyf (Dynamo 2.6.1.8786)
# category: GeniusLoci.Reference
# Obtains the reference of a given Revit surface in the current document.

surface = Input(surface: Autodesk.DesignScript.Geometry.Surface[]..[])  # Dynamo Surface
python_script = Python(IN[0]=surface)
# ---------- python_script.python (14 lines) ----------
import clr
clr.AddReference('RevitAPI')

surfaces = UnwrapElement(IN[0]) if isinstance(IN[0],list) else [UnwrapElement(IN[0])]
result = []
for surface in surfaces:
	try:
		reference = surface.Tags.LookupTag("RevitFaceReference")
		result.append(reference)
	except:
		result.append(None)
		
if isinstance(IN[0], list): OUT = result
else: OUT = result[0]
# ----------------------------------------
Reference = Output(python_script)
