# Dynamo custom node Switch between 2D or 3D extent.dyf (Dynamo 2.6.1.8786)
# category: GeniusLoci.Level
# Switch the extents of grid and level from 2d to 3d or vice versa.
# For use with "Enumerate Datum Extent Type" node.

element = Input(element: var[]..[])
view = Input(view: var[]..[])
DatumExtentType = Input(DatumExtentType: var[]..[])  # Model or ViewSpecific
python_script = Python(IN[0]=element, IN[1]=view, IN[2]=DatumExtentType)
# ---------- python_script.python (30 lines) ----------
import clr
clr.AddReference('RevitAPI')
from Autodesk.Revit.DB import *
import Autodesk

clr.AddReference("RevitServices")
import RevitServices
from RevitServices.Persistence import DocumentManager
from RevitServices.Transactions import TransactionManager

doc = DocumentManager.Instance.CurrentDBDocument
uiapp = DocumentManager.Instance.CurrentUIApplication
app = uiapp.Application

#Custom tolist definition provided by Dimitar Venkov
def tolist(x):
	if hasattr(x,'__iter__'): return x
	else : return [x]

elements = tolist(UnwrapElement(IN[0]))
views = tolist(UnwrapElement(IN[1]))
extenttype = IN[2]
TransactionManager.Instance.EnsureInTransaction(doc)
for view in views :
	for element in elements:
		element.SetDatumExtentType(DatumEnds.End0,view, extenttype)
		element.SetDatumExtentType(DatumEnds.End1,view, extenttype)
TransactionManager.Instance.TransactionTaskDone()

OUT = views
# ----------------------------------------
View = Output(python_script)
