# Dynamo custom node SynchronizeWithCentral in Document.dyf (Dynamo 2.6.2.15705)
# category: GeniusLoci.Document
# Synchronizes a workshared model with the central model with the choice of the Revit document.
# Based on a Clockwork node

relinquishProjectStandardWorksets = Input(relinquishProjectStandardWorksets: bool = false)
relinquishViewWorksets = Input(relinquishViewWorksets: bool = false)
relinquishFamilyWorksets = Input(relinquishFamilyWorksets: bool = false)
relinquishUserCreatedWorksets = Input(relinquishUserCreatedWorksets: bool = true)
relinquishBorrowedElements = Input(relinquishBorrowedElements: bool = false)
compactCentralModel = Input(compactCentralModel: bool = false)
saveLocalFileBeforeSync = Input(saveLocalFileBeforeSync: bool = false)
saveLocalFileAfterSync = Input(saveLocalFileAfterSync: bool = false)
comment = Input(comment: string = "")
runMe = Input(runMe: bool = false)
document = Input(document: var[]..[] = null)  # Use only if you want to query other document Autodesk.Revit.DB.Document
# note: From Clockwork
python_script = Python(IN[0]=relinquishProjectStandardWorksets, IN[1]=relinquishViewWorksets, IN[2]=relinquishFamilyWorksets, IN[3]=relinquishUserCreatedWorksets, IN[4]=relinquishBorrowedElements, IN[5]=compactCentralModel, IN[6]=saveLocalFileBeforeSync, IN[7]=saveLocalFileAfterSync, IN[8]=comment, IN[9]=runMe, IN[10]=document)
# ---------- python_script.python (50 lines) ----------
import clr
clr.AddReference('RevitAPI')
from Autodesk.Revit.DB import *

clr.AddReference("RevitServices")
import RevitServices
from RevitServices.Persistence import DocumentManager
from RevitServices.Transactions import TransactionManager

relStandardWS = IN[0]
relViewWS = IN[1]
relFamWS = IN[2]
relUserWS = IN[3]
relCheckedOutElems = IN[4]
compact = IN[5]
saveLocalBefore = IN[6]
saveLocalAfter = IN[7]
comment = IN[8]
runme = IN[9]
if isinstance(IN[10], list) : inputdoc = IN[10] 
else : inputdoc = [IN[10]]

#Inputdoc : Part of script by Andreas Dieckmann
if inputdoc[0] == None:
    doc = DocumentManager.Instance.CurrentDBDocument
elif inputdoc[0].GetType().ToString() == "Autodesk.Revit.DB.Document":
    doc = inputdoc[0]
else: doc = DocumentManager.Instance.CurrentDBDocument

if runme:
	tOptions = TransactWithCentralOptions()
	rOptions = RelinquishOptions(False)
	rOptions.StandardWorksets = relStandardWS
	rOptions.ViewWorksets = relViewWS
	rOptions.FamilyWorksets = relFamWS
	rOptions.UserWorksets = relUserWS
	rOptions.CheckedOutElements = relCheckedOutElems
	sOptions = SynchronizeWithCentralOptions()
	sOptions.SetRelinquishOptions(rOptions)
	sOptions.Compact = compact
	sOptions.SaveLocalBefore = saveLocalBefore
	sOptions.SaveLocalAfter = saveLocalAfter
	sOptions.Comment = comment
	TransactionManager.Instance.ForceCloseTransaction()
	try:
		doc.SynchronizeWithCentral(tOptions, sOptions)
		OUT = True,doc
	except:
		OUT = False,doc
else: OUT = False,doc
# ----------------------------------------
code_block = CodeBlock(x=python_script) { x[0]; x[1]; }
success = Output(code_block.out0)
Document = Output(code_block.out1)
