# Dynamo custom node Tag GetLeaderEnd.dyf (Dynamo 2.6.2.15705)
# category: GeniusLoci.Tag
# Retrieves the position of the leader end for a tag.

tag = Input(tag: var[]..[])
python_script = Python(IN[0]=tag)
# ---------- python_script.python (45 lines) ----------
#By Cyril Poupin on Dynamo Forum
#https://forum.dynamobim.com/t/get-endpoint-of-leader-of-independent-tag/86243/5
import clr
clr.AddReference('RevitAPI')
import Autodesk
from Autodesk.Revit.DB import *

clr.AddReference('RevitNodes')
import Revit
clr.ImportExtensions(Revit.GeometryConversion)

clr.AddReference('RevitServices')
import RevitServices
from RevitServices.Persistence import DocumentManager
from RevitServices.Transactions import TransactionManager
doc = DocumentManager.Instance.CurrentDBDocument
app = DocumentManager.Instance.CurrentUIApplication.Application
sdkNumber = int(app.VersionNumber)

tags = UnwrapElement(IN[0]) if isinstance(IN[0],list) else [UnwrapElement(IN[0])]

def setFreeEnd_temp(func):
	def wrapper(*args, **kwargs):
		tag = args[0]
		TransactionManager.Instance.ForceCloseTransaction()
		t = Transaction(doc, func.__name__)
		t.Start()
		tag.LeaderEndCondition = LeaderEndCondition.Free
		doc.Regenerate()
		ret = func(*args, **kwargs) 
		t.RollBack()
		t.Dispose()
		return ret 
	return wrapper 

@setFreeEnd_temp
def get_endpoint_of_Tag(tag):
	if sdkNumber < 2022:
		return tag.LeaderEnd.ToPoint()
	else:
		ref = next(e for e in tag.GetTaggedReferences())
		return tag.GetLeaderEnd(ref).ToPoint()

if isinstance(IN[0], list): OUT = [get_endpoint_of_Tag(tag) for tag in tags]
else: OUT = [get_endpoint_of_Tag(tag) for tag in tags][0]
# ----------------------------------------
point = Output(python_script)
