# Dynamo custom node Tag GetLocation.dyf (Dynamo 2.6.1.8786)
# category: GeniusLoci.Tag
# Retrieves the position of the head of tag. Only works in Revit 2017 and later.

tag = Input(tag: var[]..[])
python_script = Python(IN[0]=tag)
# ---------- python_script.python (9 lines) ----------
import clr
clr.AddReference('RevitNodes')
import Revit
clr.ImportExtensions(Revit.GeometryConversion)

tags = UnwrapElement(IN[0]) if isinstance(IN[0],list) else [UnwrapElement(IN[0])]

if isinstance(IN[0], list): OUT = [tag.TagHeadPosition.ToPoint() for tag in tags]
else: OUT = [tag.TagHeadPosition.ToPoint() for tag in tags][0]
# ----------------------------------------
point = Output(python_script)
