# Dynamo custom node Tag IsOrphaned.dyf (Dynamo 2.6.1.8786)
# category: GeniusLoci.Tag
# Identify the orphaned tags.
# Orphaned tags are tags that are associated with a linked document but  no longer have a host element.

tag = Input(tag: var[]..[])
python_script = Python(IN[0]=tag)
# ---------- python_script.python (38 lines) ----------
#Alban de Chasteigner 2020
#twitter : @geniusloci_bim
#geniusloci.bim@gmail.com
#https://github.com/albandechasteigner/GeniusLociForDynamo

import clr
clr.AddReference("RevitAPI")
import Autodesk
from Autodesk.Revit.DB import *

clr.AddReference('RevitNodes')
import Revit
clr.ImportExtensions(Revit.Elements)

clr.AddReference("RevitServices")
import RevitServices
from RevitServices.Persistence import DocumentManager
doc = DocumentManager.Instance.CurrentDBDocument

tag = UnwrapElement(IN[0]) if isinstance(IN[0],list) else [UnwrapElement(IN[0])]

orphaned = []
taghost = []

ueWrapper = None
wrappers = clr.GetClrType(Revit.Elements.ElementWrapper).GetMethods()
for w in wrappers:
	if w.ToString().startswith("Revit.Elements.UnknownElement"):
		ueWrapper = w
		break

for t in tag:
	if t.IsOrphaned:
		orphaned.append(ueWrapper.Invoke(None, (t, True)))
	elif not t.IsOrphaned:
		taghost.append(ueWrapper.Invoke(None, (t, True)))

OUT = orphaned, taghost
# ----------------------------------------
code_block = CodeBlock(x=python_script) { x[0]; x[1]; }
Orphaned_Tags = Output(code_block.out0)
Tag_with_Host = Output(code_block.out1)
