# Dynamo custom node Tag SetLocation.dyf (Dynamo 2.6.1.8786)
# category: GeniusLoci.Tag
# Moves the head of the tag to the given location point.

tag = Input(tag: var[]..[])
location = Input(location: var[]..[])
python_script = Python(IN[0]=tag, IN[1]=location)
# ---------- python_script.python (24 lines) ----------
import clr
clr.AddReference("RevitServices")
import RevitServices
from RevitServices.Transactions import TransactionManager
from RevitServices.Persistence import DocumentManager
doc =  DocumentManager.Instance.CurrentDBDocument

clr.AddReference("RevitNodes")
import Revit
clr.ImportExtensions(Revit.GeometryConversion)

def tolist(obj1):
	if hasattr(obj1,"__iter__"): return obj1
	else: return [obj1]

tags = UnwrapElement(tolist(IN[0]))
locations = UnwrapElement(tolist(IN[1]))

TransactionManager.Instance.EnsureInTransaction(doc)
for tag,location in zip(tags,locations):
	tag.TagHeadPosition = location.ToRevitType()
TransactionManager.Instance.TransactionTaskDone()

OUT = tags
# ----------------------------------------
Tag = Output(python_script)
