# Dynamo custom node TextNote AddLeader.dyf (Dynamo 2.6.1.8786)
# category: GeniusLoci.TextNote
# Adds a leader to the text note.

textNote = Input(textNote: var[]..[])
TextNoteLeaderTypes = Input(TextNoteLeaderTypes: var[]..[])  # String or DB.TextNoteLeaderTypes
python_script = Python(IN[0]=textNote, IN[1]=TextNoteLeaderTypes)
# ---------- python_script.python (33 lines) ----------
#Alban de Chasteigner 2020
#twitter : @geniusloci_bim
#geniusloci.bim@gmail.com
#https://github.com/albandechasteigner/GeniusLociForDynamo

import clr
clr.AddReference('RevitAPI')
import Autodesk
from Autodesk.Revit.DB import TextNote,TextNoteLeaderTypes,LeaderAtachement

clr.AddReference('RevitServices')
import RevitServices
from RevitServices.Persistence import DocumentManager
from RevitServices.Transactions import TransactionManager
doc = DocumentManager.Instance.CurrentDBDocument

leader=[]
Elements = UnwrapElement(IN[0]) if isinstance(IN[0],list) else [UnwrapElement(IN[0])]
leaders = IN[1]
if isinstance(leaders, basestring):
	exec("leaderTypes = TextNoteLeaderTypes.%s" % leaders)
else:
	leaderTypes = leaders

TransactionManager.Instance.EnsureInTransaction(doc)
for textNote in Elements:
	leader.append(textNote.AddLeader(leaderTypes))
	textNote.LeaderLeftAttachment=LeaderAtachement.Midpoint
	textNote.LeaderRightAttachment=LeaderAtachement.Midpoint
TransactionManager.Instance.TransactionTaskDone()

if isinstance(IN[0], list): OUT = leader
else: OUT = leader[0]
# ----------------------------------------
Leader = Output(python_script)
