# Dynamo custom node TextNote RemoveLeader.dyf (Dynamo 2.6.1.8786)
# category: GeniusLoci.TextNote
# Removes all leaders attached to the text note.

textNote = Input(textNote: var[]..[])
python_script = Python(IN[0]=textNote)
# ---------- python_script.python (24 lines) ----------
#Alban de Chasteigner 2021
#twitter : @geniusloci_bim
#geniusloci.bim@gmail.com
#https://github.com/albandechasteigner/GeniusLociForDynamo

import clr
clr.AddReference('RevitAPI')
import Autodesk
from Autodesk.Revit.DB import TextNote

clr.AddReference('RevitServices')
import RevitServices
from RevitServices.Persistence import DocumentManager
from RevitServices.Transactions import TransactionManager
doc = DocumentManager.Instance.CurrentDBDocument

Elements = UnwrapElement(IN[0]) if isinstance(IN[0],list) else [UnwrapElement(IN[0])]

TransactionManager.Instance.EnsureInTransaction(doc)
for textNote in Elements:
	textNote.RemoveLeaders()
TransactionManager.Instance.TransactionTaskDone()

OUT = IN[0]
# ----------------------------------------
TextNote = Output(python_script)
