# Dynamo custom node Unfold Concave.dyf (Dynamo 2.6.1.8786)
# category: GeniusLoci.Geometry
# Unfold curved elements like Walls or stairs.
# An inner perimeter circle of the element must be drawn to intersect the geometry with it.

line = Input(line: var[]..[])  # Drawn perimeter circle. (Revit line)
geometry = Element.Geometry(element=line)
length = Curve.Length(curve=geometry)
cylinder_height = CodeBlock(a=length) { -a; }
byWidthLength = Rectangle.ByWidthLength(width=length, length=cylinder_height)
byPatch = Surface.ByPatch(closedCurve=byWidthLength)
extrude = Curve.Extrude(curve=geometry, distance=cylinder_height)
Curved_element = Input(Curved_element: var[]..[])
flatten_solids = CodeBlock(x=Curved_element) { DSCore.List.Clean(DSCore.List.Flatten(x.Solids,-1), false); }
# note: Inspired by a Mostafa El Ayoubi's graph
byUnion = Solid.ByUnion(solids=flatten_solids)
intersect = Geometry.Intersect(geometry=byUnion, other=extrude)
perimeterCurves = Surface.PerimeterCurves(surface=intersect)
flatten = List.Flatten(list=perimeterCurves)
startPoint = Curve.StartPoint(curve=flatten)
UVParameterAtPoint = Surface.UVParameterAtPoint(surface=extrude, point=startPoint, lacing=Longest)
U = UV.U(uV=UVParameterAtPoint)
V = UV.V(uV=UVParameterAtPoint)
pointAtParameter = Surface.PointAtParameter(surface=byPatch, u=U, v=V, lacing=Longest)
code_block = CodeBlock { 0.5; }
pointAtParameter_2 = Curve.PointAtParameter(curve=flatten, param=code_block)
UVParameterAtPoint_2 = Surface.UVParameterAtPoint(surface=extrude, point=pointAtParameter_2, lacing=Longest)
U_2 = UV.U(uV=UVParameterAtPoint_2)
V_2 = UV.V(uV=UVParameterAtPoint_2)
pointAtParameter_3 = Surface.PointAtParameter(surface=byPatch, u=U_2, v=V_2, lacing=Longest)
endPoint = Curve.EndPoint(curve=flatten)
UVParameterAtPoint_3 = Surface.UVParameterAtPoint(surface=extrude, point=endPoint, lacing=Longest)
U_3 = UV.U(uV=UVParameterAtPoint_3)
V_3 = UV.V(uV=UVParameterAtPoint_3)
pointAtParameter_4 = Surface.PointAtParameter(surface=byPatch, u=U_3, v=V_3, lacing=Longest)
create = List.Create(item0=pointAtParameter, item1=pointAtParameter_3, item2=pointAtParameter_4)
transpose = List.Transpose(lists=create)
code_block_2 = CodeBlock { 2; }
byPoints = NurbsCurve.ByPoints(points=transpose@L2, degree=code_block_2)
Curves = Output(byPoints)
