# Dynamo custom node View ApplyViewTemplate.dyf (Dynamo 2.6.1.8786)
# category: GeniusLoci.View
# Applies to the given view the properties that are not controlled by the assigned view template. (Similar to the "Apply Template Properties" command of Revit)

view = Input(view: var[]..[])
viewTemplate = Input(viewTemplate: var[]..[])  # Source view from which to take properties
python_script = Python(IN[0]=view, IN[1]=viewTemplate)
# ---------- python_script.python (27 lines) ----------
#Alban de Chasteigner 2021
#twitter : @geniusloci_bim
#geniusloci.bim@gmail.com
#https://github.com/albandechasteigner/GeniusLociForDynamo
import clr
clr.AddReference('RevitAPI')
from Autodesk.Revit.DB import *

clr.AddReference('RevitServices')
import RevitServices
from RevitServices.Persistence import DocumentManager
from RevitServices.Transactions import TransactionManager
doc = DocumentManager.Instance.CurrentDBDocument

views = UnwrapElement(IN[0]) if isinstance(IN[0],list) else [UnwrapElement(IN[0])]
viewTemplates = UnwrapElement(IN[1]) if isinstance(IN[1],list) else [UnwrapElement(IN[1])]
viewTemp_len = len(viewTemplates) == 1

TransactionManager.Instance.EnsureInTransaction(doc)
for number in xrange(len(views)):
	v = 0 if viewTemp_len else number
	try:views[number].ApplyViewTemplateParameters(viewTemplates[v])
	except:pass
TransactionManager.Instance.TransactionTaskDone()

if isinstance(IN[0], list): OUT = views
else: OUT = views[0]
# ----------------------------------------
View = Output(python_script)
