# Dynamo custom node View CreateViewTemplate.dyf (Dynamo 2.6.1.8786)
# category: GeniusLoci.View
# Creates a new view template from a given view.
# Works only in Revit 2020 and later.

view = Input(view: var[]..[])
python_script = Python(IN[0]=view)
# ---------- python_script.python (42 lines) ----------
#Alban de Chasteigner 2021
#twitter : @geniusloci_bim
#geniusloci.bim@gmail.com
#https://github.com/albandechasteigner/GeniusLociForDynamo
  
import clr
clr.AddReference('RevitAPI')
import Autodesk
from Autodesk.Revit.DB import View,ViewType
clr.AddReference('RevitNodes')
import Revit
clr.ImportExtensions(Revit.Elements)
clr.AddReference("RevitServices")
import RevitServices
from RevitServices.Persistence import DocumentManager
from RevitServices.Transactions import TransactionManager
doc = DocumentManager.Instance.CurrentDBDocument

views = UnwrapElement(IN[0]) if isinstance(IN[0],list) else [UnwrapElement(IN[0])]
viewTemplates=[]

#ueWrapper from Dimitar Venkov
ueWrapper = None
wrappers = clr.GetClrType(Revit.Elements.ElementWrapper).GetMethods()
for w in wrappers:
	if w.ToString().startswith("Revit.Elements.UnknownElement"):
		ueWrapper = w
		break
	
TransactionManager.Instance.EnsureInTransaction(doc)
for view in views:
	viewTemplate=view.CreateViewTemplate()
	try:
		viewTemplate.Name = view.Name
	except:pass
	if view.ViewType == ViewType.ThreeD :
		viewTemplates.append(ueWrapper.Invoke(None,(viewTemplate, True)))
	else: viewTemplates.append(viewTemplate)
TransactionManager.Instance.TransactionTaskDone()

if isinstance(IN[0], list): OUT = viewTemplates
else: OUT = viewTemplates[0]
# ----------------------------------------
ViewTemplate = Output(python_script)
