# Dynamo custom node View DetailLevels.dyf (Dynamo 2.6.1.8786)
# category: GeniusLoci.View
# Enumerates the possible detail levels for a view.
# For use with the View SetDetailLevel node.

python_script = Python()  # graph input
# ---------- python_script.python (7 lines) ----------
import clr
clr.AddReference("RevitAPI")
import Autodesk
from Autodesk.Revit.DB import ViewDetailLevel
import System

OUT = System.Enum.GetValues(Autodesk.Revit.DB.ViewDetailLevel)
# ----------------------------------------
DetailLevel = Output(python_script)
