# Dynamo custom node View Level.dyf (Dynamo 2.6.1.8786)
# category: GeniusLoci.View
# Returns the level to which a view is associated.

view = Input(view: var[]..[] = Revit.Application.Document.Current.ActiveView)
python_script = Python(IN[0]=view)
# ---------- python_script.python (12 lines) ----------
import clr
clr.AddReference('RevitAPI')
from Autodesk.Revit.DB import View

def GetLevel(view) :
	if hasattr(view, "GenLevel") : return view.GenLevel
	else : return None

views = UnwrapElement(IN[0])

if isinstance(IN[0], list): OUT = [GetLevel(x) for x in views]
else: OUT = GetLevel(views)
# ----------------------------------------
Level = Output(python_script)
