# Dynamo custom node View Properties.dyf (Dynamo 2.6.1.8786)
# category: GeniusLoci.View
# Returns certain properties of the given view.

view = Input(view: var[]..[] = Revit.Application.Document.Current.ActiveView)
python_script = Python(IN[0]=view)
# ---------- python_script.python (73 lines) ----------
#Inspired by Clockwork

import clr
clr.AddReference('RevitAPI')
from Autodesk.Revit.DB import *

def Name(view):
	if hasattr(view, "Name"): return view.Name
	else: return None

def Scale(view):
	if hasattr(view, "Scale"): return str(view.Scale)
	else: return None

def DetailLevel(view):
	if hasattr(view, "DetailLevel"): return str(view.DetailLevel)
	else: return None

def DisplayStyle(view):
	if hasattr(view, "DisplayStyle"): return str(view.DisplayStyle)
	else: return None
	
def Discipline(view):
	if hasattr(view, "Discipline"): return str(view.Discipline)
	else: return None	

def GetViewType(view):
	if hasattr(view, "ViewType"): return str(view.ViewType)
	else: return None

def GetSheet(view):
	try: return view.get_Parameter(BuiltInParameter.VIEWER_SHEET_NUMBER).AsString()
	except: return None

def GetSheetName(view):
	try: return view.get_Parameter(BuiltInParameter.VIEWPORT_SHEET_NAME).AsString()
	except: return None
	
def GetSheetTitle(view):
	try: return view.get_Parameter(BuiltInParameter.VIEW_DESCRIPTION).AsString()
	except: return None

def GetViewTemplate(view):
	if not view: return None
	elif hasattr(view, "ViewTemplateId"):
		if view.ViewTemplateId.IntegerValue == -1: return None
		else: return view.Document.GetElement(view.ViewTemplateId)
	else: return None

def GetDependency(view):
	try: return view.get_Parameter(BuiltInParameter.VIEW_DEPENDENCY).AsString()
	except: return None

def GetLevel(view):
	if hasattr(view, "GenLevel"):return view.GenLevel
	else : return None

def GetScopeBox(view):
	try: return view.Document.GetElement(view.get_Parameter(BuiltInParameter.VIEWER_VOLUME_OF_INTEREST_CROP).AsElementId())
	except: return None
	
def GetViewPhase(view):
	try: return view.Document.GetElement(view.get_Parameter(BuiltInParameter.VIEW_PHASE).AsElementId())
	except: return None
	
def GetPhaseFilter(view):
	try: return view.Document.GetElement(view.get_Parameter(BuiltInParameter.VIEW_PHASE_FILTER).AsElementId())
	except: return None

views = UnwrapElement(IN[0])

if isinstance(IN[0], list): OUT = [Name(x) for x in views],[Scale(x) for x in views],[DetailLevel(x) for x in views],[DisplayStyle(x) for x in views],[Discipline(x) for x in views],[GetViewType(x) for x in views],[GetLevel(x) for x in views],[GetViewTemplate(x) for x in views],[GetScopeBox(x) for x in views],[GetDependency(x) for x in views],[GetSheet(x) for x in views],[GetSheetName(x) for x in views],[GetSheetTitle(x) for x in views],[GetViewPhase(x) for x in views],[GetPhaseFilter(x) for x in views]
else: OUT = Name(views),Scale(views),DetailLevel(views),DisplayStyle(views),Discipline(views), GetViewType(views),GetLevel(views),GetViewTemplate(views),GetScopeBox(views),GetDependency(views), GetSheet(views),GetSheetName(views),GetSheetTitle(views),GetViewPhase(views),GetPhaseFilter(views)
# ----------------------------------------
code_block = CodeBlock(x=python_script) { x[0]; x[1]; x[2]; x[3]; x[4]; x[5]; x[6]; x[7]; x[8]; x[9]; x[10]; x[11]; x[12]; x[13]; x[14]; }
View_Name = Output(code_block.out0)
View_Scale = Output(code_block.out1)
Detail_Level = Output(code_block.out2)
Visual_Style = Output(code_block.out3)
Discipline = Output(code_block.out4)
ViewType = Output(code_block.out5)
Level = Output(code_block.out6)
ViewTemplate = Output(code_block.out7)
Scope_Box = Output(code_block.out8)
Dependency = Output(code_block.out9)
Sheet_Number = Output(code_block.out10)
Sheet_Name = Output(code_block.out11)
Title_On_Sheet = Output(code_block.out12)
Phase = Output(code_block.out13)
Phase_Filter = Output(code_block.out14)
