# Dynamo custom node View ResetCropBox.dyf (Dynamo 2.6.2.15705)
# category: GeniusLoci.View
# Removes any non-rectangular boundary of the view's cropbox.

view = Input(view: var[]..[])
python_script = Python(IN[0]=view)
# ---------- python_script.python (24 lines) ----------
#solamour on https://forum.dynamobim.com/t/how-to-reset-crop-view-using-dynamo/25140/5

import clr
clr.AddReference('RevitAPI')
import Autodesk
from Autodesk.Revit.DB import View

clr.AddReference('RevitServices')
import RevitServices
from RevitServices.Persistence import DocumentManager
from RevitServices.Transactions import TransactionManager
doc = DocumentManager.Instance.CurrentDBDocument

views = UnwrapElement(IN[0]) if isinstance(IN[0],list) else [UnwrapElement(IN[0])]

TransactionManager.Instance.EnsureInTransaction(doc)
for v in views:
	if v.CropBoxActive == True:
		csm = v.GetCropRegionShapeManager()
		csm.RemoveCropRegionShape()
TransactionManager.Instance.TransactionTaskDone()

if isinstance(IN[0], list): OUT = views
else: OUT = views[0]
# ----------------------------------------
View = Output(python_script)
