# Dynamo custom node View ResetElementOverrides.dyf (Dynamo 2.6.1.8786)
# category: GeniusLoci.Graphics
# Removes all Graphics overrides for an element in a given view.

view = Input(view: var[]..[] = Revit.Application.Document.Current.ActiveView)
element = Input(element: var[]..[])
python_script = Python(IN[0]=view, IN[1]=element)
# ---------- python_script.python (34 lines) ----------
#By Cyril Poupin on Dynamo Forum
import clr
clr.AddReference('RevitAPI')
from Autodesk.Revit.DB import *

clr.AddReference("RevitServices")
import RevitServices
from RevitServices.Persistence import DocumentManager
from RevitServices.Transactions import TransactionManager

doc = DocumentManager.Instance.CurrentDBDocument

toDoList = lambda x : x if hasattr(x, '__iter__') else [x]

lstViews = UnwrapElement(IN[0]) if isinstance(IN[0],list) else [UnwrapElement(IN[0])]
items = UnwrapElement(IN[1]) if isinstance(IN[1],list) else [UnwrapElement(IN[1])]
itemsId = [x.Id for x in items]

viewsProcessing = []

override = OverrideGraphicSettings()

TransactionManager.Instance.EnsureInTransaction(doc)
for view in lstViews:
	if not view.IsTemplate: 
		if view.AreGraphicsOverridesAllowed():	
			viewsProcessing.append(view)
			elemsViewId = FilteredElementCollector(doc, view.Id).ToElementIds()
			matchSetId = set(itemsId) & set(elemsViewId)
			for itemId in matchSetId:
				view.SetElementOverrides(itemId, override)
TransactionManager.Instance.TransactionTaskDone()

OUT = items,viewsProcessing
# ----------------------------------------
code_block = CodeBlock(x=python_script) { x[0]; x[1]; }
View = Output(code_block.out0)
Element = Output(code_block.out1)
