# Dynamo custom node View SetDetailLevel.dyf (Dynamo 2.6.1.8786)
# category: GeniusLoci.View
# Sets the detail level of a given view.

view = Input(view: var[]..[])
detailLevel = Input(detailLevel: var[]..[])  # String or DB.ViewDetailLevel
python_script = Python(IN[0]=view, IN[1]=detailLevel)
# ---------- python_script.python (27 lines) ----------
import clr
clr.AddReference('RevitAPI')
from Autodesk.Revit.DB import ViewDetailLevel

clr.AddReference("RevitServices")
import RevitServices
from RevitServices.Persistence import DocumentManager
from RevitServices.Transactions import TransactionManager

doc = DocumentManager.Instance.CurrentDBDocument
views = UnwrapElement(IN[0]) if isinstance(IN[0],list) else [UnwrapElement(IN[0])]
detailLevel = IN[1]

if isinstance(detailLevel , basestring):
	exec("viewDetail = ViewDetailLevel.%s" % detailLevel )
else:
	viewDetail = detailLevel 

TransactionManager.Instance.EnsureInTransaction(doc)
for view in views:
	try:
		view.DetailLevel=viewDetail
		success=True
	except:success=False
TransactionManager.Instance.TransactionTaskDone()

OUT=views,success
# ----------------------------------------
code_block = CodeBlock(x=python_script) { x[0]; x[1]; }
View = Output(code_block.out0)
Success = Output(code_block.out1)
