# Dynamo custom node View Types.dyf (Dynamo 2.6.1.8786)
# category: GeniusLoci.View
# Enumerates the available view types.

view_type = Python()
# ---------- view_type.python (11 lines) ----------
import clr
# Import RevitAPI
clr.AddReference("RevitAPI")
import Autodesk
from Autodesk.Revit.DB import *
import System

viewTypes = [strview.ToString() for strview in System.Enum.GetValues(Autodesk.Revit.DB.ViewType)]
viewTypes.Add("View Template")

OUT = sorted(viewTypes)
# ----------------------------------------
ViewType = Output(view_type)
