# Dynamo custom node ViewSheetSet ByName.dyf (Dynamo 2.6.1.8786)
# category: GeniusLoci.Sheet
# Collect ViewSheetSet by given name in the active or given document.

ViewSheetSetName = Input(ViewSheetSetName: var[]..[])  # String
docOrRevitLinkInstance = Input(docOrRevitLinkInstance: var = null)  # Use only if you want to query a linked model
python_script = Python(IN[0]=ViewSheetSetName, IN[1]=docOrRevitLinkInstance)
# ---------- python_script.python (36 lines) ----------
import clr
clr.AddReference('RevitServices')
from RevitServices.Persistence import DocumentManager
clr.AddReference('RevitAPI')
from Autodesk.Revit.DB import FilteredElementCollector, ViewSheetSet, RevitLinkInstance, Document

# Part of script from Clockwork
inputdoc = UnwrapElement(IN[1])
if inputdoc == None:
	doc = DocumentManager.Instance.CurrentDBDocument
elif isinstance (inputdoc, RevitLinkInstance) :
	doc = inputdoc.GetLinkDocument()
elif isinstance (inputdoc, Document) :
	doc = inputdoc
else: doc = DocumentManager.Instance.CurrentDBDocument

def tolist(obj1):
	if hasattr(obj1,"__iter__"): return obj1
	else: return [obj1]

names = tolist(IN[0])
outList = []

viewSheets = {}
viewSets = FilteredElementCollector(doc).OfClass(ViewSheetSet)
for viewSet in viewSets:
	viewSheets[viewSet.Name] = viewSet

for name in names:
	for key in viewSheets.keys():
		if key == name:
			outList.append(viewSheets[name])
			break

if isinstance(IN[0], list): OUT = outList
else: OUT = outList[0]
# ----------------------------------------
ViewSheetSet = Output(python_script)
