# Dynamo custom node Wall ByCurveAndLevel.dyf (Dynamo 2.6.1.8786)
# category: GeniusLoci.CompoundStructure
# Creates a wall using the specified guiding curve and level.

curve = Input(curve: var[]..[])
Height = Input(Height: double[]..[] = null)
level = Input(level: var[]..[])
wallType = Input(wallType: var[]..[] = null)
WallLocation = Input(WallLocation: string[]..[] = "WallCenterline")
Flip = Input(Flip: bool[]..[] = false)
IsStructural = Input(IsStructural: bool[]..[] = false)
byCurveAndLevel = Python(IN[0]=curve, IN[1]=Height, IN[2]=level, IN[3]=wallType, IN[4]=WallLocation, IN[5]=Flip, IN[6]=IsStructural)  # "Wall.ByCurveAndLevel"
# ---------- byCurveAndLevel.python (69 lines) ----------
#Alban de Chasteigner 2019
#twitter : @geniusloci_bim
#geniusloci.bim@gmail.com
#https://github.com/albandechasteigner/GeniusLociForDynamo

import clr
clr.AddReference('RevitServices')
import RevitServices
from RevitServices.Persistence import DocumentManager
from RevitServices.Transactions import TransactionManager
doc = DocumentManager.Instance.CurrentDBDocument
uiapp = DocumentManager.Instance.CurrentUIApplication
app = uiapp.Application
version=int(app.VersionNumber)

clr.AddReference('RevitAPI')
import Autodesk
from Autodesk.Revit.DB import *

clr.AddReference('RevitNodes')
import Revit
clr.ImportExtensions(Revit.Elements)
clr.ImportExtensions(Revit.GeometryConversion)

if version < 2021:
	UIunit = doc.GetUnits().GetFormatOptions(UnitType.UT_Length).DisplayUnits
else:
	UIunit = doc.GetUnits().GetFormatOptions(SpecTypeId.Length).GetUnitTypeId()

lines = IN[0] if isinstance(IN[0],list) else [IN[0]]
height=IN[1]
level = UnwrapElement(IN[2])
type = UnwrapElement(IN[3])
location = IN[4]
flip=IN[5]
Struc = IN[6]
ele = []

if location == "WallCenterline":
	locationLine=0
elif location == "CoreCenterline":
	locationLine=1
elif location == "FinishFaceExterior":
	locationLine=2	
elif location == "FinishFaceInterior":
	locationLine=3	
elif location == "CoreExterior":
	locationLine=4
elif location == "CoreInterior":
	locationLine=5
else:
	locationLine=0
TransactionManager.Instance.EnsureInTransaction(doc)
for i in lines:
	if height != None:
		wall = Wall.Create(doc,i.ToRevitType(),type.Id,level.Id,(UnitUtils.ConvertToInternalUnits(height,UIunit)),0,flip,Struc)
	else :
		wall = Wall.Create(doc,i.ToRevitType(),level.Id,Struc)
		if type != None:
			wall.ChangeTypeId(type.Id)
		else:
			pass
	location = wall.get_Parameter(BuiltInParameter.WALL_KEY_REF_PARAM)
	location.Set(locationLine)
	ele.append(wall)	
TransactionManager.Instance.TransactionTaskDone()

if isinstance(IN[0], list): OUT = ele 
else: OUT = ele[0]
# ----------------------------------------
Wall = Output(byCurveAndLevel)
