# Dynamo custom node Wall Edges References.dyf (Dynamo 2.6.1.8786)
# category: GeniusLoci.Reference
# Get the vertical and horizontal edges and their references from the exterior and interior faces.
# Also works with linked walls.

wall = Input(wall: var[]..[])
python_script = Python(IN[0]=wall)
# ---------- python_script.python (70 lines) ----------
#Alban de Chasteigner 2019
#twitter : @geniusloci_bim
#geniusloci.bim@gmail.com

import clr
clr.AddReference('RevitAPI')
import Autodesk
from Autodesk.Revit.DB import *

clr.AddReference('RevitNodes')
import Revit
clr.ImportExtensions(Revit.GeometryConversion)

def isAlmostEqualTo(v1, v2):
    return v1.IsAlmostEqualTo(v2)

def isParallel(v1,v2):
  return v1.CrossProduct(v2).IsAlmostEqualTo(XYZ(0,0,0))

items = UnwrapElement(IN[0])
if not hasattr(items, '__iter__'):
	items = [items]

extFaces,intFaces,allExtEdges,allIntEdges,allExtReferences,allIntReferences,allextHEdges,allextHReferences,allintHEdges,allintHReferences=[],[],[],[],[],[],[],[],[],[]

opt = Options()
opt.ComputeReferences = True
opt.IncludeNonVisibleObjects = True
for item in items:
	extSide = HostObjectUtils.GetSideFaces(item,ShellLayerType.Exterior)
	for e in extSide:
		extFace = item.GetGeometryObjectFromReference(e)
		extFaces.append(extFace)
	intSide = HostObjectUtils.GetSideFaces(item,ShellLayerType.Interior)
	for i in intSide:
		intFace = item.GetGeometryObjectFromReference(i)
		intFaces.append(intFace)
	for obj in item.get_Geometry(opt):
		extEdges,intEdges,extReferences,intReferences,extHEdges,extHReferences,intHEdges,intHReferences=[],[],[],[],[],[],[],[]
		if isinstance(obj, Solid):	
			for edges in obj.Edges:
				if round(edges.AsCurve().GetEndPoint(0).ToPoint().Z,10) != round(edges.AsCurve().GetEndPoint(1).ToPoint().Z,10):
					if edges.GetFace(0) in extFaces :
						extEdges.append(edges.AsCurve().ToProtoType())
						extReferences.append(edges.Reference)
					if edges.GetFace(0) in intFaces :
						intEdges.append(edges.AsCurve().ToProtoType())
						intReferences.append(edges.Reference)
				else :
					line = item.Location.Curve
					lineDir = line.GetEndPoint(1) - line.GetEndPoint(0)
					if not isinstance(edges.AsCurve(), Arc):
						faceNormal = edges.AsCurve().Direction.Normalize()
						if isParallel(faceNormal,lineDir):
							if edges.GetFace(0) in extFaces :
								extHEdges.append(edges.AsCurve().ToProtoType())
								extHReferences.append(edges.Reference)
							if edges.GetFace(0) in intFaces :
								intHEdges.append(edges.AsCurve().ToProtoType())
								intHReferences.append(edges.Reference)					
			allExtEdges.append(extEdges)
			allIntEdges.append(intEdges)
			allExtReferences.append(extReferences)
			allIntReferences.append(intReferences)
			allextHEdges.append(extHEdges)
			allextHReferences.append(extHReferences)
			allintHEdges.append(intHEdges)
			allintHReferences.append(intHReferences)
if isinstance(IN[0], (list)): OUT = filter(None, allExtEdges),filter(None,allExtReferences),filter(None,allIntEdges),filter(None,allIntReferences),filter(None,allextHEdges),filter(None,allextHReferences),filter(None,allintHEdges),filter(None,allintHReferences)
else: OUT = filter(None, allExtEdges)[0],filter(None,allExtReferences)[0],filter(None,allIntEdges)[0],filter(None,allIntReferences)[0],filter(None,allextHEdges)[0],filter(None,allextHReferences)[0],filter(None,allintHEdges)[0],filter(None,allintHReferences)[0]
# ----------------------------------------
code_block = CodeBlock(x=python_script) { x[0]; x[1]; x[2]; x[3]; x[4]; x[5]; x[6]; x[7]; }
Exterior_Side_Vertical_Edges = Output(code_block.out0)
Exterior_Side_Vertical_References = Output(code_block.out1)
Interior_Side_Vertical_Edges = Output(code_block.out2)
Interior_Side_Vertical_References = Output(code_block.out3)
Exterior_Side_Horizontal_Edges = Output(code_block.out4)
Exterior_Side_Horizontal_References = Output(code_block.out5)
Interior_Side_Horizontal_Edges = Output(code_block.out6)
Interior_Side_Horizontal_References = Output(code_block.out7)
