# Dynamo custom node Wall's Elevation Profile.dyf (Dynamo 2.6.1.8786)
# category: GeniusLoci.CompoundStructure
# Obtains the curves which bound the wall's elevation profile.
# Only works with a wall whose profile has been edited.

wall = Input(wall: var[]..[])
python_script = Python(IN[0]=wall)
# ---------- python_script.python (33 lines) ----------
#Alban de Chasteigner 2019
#twitter : @geniusloci_bim
#geniusloci.bim@gmail.com

import clr
clr.AddReference('RevitAPI')
import Autodesk
from Autodesk.Revit.DB import *

clr.AddReference('RevitNodes')
import Revit
clr.ImportExtensions(Revit.GeometryConversion)
clr.ImportExtensions(Revit.Elements)
from Revit.Elements import *

clr.AddReference('RevitAPIIFC')
from Autodesk.Revit.DB.IFC import *

walls = UnwrapElement(IN[0]) if isinstance(IN[0],list) else [UnwrapElement(IN[0])]

curvess=[]
for wall in walls :
	if ExporterIFCUtils.HasElevationProfile(wall):
		profile = ExporterIFCUtils.GetElevationProfile(wall)
		for curve in profile:
			curves=[]
			for curv in curve:
				curves.append(curv.ToProtoType())
			curvess.append(curves)
	else:
		pass
		
OUT = curvess
# ----------------------------------------
Curves = Output(python_script)
