# Dynamo custom node Workset ById.dyf (Dynamo 2.6.1.8786)
# category: GeniusLoci.Workset
# Retrieves the workset by Id.

WorksetId = Input(WorksetId: int[]..[])  # Integer
python_script = Python(IN[0]=WorksetId)
# ---------- python_script.python (30 lines) ----------
#Alban de Chasteigner 2021
#twitter : @geniusloci_bim
#geniusloci.bim@gmail.com
#https://github.com/albandechasteigner/GeniusLociForDynamo

import clr
# Import DocumentManager and TransactionManager
clr.AddReference("RevitServices")
import RevitServices
from RevitServices.Persistence import DocumentManager
doc = DocumentManager.Instance.CurrentDBDocument
# Import RevitAPI
clr.AddReference("RevitAPI")
import Autodesk
from Autodesk.Revit.DB import WorksetId

ids = IN[0] if isinstance(IN[0],list) else [IN[0]]
wks, names = [],[]

for worksetId in ids :
	try:
		workset=doc.GetWorksetTable().GetWorkset(WorksetId(worksetId))
		wks.append(workset)
		names.append(workset.Name)
	except:
		wks.append(None)
		names.append(None)
		
if isinstance(IN[0], list): OUT = wks, names
else: OUT = wks[0], names[0]
# ----------------------------------------
code_block = CodeBlock(x=python_script) { x[0]; x[1]; }
Workset = Output(code_block.out0)
WorksetName = Output(code_block.out1)
