# Dynamo custom node Workset ByName.dyf (Dynamo 2.13.1.3887)
# category: GeniusLoci.Workset
# Retrieves the workset by the given name.

WorksetName = Input(WorksetName: string[]..[])
python_script = Python(IN[0]=WorksetName)  # IronPython2
# ---------- python_script.python (25 lines) ----------
#Alban de Chasteigner 2020
#twitter : @geniusloci_bim
#geniusloci.bim@gmail.com

import clr
# Import DocumentManager and TransactionManager
clr.AddReference("RevitServices")
import RevitServices
from RevitServices.Persistence import DocumentManager
doc = DocumentManager.Instance.CurrentDBDocument
# Import RevitAPI
clr.AddReference("RevitAPI")
import Autodesk
from Autodesk.Revit.DB import *

worksets = IN[0] if isinstance(IN[0],list) else [IN[0]]
wks, ids = [],[]
userWorksets = FilteredWorksetCollector(doc).OfKind(WorksetKind.UserWorkset).ToWorksets()

for workset in worksets :
	wks.append(next((ws for ws in userWorksets if ws.Name.lower() == workset.lower()), None))
	ids.append(next((ws.Id.IntegerValue for ws in userWorksets if ws.Name.lower() == workset.lower()), None))
	
if isinstance(IN[0], list): OUT = wks, ids
else: OUT = wks[0], ids[0]
# ----------------------------------------
code_block = CodeBlock(x=python_script) { x[0]; x[1]; }
Workset = Output(code_block.out0)
Id = Output(code_block.out1)  # Integer
