# Dynamo custom node 3DView Restore Orientation.dyf (Dynamo 1.3.4.6666)
# category: GeniusLoci.View
# Locks the view and restores its orientation.
# The 3D view must have been locked once.

ThreeDView = Input(ThreeDView: Revit.Elements.Views.View3D = Revit.Application.Document.Current.ActiveView)
n3dview_restore_orientation = Python(IN[0]=ThreeDView)  # "3DView Restore Orientation"
# ---------- n3dview_restore_orientation.python (43 lines) ----------
#Alban de Chasteigner 2018
#twitter : @geniusloci_bim
#geniusloci.bim@gmail.com

import clr
clr.AddReference('ProtoGeometry')
from Autodesk.DesignScript.Geometry import *

clr.AddReference("RevitNodes")
import Revit
clr.ImportExtensions(Revit.Elements)

clr.AddReference("RevitAPI")
import Autodesk

clr.AddReference("RevitServices")
import RevitServices
from RevitServices.Persistence import DocumentManager
from RevitServices.Transactions import TransactionManager

doc = DocumentManager.Instance.CurrentDBDocument

def ProcessList(_func, _list):
    return map( lambda x: ProcessList(_func, x) if type(x)==list else _func(x), _list )

def Unwrap(item):
    return UnwrapElement(item)

if isinstance(IN[0], list):
    views = ProcessList(Unwrap, IN[0])
else:
    views = [Unwrap(IN[0])]

TransactionManager.Instance.EnsureInTransaction(doc)
for view in views:
	locked=view.HasBeenLocked()
	if locked == True:
		view.RestoreOrientationAndLock()
	else:
		pass
TransactionManager.Instance.TransactionTaskDone()

OUT = views
# ----------------------------------------
ThreeDView_2 = Output(n3dview_restore_orientation)  # "ThreeDView"
