# Dynamo custom node 3DView To BoundingBox.dyf (Dynamo 1.3.4.6666)
# category: GeniusLoci.View
# Extract section boxes from desired 3D views, and convert them into bounding box element.
# Based on Amy Williams's script.

ThreeDView = Input(ThreeDView: Revit.Elements.Views.View3D = Revit.Application.Document.Current.ActiveView)
get_section_box_from_this_view = Python(IN[0]=ThreeDView)
# ---------- get_section_box_from_this_view.python (49 lines) ----------
#From Amy Williams
#https://forum.dynamobim.com/t/bounding-box-of-section-box-min-max-pts-z-values-dont-correspond-with-model-elevation/15776

import clr
# Import ToDSType(bool) extension method
clr.AddReference("RevitNodes")
import Revit
clr.ImportExtensions(Revit.GeometryConversion)
# Import RevitAPI
clr.AddReference("RevitAPI")
import Autodesk
from Autodesk.Revit.DB import *

def ProcessList(_func, _list):
    return map( lambda x: ProcessList(_func, x) if type(x)==list else _func(x), _list )

def Unwrap(item):
    return UnwrapElement(item)

if isinstance(IN[0], list):
    views = ProcessList(Unwrap, IN[0])
else:
    views = [Unwrap(IN[0])]

viewlist = []
sectionboxes = []

for view in views:
    viewlist.append(view)
    sectionbox = view.GetSectionBox()
    transform = sectionbox.Transform
    sboxoriginx = transform.Origin.X
    sboxoriginy = transform.Origin.Y
    sboxoriginz = transform.Origin.Z
    minx = sectionbox.Min.X + sboxoriginx
    maxx = sectionbox.Max.X + sboxoriginx
    miny = sectionbox.Min.Y + sboxoriginy
    maxy = sectionbox.Max.Y + sboxoriginy
    minz = sectionbox.Min.Z + sboxoriginz
    maxz = sectionbox.Max.Z + sboxoriginz
    bbox = BoundingBoxXYZ()
    bbox.Min = XYZ((minx), (miny), (minz))
    bbox.Max = XYZ((maxx), (maxy), (maxz))
    tsectionbox = bbox.ToProtoType()
    sectionboxes.append(tsectionbox)

#Assign your output to the OUT variable
if isinstance(IN[0], list): OUT = views, sectionboxes
else: OUT = views[0], sectionboxes[0]
# ----------------------------------------
code_block = CodeBlock(seq=get_section_box_from_this_view) { seq[0]; seq[1]; }
Views = Output(code_block.out0)
BoundingBox = Output(code_block.out1)
