# Dynamo custom node 3DView by BoundingBox.dyf (Dynamo 1.3.4.6666)
# category: GeniusLoci.View
# Use a boundingbox to create a new 3D View with a specified name.
# Note: Use the "Remove Special Characters from String" node to obtain a view name without prohibited characters.

boundingBox = Input()  # Future Section box
viewName = Input()
python_script = Python(IN[0]=boundingBox, IN[1]=viewName)
# ---------- python_script.python (48 lines) ----------
import clr
clr.AddReference('RevitAPI')
import Autodesk
from Autodesk.Revit.DB import *

clr.AddReference('RevitNodes')
import Revit
clr.ImportExtensions(Revit.GeometryConversion)

clr.AddReference('RevitServices')
import RevitServices
from RevitServices.Persistence import DocumentManager
from RevitServices.Transactions import TransactionManager
doc = DocumentManager.Instance.CurrentDBDocument

def tolist(obj1):
    if hasattr(obj1,"__iter__"): return obj1
    else: return [obj1]

bboxs = tolist(IN[0])
viewNames = tolist(IN[1])
views=[]

#Get 3D View ViewFamilyType
viewTypeColl = FilteredElementCollector(doc).OfClass(ViewFamilyType)
for i in viewTypeColl:
	if i.ViewFamily == ViewFamily.ThreeDimensional:
		viewType = i
	else:
		continue

for bbox,viewName in zip(bboxs,viewNames):
	newmax = UnwrapElement(bbox.MaxPoint).ToRevitType()
	newmin = UnwrapElement(bbox.MinPoint).ToRevitType()
	newbox = BoundingBoxXYZ()
	newbox.Max = newmax
	newbox.Min = newmin
	try:
		TransactionManager.Instance.EnsureInTransaction(doc)
		view = View3D.CreateIsometric(doc, viewType.Id)
		view.Name = viewName
		view.SetSectionBox(newbox)
		views.append(view)
		TransactionManager.Instance.TransactionTaskDone()
	except Exception, ex:
		views.append(ex.message)

OUT = views
# ----------------------------------------
Views = Output(python_script)
