# Dynamo custom node Align Tag with CropRegion.dyf (Dynamo 1.3.4.6666)
# category: GeniusLoci.Tag
# Aligns the tags with the Crop Region's boundaries of the view.
# By Cyril Poupin on Dynamo Forum

category = Input()  # Tag Category
offset = Input()  # Distance offset from Crop Region
python_script = Python(IN[0]=category, IN[1]=offset)
# ---------- python_script.python (71 lines) ----------
#By Cyril Poupin on Dynamo Forum
#https://forum.dynamobim.com/t/room-tags-should-be-outside-the-crop-region/57507/5

import clr
clr.AddReference('ProtoGeometry')
from Autodesk.DesignScript.Geometry import *
import Autodesk.DesignScript.Geometry as DS

clr.AddReference('RevitAPI')
import Autodesk
from Autodesk.Revit.DB import *

clr.AddReference('RevitServices')
import RevitServices
from RevitServices.Persistence import DocumentManager
from RevitServices.Transactions import TransactionManager
doc = DocumentManager.Instance.CurrentDBDocument

clr.AddReference("RevitNodes")
import Revit
clr.ImportExtensions(Revit.GeometryConversion)

def moveTgtoCrop(boundLines, rtag):
	if isinstance(rtag,SpatialElementTag):
		ptTag = rtag.Location.Point
	elif isinstance(rtag,IndependentTag):
		ptTag = rtag.TagHeadPosition
	lstInter = []
	for lineBound in boundLines:
		interResult = lineBound.Project(ptTag)
		lstInter.append(interResult)
	lstInter.sort(key = lambda x : ptTag.DistanceTo(x.XYZPoint))
	firsttInterResult = lstInter[0]
	rtag.TagHeadPosition = firsttInterResult.XYZPoint
	#move location to update TagHeadPosition
	rtag.Location.Move(XYZ(0.001,0.001,0))

def getBoundLines(bbx, Zvalue, offsetCrop = 1):
	lstPt = []
	lstLine = []
	lstPt.append(XYZ(bbx.Min.X, bbx.Min.Y, Zvalue))
	lstPt.append(XYZ(bbx.Max.X, bbx.Min.Y, Zvalue))
	lstPt.append(XYZ(bbx.Max.X, bbx.Max.Y, Zvalue))
	lstPt.append(XYZ(bbx.Min.X, bbx.Max.Y, Zvalue))
	for idx, pt in enumerate(lstPt):
		if idx == 0:
			lstLine.append(Line.CreateBound(lstPt[- 1], pt))
		else:	
			lstLine.append(Line.CreateBound(lstPt[idx - 1], pt))		
	polycuDS = DS.PolyCurve.ByJoinedCurves([x.ToProtoType()  for x in lstLine])	
	polycuDS = polycuDS.Offset(offsetCrop)
	rvtLines = [x.ToRevitType() for x in polycuDS.Explode()]
	return rvtLines		

category=UnwrapElement(IN[0])
offsetCrop = IN[1]
activView = doc.ActiveView
cropBox = activView.CropBox 
viewRange = activView.GetViewRange()
cutOffset = viewRange.GetOffset(PlanViewPlane.CutPlane)

fecRoomTg = FilteredElementCollector(doc, activView.Id).OfCategoryId(category.Id).ToElements()
	
boundLines = getBoundLines(cropBox, cutOffset, offsetCrop)
TransactionManager.Instance.EnsureInTransaction(doc)
for rtag in fecRoomTg:
	rtag.HasLeader = True
	moveTgtoCrop(boundLines, rtag)
TransactionManager.Instance.TransactionTaskDone()

OUT = fecRoomTg
# ----------------------------------------
Tag = Output(python_script)
