# Dynamo custom node Collector of FillPatternElement.dyf (Dynamo 1.3.4.6666)
# category: GeniusLoci.FillPattern
# Collect Fill Pattern Elements and separate the pattern types between Drafting and Model.

get_fillpatterns = Python()
# ---------- get_fillpatterns.python (32 lines) ----------
#Alban de Chasteigner, 2018
#geniusloci.bim@gmail.com

import clr
clr.AddReference("RevitAPI")
import Autodesk
from Autodesk.Revit.DB import *

clr.AddReference("RevitServices")
import RevitServices
from RevitServices.Persistence import DocumentManager
doc = DocumentManager.Instance.CurrentDBDocument

fillpatterns = FilteredElementCollector(doc).OfClass(FillPatternElement)

draft = []
model = []
draftid = []
modelid = []

for fillpattern in fillpatterns:
	fpt=fillpattern.GetFillPattern()
	if fpt.Target == FillPatternTarget.Drafting :
		draft.append(fillpattern)
		#draftid.append(fillpattern.Id)
		draftid.append(fillpattern.Name)
	elif fpt.Target == FillPatternTarget.Model:
		model.append(fillpattern)
		#modelid.append(fillpattern.Id)
		modelid.append(fillpattern.Name)
		
OUT = draft,model,draftid,modelid
# ----------------------------------------
code_block = CodeBlock(x=get_fillpatterns) { x[0]; x[1]; x[2]; x[3]; }
Drafting_Pattern = Output(code_block.out0)
Model_Pattern = Output(code_block.out1)
DraftingPatternName = Output(code_block.out2)
ModelPatternName = Output(code_block.out3)
