# Dynamo custom node Collector of Levels.dyf (Dynamo 1.3.4.6666)
# category: GeniusLoci.Level
# Collects the levels in the active or given document and sort them by elevation.

docOrRevitLinkInstance = Input(docOrRevitLinkInstance : var = null)  # Use only if you want to query a linked model
python_script = Python(IN[0]=docOrRevitLinkInstance)
# ---------- python_script.python (42 lines) ----------
#Alban de Chasteigner 2018
#twitter : @geniusloci_bim
#geniusloci.bim@gmail.com

import clr
# Import RevitAPI
clr.AddReference("RevitAPI")
import Autodesk
from Autodesk.Revit.DB import *

# Import DocumentManager and TransactionManager
clr.AddReference("RevitServices")
import RevitServices
from RevitServices.Persistence import DocumentManager

uiapp = DocumentManager.Instance.CurrentUIApplication
app = uiapp.Application
version=int(app.VersionNumber)

#Part of script from Clockwork
inputdoc = UnwrapElement(IN[0])
if inputdoc == None:
	doc = DocumentManager.Instance.CurrentDBDocument
elif isinstance (inputdoc, RevitLinkInstance) :
	doc = inputdoc.GetLinkDocument()
elif isinstance (inputdoc, Document) :
	doc = inputdoc
else: doc = None

if version <2021:
	UIunit = doc.GetUnits().GetFormatOptions(UnitType.UT_Length).DisplayUnits
else:
	UIunit = doc.GetUnits().GetFormatOptions(SpecTypeId.Length).GetUnitTypeId()

levels = FilteredElementCollector(doc).OfClass(Level).ToElements()
sortedLevels = sorted(levels,key=lambda level : level.Elevation, reverse=True)

names=[level.Name for level in sortedLevels]
elevations=[round(UnitUtils.ConvertFromInternalUnits(level.Elevation,UIunit),6) for level in sortedLevels]
projectElevations=[round(UnitUtils.ConvertFromInternalUnits(level.ProjectElevation,UIunit),6) for level in sortedLevels]

OUT = sortedLevels, names, elevations, projectElevations
# ----------------------------------------
code_block = CodeBlock(x=python_script) { x[0]; x[1]; x[2]; x[3]; }
Element = Output(code_block.out0)
Name = Output(code_block.out1)
Elevation = Output(code_block.out2)
ProjectElevation = Output(code_block.out3)  # Elevation relative to project origin
