# Dynamo custom node Collector of PlacedViews.dyf (Dynamo 1.3.4.6666)
# category: GeniusLoci.View
# This node will collect all views placed on sheets in the active or given document.

docOrRevitLinkInstance = Input(docOrRevitLinkInstance : var = null)  # Use only if you want to query a linked model
placed_views = Python(IN[0]=docOrRevitLinkInstance)
# ---------- placed_views.python (49 lines) ----------
import clr
clr.AddReference("RevitServices")
from RevitServices.Persistence import DocumentManager
clr.AddReference("RevitNodes")
import Revit
clr.ImportExtensions(Revit.Elements)
clr.AddReference("RevitAPI")
from Autodesk.Revit.DB import *

def tolist(obj1):
	if hasattr(obj1,"__iter__"): return obj1
	else: return [obj1]

def GetPrimaryView(view):
	return view.Document.GetElement(view.GetPrimaryViewId())

#Part of script from Clockwork
inputdoc = UnwrapElement(IN[0])
if inputdoc == None:
	doc = DocumentManager.Instance.CurrentDBDocument
elif inputdoc.GetType().ToString() == "Autodesk.Revit.DB.RevitLinkInstance":
	doc = inputdoc.GetLinkDocument()
elif inputdoc.GetType().ToString() == "Autodesk.Revit.DB.Document":
	doc = inputdoc
else: doc = DocumentManager.Instance.CurrentDBDocument

allScheds,legends,sheetInstances = [],[], []

sheets = FilteredElementCollector(doc).OfCategory(BuiltInCategory.OST_Sheets).ToElements()

schedSheets = FilteredElementCollector(doc).OfClass(ScheduleSheetInstance).ToElements()

for s in schedSheets:
	if s.IsTitleblockRevisionSchedule is False:
		sched = doc.GetElement(s.ScheduleId)
		allScheds.append(sched)

for i in sheets:
	viewsid = i.GetAllPlacedViews()
	views = [doc.GetElement(v) for v in viewsid]
	for w in views:
		if w.ViewType == ViewType.Legend:
			legends.append(w)
		else:
			sheetInstances.append(w)
			
parents = [GetPrimaryView(x) for x in sheetInstances]

OUT = sheetInstances, allScheds, legends, filter(None, parents)
# ----------------------------------------
code_block = CodeBlock(list=placed_views) { list[0]; DSCore.List.UniqueItems(list[1]); DSCore.List.UniqueItems(list[2]); list[3]; }
View = Output(code_block.out0)
Schedule = Output(code_block.out1)
Legend = Output(code_block.out2)
ParentView = Output(code_block.out3)
code_block_2 = CodeBlock(l1=code_block.out0, l2=code_block.out1, l3=code_block.out2) { DSCore.List.Flatten({l1,l2,l3},-1); }
All_Placed_Views = Output(code_block_2)
