# Dynamo custom node Collector of Print Settings.dyf (Dynamo 1.3.4.6666)
# category: GeniusLoci.Printing
# Collects printsettings and their names in the active or given document.
# Inspired by an archilab node.

docOrRevitLinkInstance = Input(docOrRevitLinkInstance : var = null)  # Use only if you want to query a linked model
printsettings = Python(IN[0]=docOrRevitLinkInstance)
# ---------- printsettings.python (27 lines) ----------
#Copyright(c) 2015, Konrad Sobon
# @arch_laboratory, http://archi-lab.net

import clr

clr.AddReference("RevitServices")
import RevitServices
from RevitServices.Persistence import DocumentManager

clr.AddReference("RevitAPI")
import Autodesk
from Autodesk.Revit.DB import *

inputdoc = UnwrapElement(IN[0])

#Part of script from Clockwork
if inputdoc == None:
	doc = DocumentManager.Instance.CurrentDBDocument
elif inputdoc.GetType().ToString() == "Autodesk.Revit.DB.RevitLinkInstance":
	doc = inputdoc.GetLinkDocument()
elif inputdoc.GetType().ToString() == "Autodesk.Revit.DB.Document":
	doc = inputdoc
else: doc = None

ps = FilteredElementCollector(doc).OfClass(PrintSetting)

OUT = [i for i in ps],[i.Name for i in ps]
# ----------------------------------------
code_block = CodeBlock(x=printsettings) { x[0]; x[1]; }
Printsetting = Output(code_block.out0)
Printsetting_s_name = Output(code_block.out1)  # "Printsetting's name"
