# Dynamo custom node Collector of UserWorksets.dyf (Dynamo 1.3.4.6666)
# category: GeniusLoci.Workset
# Retrieves the UserWorksets and their proprieties in the active or given document.

docOrRevitLinkInstance = Input(docOrRevitLinkInstance : var = null)  # Use only if you want to query a linked model
get_user_worksets = Python(IN[0]=docOrRevitLinkInstance)
# ---------- get_user_worksets.python (36 lines) ----------
import clr
clr.AddReference('RevitAPI')
from Autodesk.Revit.DB import *
import Autodesk

clr.AddReference("RevitServices")
import RevitServices
from RevitServices.Persistence import DocumentManager

#Part of script from Clockwork
inputdoc = UnwrapElement(IN[0])
if inputdoc == None:
	doc = DocumentManager.Instance.CurrentDBDocument
elif inputdoc.GetType().ToString() == "Autodesk.Revit.DB.RevitLinkInstance":
	doc = inputdoc.GetLinkDocument()
elif inputdoc.GetType().ToString() == "Autodesk.Revit.DB.Document":
	doc = inputdoc
else: doc = None

names,ids,owners,wsIsOpens, wsIsVis, wsIsDefault=[],[], [], [], [], []
#Collect worksets
userWorksets = FilteredWorksetCollector(doc).OfKind(WorksetKind.UserWorkset).ToWorksets()
for userWorkset in userWorksets:
	names.append(userWorkset.Name)
	ids.append(userWorkset.Id)
	owners.append(userWorkset.Owner)
	wsIsOpens.append(userWorkset.IsOpen)
	wsIsVis.append(userWorkset.IsVisibleByDefault)
	if userWorkset.IsDefaultWorkset ==True:
		wsIsDefault.append(userWorkset.Name)

worksetTable = doc.GetWorksetTable()
activeWs = worksetTable.GetWorkset(worksetTable.GetActiveWorksetId()).Name

#Assign your output to the OUT variable
OUT = userWorksets, names, ids, owners, wsIsOpens, wsIsVis, wsIsDefault,activeWs
# ----------------------------------------
code_block = CodeBlock(x=get_user_worksets) { x[0]; x[1]; x[2]; x[3]; x[4]; x[5]; x[6]; x[7]; }
Worksets = Output(code_block.out0)
Worksets_Names = Output(code_block.out1)
Ids = Output(code_block.out2)
Owner = Output(code_block.out3)
IsOpen = Output(code_block.out4)
IsVisibleByDefault = Output(code_block.out5)
DefaultWorkset = Output(code_block.out6)
ActiveWorkset = Output(code_block.out6)
