# Dynamo custom node Collector of Views.dyf (Dynamo 1.3.4.6666)
# category: GeniusLoci.View
# Collects all views in the active or given document.

docOrRevitLinkInstance = Input(docOrRevitLinkInstance : var = null)  # Use only if you want to query a linked model
list_all_views = Python(IN[0]=docOrRevitLinkInstance)
# ---------- list_all_views.python (49 lines) ----------
#Alban de Chasteigner 2018
#twitter : @geniusloci_bim
#geniusloci.bim@gmail.com

import clr
# Import DocumentManager and TransactionManager
clr.AddReference("RevitServices")
import RevitServices
from RevitServices.Persistence import DocumentManager
doc = DocumentManager.Instance.CurrentDBDocument
# Import RevitAPI
clr.AddReference("RevitAPI")
import Autodesk
from Autodesk.Revit.DB import *

# Import ToDSType(bool) extension method
clr.AddReference("RevitNodes")
import Revit
clr.ImportExtensions(Revit.Elements)

#Part of script from Clockwork
inputdoc = UnwrapElement(IN[0])
if inputdoc == None:
	doc = DocumentManager.Instance.CurrentDBDocument
elif isinstance (inputdoc, RevitLinkInstance) :
	doc = inputdoc.GetLinkDocument()
elif isinstance (inputdoc, Document) :
	doc = inputdoc
else: doc = None

views = FilteredElementCollector(doc).OfClass(View).ToElements()

allViews,legends,schedules, drawingSheets=[], [], [], []

for i in views:
	if not i.IsTemplate:
		if i.ViewType != ViewType.Schedule and i.ViewType != ViewType.Legend and i.ViewType != ViewType.DrawingSheet and i.ViewType != ViewType.ProjectBrowser and i.ViewType != ViewType.SystemBrowser:
			allViews.append(i.ToDSType(True))
		elif i.ViewType == ViewType.Schedule:
			if not i.IsTitleblockRevisionSchedule :
				schedules.append(i.ToDSType(True))
		elif i.ViewType == ViewType.Legend:
			legends.append(i.ToDSType(True))
		elif i.ViewType == ViewType.DrawingSheet:
			drawingSheets.append(i.ToDSType(True))
		else:
			continue

OUT = allViews, schedules, legends, drawingSheets, (allViews+legends+schedules)
# ----------------------------------------
code_block = CodeBlock(x=list_all_views) { x[0]; x[1]; x[2]; x[3]; x[4]; }
View = Output(code_block.out0)
Schedule = Output(code_block.out1)
Legend = Output(code_block.out2)
Sheet = Output(code_block.out3)
Without_Sheet_All_Views = Output(code_block.out4)  # "(Without Sheet) All Views"
