# Dynamo custom node ColorFill Scheme RemoveEntry.dyf (Dynamo 2.0.4.12684)
# category: GeniusLoci.ColorScheme
# Works only in Revit 2022 and later.
# Removes unused entries from the given color scheme.

colorFillScheme = Input(colorFillScheme: var[]..[])  # ColorFillScheme element or ColorFillScheme Name
entry = Input(entry: var[]..[])  # Autodesk.Revit.DB.ColorFillSchemeEntry. The entry can not be removed if it is in use.
python_script = Python(IN[0]=colorFillScheme, IN[1]=entry)
# ---------- python_script.python (34 lines) ----------
#Alban de Chasteigner 2021
#twitter : @geniusloci_bim
#geniusloci.bim@gmail.com
#https://github.com/albandechasteigner/GeniusLociForDynamo
 
import clr
clr.AddReference('RevitAPI')
import Autodesk
from Autodesk.Revit.DB import *
clr.AddReference('RevitNodes')
import Revit
clr.AddReference('RevitServices')
import RevitServices
from RevitServices.Persistence import DocumentManager
from RevitServices.Transactions import TransactionManager
doc = DocumentManager.Instance.CurrentDBDocument

element = UnwrapElement(IN[0])
if isinstance(IN[1], list) : entries = UnwrapElement(IN[1])
else : entries = [UnwrapElement(IN[1])]

if isinstance(element, Autodesk.Revit.DB.ColorFillScheme):
	scheme = element
elif isinstance(element, basestring):
	scheme = FilteredElementCollector(doc).OfCategory(BuiltInCategory.OST_ColorFillSchema).ToElements().Find(lambda x : x.Name == element)
	
TransactionManager.Instance.EnsureInTransaction(doc)
for entry in entries:
	if scheme.CanRemoveEntry(entry):
		try:scheme.RemoveEntry(entry)	
		except:pass
TransactionManager.Instance.TransactionTaskDone()

OUT = scheme
# ----------------------------------------
ColorFillScheme = Output(python_script)
