# Dynamo custom node Convert text file.dyf (Dynamo 1.3.4.6666)
# category: GeniusLoci.Export
# Convert exported schedules from format Unicode to ANSI (or utf_8)

Filepath = Input(Filepath : string)
Format = Input(Format : string = "latin-1")
# note: https://docs.python.org/2/library/codecs.html#standard-encodings
python_script = Python(IN[0]=Filepath, IN[1]=Format)
# ---------- python_script.python (15 lines) ----------
import sys
sys.path.append(r'C:\Program Files (x86)\IronPython 2.7\Lib')
import codecs

filepath = IN[0]

with codecs.open(filepath, 'r', encoding = 'UTF-16') as file:
	lines = file.read()  

#write output file
with codecs.open(filepath, 'w', encoding = IN[1]) as file:
	file.write(lines)

#Affectez la sortie à la variable OUT.
OUT = "Success"
# ----------------------------------------
Result = Output(python_script)
