# Dynamo custom node Create Family Parameter.dyf (Dynamo 1.3.4.6666)
# category: GeniusLoci.Parameter
# Creates a family parameter in the active family.
# Can also be used to associate a label with a given dimension.

ParameterName = Input(ParameterName:var[]..[] = null)
ParameterType = Input(ParameterType:var[]..[] = null)  # String or DB.ParameterType
ParameterGroup = Input(ParameterGroup:var[]..[] = null)  # String or DB.BuiltInParameterGroup
IsInstance = Input(IsInstance:bool=false)  # Is instance parameter otherwise it's a type parameter
reporting = Input(reporting:bool=false)  # Is reporting parameter. This is only available with Length and Angle parameters
dimension = Input(dimension:var[]..[] = null)  # Use only to associate a label (parameter) with the dimension
familyParameter = Input(familyParameter:var[]..[] = null)  # Optional input to use with the dimension input
python_script = Python(IN[0]=ParameterName, IN[1]=ParameterType, IN[2]=ParameterGroup, IN[3]=IsInstance, IN[4]=reporting, IN[5]=dimension, IN[6]=familyParameter)
# ---------- python_script.python (47 lines) ----------
#Alban de Chasteigner 2020
#twitter : @geniusloci_bim
#geniusloci.bim@gmail.com

import clr
clr.AddReference('RevitAPI')
import Autodesk
from Autodesk.Revit.DB import *

clr.AddReference("RevitServices")
import RevitServices
from RevitServices.Persistence import DocumentManager
from RevitServices.Transactions import TransactionManager
doc = DocumentManager.Instance.CurrentDBDocument

paramName = IN[0]
parameterType = IN[1]
parameterGroup = IN[2]
instance = IN[3]
reporting = IN[4]
dimension = UnwrapElement(IN[5])
famParameter = UnwrapElement(IN[6])

TransactionManager.Instance.EnsureInTransaction(doc)
if famParameter == None:
	if isinstance(parameterGroup, basestring):
		exec("paramGroup = BuiltInParameterGroup.%s" % parameterGroup)
	else:
		paramGroup = parameterGroup
	
	if isinstance(parameterType, basestring):
		exec("paramType = ParameterType.%s" % parameterType)
	else :
		paramType = parameterType
		
	familyParam = doc.FamilyManager.AddParameter(paramName, paramGroup, paramType, instance)
	if reporting == True:
		doc.FamilyManager.MakeReporting(familyParam)
else:
	familyParam = famParameter

if dimension :
	dimension.FamilyLabel = familyParam
else:
	pass
TransactionManager.Instance.TransactionTaskDone()	
OUT = familyParam.Definition.Name
# ----------------------------------------
FamilyParameter_Name = Output(python_script)
