# Dynamo custom node Create Repeating Sequence.dyf "Repeating sequence for FillPattern" (Dynamo 2.0.3.8104)
# category: GeniusLoci.FillPattern
# Select a group of Revit Lines to produce a repeating sequence of angles, origins, shifts, offsets,
# dashes and spaces..
# For patterns that have a lot of blank space, it is possible to add a border.  Just type in the Line Style that you are using if one exists; it doesn't have to be square.
# The Slope Tolerance governs the available Angle at which the diagonal lines will be corrected. Feel free to increase it, but if a line family exceeds or 30 000 millimeters, the pattern will probably not been seen.
# Watch the Slope Tolerance Results to see why a FillPattern doesn't appear.
# Arc lines will fail.
# By dcmasten1 on forum.dynamobim.com

lines = Input(lines: var[]..[])  # Select a group of Revit lines

# group: Box Builder
curves = Element.Curves(element=lines)
code_block = CodeBlock(curve=curves)
# ---------- code_block.designscript (30 lines) ----------
//Box Builder
//  The Bounds of the Hatch do not need to be a Square.
//  Now more patterns are possible.

allPoints =
DSCore.List.Flatten([
Autodesk.DesignScript.Geometry.Curve.StartPoint(curve),
Autodesk.DesignScript.Geometry.Curve.EndPoint(curve)
],-1);

pointX = Autodesk.DesignScript.Geometry.Point.X(allPoints);
pointY = Autodesk.DesignScript.Geometry.Point.Y(allPoints);
minX = DSCore.List.MinimumItem(pointX);
minY = DSCore.List.MinimumItem(pointY);
maxX = DSCore.List.MaximumItem(pointX);
maxY = DSCore.List.MaximumItem(pointY);

//Pattern Origin
Autodesk.DesignScript.Geometry.Point.ByCoordinates(minX,minY);

//Pattern Width/Scale
patternWidth =
maxX-minX;

//Pattern Height
patternHeight =
maxY-minY;

//Bounds Ratio
patternHeight/patternWidth;
# ----------------------------------------

SlopeTolerance = Input(SlopeTolerance: int = 25)

# group: Available Line Types Generator
code_block_2 = CodeBlock(boundsRatio=code_block.out10, tolerance=SlopeTolerance)
# ---------- code_block_2.designscript (42 lines) ----------
//Available Line Types Generator
//This Node is Necessary to Prevent the occurrence of Diagonal Lines
//  with Irregular Slopes. If you plot a Line at just any Angle,
//  the Slope could be 1/854,239,645 and the Resulting Dash (to get
//  back to the same place on the grid) would be well over 1200 IN.
//  Line Families that exceed 1200 IN will not load!

riseSeq = (boundsRatio..#tolerance..boundsRatio);
rise = DSCore.List.Flatten(DSCore.List.OfRepeatedItem(riseSeq@L1<1>,tolerance),-1);
runSeq = (1..#tolerance..1);
run = DSCore.List.Flatten(DSCore.List.OfRepeatedItem(runSeq,tolerance),-1);
diagonal = DSCore.Math.Round(DSCore.Math.Sqrt(DSCore.Math.Pow(rise,2)+DSCore.Math.Pow(run,2)),7);
degrees = DSCore.Math.Round(DSCore.Math.Atan(rise/run),7);
ltIndex = DSCore.List.FirstIndexOf(degrees,DSCore.List.UniqueItems(degrees));

lineTypes =
DSCore.List.Flatten([
[[0,0,1,1]],
DSCore.List.Transpose([
DSCore.List.GetItemAtIndex(degrees,ltIndex),
DSCore.List.GetItemAtIndex(rise,ltIndex),
DSCore.List.GetItemAtIndex(run,ltIndex),
DSCore.List.GetItemAtIndex(diagonal,ltIndex)
]),
[[90,boundsRatio,0,boundsRatio]]
],1);

//Degrees
degreesSorted = DSCore.List.Sort(degreesCleaned);
degreesCleaned = DSCore.List.GetItemAtIndex(lineTypes@L2<1>, 0);
degreeIndex = DSCore.List.AllIndicesOf(degreesCleaned,degreesSorted);

//Diagonal
DSCore.List.GetItemAtIndex(
DSCore.List.GetItemAtIndex(lineTypes@L2<1>, 3),
degreeIndex);

//X Origin Multiplier
DSCore.List.GetItemAtIndex(DSCore.Math.Max(
DSCore.List.GetItemAtIndex(lineTypes@L2<1>, 1),
DSCore.List.GetItemAtIndex(lineTypes@L2<1>, 2)
),degreeIndex);
# ----------------------------------------
string_from_object = FromObject(obj=code_block_2.degreesSorted)
code_block_3 = CodeBlock(angles=string_from_object)
# ---------- code_block_3.designscript (7 lines) ----------
//Available Angles from X Axis
//  Any Diagonal Line will be
//  Corrected to one of these.
DSCore.List.Count(angles)+
" Available Angles: "+
DSCore.String.Join(", ",angles)+
" (from X Axis)";
# ----------------------------------------

# note: Created By: dcmasten1
# note: https://forum.dynamobim.com/t/create-hatch-pattern-from-selection/24001/42
notes = StringInput("""   This Graph will Write a Hatch Pattern Text File for any set of Straight Lines.

   Drag Select over a group of Lines in a Plan or Drafting View. For patterns that have a lot of Blank Space, you have the option to add a Border.  Just type in the Line Style that you are using if one exists; it need not be Square.

   The Slope Tolerance governs the available Angle that Diagonal Lines will be corrected to. Feel free to Increase it, but if a line family exceeds 1200 IN or 30000 MM, the pattern will probably not load! Watch the Slope Tolerance Results to see if a Hatch Pattern cannot be Loaded.""")  # graph input
BorderLineStyle = Input(BorderLineStyle: string = "Hidden Lines")

# group: Get Lines
parameters = Element.Parameters(element=lines)
string_from_object_2 = FromObject(obj=parameters)
code_block_4 = CodeBlock(input=BorderLineStyle)
# ---------- code_block_4.designscript (2 lines) ----------
//Border Line Style
"Line Style : "+input;
# ----------------------------------------
contains = String.Contains(str=string_from_object_2, searchFor=code_block_4)
allFalse = List.AllFalse(list=contains@L2)
filterByBoolMask = List.FilterByBoolMask(list=lines, mask=allFalse)
curves_2 = Element.Curves(element=filterByBoolMask.in)
length = Curve.Length(curve=curves_2)

# group: Correct Lines & Get Angle
code_block_5 = CodeBlock(originalCurves=curves_2)
# ---------- code_block_5.designscript (12 lines) ----------
//Original Line Direction
originalLineDir =
Autodesk.DesignScript.Geometry.Line.Direction(originalCurves);

//Original Angle from X Axis
angleFromX =
DSCore.Math.Round(
Autodesk.DesignScript.Geometry.Vector.AngleWithVector(
Autodesk.DesignScript.Geometry.Vector.XAxis(),
originalLineDir
),7);
originalCurves;
# ----------------------------------------
code_block_6 = CodeBlock(degreesSorted=code_block_2.degreesSorted, angleFromX=code_block_5.angleFromX)
# ---------- code_block_6.designscript (15 lines) ----------
//Corrected Index
DSCore.List.IndexOf(mapped@L2<1>,
DSCore.List.Chop(DSCore.List.MinimumItem(mapped), 1)@L2<1>
);
mapped =
DSCore.List.Chop(DSCore.List.Flatten(
DSCore.Math.Sqrt(DSCore.Math.Pow(
originalAngleFromX<1> - degreesSorted<2>,
2))
),DSCore.List.Count(degreesSorted));

originalAngleFromX =
angleFromX>90?
180-angleFromX:
angleFromX;
# ----------------------------------------
code_block_7 = CodeBlock(angleFromX=code_block_5.angleFromX, degreesSorted=code_block_2.degreesSorted, index=code_block_6.out0)
# ---------- code_block_7.designscript (8 lines) ----------
//Corrected Angle from X (0-180)
angleFromX > 90?
180-correctedAngleFromX:
correctedAngleFromX;

//Corrected Angle from X (0-90)
correctedAngleFromX =
DSCore.List.GetItemAtIndex(degreesSorted,index);
# ----------------------------------------
code_block_8 = CodeBlock(angle=code_block_7.out0, angleFromX=code_block_5.angleFromX, lineDir=code_block_5.originalLineDir)
# ---------- code_block_8.designscript (11 lines) ----------
//Corrected Angle
correctedAngle =
negY?angle*-1:angle;

//Angle Rotation
correctedAngle-
DSCore.Math.Round(
negY?angleFromX*-1:angleFromX,7);

//Check if Vector Y is Negative
negY = Autodesk.DesignScript.Geometry.Vector.Y(lineDir) < 0;
# ----------------------------------------
code_block_9 = CodeBlock(originalCurves=curves_2, length=length, rotation=code_block_8.out1)
# ---------- code_block_9.designscript (19 lines) ----------
//Corrected Start Points
Autodesk.DesignScript.Geometry.Curve.StartPoint(correctedLines);

//Corrected Lines
correctedLines = Autodesk.DesignScript.Geometry.Curve.ExtendStart(
Autodesk.DesignScript.Geometry.Line.ByStartPointDirectionLength(
Autodesk.DesignScript.Geometry.Curve.PointAtParameter(originalCurves,0.5),
correctedVector,
length/2),
length/2);

originalCurvesDir =
Autodesk.DesignScript.Geometry.Line.Direction(originalCurves);

//Corrected Vector
//(for finding Delta X & Y)
correctedVector =
Autodesk.DesignScript.Geometry.Vector.Rotate(originalCurvesDir,Autodesk.DesignScript.Geometry.Vector.ZAxis(),
rotation);
# ----------------------------------------

code_block_10 = CodeBlock { 1; }

# group: X Origin
code_block_11 = CodeBlock(patternSize=code_block.patternWidth, unitMult=code_block_10, origin=code_block.out7, startPoints=code_block_9.out0, mult=code_block_2.out12, index=code_block_6.out0)
# ---------- code_block_11.designscript (18 lines) ----------
//X Origin
//  A sequence is generated for each angle so that
//  a pattern with diagonal lines is not just
//  continuous allong the Y Axis.
xOrigin =
(start..#amount..patternSize);

DSCore.Math.Round(xOrigin*unitMult,7);

start =
Autodesk.DesignScript.Geometry.DistanceTo(
Autodesk.DesignScript.Geometry.Plane.ByOriginNormal(origin,Autodesk.DesignScript.Geometry.Vector.XAxis()),
startPoints);

amount =
runLengths == 0?1:runLengths;

runLengths = DSCore.List.GetItemAtIndex(mult, index);
# ----------------------------------------

# group: Y Origin
code_block_12 = CodeBlock(origin=code_block.out7, patternOrigin=code_block_9.out0, unitMult=code_block_10)
# ---------- code_block_12.designscript (7 lines) ----------
//Y Origin
yOrigin =
Autodesk.DesignScript.Geometry.Geometry.DistanceTo(
Autodesk.DesignScript.Geometry.Plane.ByOriginNormal(origin,Autodesk.DesignScript.Geometry.Vector.YAxis()),
patternOrigin);

DSCore.Math.Round(yOrigin*unitMult,7);
# ----------------------------------------

translate = Geometry.Translate(geometry=code_block_9.out0, yTranslation=code_block.patternHeight)

# group: Delta X
code_block_13 = CodeBlock(negY=code_block_8.negY, unitMult=code_block_10, origin=code_block_9.out0, normal=code_block_9.correctedVector, pointOffsetByY=translate)
# ---------- code_block_13.designscript (10 lines) ----------
//Delta X
deltaX =
negY?dX*-1:dX;

DSCore.Math.Round(deltaX*unitMult,7);

dX =
Autodesk.DesignScript.Geometry.Geometry.DistanceTo(
Autodesk.DesignScript.Geometry.Plane.ByOriginNormal(origin,normal),
pointOffsetByY);
# ----------------------------------------

# group: Delta Y
code_block_14 = CodeBlock(angle=code_block_7.out0, unitMult=code_block_10, size=code_block.patternWidth, origin=code_block_9.out0, vector=code_block_9.correctedVector, pointOffsetByY=translate)
# ---------- code_block_14.designscript (14 lines) ----------
//Delta Y
deltaY =
angle>90?dYFixed*-1:dYFixed;

DSCore.Math.Round(deltaY*unitMult,7);

dYFixed =
dY == 0?size:dY;

dY = Autodesk.DesignScript.Geometry.DistanceTo(
Autodesk.DesignScript.Geometry.Plane.ByOriginNormal(
origin,
Autodesk.DesignScript.Geometry.Vector.Rotate(vector,Autodesk.DesignScript.Geometry.Vector.ZAxis(),90)
),pointOffsetByY);
# ----------------------------------------

# group: Segment Length
code_block_15 = CodeBlock(segmentLength=length, unitMult=code_block_10)
# ---------- code_block_15.designscript (4 lines) ----------
//Line
segmentLength;

DSCore.Math.Round(segmentLength*unitMult,7);
# ----------------------------------------

# group: Dash Length
code_block_16 = CodeBlock(diagonal=code_block_2.out11, index=code_block_6.out0, box=code_block.patternWidth, segmentLength=length, unitMult=code_block_10)
# ---------- code_block_16.designscript (9 lines) ----------
//(-)Dash
dashLength =
(DSCore.List.GetItemAtIndex(
diagonal,index)*box)-segmentLength;

DSCore.String.Replace(
",-"+DSCore.Math.Round(dashLength*unitMult,7),
",-0.000000",
"");
# ----------------------------------------
code_block_17 = CodeBlock(DashLength=code_block_16.out1)
# ---------- code_block_17.designscript (2 lines) ----------
DSCore.String.Substring(DashLength, 1,
DSCore.String.Length(DashLength)-1);
# ----------------------------------------

code_block_18 = CodeBlock(direction=code_block_8.correctedAngle, xOrigin=code_block_11.out1, yOrigin=code_block_12.out1, DeltaX=code_block_13.out1, DeltaY=code_block_14.out1, SegmentLength=code_block_15.out1, DashLength=code_block_17)
# ---------- code_block_18.designscript (8 lines) ----------
//Create Line Families
direction+"*"+
xOrigin+"*"+
yOrigin+"*"+
DeltaX+"*"+
DeltaY+"*"+
SegmentLength+"*"+
DashLength;
# ----------------------------------------
code_block_19 = CodeBlock(strL=code_block_18)
# ---------- code_block_19.designscript (7 lines) ----------
//Remove Trailing Zeros
str01 = DSCore.String.Replace(
strL, ",", ".");
str02 = DSCore.String.Replace(
str01, "*", ",");
str03 = DSCore.String.Replace(
str02, ".000000", ".0");
# ----------------------------------------
flatten = List.Flatten(list=code_block_19.str03)
code_block_20 = CodeBlock { ","; }
split = String.Split(str=flatten, separater0=code_block_20)
toNumber = String.ToNumber(str=split)
transpose = List.Transpose(lists=toNumber)
code_block_21 = CodeBlock(x=transpose) { x[0]; x[1]; x[2]; x[3]; x[4]; x[5]; x[6]; }
Angles = Output(code_block_21.out0)  # Degrees
X_Origins = Output(code_block_21.out1)
Y_Origins = Output(code_block_21.out2)
Shifts = Output(code_block_21.out3)
Offsets = Output(code_block_21.out4)
Dashes = Output(code_block_21.out5)
Spaces = Output(code_block_21.out6)
code_block_22 = CodeBlock { "MM"; }

# group: SLope Tolerance Results
string = StringInput("\n")
code_block_23 = CodeBlock(segmentLength=code_block_15.segmentLength, dashLength=code_block_16.dashLength, units=code_block_22)
# ---------- code_block_23.designscript (12 lines) ----------
//Report Longest Line Family for Inches
longestLine>unitMax?
"WARNING! A line family exceeds "+unitMax+" "+measure+" ("+longestLine+" "+measure+"). This Pattern May Not Load, try a Lower Tolerance or Shrink your Sketch.":
"Longest Line Family: "+longestLine+" "+measure+" (Segment + Resulting Dash)";

longestLine = DSCore.List.MaximumItem((
DSCore.List.Flatten(segmentLength, -1)+
DSCore.List.Flatten(dashLength, -1))*unitMult);

measure = units=="INCH"? "INCH": "MM";
unitMult = units=="INCH"? 12: 1;
unitMax = units=="INCH"? 1200: 30000;
# ----------------------------------------
code_block_24 = CodeBlock(angleO=code_block_5.angleFromX, angleC=code_block_7.out0)
# ---------- code_block_24.designscript (11 lines) ----------
//Listed Angles with Paired Corrections
DSCore.String.Join("",DSCore.List.Flatten(
[
["From ("+DSCore.List.Count(DSCore.List.UniqueItems(angleO))+") Different Angles: "],
[DSCore.List.UniqueItems(DSCore.String.Replace("("+angleO+","+angleC+")",".000000",""))],
["(original,corrected)"]
]
, -1));
"Largest Correction: "+
DSCore.List.MaximumItem(DSCore.List.Flatten(angleO-angleC,-1))+
" Degrees";
# ----------------------------------------
join = String.Join(separator=string, string0=code_block_23.out0, string1=code_block_24.out0, string2=code_block_24.out1)

Slope_Tolerance_Results = Output(join)
