# Dynamo custom node Create Workset.dyf (Dynamo 1.3.4.6666)
# category: GeniusLoci.Workset
# Create user worksets by name.

name = Input(name:string[]..[])
python_script = Python(IN[0]=name)
# ---------- python_script.python (23 lines) ----------
import clr
# Import RevitAPI Classes
clr.AddReference('RevitAPI')
import Autodesk
from Autodesk.Revit.DB import *
# Import DocumentManager and TransactionManager
clr.AddReference("RevitServices")
import RevitServices
from RevitServices.Persistence import DocumentManager
from RevitServices.Transactions import TransactionManager
doc = DocumentManager.Instance.CurrentDBDocument

names = IN[0] if isinstance(IN[0],list) else [IN[0]]
result, ids = [],[]

TransactionManager.Instance.EnsureInTransaction(doc)
for name in names:
	workset = Workset.Create(doc, name)
	result.append(workset)
	ids.append(workset.Id)
TransactionManager.Instance.TransactionTaskDone()

OUT = result, ids
# ----------------------------------------
code_block = CodeBlock(x=python_script) { x[0]; x[1]; }
Workset = Output(code_block.out0)
Id = Output(code_block.out1)  # Integer
