# Dynamo custom node CurtainWall Vertical References.dyf (Dynamo 1.3.4.6666)
# category: GeniusLoci.Reference
# Collects references from the vertical grid lines of the curtain wall. Also works with a linked curtain wall.

CurtainWall = Input(CurtainWall: var[]..[])
python_script = Python(IN[0]=CurtainWall)
# ---------- python_script.python (42 lines) ----------
#Based on a script of maciek.glowka : http://lubim.co
import clr
clr.AddReference("RevitAPI")
from Autodesk.Revit.DB import *
clr.AddReference("RevitServices")
import RevitServices
from RevitServices.Persistence import DocumentManager

walls = UnwrapElement(IN[0])
if not hasattr(walls, '__iter__'):
    walls = [walls]

def isParallel(v1,v2):
	return v1.CrossProduct(v2).IsAlmostEqualTo(XYZ(0,0,0))
	
for wall in walls:
	line = wall.Location.Curve
	lineDir = line.GetEndPoint(1) - line.GetEndPoint(0)
	doc=wall.Document
	
refArray = ReferenceArray()
options = Options()
options.ComputeReferences = True
options.IncludeNonVisibleObjects = True
geoElement = wall.get_Geometry(options)
#get side references
for obj in geoElement:
	if isinstance(obj,Solid):
		for f in obj.Faces:
			faceNormal = f.FaceNormal
			if isParallel(faceNormal,lineDir):
				refArray.Append(f.Reference)
    
#get grid references
for id in wall.CurtainGrid.GetVGridLineIds():
	gridLine = doc.GetElement(id)
	gridGeo = gridLine.get_Geometry(options)
	for obj in gridGeo:
		if isinstance(obj,Line):
			refArray.Append(obj.Reference)

OUT = refArray
# ----------------------------------------
References = Output(python_script)
