# Dynamo custom node Curves FromHatch.dyf (Dynamo 1.3.4.6666)
# category: GeniusLoci.CAD Import
# Gets the boundaries of the hatches from a CAD link or import.
# By Cyril Poupin on the Dynamo Forum

importInstance = Input()
layerName = Input(layerName : var[]..[] = null)  # Optional input
python_script = Python(IN[0]=importInstance, IN[1]=layerName)
# ---------- python_script.python (36 lines) ----------
#By Cyril Poupin on the Dynamo Forum
#https://forum.dynamobim.com/t/get-face-from-cad-dwg/70043/3

import clr
clr.AddReference('ProtoGeometry')
from Autodesk.DesignScript.Geometry import *
import Autodesk.DesignScript.Geometry as DS

clr.AddReference('RevitAPI')
import Autodesk
from Autodesk.Revit.DB import *

clr.AddReference('RevitNodes')
import Revit
clr.ImportExtensions(Revit.GeometryConversion)

importinstance = UnwrapElement(IN[0])

polycurves = []
opt = Options()
geoSet = importinstance.get_Geometry(opt)
for geo in geoSet:
	if isinstance(geo, GeometryInstance):
		for g in  geo.GetInstanceGeometry():
			if isinstance(g, Solid) and g.Volume == 0 :
				for f in g.Faces:
					gstyleName = importinstance.Document.GetElement(f.GraphicsStyleId).GraphicsStyleCategory.Name
					if gstyleName == IN[1] :
						for loopCurve in f.GetEdgesAsCurveLoops():
							ds_polycurv = DS.PolyCurve.ByJoinedCurves(x.ToProtoType() for x in loopCurve)
							polycurves.append(ds_polycurv)
					elif IN[1] == None :
						for loopCurve in f.GetEdgesAsCurveLoops():
							ds_polycurv = DS.PolyCurve.ByJoinedCurves(x.ToProtoType() for x in loopCurve)
							polycurves.append(ds_polycurv)
OUT = polycurves
# ----------------------------------------
Curve = Output(python_script)
