# Dynamo custom node Document SaveAs.dyf (Dynamo 1.3.4.6666)
# category: GeniusLoci.Document
# Saves the given Revit document under the given name.
# Based on a Clockwork node

filePath = Input(filePath : string)  # File path to save to. File extension (*.rvt/*.rfa) will be automatically added.
code_block = CodeBlock(path1=filePath)
# ---------- code_block.designscript (4 lines) ----------
// Delete filetype (if present in string)
// Filetype will automatically be added by Python script
path2 = DSCore.String.Replace(path1,".rvt","");
DSCore.String.Replace(path2,".rfa","");
# ----------------------------------------
compactFile = Input(compactFile : bool = false)  # Should the file be compacted?
saveAsCentral = Input(saveAsCentral : bool = false)  # Should the file be saved as a new central file? Will be ignored for non-workshared projects and families
isWorkshared = Input(isWorkshared : bool = false)  # Set true if the given project is workshared
openWorksetsConfiguration = Input(openWorksetsConfiguration : var[]..[] = null)  # String or DB.SimpleWorksetConfiguration For use with the OpenWorksets Enumeration node
document = Input(document : var[]..[] = null)  # Use only if you want to query other document
python_script = Python(IN[0]=code_block.out1, IN[1]=compactFile, IN[2]=saveAsCentral, IN[3]=isWorkshared, IN[4]=openWorksetsConfiguration, IN[5]=document)
# ---------- python_script.python (55 lines) ----------
import clr
clr.AddReference('RevitAPI')
from Autodesk.Revit.DB import *

clr.AddReference("RevitServices")
import RevitServices
from RevitServices.Persistence import DocumentManager
from RevitServices.Transactions import TransactionManager

path = IN[0]
compact = IN[1]
newcentral = IN[2]
isworkshared = IN[3]
worksetConfiguration = IN[4]
if isinstance(worksetConfiguration , basestring):
	exec("openWorksets = SimpleWorksetConfiguration.%s" % worksetConfiguration)
else:
	openWorksets = worksetConfiguration
inputdoc = IN[5] if isinstance(IN[5],list) else [IN[5]]

#Inputdoc : Part of script by Andreas Dieckmann
if inputdoc[0] == None:
    doc = DocumentManager.Instance.CurrentDBDocument
elif inputdoc[0].GetType().ToString() == "Autodesk.Revit.DB.Document":
    doc = inputdoc[0]
else: doc = DocumentManager.Instance.CurrentDBDocument

TransactionManager.Instance.ForceCloseTransaction()
if doc.IsFamilyDocument:
	path += '.rfa'
else:
	path += '.rvt'
opt = SaveAsOptions()
opt.OverwriteExistingFile = True
opt.Compact = compact
if isworkshared and newcentral:
	wsopt = WorksharingSaveAsOptions()
	#Set workset configuration
	if worksetConfiguration :
		wsopt.OpenWorksetsDefault = openWorksets
	else : wsopt.OpenWorksetsDefault = SimpleWorksetConfiguration.AskUserToSpecify
	wsopt.ClearTransmitted = True
	wsopt.SaveAsCentral = True
	opt.SetWorksharingOptions(wsopt)
try:
	doc.SaveAs(path, opt)
	OUT = True,doc
except:
	try:
		wsopt.ClearTransmitted = False
		opt.SetWorksharingOptions(wsopt)
		doc.SaveAs(path, opt)
		OUT = True,doc
	except:
		OUT = False,doc
# ----------------------------------------
code_block_2 = CodeBlock(x=python_script) { x[0]; x[1]; }
Success = Output(code_block_2.out0)
Document = Output(code_block_2.out1)
