# Dynamo custom node Element GetLoadableFamily.dyf (Dynamo 1.3.4.6666)
# category: GeniusLoci.Family
# Get the loadable family from the given element.

element = Input()
python_script = Python(IN[0]=element)
# ---------- python_script.python (23 lines) ----------
#Alban de Chasteigner 2020
#twitter : @geniusloci_bim
#geniusloci.bim@gmail.com
#https://github.com/albandechasteigner/GeniusLociForDynamo

import clr
clr.AddReference("RevitAPI")
import Autodesk
from Autodesk.Revit.DB import FilteredElementCollector, Family

elements = UnwrapElement(IN[0]) if isinstance(IN[0],list) else [UnwrapElement(IN[0])]
families,familyNames = [],[]

for elem in elements :
	if elem :
		doc = elem.Document
		familyName = doc.GetElement(elem.GetTypeId()).FamilyName
		coll=FilteredElementCollector(doc).OfClass(Family).ToElements().Find(lambda x :  x.Name == familyName)
		families.append(coll)
		familyNames.append(familyName)
	
if isinstance(IN[0], list): OUT = families,familyNames
else: OUT = families[0],familyNames[0]
# ----------------------------------------
code_block = CodeBlock(x=python_script) { x[0]; x[1]; }
Family = Output(code_block.out0)
FamilyName = Output(code_block.out1)
