# Dynamo custom node Element Reference.dyf (Dynamo 1.3.4.6666)
# category: GeniusLoci.Reference
# Gets the reference of a geometric object or a dimension or a reference plane.

element = Input()
python_script = Python(IN[0]=element)
# ---------- python_script.python (17 lines) ----------
import clr
clr.AddReference('RevitAPI')
import Autodesk
from Autodesk.Revit.DB import *

elements = UnwrapElement(IN[0]) if isinstance(IN[0],list) else [UnwrapElement(IN[0])]

ref=[]
for element in elements:
	if isinstance (element, Autodesk.Revit.DB.Dimension):
		ref.append(element.References)
	elif isinstance (element, Autodesk.Revit.DB.ReferencePlane):
		ref.append(element.GetReference())
	else : ref.append(Reference(element))

if isinstance(IN[0], list): OUT = ref
else: OUT = ref[0]
# ----------------------------------------
Reference = Output(python_script)
