# Dynamo custom node Element Surfaces References.dyf (Dynamo 1.3.4.6666)
# category: GeniusLoci.Reference
# Retrieve the top, bottom, side surfaces and their associated references of the system family.
# This doesn't work with cylindrical system families (pipe...)

element = Input()
python_script = Python(IN[0]=element)
# ---------- python_script.python (87 lines) ----------
#Suggestion by Mark.Ackerley
#Alban de Chasteigner 2019
#twitter : @geniusloci_bim
#geniusloci.bim@gmail.com

import clr
clr.AddReference('RevitAPI')
from Autodesk.Revit.DB import *
import Autodesk

clr.AddReference('RevitNodes')
import Revit
clr.ImportExtensions(Revit.GeometryConversion)

items  = UnwrapElement(IN[0]) if isinstance(IN[0],list) else [UnwrapElement(IN[0])]

horizontaldown,horizontalup,verticals,refDown,refUp,refVer = [],[],[],[],[],[]
opt = Options()
opt.ComputeReferences = True

for item in items:
	#System families
	if hasattr(item, "FindInserts") :
		downList,upList,vertical = [],[],[]
		downArray,upArray,verArray = ReferenceArray(),ReferenceArray(),ReferenceArray()
		for obj in item.get_Geometry(opt):
			for face in obj.Faces: 
				if face.FaceNormal.IsAlmostEqualTo(XYZ(0,0,-1)):
					downList.append(face.ToProtoType()[0])
					downArray.Append(face.Reference)
				elif face.FaceNormal.IsAlmostEqualTo(XYZ(0,0,1)):
					upList.append(face.ToProtoType()[0])
					upArray.Append(face.Reference)
				elif face.FaceNormal.Z >= (0 - 1.0e-09) and face.FaceNormal.Z <= (0 + 1.0e-09):
					vertical.append(face.ToProtoType()[0])
					verArray.Append(face.Reference)
			horizontaldown.append(downList)
			horizontalup.append(upList)
			verticals.append(vertical)
			refDown.append(downArray)
			refUp.append(upArray)
			refVer.append(verArray)
	elif isinstance(item, FamilyInstance):
		downList,upList,vertical = [],[],[]
		downArray,upArray,verArray = ReferenceArray(),ReferenceArray(),ReferenceArray()
		for obj in item.get_Geometry(opt):
			if isinstance(obj,Solid) and obj.Volume > 0 :	
				for face in obj.Faces: 
					if face.FaceNormal.IsAlmostEqualTo(XYZ(0,0,-1)):
						downList.append(face.ToProtoType()[0])
						downArray.Append(face.Reference)
					elif face.FaceNormal.IsAlmostEqualTo(XYZ(0,0,1)):
						upList.append(face.ToProtoType()[0])
						upArray.Append(face.Reference)
					elif face.FaceNormal.Z >= (0 - 1.0e-09) and 	face.FaceNormal.Z <= (0 + 1.0e-09):
						vertical.append(face.ToProtoType()[0])
						verArray.Append(face.Reference)
				horizontaldown.append(downList)
				horizontalup.append(upList)
				verticals.append(vertical)
				refDown.append(downArray)
				refUp.append(upArray)
				refVer.append(verArray)
			elif isinstance(obj, GeometryInstance) :
				for symbIns in obj.GetInstanceGeometry() :
					if isinstance(symbIns,Solid) and symbIns.Volume > 0 :
						for face in symbIns.Faces: 
							if face.FaceNormal.IsAlmostEqualTo(XYZ(0,0,-1)):
								downList.append(face.ToProtoType()[0])
								downArray.Append(face.Reference)
							elif face.FaceNormal.IsAlmostEqualTo(XYZ(0,0,1)):
								upList.append(face.ToProtoType()[0])
								upArray.Append(face.Reference)
							elif face.FaceNormal.Z >= (0 - 1.0e-09) and 	face.FaceNormal.Z <= (0 + 1.0e-09):
								vertical.append(face.ToProtoType()[0])
								verArray.Append(face.Reference)
						horizontaldown.append(downList[0])
						horizontalup.append(upList[0])
						verticals.append(vertical)
						refDown.append(downArray[0])
						refUp.append(upArray[0])
						refVer.append(verArray)
	else:
		pass
		
if isinstance(IN[0], list): OUT = horizontalup,refUp,horizontaldown,refDown,verticals,refVer
else: OUT = horizontalup[0],refUp[0],horizontaldown[0],refDown[0],verticals[0],refVer[0]
# ----------------------------------------
code_block = CodeBlock(x=python_script) { x[0]; x[1]; x[2]; x[3]; x[4]; x[5]; }
Top_Surface = Output(code_block.out0)
Top_Reference = Output(code_block.out1)
Bottom_Surface = Output(code_block.out2)
Bottom_Reference = Output(code_block.out3)
Vertical_Surface = Output(code_block.out4)
Vertical_Reference = Output(code_block.out5)
