# Dynamo custom node Element TaggedStatus.dyf (Dynamo 1.3.4.6666)
# category: GeniusLoci.Tag
# Identify the tagged and untagged elements.
# Please note : This doesn't work with areas and spaces.

element = Input()
python_script = Python(IN[0]=element)
# ---------- python_script.python (30 lines) ----------
import clr
clr.AddReference("RevitServices")
import RevitServices
from RevitServices.Persistence import DocumentManager
# Import RevitAPI
clr.AddReference("RevitAPI")
import Autodesk
from Autodesk.Revit.DB import FilteredElementCollector,IndependentTag,BuiltInCategory
doc = DocumentManager.Instance.CurrentDBDocument

elements = UnwrapElement(IN[0]) if isinstance(IN[0],list) else [UnwrapElement(IN[0])]

tagged,notTagged = [], []

collector = FilteredElementCollector(doc,doc.ActiveView.Id).OfClass(IndependentTag).ToElements()
collector2 = FilteredElementCollector(doc,doc.ActiveView.Id).OfCategory(BuiltInCategory.OST_RoomTags).ToElements()

for elem in elements:
	isTagged = False
	for t in collector:
		if t.TaggedLocalElementId == elem.Id:
			isTagged = True
	for t in collector2:
		if t.TaggedLocalRoomId == elem.Id:
			isTagged = True
	if not isTagged :
		notTagged.append(elem)
	else: tagged.append(elem)

OUT = tagged,notTagged
# ----------------------------------------
code_block = CodeBlock(x=python_script) { x[0]; x[1]; }
Tagged = Output(code_block.out0)
NotTagged = Output(code_block.out1)
