# Dynamo custom node Enumerate DWG import options.dyf (Dynamo 1.3.4.6666)
# category: GeniusLoci.CAD Import
# Enumerate Color mode, Type of Placement and Type of Unit.
# Works with the "Link DWG" and "Import DWG" nodes.

python_script = Python()
# ---------- python_script.python (9 lines) ----------
import clr
# Import RevitAPI
clr.AddReference("RevitAPI")
import Autodesk
from Autodesk.Revit.DB import *
import System

#Assign your output to the OUT variable
OUT = System.Enum.GetValues(Autodesk.Revit.DB.ImportColorMode), System.Enum.GetValues(Autodesk.Revit.DB.ImportPlacement),System.Enum.GetValues(Autodesk.Revit.DB.ImportUnit)
# ----------------------------------------
code_block = CodeBlock(Option=python_script) { Option[0]; Option[1]; Option[2]; }
Colormode = Output(code_block.out0)
Placement = Output(code_block.out1)
Unit = Output(code_block.out2)
