# Dynamo custom node Enumerate Datum Extent Type.dyf (Dynamo 1.3.4.6666)
# category: GeniusLoci.Level
# Enumerate Datum Extent Type : Model (3D extent) or ViewSpecific (2D extent).
# For use with "Switch between 2D or 3D extent" node.

enumerate_datum_extent_type = Python()
# ---------- enumerate_datum_extent_type.python (9 lines) ----------
import clr
# Import RevitAPI
clr.AddReference("RevitAPI")
import Autodesk
from Autodesk.Revit.DB import *
import System

#Assign your output to the OUT variable
OUT = System.Enum.GetValues(Autodesk.Revit.DB.DatumExtentType)
# ----------------------------------------
code_block = CodeBlock(Option=enumerate_datum_extent_type) { Option[0]; Option[1]; }
n3D_extent = Output(code_block.out0)  # "3D extent"
n2D_extent = Output(code_block.out1)  # "2D extent"
