# Dynamo custom node Enumerate Naviswork Coordinates and Exportscope.dyf (Dynamo 1.3.4.6666)
# category: GeniusLoci.Export
# Use with the "Export NWC in Document" node.

python_script = Python()
# ---------- python_script.python (7 lines) ----------
import clr
clr.AddReference("RevitAPI")
import Autodesk
from Autodesk.Revit.DB import *
import System

OUT = System.Enum.GetValues(Autodesk.Revit.DB.NavisworksExportScope), System.Enum.GetValues(Autodesk.Revit.DB.NavisworksCoordinates)
# ----------------------------------------
code_block = CodeBlock(ExportScope=python_script, ExportCoordinates=python_script) { ExportScope[0]; ExportCoordinates[1]; }
ExportScope = Output(code_block.out0)
ChooseCoordinates = Output(code_block.out1)
