# Dynamo custom node Enumerate TextNoteLeaderTypes.dyf (Dynamo 1.3.4.6666)
# category: GeniusLoci.TextNote
# Enumerates the types of text-note leaders.
# For use with the TextNote AddLeader node.

python_script = Python()
# ---------- python_script.python (7 lines) ----------
import clr
clr.AddReference('RevitAPI')
import Autodesk
from Autodesk.Revit.DB import TextNoteLeaderTypes
import System

OUT = System.Enum.GetValues(Autodesk.Revit.DB.TextNoteLeaderTypes)
# ----------------------------------------
TextNoteLeaderTypes = Output(python_script)
