# Dynamo custom node FamilyDocument Load.dyf (Dynamo 1.3.4.6666)
# category: GeniusLoci.Family
# Load the family as familyDocument, existing family will be overwritten.
# Use the "FamilyDocument Close" node to close the familyDocument.

familyDocument = Input()
python_script = Python(IN[0]=familyDocument)
# ---------- python_script.python (26 lines) ----------
#Inspired by Dynamo Forum
import clr
clr.AddReference('RevitAPI')
from Autodesk.Revit.DB import Document, FamilySource, IFamilyLoadOptions

clr.AddReference('RevitServices')
from RevitServices.Persistence import DocumentManager
doc = DocumentManager.Instance.CurrentDBDocument

famDocs = IN[0] if isinstance(IN[0],list) else [IN[0]]
output = []
#Ensure loaded families can overwrite existing families.
class FamilyOption(IFamilyLoadOptions):
	def OnFamilyFound(self, familyInUse, overwriteParameterValues):
		overwriteParameterValues = True
		return True

	def OnSharedFamilyFound(self, sharedFamily, familyInUse, source, overwriteParameterValues):
		source = FamilySource.Family
		overwriteParameterValues = True
		return True

for famDoc in famDocs:
	output.append(famDoc.LoadFamily(doc, FamilyOption()))

OUT = output
# ----------------------------------------
Family = Output(python_script)
