# Dynamo custom node FamilyDocument Open.dyf (Dynamo 1.3.4.6666)
# category: GeniusLoci.Family
# Gets the familyDocument by family or family instance. (Opens the family in the background)
# Use the "FamilyDocument Close" node to close the familyDocument.

FamilyOrFamilyInstance = Input()
python_script = Python(IN[0]=FamilyOrFamilyInstance)
# ---------- python_script.python (28 lines) ----------
#Alban de Chasteigner 2020
#twitter : @geniusloci_bim
#geniusloci.bim@gmail.com

import clr
clr.AddReference('RevitAPI')
import Autodesk
from Autodesk.Revit.DB import *

clr.AddReference("RevitServices")
import RevitServices
from RevitServices.Transactions import TransactionManager
from RevitServices.Persistence import DocumentManager
doc = DocumentManager.Instance.CurrentDBDocument

families = UnwrapElement(IN[0]) if isinstance(IN[0],list) else [UnwrapElement(IN[0])]
famDoc=[]

TransactionManager.Instance.ForceCloseTransaction()
for fam in families:
	if isinstance(fam,Autodesk.Revit.DB.FamilyInstance):
		famDoc.append(Document.EditFamily(doc,fam.Symbol.Family))
	else:
		if fam.IsInPlace ==False:
			famDoc.append(Document.EditFamily(doc,fam))

if isinstance(IN[0], list): OUT = famDoc
else: OUT = famDoc[0]
# ----------------------------------------
familyDocument = Output(python_script)
