# Dynamo custom node FilenameToFilePaths.dyf (Dynamo 1.3.4.6666)
# category: GeniusLoci.Printing
# Add directory and .pdf extension to filenames.
# Be careful with forbidden characters in filenames  (* . " / \ : ;)
# For use with the "Remove Special Characters from String" node.

DirectoryPath = Input()
Filenames = Input()  # Filenames as list
code_block = CodeBlock(Directorypath=DirectoryPath, Filename=Filenames) { Directorypath+"\\"+Filename+".pdf"; }
FilePaths = Output(code_block)
