# Dynamo custom node Get Project Locations.dyf (Dynamo 1.3.4.6666)
# category: GeniusLoci.Document
# Works only in Revit 2018 and later.
# Retrieves the project positions of the given document in the Survey Coordinate System.
# (Coordinates of Internal origin, project base point and survey point)

docOrRevitLinkInstance = Input(docOrRevitLinkInstance : var = null)  # Use only if you want to query a linked model
get_project_origin_basepoint_and = Python(IN[0]=docOrRevitLinkInstance)  # "Get Project Origin, BasePoint and SurveyPoint"
# ---------- get_project_origin_basepoint_and.python (69 lines) ----------
#Alban de Chasteigner 2018
#twitter : @geniusloci_bim
#geniusloci.bim@gmail.com
#https://github.com/albandechasteigner/GeniusLociForDynamo

import clr
import math
clr.AddReference("RevitServices")
import RevitServices 
from RevitServices.Persistence import DocumentManager
uiapp = DocumentManager.Instance.CurrentUIApplication
app = uiapp.Application
version=int(app.VersionNumber)

clr.AddReference("RevitNodes")
import Revit
clr.ImportExtensions(Revit.GeometryConversion)

clr.AddReference("RevitAPI")
import Autodesk
from Autodesk.Revit.DB import *

inputdoc = UnwrapElement(IN[0]) if isinstance(IN[0],list) else [UnwrapElement(IN[0])]

#Inputdoc : Part of script by Andreas Dieckmann
if inputdoc[0] == None:
    doc = DocumentManager.Instance.CurrentDBDocument
elif isinstance(inputdoc[0],Document):
    doc = inputdoc[0]
elif isinstance(inputdoc[0],RevitLinkInstance):
    doc = inputdoc[0].GetLinkDocument()
else: doc = DocumentManager.Instance.CurrentDBDocument

if version < 2021:
	angleUnit = doc.GetUnits().GetFormatOptions(UnitType.UT_Angle).DisplayUnits
else:
	angleUnit = doc.GetUnits().GetFormatOptions(SpecTypeId.Angle).GetUnitTypeId()

outProjBasePt, outProjSurvPt, outProjLoc = [],[],[]

pbp = FilteredElementCollector(doc).OfCategory(BuiltInCategory.OST_ProjectBasePoint).ToElements()
sbp = FilteredElementCollector(doc).OfCategory(BuiltInCategory.OST_SharedBasePoint).ToElements()

if version < 2018:
	projPos = doc.ActiveProjectLocation.get_ProjectPosition(XYZ(0,0,0))
else :
	projPos = doc.ActiveProjectLocation.GetProjectPosition(XYZ(0,0,0))
	
if version > 2019 and inputdoc != None :
	outProjBasePt = [pbp[0].SharedPosition.ToPoint(),abs(360-(round(Autodesk.Revit.DB.UnitUtils.ConvertFromInternalUnits(projPos.Angle,angleUnit),6)))]
	outProjSurvPt = sbp[0].SharedPosition.ToPoint()
else :
	pbpEW = pbp[0].get_Parameter(BuiltInParameter.BASEPOINT_EASTWEST_PARAM).AsDouble()
	pbpNS = pbp[0].get_Parameter(BuiltInParameter.BASEPOINT_NORTHSOUTH_PARAM).AsDouble()
	pbpElev = pbp[0].get_Parameter(BuiltInParameter.BASEPOINT_ELEVATION_PARAM).AsDouble()
	pbpAngle = pbp[0].get_Parameter(BuiltInParameter.BASEPOINT_ANGLETON_PARAM).AsDouble()*180/math.pi    
	outProjBasePt=[(XYZ(pbpEW,pbpNS,pbpElev)).ToPoint(),round(pbpAngle,6)]

	pspEW = sbp[0].get_Parameter(BuiltInParameter.BASEPOINT_EASTWEST_PARAM).AsDouble()
	pspNS = sbp[0].get_Parameter(BuiltInParameter.BASEPOINT_NORTHSOUTH_PARAM).AsDouble()
	pspElev = sbp[0].get_Parameter(BuiltInParameter.BASEPOINT_ELEVATION_PARAM).AsDouble()
	outProjSurvPt = XYZ(pspEW,pspNS,pspElev).ToPoint()
    	
if projPos == None:
	outProjLoc.append("No Project Position at origin point")
else:
	outProjLoc = XYZ(projPos.EastWest,projPos.NorthSouth,0).ToPoint()
	
OUT = outProjLoc, outProjBasePt, outProjSurvPt, doc.ActiveProjectLocation.Name
# ----------------------------------------
code_block = CodeBlock(x=get_project_origin_basepoint_and) { x[0]; x[1]; x[2]; x[3]; }
Internal_Origin = Output(code_block.out0)
Project_Base_Point = Output(code_block.out1)
Project_Survey_Point = Output(code_block.out2)
Site_Name = Output(code_block.out3)
