# Dynamo custom node Level ByName.dyf (Dynamo 1.3.4.6666)
# category: GeniusLoci.Level
# Collects Levels by name in the active or given document.

name = Input(name : string[]..[])
docOrRevitLinkInstance = Input(docOrRevitLinkInstance : var[]..[] = null)  # To use with a linked model or a background opened document
python_script = Python(IN[0]=name, IN[1]=docOrRevitLinkInstance)
# ---------- python_script.python (34 lines) ----------
#Alban de Chasteigner 2021
#twitter : @geniusloci_bim
#geniusloci.bim@gmail.com
#https://github.com/albandechasteigner/GeniusLociForDynamo

import clr
clr.AddReference("RevitServices")
import RevitServices
from RevitServices.Persistence import DocumentManager
# Import RevitAPI
clr.AddReference("RevitAPI")
import Autodesk
from Autodesk.Revit.DB import *

names = IN[0] if isinstance(IN[0],list) else [IN[0]]
inputdoc = (UnwrapElement(IN[1]) if isinstance(IN[1],list) else [UnwrapElement(IN[1])])[0]

#Inspired by Clockwork
if inputdoc == None:
	doc = DocumentManager.Instance.CurrentDBDocument
elif isinstance (inputdoc, Document):
	doc = inputdoc
elif isinstance (inputdoc, RevitLinkInstance):
	doc = inputdoc.GetLinkDocument()
else: doc = DocumentManager.Instance.CurrentDBDocument

listLevels = []
levels = FilteredElementCollector(doc).OfClass(Level).WhereElementIsNotElementType().ToElements()

for name in names :
	listLevels.append(next((lev for lev in levels if lev.Name.lower() == name.lower()), None))
	
if isinstance(IN[0], list): OUT = listLevels
else: OUT = listLevels[0]
# ----------------------------------------
Level = Output(python_script)
