# Dynamo custom node MEP System Size.dyf (Dynamo 1.3.4.6666)
# category: GeniusLoci.MEP
# Retrieves the width, height or diameter of the MEP system elements (pipe, duct, cable tray, accessory...).

element = Input()  # MEP element
python_script = Python(IN[0]=element)
# ---------- python_script.python (70 lines) ----------
#Alban de Chasteigner 2021
#twitter : @geniusloci_bim
#geniusloci.bim@gmail.com
#https://github.com/albandechasteigner/GeniusLociForDynamo

import clr
clr.AddReference("RevitAPI")
import Autodesk
from Autodesk.Revit.DB import *

clr.AddReference("RevitServices")
import RevitServices
from RevitServices.Persistence import DocumentManager
uiapp = DocumentManager.Instance.CurrentUIApplication
app = uiapp.Application
version=int(app.VersionNumber)

elements = UnwrapElement(IN[0]) if isinstance(IN[0],list) else [UnwrapElement(IN[0])]
	
abbreviation, width, height, diameter = [], [], [], []

for elem in elements:
	doc = elem.Document
	if version < 2021:
		UIunit = doc.GetUnits().GetFormatOptions(UnitType.UT_Length).DisplayUnits
		#UIunit = DisplayUnitType.DUT_MILLIMETERS
	else:
		UIunit = doc.GetUnits().GetFormatOptions(SpecTypeId.Length).GetUnitTypeId()
		#UIunit = UnitTypeId.Millimeters
	if isinstance(elem, MEPCurve):
		try:
			height.append(UnitUtils.ConvertFromInternalUnits(elem.Height,UIunit))
		except:
			height.append(None)
		try:
			width.append(UnitUtils.ConvertFromInternalUnits(elem.Width,UIunit))
		except:
			width.append(None)
		try:		
			diameter.append(UnitUtils.ConvertFromInternalUnits(elem.Diameter,UIunit))
		except:
			diameter.append(None)
		try:	
			abbreviation.append(doc.GetElement(elem.MEPSystem.GetTypeId()).Abbreviation)
		except:
			if isinstance(elem, Electrical.CableTrayConduitBase):
				abbreviation.append(elem.get_Parameter(BuiltInParameter.RBS_CTC_SERVICE_TYPE).AsString())
			else:
				abbreviation.append(None)
	elif isinstance(elem, FamilyInstance):
		try:
			connectors = elem.MEPModel.ConnectorManager.Connectors
		except:
			try:
				connectors = elem.ConnectorManager.Connectors
			except:			
				continue
		try : height.append(UnitUtils.ConvertFromInternalUnits(max(connector.Height for connector in connectors if connector.Shape == ConnectorProfileType.Rectangular),UIunit))
		except : height.append(None)
		try : width.append(UnitUtils.ConvertFromInternalUnits(max(connector.Width for connector in connectors if connector.Shape == ConnectorProfileType.Rectangular),UIunit))
		except : width.append(None)
		try : diameter.append(UnitUtils.ConvertFromInternalUnits(2 * max(connector.Radius for connector in connectors if connector.Shape == ConnectorProfileType.Round),UIunit))
		except : diameter.append(None)
		try:
			abbrev=list((doc.GetElement(connector.MEPSystem.GetTypeId()).Abbreviation for connector in connectors if connector.Shape != ConnectorProfileType.Invalid))[0]
			abbreviation.append(abbrev)			
		except : abbreviation.append(None)

if isinstance(IN[0], list): OUT = abbreviation, width, height, diameter 
else: OUT = abbreviation[0], width[0], height[0], diameter[0]
# ----------------------------------------
code_block = CodeBlock(x=python_script) { x[0]; x[1]; x[2]; x[3]; }
System_Abbreviation = Output(code_block.out0)
Width = Output(code_block.out1)
Height = Output(code_block.out2)
Diameter = Output(code_block.out3)
