# Dynamo custom node Material Create.dyf (Dynamo 1.3.4.6666)
# category: GeniusLoci.Material
# Create new materials or overwrite properties of existing materials.
# (All graphics inputs are optional)

Name = Input(Name:string[]..[])
color = Input(color:var[]..[]= null)  # Dynamo Color
SurfaceForegroundPattern = Input(SurfaceForegroundPattern:var[]..[]= null)  # Pattern as String or FillPatternElement
SurfaceForegroundPatternColor = Input(SurfaceForegroundPatternColor:var[]..[] = null)  # Dynamo Color
CutForegroundPattern = Input(CutForegroundPattern:var[]..[]=null)  # Pattern (Drafting) as String or FillPatternElement
CutForegroundPatternColor = Input(CutForegroundPatternColor:var[]..[] = null)  # Dynamo Color
Transparency = Input(Transparency:var[]..[]=null)  # Integer
create_material = Python(IN[0]=Name, IN[1]=color, IN[2]=SurfaceForegroundPattern, IN[3]=SurfaceForegroundPatternColor, IN[4]=CutForegroundPattern, IN[5]=CutForegroundPatternColor, IN[6]=Transparency)
# ---------- create_material.python (179 lines) ----------
#By GregX, David Dória and Alban de Chasteigner, 2018
#twitter : @geniusloci_bim
#geniusloci.bim@gmail.com

import clr
clr.AddReference('RevitAPI')
import Autodesk
from Autodesk.Revit.DB import *
clr.AddReference('RevitServices')
import RevitServices
from RevitServices.Persistence import DocumentManager
from RevitServices.Transactions import TransactionManager

doc = DocumentManager.Instance.CurrentDBDocument
uiapp = DocumentManager.Instance.CurrentUIApplication
app = uiapp.Application
version=int(app.VersionNumber)

def toList(obj):
    if hasattr(obj, '__iter__'): return obj
    else: return [obj]

names = toList(IN[0])
colors = toList(IN[1])
surfPat = toList(UnwrapElement(IN[2]))
surfPatCl = toList(IN[3])
cutPat = toList(UnwrapElement(IN[4]))
cutPatCl = toList(IN[5])
transparency = toList(IN[6])

#New materials OUT list
newMaterials = []
#Overwritten materials OUT list
#ovwMaterials = []

def ToRevitColor(dynamoColor):
	return Color(dynamoColor.Red, dynamoColor.Green, dynamoColor.Blue)
tar = FillPatternTarget.Drafting

fillPattern = FilteredElementCollector(doc).OfClass(Autodesk.Revit.DB.FillPatternElement)
#Iterate through the input names list
for n, cl, sp, spC, cp, cpC, trans in zip(names,colors,surfPat,surfPatCl,cutPat,cutPatCl,transparency):
	#Check if the material with the specified name already exists
	if Material.IsNameUnique(doc,n):
		#If name is unique, create material
		TransactionManager.Instance.EnsureInTransaction(doc)
		new_mat_id = Material.Create(doc, n)
		new_mat = doc.GetElement(new_mat_id)
		if cl == None:
			pass
		else:
			new_mat.Color = ToRevitColor(cl)
		if trans == None:
			pass
		else:	
			new_mat.Transparency = trans
		if version < 2019 :
			if sp == None:
				pass
			else:
				if sp.GetType().ToString()	== "System.String" :
					spId=[elem for elem in fillPattern if elem.Name.lower() == sp.lower()][0].Id
					new_mat.SurfacePatternId = spId
				else:
					new_mat.SurfacePatternId = sp.Id
			if spC == None:
				pass
			else:
				new_mat.SurfacePatternColor = ToRevitColor(spC)
			if cp == None:
				pass
			else:
				if cp.GetType().ToString()	== "System.String" :
					new_mat.CutPatternId = FillPatternElement.GetFillPatternElementByName(doc, FillPatternTarget.Drafting,cp).Id
				else:
					new_mat.CutPatternId = cp.Id
			if cpC == None:
				pass
			else:
				new_mat.CutPatternColor = ToRevitColor(cpC)
		else:
			if sp == None:
				pass
			else:
				if sp.GetType().ToString()	== "System.String" :
					spId=[elem for elem in fillPattern if elem.Name.lower() == sp.lower()][0].Id
					new_mat.SurfaceForegroundPatternId = spId
				else:
					new_mat.SurfaceForegroundPatternId = sp.Id
			if spC == None:
				pass
			else:
				new_mat.SurfaceForegroundPatternColor = ToRevitColor(spC)
			if cp == None:
				pass
			else:
				if cp.GetType().ToString()	== "System.String" :
					new_mat.CutForegroundPatternId = FillPatternElement.GetFillPatternElementByName(doc, FillPatternTarget.Drafting,cp).Id
				else:
					new_mat.CutForegroundPatternId = cp.Id
			if cpC == None:
				pass
			else:
				new_mat.CutForegroundPatternColor = ToRevitColor(cpC)


		TransactionManager.Instance.TransactionTaskDone()
		newMaterials.append(new_mat)
	else:
		#If it already exists, collect it and modify it
		TransactionManager.Instance.EnsureInTransaction(doc)
		namePar = ParameterValueProvider(ElementId(BuiltInParameter.MATERIAL_NAME))
		fRule = FilterStringRule(namePar,FilterStringEquals(),n, True)
		filter = ElementParameterFilter(fRule)
		exist_mat = FilteredElementCollector(doc).OfClass(Material).WherePasses(filter).ToElements()
		#Iteration is necessary because the output of exist_mat is invariably a list
		for em in exist_mat:
			#Modify the Material Properties and Parameters
			if cl == None:
				pass
			else:	
				em.Color = ToRevitColor(cl)
			if trans == None:
				pass
			else:	
				em.Transparency = trans
			if version < 2019 :
				if sp == None:
					pass
				else:
					if sp.GetType().ToString()	== "System.String" :
						spId=[elem for elem in fillPattern if elem.Name.lower() == sp.lower()][0].Id
						em.SurfacePatternId = spId
					else:
						em.SurfacePatternId = sp.Id
				if spC == None:
					pass
				else:
					em.SurfacePatternColor = ToRevitColor(spC)
				if cp == None:
					pass
				else:
					if cp.GetType().ToString()	== "System.String" :
						em.CutPatternId = FillPatternElement.GetFillPatternElementByName(doc, FillPatternTarget.Drafting,cp).Id
					else:
						em.CutPatternId = cp.Id
				if cpC == None:
					pass
				else:
					em.CutPatternColor = ToRevitColor(cpC)
			else:	
				if sp == None:
					pass
				else:
					if sp.GetType().ToString()	== "System.String" :
						spId=[elem for elem in fillPattern if elem.Name.lower() == sp.lower()][0].Id
						em.SurfaceForegroundPatternId = spId
					else:
						em.SurfaceForegroundPatternId = sp.Id
				if spC == None:
					pass
				else:
					em.SurfaceForegroundPatternColor = ToRevitColor(spC)
				if cp == None:
					pass
				else:
					if cp.GetType().ToString()	== "System.String" :
						em.CutForegroundPatternId = FillPatternElement.GetFillPatternElementByName(doc, FillPatternTarget.Drafting,cp).Id
					else:
						em.CutForegroundPatternId = cp.Id
				if cpC == None:
					pass
				else:
					em.CutForegroundPatternColor = ToRevitColor(cpC)
			newMaterials.append(em)
		TransactionManager.Instance.TransactionTaskDone()

if isinstance(IN[0], list): OUT = newMaterials
else: OUT = newMaterials[0]
# ----------------------------------------
Material = Output(create_material)
