# Dynamo custom node Nearest Level.dyf "NearestLevel" (Dynamo 2.10.1.3976)
# category: GeniusLoci.Level
# Works only in Revit 2022 and later.
# Returns the closest level to the specified elevation.

elevation = Input(elevation: double[]..[])
python_script = Python(IN[0]=elevation)  # IronPython2
# ---------- python_script.python (25 lines) ----------
#Alban de Chasteigner 2021
#twitter : @geniusloci_bim
#geniusloci.bim@gmail.com
#https://github.com/albandechasteigner/GeniusLociForDynamo
  
import clr
# Import RevitAPI Classes
clr.AddReference('RevitAPI')
import Autodesk
from Autodesk.Revit.DB import *
# Import DocumentManager and TransactionManager
clr.AddReference("RevitServices")
import RevitServices
from RevitServices.Persistence import DocumentManager

doc = DocumentManager.Instance.CurrentDBDocument
UIunit = Document.GetUnits(doc).GetFormatOptions(SpecTypeId.Length).GetUnitTypeId()

numbers = IN[0] if isinstance(IN[0],list) else [IN[0]]
result=[]
for number in numbers:
	result.append(doc.GetElement(Autodesk.Revit.DB.Level.GetNearestLevelId(doc,UnitUtils.ConvertToInternalUnits(number,UIunit))))

if isinstance(IN[0], list): OUT = result
else: OUT = result[0]
# ----------------------------------------
Level = Output(python_script)
