# Dynamo custom node OpenWorksets Enumeration.dyf (Dynamo 1.3.4.6666)
# category: GeniusLoci.Workset
# Enumerates the set of user-created worksets to open in memory. For use with the Document SaveAs node.

python_script = Python()
# ---------- python_script.python (7 lines) ----------
import clr
clr.AddReference('RevitAPI')
import Autodesk
from Autodesk.Revit.DB import SimpleWorksetConfiguration
import System

OUT = System.Enum.GetValues(Autodesk.Revit.DB.SimpleWorksetConfiguration)
# ----------------------------------------
WorksetConfiguration = Output(python_script)
