# Dynamo custom node Package Information.dyf (Dynamo 1.3.4.6666)
# category: GeniusLoci.Logo
# Displays package information.

python_script = Python()
# ---------- python_script.python (1 lines) ----------
OUT = "Author : Alban de Chasteigner","Contact : geniusloci.bim@gmail.com", "Twitter : @geniusloci_bim", "GitHub : https://github.com/albandechasteigner/GeniusLociForDynamo"
# ----------------------------------------
Information = Output(python_script)
