# Dynamo custom node PlanView ToBoundingBox.dyf (Dynamo 1.3.4.6666)
# category: GeniusLoci.View
# Create boundingBox from plan view based on the view range settings. (Z is calculed from ProjectElevation)

PlanView = Input(PlanView: var[]..[] = Revit.Application.Document.Current.ActiveView)
python_script = Python(IN[0]=PlanView)
# ---------- python_script.python (39 lines) ----------
import clr
clr.AddReference('RevitNodes')
import Revit
clr.ImportExtensions(Revit.GeometryConversion)

clr.AddReference('RevitServices')
from RevitServices.Persistence import DocumentManager
doc = DocumentManager.Instance.CurrentDBDocument

clr.AddReference("RevitAPI")
from Autodesk.Revit.DB import PlanViewPlane, XYZ, BoundingBoxXYZ

views = UnwrapElement(IN[0]) if isinstance(IN[0],list) else [UnwrapElement(IN[0])]
result = []

for v in views:
	bbxView = v.CropBox
	viewRange = v.GetViewRange() 
	topLevel = doc.GetElement(viewRange.GetLevelId(PlanViewPlane.TopClipPlane))
	topOffset = viewRange.GetOffset(PlanViewPlane.TopClipPlane)
	
	bttmLevel = doc.GetElement(viewRange.GetLevelId(PlanViewPlane.BottomClipPlane))
	bttmOffset = viewRange.GetOffset(PlanViewPlane.BottomClipPlane)

	cutLevel = doc.GetElement(viewRange.GetLevelId(PlanViewPlane.CutPlane))
	cutOffset = viewRange.GetOffset(PlanViewPlane.CutPlane)

	if bttmLevel : newmin = XYZ(bbxView.Min.X, bbxView.Min.Y, bttmLevel.ProjectElevation + bttmOffset)
	else: newmin = XYZ(bbxView.Min.X, bbxView.Min.Y, cutLevel.ProjectElevation + bttmOffset)
	if topLevel : newmax = XYZ(bbxView.Max.X, bbxView.Max.Y, topLevel.ProjectElevation + topOffset)
	else: newmax = XYZ(bbxView.Max.X, bbxView.Max.Y, cutLevel.ProjectElevation + cutOffset)
	
	newbox = BoundingBoxXYZ()
	newbox.Max = newmax
	newbox.Min = newmin
	result.append(newbox.ToProtoType())

if isinstance(IN[0], (list)): OUT = result
else: OUT = result[0]
# ----------------------------------------
BoundingBox = Output(python_script)
