# Dynamo custom node Purge Unused UI.dyf (Dynamo 1.3.3.4651)
# category: GeniusLoci.Utilities
# Using the Postable Command, run the Purge Unused function.

RunIt = Input(RunIt : bool = false)
purge_unused = Python(IN[0]=RunIt)
# ---------- purge_unused.python (28 lines) ----------
#Postable Command by nathan.chapman
import clr
clr.AddReference('RevitAPI')
clr.AddReference('RevitAPIUI')
import Autodesk
from Autodesk.Revit.UI import RevitCommandId
from Autodesk.Revit.UI import UIApplication
from Autodesk.Revit.UI import ExternalCommandData
clr.AddReference('RevitServices')
import RevitServices
from RevitServices.Persistence import DocumentManager
from RevitServices.Transactions import TransactionManager

doc = DocumentManager.Instance.CurrentDBDocument
uiapp = DocumentManager.Instance.CurrentUIApplication

RunIt = IN[0]

if RunIt ==  True:
	CmndID = RevitCommandId.LookupCommandId('ID_PURGE_UNUSED')
	CmId = CmndID.Id
	uiapp.PostCommand(CmndID)
	errorReport = 'Success'
else:
	errorReport = 'Set IN[0] to true'

#Assign your output to the OUT variable
OUT = errorReport
# ----------------------------------------
Result = Output(purge_unused)
