# Dynamo custom node ResetSharedCoordinates.dyf (Dynamo 2.10.1.3976)
# category: GeniusLoci.Document
# Works only in Revit 2021.1 and later.
# Erases the shared coordinates of the host model will be erased. The shared relationship with all the linked models will be eliminated. Survey point will be reset back to startup location, where it coincides with the Internal Origin. The rotation angle between Project North and True North will be reset back to 0.

resetsharedcoordinates = Python()  # IronPython2
# ---------- resetsharedcoordinates.python (16 lines) ----------
import clr
clr.AddReference('RevitAPI')
import Autodesk
from Autodesk.Revit.DB import Document

clr.AddReference('RevitServices')
import RevitServices
from RevitServices.Persistence import DocumentManager
from RevitServices.Transactions import TransactionManager
doc = DocumentManager.Instance.CurrentDBDocument

TransactionManager.Instance.EnsureInTransaction(doc)
doc.ResetSharedCoordinates()
TransactionManager.Instance.TransactionTaskDone()

OUT = True
# ----------------------------------------
Succeed = Output(resetsharedcoordinates)
