# Dynamo custom node Room ByName.dyf (Dynamo 1.3.4.6666)
# category: GeniusLoci.Room
# Enter the room/space name or number to get the room.

NameOrNumber = Input(NameOrNumber : string[]..[])
RoomOrSpace = Input(RoomOrSpace : bool=true)  # Category Room = true Category Space = false
docOrRevitLinkInstance = Input(docOrRevitLinkInstance : var[]..[] = null)  # Use only if you want to query a linked model
get_rooms_by_name_or_number = Python(IN[0]=NameOrNumber, IN[1]=RoomOrSpace, IN[2]=docOrRevitLinkInstance)
# ---------- get_rooms_by_name_or_number.python (39 lines) ----------
#Node Inspired by jeremy@learndynamo.com
#www.Learndynamo.com 

import clr
clr.AddReference('RevitServices')
import RevitServices
from RevitServices.Persistence import DocumentManager
clr.AddReference('RevitAPI')
import Autodesk
from Autodesk.Revit.DB import Document, RevitLinkInstance, FilteredElementCollector, BuiltInCategory, BuiltInParameter

namnums = IN[0] if isinstance(IN[0],list) else [IN[0]]
toggle = IN[1]
inputdoc = (UnwrapElement(IN[2]) if isinstance(IN[2],list) else [UnwrapElement(IN[2])])[0]

rooms,roomLevels = [], []

#Inspired by Clockwork
if inputdoc == None:
	doc = DocumentManager.Instance.CurrentDBDocument
elif isinstance (inputdoc, Document):
	doc = inputdoc
elif isinstance (inputdoc, RevitLinkInstance):
	doc = inputdoc.GetLinkDocument()
else: doc = DocumentManager.Instance.CurrentDBDocument

if toggle == True:
	collector = FilteredElementCollector(doc).OfCategory(BuiltInCategory.OST_Rooms)
else:
	collector = FilteredElementCollector(doc).OfCategory(BuiltInCategory.OST_MEPSpaces)
for i in collector:
	for namnum in namnums:
		if namnum in i.get_Parameter(BuiltInParameter.ROOM_NAME).AsString() or namnum in i.get_Parameter(BuiltInParameter.ROOM_NUMBER).AsString():
			if i.Location != None:	
				rooms.append(i)
				roomLevels.append(i.Level)
										
if len(rooms)>1 : OUT = rooms, roomLevels 
else: OUT = rooms[0], roomLevels[0]
# ----------------------------------------
code_block = CodeBlock(x=get_rooms_by_name_or_number) { x[0]; x[1]; }
Rooms = Output(code_block.out0)
Levels = Output(code_block.out1)
