# Dynamo custom node Select Point on Element.dyf (Dynamo 1.3.4.6666)
# category: GeniusLoci.Reference
# Select the point(s) on the face(s) and get the reference(s).

Refresh = Input(Refresh  : bool = true)
select_point_s_pickobject = Python(IN[0]=Refresh)
# ---------- select_point_s_pickobject.python (25 lines) ----------
import clr
clr.AddReference('RevitServices')
import RevitServices
from RevitServices.Persistence import DocumentManager
doc = DocumentManager.Instance.CurrentDBDocument
uiapp = DocumentManager.Instance.CurrentUIApplication

clr.AddReference('RevitAPIUI')
from Autodesk.Revit.UI.Selection import ObjectType

# Import ToDSType  (bool) extension method
clr.AddReference("RevitNodes")
import Revit
# Adds ToProtoType, ToRevitType geometry conversion extension methods to objects
clr.ImportExtensions(Revit.GeometryConversion)

pickedRef,coords=[],[]

sel = uiapp.ActiveUIDocument.Selection
pickedRef=sel.PickObjects(ObjectType.PointOnElement, "Select Points on Face")

for ref in pickedRef :
	coords.append(ref.GlobalPoint.ToPoint())

OUT = coords,pickedRef
# ----------------------------------------
code_block = CodeBlock(x=select_point_s_pickobject) { x[0]; x[1]; }
Point = Output(code_block.out0)
Reference = Output(code_block.out1)
