# Dynamo custom node SelectByCateOrTypeAndView.dyf (Dynamo 1.3.4.6666)
# category: GeniusLoci.Select
# Collects elements by Category, Element Type or Family Type and View in the active or given document.

view = Input(view:var[]..[] = Revit.Application.Document.Current.ActiveView)  # View of current or given document
CategoryOrType = Input()
selectByCategoryAndView = Python(IN[0]=view, IN[1]=CategoryOrType)
# ---------- selectByCategoryAndView.python (47 lines) ----------
#Alban de Chasteigner 2018
#twitter : @geniusloci_bim
#geniusloci.bim@gmail.com

import clr
clr.AddReference('RevitAPI')
import Autodesk
from Autodesk.Revit.DB import *
clr.AddReference('RevitServices')
import RevitServices
from RevitServices.Persistence import DocumentManager
import System

def tolist(x):
    if hasattr(x,'__iter__'): return x
    else : return [x]

views = tolist(UnwrapElement(IN[0]))
cats = tolist(UnwrapElement(IN[1]))

provider = ParameterValueProvider(ElementId(BuiltInParameter.ELEM_FAMILY_PARAM))
provider2 = ParameterValueProvider(ElementId(BuiltInParameter.ELEM_TYPE_PARAM))
evaluator = FilterNumericEquals()

linkedEl,elements = [],[]
for view in views:
	doc=view.Document
	for cat in cats:
		if isinstance(cat, Category):
			collector = FilteredElementCollector(doc,view.Id).OfCategoryId(cat.Id).ToElements()
		elif isinstance(cat, System.Type): 
			collector = FilteredElementCollector(doc,view.Id).OfClass(cat).ToElements()
		elif isinstance(cat, FamilySymbol):
			filter = ElementParameterFilter(FilterElementIdRule(provider, evaluator, cat.Id))	
			collector = FilteredElementCollector(doc, view.Id).OfCategoryId(cat.Category.Id).WherePasses(filter).ToElements()
		elif isinstance(cat, TextNoteType):
			collector = FilteredElementCollector(doc, view.Id).OfClass(TextNote).WhereElementIsNotElementType().ToElements().FindAll(lambda x : x.GetTypeId() == cat.Id)
		elif isinstance(cat, ModelTextType):
			collector = FilteredElementCollector(doc, view.Id).OfClass(ModelText).WhereElementIsNotElementType().ToElements().FindAll(lambda x : x.GetTypeId() == cat.Id)
		elif isinstance(cat, HostObjAttributes):
			filter = ElementParameterFilter(FilterElementIdRule(provider2, evaluator, cat.Id))	
			collector = FilteredElementCollector(doc, view.Id).OfCategoryId(cat.Category.Id).WherePasses(filter).ToElements()
		linkedEl.append(collector)
	elements.append(linkedEl)

if not isinstance(IN[0], list) and not isinstance(IN[1], list): OUT = elements[0][0]
else: OUT = elements[0]
# ----------------------------------------
Elements = Output(selectByCategoryAndView)
