# Dynamo custom node Set SubCategory Properties.dyf (Dynamo 1.3.4.6666)
# category: GeniusLoci.Graphics
# Assigns Line Weight, Line Pattern and Line Color to the given subcategory.

subCategory = Input()
LinePattern = Input(LinePattern:var[]..[]= null)  # LinePattern element
ProjectionLineWeight = Input(ProjectionLineWeight:var[]..[]= null)  # Integer
CutLineWeight = Input(CutLineWeight:var[]..[]=null)  # Integer
color = Input(color:var[]..[]= null)  # Dynamo Color
material = Input(material:var[]..[]=null)
python_script = Python(IN[0]=subCategory, IN[1]=LinePattern, IN[2]=ProjectionLineWeight, IN[3]=CutLineWeight, IN[4]=color, IN[5]=material)
# ---------- python_script.python (62 lines) ----------
#Alban de Chasteigner 2018
#twitter : @geniusloci_bim
#geniusloci.bim@gmail.com

import clr
clr.AddReference('RevitAPI')
import Autodesk
from Autodesk.Revit.DB import *

clr.AddReference("RevitServices")
import RevitServices
from RevitServices.Persistence import DocumentManager
from RevitServices.Transactions import TransactionManager

def tolist(obj1):
    if hasattr(obj1,"__iter__"): return obj1
    else: return [obj1]

def ConvertColor(e):
	return Autodesk.Revit.DB.Color(e.Red, e.Green, e.Blue)

doc = DocumentManager.Instance.CurrentDBDocument
subcategory = tolist(UnwrapElement(IN[0]))
linePatterns=tolist(UnwrapElement(IN[1]))
projWeights=tolist(IN[2])
cutWeights=tolist(IN[3])
colors=tolist(IN[4])
materials = tolist(UnwrapElement(IN[5]))
listGraph = []

# "Start" the transaction
TransactionManager.Instance.EnsureInTransaction(doc)

for subcat, projWeight, cutWeight,linePattern,color,material in zip(subcategory,projWeights,cutWeights,linePatterns,colors,materials):
	if linePattern :
		patternId = linePattern.Id
		subLinePattern = subcat.SetLinePatternId(patternId,GraphicsStyleType.Projection)
	else :
		#patternId=LinePatternElement.GetSolidPatternId()
		pass
	if projWeight :
		lineProjWeight = subcat.SetLineWeight(projWeight,GraphicsStyleType.Projection)
	else:
		pass
	if cutWeight:
		lineCutweight= subcat.SetLineWeight(cutWeight,GraphicsStyleType.Cut)
	else:
		pass
	if color:
		subcat.LineColor = Color(color.Red, color.Green, color.Blue)
	else:
		pass
	if material:
		subcat.Material = material
	else:
		pass
	style = subcat.GetGraphicsStyle(GraphicsStyleType.Projection)
	listGraph.append(style)
	
TransactionManager.Instance.TransactionTaskDone()

OUT = listGraph
# ----------------------------------------
Graphic_Style = Output(python_script)
