# Dynamo custom node Topography ByPointsAndFacets.dyf (Dynamo 2.0.4.12684)
# category: GeniusLoci.Element
# Works only in Revit 2019.2 and later.
# Creates a topography surface from a mesh (facets and a list of points).
# Note : Points with same x, y are not allowed.
# The topography can't be edited in UI after creation, with this API method.

points = Input(points: Autodesk.DesignScript.Geometry.Point[]..[])
PolymeshFacet = Input(PolymeshFacet: var[]..[])  # 3 integers representing vertex indices
python_script = Python(IN[0]=points, IN[1]=PolymeshFacet)
# ---------- python_script.python (35 lines) ----------
##Main part of the code by Maciej Wypych
#https://www.linkedin.com/pulse/toposurface-from-mesh-revit-maciej-wypych
import clr
clr.AddReference('RevitNodes')
import Revit
clr.ImportExtensions(Revit.GeometryConversion)

clr.AddReference('RevitAPI')
import Autodesk
from Autodesk.Revit.DB import PolymeshFacet
from Autodesk.Revit.DB.Architecture import TopographySurface

clr.AddReference('RevitServices')
import RevitServices
from RevitServices.Persistence import DocumentManager
from RevitServices.Transactions import TransactionManager
doc = DocumentManager.Instance.CurrentDBDocument
uiapp = DocumentManager.Instance.CurrentUIApplication
app = uiapp.Application
version=float(app.SubVersionNumber)

#Get points and convert them to Revit XYZ points
pnts = [i.ToXyz() for i in IN[0]]
#Get indices and create polymesh facets
facets = [PolymeshFacet(i[0],i[1],i[2]) for i in IN[1]]

TransactionManager.Instance.EnsureInTransaction(doc)
if version < 2019.2 :
	newtopo = "This method is only available for Revit 2019.2 and later"
else:
	#Create topography
	newtopo=Autodesk.Revit.DB.Architecture.TopographySurface.Create(doc,pnts,facets)
TransactionManager.Instance.TransactionTaskDone()

OUT = newtopo
# ----------------------------------------
Topography = Output(python_script)
