# Dynamo custom node View Get ColorFill Scheme.dyf (Dynamo 2.0.4.12684)
# category: GeniusLoci.ColorScheme
# Works only in Revit 2022 and later.
# Returns the color fill scheme element applied to the view.

view = Input(view: var[]..[] = Revit.Application.Document.Current.ActiveView)
category = Input(category: var[]..[])  # The category which the color fill scheme element belongs to. Rooms, zones, spaces, areas, pipes or ducts
python_script = Python(IN[0]=view, IN[1]=category)
# ---------- python_script.python (28 lines) ----------
##Alban de Chasteigner 2021
#twitter : @geniusloci_bim
#geniusloci.bim@gmail.com
#https://github.com/albandechasteigner/GeniusLociForDynamo

import clr
clr.AddReference('RevitAPI')
from Autodesk.Revit.DB import *

clr.AddReference('RevitServices')
import RevitServices
from RevitServices.Persistence import DocumentManager
uiapp = DocumentManager.Instance.CurrentUIApplication
app = uiapp.Application
version=int(app.VersionNumber)

def GetColorFillScheme(view):
	if version < 2022: return "This method is only available for Revit 2022 and later"
	elif hasattr(view, "GetColorFillSchemeId"):
		if view.GetColorFillSchemeId(category.Id).IntegerValue == -1: return None
		else: return view.Document.GetElement(view.GetColorFillSchemeId(category.Id))
	else: return None

views = UnwrapElement(IN[0])
category = UnwrapElement(IN[1])

if isinstance(IN[0], list): OUT = [GetColorFillScheme(x) for x in views]
else: OUT = GetColorFillScheme(views)
# ----------------------------------------
ColorFillScheme = Output(python_script)
