# Dynamo custom node View Set ColorFill Scheme.dyf (Dynamo 2.0.4.12684)
# category: GeniusLoci.ColorScheme
# Works only in Revit 2022 and later.
# Applies color fill scheme to the given view.

view = Input(view: var[]..[] = Revit.Application.Document.Current.ActiveView)
category = Input(category: var[]..[])  # The category which the color fill scheme element belongs to. Rooms, zones, spaces, areas, pipes or ducts
colorFillScheme = Input(colorFillScheme: var[]..[])  # colorFillScheme element
python_script = Python(IN[0]=view, IN[1]=category, IN[2]=colorFillScheme)
# ---------- python_script.python (35 lines) ----------
##Alban de Chasteigner 2021
#twitter : @geniusloci_bim
#geniusloci.bim@gmail.com
#https://github.com/albandechasteigner/GeniusLociForDynamo

import clr
clr.AddReference('RevitAPI')
from Autodesk.Revit.DB import *

clr.AddReference('RevitServices')
import RevitServices
from RevitServices.Persistence import DocumentManager
from RevitServices.Transactions import TransactionManager
doc = DocumentManager.Instance.CurrentDBDocument
uiapp = DocumentManager.Instance.CurrentUIApplication
app = uiapp.Application
version=int(app.VersionNumber)

def SetColorFillScheme(view):
	if version < 2022: return "This method is only available for Revit 2022 and later"
	elif hasattr(view, "SetColorFillSchemeId"):
		TransactionManager.Instance.EnsureInTransaction(doc)
		try:
			view.SetColorFillSchemeId(category.Id,colorScheme.Id)
			result= colorScheme
		except: result = "Failed"
		TransactionManager.Instance.TransactionTaskDone()
		return result

views = UnwrapElement(IN[0])
category = UnwrapElement(IN[1])
colorScheme = UnwrapElement(IN[2])

if isinstance(IN[0], list): OUT = [SetColorFillScheme(x) for x in views]
else: OUT = SetColorFillScheme(views)
# ----------------------------------------
ColorFillScheme = Output(python_script)
