# Dynamo graph Copy,duplicate columns from Linked file_script.dyn (Dynamo 2.5.0.7460)
# packages: Bakery 2018.4.298, archi-lab.net 2022.212.2722, spring nodes 204.1.0, Data-Shapes 2023.2.111

get_linked_rvt_documents = Custom[Get Linked RVT Documents]()  # package Bakery
code_block = CodeBlock { "copy elements in link"; true; "Done"; "Cancel"; }
file_path = Filename("..\RIYAN-WEB.pulldown\icon.png")
code_block_2 = CodeBlock { "Link name"; }
dropdown_data = Custom[DropDown Data](InputName=code_block_2, Keys=get_linked_rvt_documents.Link_Name, Values=get_linked_rvt_documents.Link_Doc)  # package Data-Shapes; Create data for DropDown input in UI.MultiInputForm ++ . Check out www.data-shapes.net for more infos.
string = StringInput("Categories")
categories_list = Custom[Categories list]()  # package Data-Shapes; Gives list of all Revit categories and a matching list of their names
dropdown_data_2 = Custom[DropDown Data](InputName=string, Keys=categories_list.Category_name_s, Values=categories_list.Category_name_s)
list_create = List.Create(item0=dropdown_data, item1=dropdown_data_2)
multipleinputform = Custom[MultipleInputForm ++](Description_optional=code_block.out0, Logo_optional=file_path, ButtonText_optional=code_block.out2, Inputs=list_create, Toggle=code_block.out1, CancelButtonText_optional=code_block.out3)  # package Data-Shapes; Create a form with multiple inputs. see www.data-shapes.net for tutorials and infos!
code_block_3 = CodeBlock(x=multipleinputform.User_Inputs) { x[0]; x[1]; }
byName = Category.ByName(name=code_block_3.out1, lacing=CrossProduct)
get_all_elements_from_linked = Custom[Get All Elements From Linked Model](linkDoc=code_block_3.out0, category=byName)  # package archi-lab.net; This node is based on code posted by Julien Benoit. Big thanks to Julien for sharing his work. This node will retrieve all elements of a given category from a given linked model.
ꟿ_document_copyfromlinkinstance = Custom[ꟿ Document.CopyFromLinkInstance](LinkInstance=get_linked_rvt_documents.Link_Instance, element=get_all_elements_from_linked)  # package spring nodes; The node will use the total transformation of the link instance to copy the input elements into the local document.
getCategory = Element.GetCategory()  # unwired: element
watch = Watch(multipleinputform.User_Inputs)
